vi "DC Voltage.gvi"   [LabVIEW NXG 5.1.0]
panel controls:
  "Manual Range": f64 = "1 V"(1)
  "Auto Range": bool = TRUE
  "Auto Zero": bool = TRUE
  "DCV Ratio": bool
  "Auto Impedance": bool
  "Aperture NPLC": f64 = "10 PLC"(10)
  "Aperture Time": f64 = 0.1
  "Aperture": bool = TRUE
  "DIG Option On/Off": bool
  "ZATWIERDZ": bool
panel indicators:
  "Auto Zero_2": bool
  "DCV Ratio_2": bool
  "Auto Impedance_2": bool
  "Manual Range_2": f64
  "Aperture NPLC_2": f64
  "Aperture Time_2": f64
  "resulting string": string
diagram:
  while {
    Quotient And Remainder(x=$"Aperture Time", y=2e-06) -> (floor(x/y)=w1, x-y*floor(x/y)=w2)
    Multiply(w2, 1000000) -> w3
    Round To Nearest(number=w3) -> w4
    To Signed 32 Bit Integer(number=w4) -> w5
    case (w5) {
      frame 0, Default {
        Multiply(2e-06, w1) -> w6
      }
      frame 1 {
        Multiply(2e-06, w1) -> w6
      }
      frame 2 {
        Add(1, w1) -> w7
        Multiply(2e-06, w7) -> w6
      }
    }
    Format Into String(formatString="%_6ps", initString="The Aperture Time has been set to: ", w6) -> w8
    $"resulting string" <- w8
    $"Aperture Time_2" <- $"Aperture Time"
    Property Node(instance in=reference to "Manual Range", "Disabled"=$"Auto Range")
    $"Manual Range_2" <- $"Manual Range"
    $"Aperture NPLC_2" <- $"Aperture NPLC"
    case ($"Auto Range") {
      frame False, Default {
        Format Into String(formatString="%.0pV", initString="Range: ", $"Manual Range") -> w9
      }
      frame True {
        w9 = "Range: Auto"
      }
    }
    case ($Aperture) {
      frame False, Default {
        Format Into String(formatString="%_6ps", initString="Aperture Time: ", w6) -> w10
      }
      frame True {
        Format Into String(formatString="%#gPLC", initString="Aperture NPLC: ", $"Aperture NPLC") -> w10
      }
    }
    case ($"Auto Zero") {
      frame False, Default {
        w11 = "Auto Zero: Off"
      }
      frame True {
        w11 = "Auto Zero: On"
      }
    }
    case ($"Auto Impedance") {
      frame False, Default {
        w12 = "Input Z: 10MΩ"
      }
      frame True {
        w12 = "Input Z: Auto"
      }
    }
    case ($"DCV Ratio") {
      frame False, Default {
        w13 = "DCV Ratio: Off"
      }
      frame True {
        w13 = "DCV Ratio: On"
      }
    }
    Concatenate Strings("Your settings:", "\r\n", w9, "\r\n", w10, "\r\n", w11, "\r\n", w12, "\r\n", w13, "\r\n", "Are you sure you want to change settings?") -> w14
    Two Button Dialog(message=w14)
    case ($"DIG Option On/Off") {
      frame False, Default {
        w15 = 0.0002
      }
      frame True {
        w15 = 2e-05
      }
    }
    Property Node(instance in=reference to "Aperture Time", "Minimum"=w15)
    case ($"DIG Option On/Off") {
      frame False, Default {
        w16 = [0, 1, 2]
      }
      frame True {
        w16 = i32[] []
      }
    }
    Property Node(instance in=reference to "Aperture NPLC", "DisabledIndexes"=w16)
    Property Node(instance in=reference to "Aperture Time", "Disabled"=$Aperture)
    Not(x=$Aperture) -> w17
    Property Node(instance in=reference to "Aperture NPLC", "Disabled"=w17)
    $"Auto Zero_2" <- $"Auto Zero"
    $"Auto Impedance_2" <- $"Auto Impedance"
    $"DCV Ratio_2" <- $"DCV Ratio"
    stop if _
  }
