vi "DCVRATIOGUI_eventcontrol.gvi"   [LabVIEW NXG 5.1.0]
panel controls:
  "VoltageDC_control": bool
  "VoltageAC_control": bool
  "CurrentDC_control": bool
  "CurrentAC_control": bool
  "stop": bool
  "AutoRange_DCV": bool = TRUE
  "AutoZero_DCV": bool = TRUE
  "ApertureNPLC_DCV": f64 = "10 PLC"(10)
  "ApertureTime_DCV": f64 = 0.1
  "Aperture_DCV": bool = TRUE
  "ManualRange_DCV": f64 = "1 V"(1)
  "AutoRange_DCVR": bool = TRUE
  "ManualRange_DCVR": f64 = "1 V"(1)
  "Aperture_DCVR": bool = TRUE
  "ApertureNPLC_DCVR": f64 = "10 PLC"(10)
  "ManualRange_ACV": f64 = "1 V"(1)
  "ACFilter_ACV": i32 = 1
  "AutoRange_ACV": bool = TRUE
  "AutoRange_DCC": bool = TRUE
  "ManualRange_DCC": f64 = "1 A"(1)
  "TerminalType_DCC": i32 = 1
  "Aperture_DCC": bool = TRUE
  "ApertureNPLC_DCC": f64 = "10 PLC"(10)
  "AutoZero_DCC": bool = TRUE
  "TerminalType_ACC": i32 = 1
  "AutoRange_ACC": bool = TRUE
  "ManualRange_ACC": f64 = "1 A"(1)
  "ACFilter_ACC": i32 = ">3Hz"(3)
  "2WResistance_control": bool
  "4WResistance_control": bool
  "Frequency_control": bool
  "Capacitance_control": bool
  "Continuity_control": bool
  "Diode_control": bool
  "Temperature_control": bool
  "AutoRange_2WR": bool = TRUE
  "ManualRange_2WR": f64 = "1 kΩ"(1000)
  "Aperture_2WR": bool = TRUE
  "ApertureNPLC_2WR": f64 = "10 PLC"(10)
  "OffstComp_2WR": bool = TRUE
  "LowPower_2WR": bool = TRUE
  "AutoZero_2WR": bool = TRUE
  "AutoRange_4WR": bool = TRUE
  "ManualRange_4WR": f64 = "1 kΩ"(1000)
  "Aperture_4WR": bool = TRUE
  "ApertureNPLC_4WR": f64 = "10 PLC"(10)
  "LowPower_4WR": bool = TRUE
  "OffstComp_4WR": bool = TRUE
  "AutoRange_Freq": bool = TRUE
  "ManualRange_Freq": f64 = "1 V"(1)
  "ACFilter_Freq": i32 = ">3Hz"(3)
  "GateTime_Freq": f64 = "1 s"(1)
  "Timeout_Freq": bool = TRUE
  "AutoRange_Capaci": bool = TRUE
  "ManualRange_Capaci": f64 = 1e-07
  "Beeper_Cont": bool = TRUE
  "Beeper_Diode": bool = TRUE
  "Aperture_TempRTD4w": bool = TRUE
  "ApertureNPLC_TempRTD4w": f64 = "10 PLC"(10)
  "Units_TempRTD4w": i32 = "°C"(0)
  "Probe_TempMain": i32 = "RTD 4w"(1)
  "OffstComp_TempRTD4w": bool = TRUE
  "LowPower_TempRTD4w": bool = TRUE
  "OffstComp_TempRTD2w": bool = TRUE
  "LowPower_TempRTD2w": bool = TRUE
  "AutoZero_TempRTD2w": bool = TRUE
  "Aperture_TempRTD2w": bool = TRUE
  "ApertureNPLC_TempRTD2w": f64 = "10 PLC"(10)
  "Units_TempRTD2w": i32 = "°C"(0)
  "Units_TempThermis2w": i32 = "°C"(0)
  "Aperture_TempThermis2w": bool = TRUE
  "ApertureNPLC_TempThermis2w": f64 = "10 PLC"(10)
  "LowPower_TempThermis4w": bool = TRUE
  "LowPower_TempThermis2w": bool = TRUE
  "Aperture_TempThermis4w": bool = TRUE
  "Units_TempThermis4w": i32 = "°C"(0)
  "ApertureNPLC_TempThermis4w": f64 = "10 PLC"(10)
  "AutoZero_TempThermis2w": bool = TRUE
  "Aperture_TempTCouple": bool = TRUE
  "ApertureNPLC_TempTCouple": f64 = "10 PLC"(10)
  "Units_TempTCouple": i32 = "°C"(0)
  "AutoZero_TempTCouple": bool = TRUE
  "OpenCheck_TempTCouple": bool = TRUE
  "Type_TempTCouple": i32 = "K"(1)
  "Reference_TempTCouple": i32 = "Internal"(0)
  "Run/Stop_control": bool
  "Reset_control": bool
  "Single_control": bool
  "ProbeHold_control": bool
  "Null_control": bool
  "Math_control": bool
  "Display_control": bool
  "Utility_control": bool
  "Acquire_control": bool
  "Help_control": bool
  "ACAL_control": bool
  "AutoRange_Period": bool = TRUE
  "ManualRange_Period": f64 = "1 V"(1)
  "ACFilter_Period": i32 = ">3Hz"(3)
  "GateTime_Period": f64 = "1 s"(1)
  "Timeout_Period": bool = TRUE
panel indicators:
  "VoltageDC_indicator": bool
  "VoltageAC_indicator": bool
  "CurrentDC_indicator": bool
  "CurrentAC_indicator": bool
  "DCV Ratio_toenable": bool
  "Auto Impedance_DCV": bool
  "DIG Option On/Off_DCV": bool
  "String_DCV": string
  "String_DCVR": string
  "DIG Option On/Off_DCVR": bool
  "ApertureTime_DCVR": f64
  "DCV Ratio_todisable": bool
  "Auto Impedance_DCVR": bool
  "String_ACV": string
  "ApertureTime_DCC": f64
  "String_DCC": string
  "String_ACC": string
  "2WResistance_indicator": bool
  "4WResistance_indicator": bool
  "Frequency_indicator": bool
  "Capacitance_indicator": bool
  "Continuity_indicator": bool
  "Diode_indicator": bool
  "Temperature_indicator": bool
  "ApertureTime_2WR": f64
  "String_2WR": string
  "String_4WR": string
  "ApertureTime_4WR": f64
  "String_Freq": string
  "String_Capaci": string
  "String_Cont": string
  "String_Diode": string
  "String_TempRTD4w": string
  "ApertureTime_TempRTD4w": f64
  "R0_TempRTD4w": f64
  "R0_TempRTD2w": f64
  "ApertureTime_TempRTD2w": f64
  "ApertureTime_TempThermis2w": f64
  "ApertureTime_TempThermis4w": f64
  "String_TempThermis4w": string
  "String_TempThermis2w": string
  "String_TempRTD2w": string
  "ApertureTime_TempTCouple": f64
  "String_TempTCouple": string
  "OffsetAdjust_TempTCouple": f64
  "FixedOffset_TempTCouple": f64
  "Period_todisable": bool
  "Period_toenable": bool
  "String_Period": string
diagram:
  # TEMPRTD4W DEFAULTS
  $Units_TempRTD4w <- "°C"(0)
  # TEMPRTD2W DEFAULTS
  $AutoZero_TempRTD2w <- TRUE
  # DCV DEFAULTS
  $AutoRange_DCV <- TRUE
  # TEMPTHERMIS4W DEFAULTS
  $ApertureNPLC_TempThermis4w <- "10 PLC"(10)
  # TEMPTHERMIS2W DEFAULTS
  $ApertureNPLC_TempThermis2w <- "10 PLC"(10)
  # TEMPTCOUPLE DEFAULTS
  $Aperture_TempTCouple <- TRUE
  # CONT DEFAULTS
  $Beeper_Cont <- TRUE
  # DIODE DEFAULTS
  $Beeper_Diode <- TRUE
  $LowPower_TempRTD4w <- FALSE
  # DCVRATIO DEFAULTS
  $AutoRange_DCVR <- TRUE
  # ACC DEFAULTS
  $AutoRange_ACC <- TRUE
  # 2WR DEFAULTS
  $ApertureNPLC_2WR <- "10 PLC"(10)
  # CAPACI DEFAULTS
  $AutoRange_Capaci <- TRUE
  $LowPower_TempRTD2w <- FALSE
  $AutoZero_DCV <- TRUE
  # DCC DEFAULTS
  $Aperture_DCC <- TRUE
  $ApertureTime_TempThermis4w <- 0.1
  $ApertureTime_TempThermis2w <- 0.1
  $ApertureNPLC_TempTCouple <- "10 PLC"(10)
  # 4WR DEFAULTS
  $ApertureNPLC_4WR <- "10 PLC"(10)
  # ACV DEFAULTS
  $AutoRange_ACV <- TRUE
  # FREQ DEFAULTS
  $Period_toenable <- FALSE
  # PERIOD DEFAULTS
  $Period_todisable <- FALSE
  # TEMPMAIN DEFAULTS
  $Probe_TempMain <- "RTD 4w"(1)
  $OffstComp_TempRTD4w <- FALSE
  $Aperture_DCVR <- TRUE
  $ManualRange_ACC <- "100 mA"(0.1)
  $ApertureTime_2WR <- 0.1
  $ManualRange_Capaci <- "100 nF"(1e-07)
  $OffstComp_TempRTD2w <- FALSE
  $AutoZero_DCC <- TRUE
  $Aperture_TempThermis4w <- TRUE
  $Aperture_TempThermis2w <- TRUE
  $ApertureTime_TempTCouple <- 0.1
  $"DIG Option On/Off_DCV" <- TRUE
  $ApertureTime_4WR <- 0.1
  $R0_TempRTD4w <- 100
  $ACFilter_ACV <- ">20Hz"(20)
  $ACFilter_ACC <- ">20Hz"(20)
  $Aperture_2WR <- TRUE
  $ACFilter_Freq <- ">20Hz"(20)
  $ACFilter_Period <- ">20Hz"(20)
  $R0_TempRTD2w <- 100
  $"DIG Option On/Off_DCVR" <- TRUE
  $LowPower_TempThermis4w <- FALSE
  $AutoZero_TempThermis2w <- TRUE
  $FixedOffset_TempTCouple <- 0
  $ApertureNPLC_DCC <- "10 PLC"(10)
  $Aperture_4WR <- TRUE
  $Aperture_DCV <- TRUE
  $ApertureNPLC_TempRTD4w <- "10 PLC"(10)
  $TerminalType_ACC <- "3 A"(3)
  $AutoRange_2WR <- TRUE
  $AutoRange_Period <- TRUE
  $ApertureNPLC_TempRTD2w <- "10 PLC"(10)
  $ManualRange_ACV <- "1 V"(1)
  $AutoRange_Freq <- TRUE
  $Units_TempThermis4w <- "°C"(0)
  $LowPower_TempThermis2w <- FALSE
  $OffsetAdjust_TempTCouple <- 0
  $"DCV Ratio_todisable" <- FALSE
  $AutoRange_4WR <- TRUE
  $ApertureTime_DCC <- 0.1
  $ApertureTime_TempRTD4w <- 0.1
  $"DCV Ratio_toenable" <- FALSE
  $ApertureTime_TempRTD2w <- 0.1
  $AutoZero_2WR <- TRUE
  $GateTime_Period <- "100 ms"(0.1)
  $Units_TempThermis2w <- "°C"(0)
  $OpenCheck_TempTCouple <- FALSE
  $LowPower_4WR <- FALSE
  $GateTime_Freq <- "100 ms"(0.1)
  $"Auto Impedance_DCVR" <- FALSE
  $ManualRange_DCC <- "100 mA"(0.1)
  $Aperture_TempRTD4w <- TRUE
  $"Auto Impedance_DCV" <- FALSE
  $Aperture_TempRTD2w <- TRUE
  $LowPower_2WR <- FALSE
  $AutoZero_TempTCouple <- TRUE
  $ManualRange_4WR <- "1 kΩ"(1000)
  $ManualRange_Period <- "10 V"(10)
  $AutoRange_DCC <- TRUE
  $ManualRange_Freq <- "10 V"(10)
  $Units_TempRTD2w <- "°C"(0)
  $ManualRange_2WR <- "1 kΩ"(1000)
  $Reference_TempTCouple <- "Internal"(0)
  $OffstComp_4WR <- FALSE
  $TerminalType_DCC <- "3 A"(3)
  $Timeout_Freq <- FALSE
  $Timeout_Period <- FALSE
  $Type_TempTCouple <- "J"(0)
  $OffstComp_2WR <- FALSE
  $Units_TempTCouple <- "°C"(0)
  # DCC VISIBILITY
  Property Node(instance in=reference to "TerminalType_DCC", "Visible"=FALSE)
  # TEMPRTD2W VISIBILITY
  Property Node(instance in=reference to "AutoZero_TempRTD2w", "Visible"=FALSE)
  # TEMPTHERMIS4W VISIBILITY
  Property Node(instance in=reference to "ApertureNPLC_TempThermis4w", "Visible"=FALSE)
  # TEMPTCOUPLE VISIBILITY
  Property Node(instance in=reference to "Aperture_TempTCouple", "Visible"=FALSE)
  # TEMPRTD4W VISIBILITY
  Property Node(instance in=reference to "LowPower_TempRTD4w", "Visible"=FALSE)
  # DCV VISIBILITY
  Property Node(instance in=reference to "DIG Option On/Off_DCV", "Visible"=FALSE)
  # DCVRATIO VISIBILITY
  Property Node(instance in=reference to "DIG Option On/Off_DCVR", "Visible"=FALSE)
  # ACV VISIBILITY
  Property Node(instance in=reference to "ManualRange_ACV", "Visible"=FALSE)
  # 4WR VISIBILITY
  Property Node(instance in=reference to "ApertureNPLC_4WR", "Visible"=FALSE)
  # ACC VISIBILITY
  Property Node(instance in=reference to "TerminalType_ACC", "Visible"=FALSE)
  # CONT VISIBILITY
  Property Node(instance in=reference to "Beeper_Cont", "Visible"=FALSE)
  # TEMPTHERMIS2W VISIBILITY
  Property Node(instance in=reference to "ApertureNPLC_TempThermis2w", "Visible"=FALSE)
  # 2WR VISIBILITY
  Property Node(instance in=reference to "ApertureNPLC_2WR", "Visible"=FALSE)
  # FREQ VISIBILITY
  Property Node(instance in=reference to "ACFilter_Freq", "Visible"=FALSE)
  # CAPACI VISIBILITY
  Property Node(instance in=reference to "ManualRange_Capaci", "Visible"=FALSE)
  # DIODE VISIBILITY
  Property Node(instance in=reference to "Beeper_Diode", "Visible"=FALSE)
  # TEMPMAIN VISIBILITY
  Property Node(instance in=reference to "Probe_TempMain", "Visible"=FALSE)
  Property Node(instance in=reference to "AutoRange_DCC", "Visible"=FALSE)
  Property Node(instance in=reference to "LowPower_TempRTD2w", "Visible"=FALSE)
  Property Node(instance in=reference to "ApertureTime_TempThermis4w", "Visible"=FALSE)
  Property Node(instance in=reference to "ApertureNPLC_TempTCouple", "Visible"=FALSE)
  Property Node(instance in=reference to "OffstComp_TempRTD4w", "Visible"=FALSE)
  Property Node(instance in=reference to "Auto Impedance_DCV", "Visible"=FALSE)
  Property Node(instance in=reference to "Auto Impedance_DCVR", "Visible"=FALSE)
  Property Node(instance in=reference to "ApertureTime_4WR", "Visible"=FALSE)
  Property Node(instance in=reference to "ApertureTime_TempThermis2w", "Visible"=FALSE)
  Property Node(instance in=reference to "ACFilter_ACC", "Visible"=FALSE)
  Property Node(instance in=reference to "String_Cont", "Visible"=FALSE)
  Property Node(instance in=reference to "ACFilter_ACV", "Visible"=FALSE)
  Property Node(instance in=reference to "ApertureTime_2WR", "Visible"=FALSE)
  Property Node(instance in=reference to "AutoRange_Freq", "Visible"=FALSE)
  Property Node(instance in=reference to "AutoRange_Capaci", "Visible"=FALSE)
  Property Node(instance in=reference to "String_Diode", "Visible"=FALSE)
  Property Node(instance in=reference to "ManualRange_DCC", "Visible"=FALSE)
  Property Node(instance in=reference to "OffstComp_TempRTD2w", "Visible"=FALSE)
  Property Node(instance in=reference to "Aperture_TempThermis4w", "Visible"=FALSE)
  Property Node(instance in=reference to "ApertureTime_TempTCouple", "Visible"=FALSE)
  Property Node(instance in=reference to "R0_TempRTD4w", "Visible"=FALSE)
  Property Node(instance in=reference to "Aperture_TempThermis2w", "Visible"=FALSE)
  Property Node(instance in=reference to "ManualRange_DCV", "Visible"=FALSE, "Disabled"=TRUE)
  Property Node(instance in=reference to "ManualRange_DCVR", "Visible"=FALSE)
  Property Node(instance in=reference to "Aperture_4WR", "Visible"=FALSE)
  Property Node(instance in=reference to "ManualRange_ACC", "Visible"=FALSE)
  Property Node(instance in=reference to "Aperture_2WR", "Visible"=FALSE)
  Property Node(instance in=reference to "GateTime_Freq", "Visible"=FALSE)
  Property Node(instance in=reference to "String_Capaci", "Visible"=FALSE)
  Property Node(instance in=reference to "String_ACV", "Visible"=FALSE)
  Property Node(instance in=reference to "Aperture_DCC", "Visible"=FALSE)
  Property Node(instance in=reference to "R0_TempRTD2w", "Visible"=FALSE)
  Property Node(instance in=reference to "LowPower_TempThermis4w", "Visible"=FALSE)
  Property Node(instance in=reference to "FixedOffset_TempTCouple", "Visible"=FALSE)
  Property Node(instance in=reference to "ApertureNPLC_TempRTD4w", "Visible"=FALSE)
  Property Node(instance in=reference to "AutoZero_TempThermis2w", "Visible"=FALSE)
  Property Node(instance in=reference to "ApertureNPLC_DCV", "Visible"=FALSE)
  Property Node(instance in=reference to "ApertureNPLC_DCVR", "Visible"=FALSE)
  Property Node(instance in=reference to "AutoRange_4WR", "Visible"=FALSE)
  Property Node(instance in=reference to "AutoRange_ACC", "Visible"=FALSE)
  Property Node(instance in=reference to "AutoRange_2WR", "Visible"=FALSE)
  Property Node(instance in=reference to "ManualRange_Freq", "Visible"=FALSE)
  Property Node(instance in=reference to "AutoRange_ACV", "Visible"=FALSE)
  Property Node(instance in=reference to "ApertureNPLC_DCC", "Visible"=FALSE)
  Property Node(instance in=reference to "ApertureNPLC_TempRTD2w", "Visible"=FALSE)
  Property Node(instance in=reference to "Units_TempThermis4w", "Visible"=FALSE)
  Property Node(instance in=reference to "OffsetAdjust_TempTCouple", "Visible"=FALSE)
  Property Node(instance in=reference to "ApertureTime_TempRTD4w", "Visible"=FALSE)
  Property Node(instance in=reference to "LowPower_TempThermis2w", "Visible"=FALSE)
  Property Node(instance in=reference to "Aperture_DCV", "Visible"=FALSE)
  Property Node(instance in=reference to "Aperture_DCVR", "Visible"=FALSE)
  Property Node(instance in=reference to "LowPower_4WR", "Visible"=FALSE)
  Property Node(instance in=reference to "String_ACC", "Visible"=FALSE)
  Property Node(instance in=reference to "AutoZero_2WR", "Visible"=FALSE)
  Property Node(instance in=reference to "Timeout_Freq", "Visible"=FALSE)
  Property Node(instance in=reference to "ApertureTime_DCC", "Visible"=FALSE)
  Property Node(instance in=reference to "ApertureTime_TempRTD2w", "Visible"=FALSE)
  Property Node(instance in=reference to "String_TempThermis4w", "Visible"=FALSE)
  Property Node(instance in=reference to "OpenCheck_TempTCouple", "Visible"=FALSE)
  Property Node(instance in=reference to "Aperture_TempRTD4w", "Visible"=FALSE)
  Property Node(instance in=reference to "Units_TempThermis2w", "Visible"=FALSE)
  Property Node(instance in=reference to "AutoRange_DCV", "Visible"=FALSE)
  Property Node(instance in=reference to "AutoRange_DCVR", "Visible"=FALSE)
  Property Node(instance in=reference to "ManualRange_4WR", "Visible"=FALSE)
  Property Node(instance in=reference to "LowPower_2WR", "Visible"=FALSE)
  Property Node(instance in=reference to "String_Freq", "Visible"=FALSE)
  Property Node(instance in=reference to "AutoZero_DCC", "Visible"=FALSE)
  Property Node(instance in=reference to "Aperture_TempRTD2w", "Visible"=FALSE)
  Property Node(instance in=reference to "AutoZero_TempTCouple", "Visible"=FALSE)
  Property Node(instance in=reference to "Units_TempRTD4w", "Visible"=FALSE)
  Property Node(instance in=reference to "String_TempThermis2w", "Visible"=FALSE)
  Property Node(instance in=reference to "DCV Ratio_toenable", "Visible"=FALSE, "Value"=FALSE)
  Property Node(instance in=reference to "DCV Ratio_todisable", "Visible"=FALSE, "Value"=FALSE)
  Property Node(instance in=reference to "OffstComp_4WR", "Visible"=FALSE)
  Property Node(instance in=reference to "ManualRange_2WR", "Visible"=FALSE)
  Property Node(instance in=reference to "Period_toenable", "Visible"=FALSE)
  Property Node(instance in=reference to "Units_TempRTD2w", "Visible"=FALSE)
  Property Node(instance in=reference to "Reference_TempTCouple", "Visible"=FALSE)
  Property Node(instance in=reference to "String_TempRTD4w", "Visible"=FALSE)
  Property Node(instance in=reference to "ApertureTime_DCV", "Visible"=FALSE)
  Property Node(instance in=reference to "ApertureTime_DCVR", "Visible"=FALSE)
  Property Node(instance in=reference to "String_4WR", "Visible"=FALSE)
  Property Node(instance in=reference to "String_DCC", "Visible"=FALSE)
  Property Node(instance in=reference to "OffstComp_2WR", "Visible"=FALSE)
  Property Node(instance in=reference to "Type_TempTCouple", "Visible"=FALSE)
  Property Node(instance in=reference to "String_TempRTD2w", "Visible"=FALSE)
  Property Node(instance in=reference to "String_DCV", "Visible"=FALSE)
  Property Node(instance in=reference to "String_DCVR", "Visible"=FALSE)
  Property Node(instance in=reference to "String_2WR", "Visible"=FALSE)
  Property Node(instance in=reference to "Units_TempTCouple", "Visible"=FALSE)
  Property Node(instance in=reference to "AutoZero_DCV", "Visible"=FALSE)
  # PERIOD VISIBILITY
  Property Node(instance in=reference to "ACFilter_Period", "Visible"=FALSE)
  Property Node(instance in=reference to "String_TempTCouple", "Visible"=FALSE)
  Property Node(instance in=reference to "AutoRange_Period", "Visible"=FALSE)
  Property Node(instance in=reference to "GateTime_Period", "Visible"=FALSE)
  Property Node(instance in=reference to "ManualRange_Period", "Visible"=FALSE)
  Property Node(instance in=reference to "Timeout_Period", "Visible"=FALSE)
  Property Node(instance in=reference to "String_Period", "Visible"=FALSE)
  Property Node(instance in=reference to "Period_todisable", "Visible"=FALSE)
  # MAIN DEFAULTS
  $stop <- FALSE
  $VoltageAC_control <- FALSE
  $VoltageDC_control <- FALSE
  $CurrentDC_control <- FALSE
  # TITLES VISIBILITY
  Property Node(instance in=reference to unnamed text, "Visible"=TRUE)
  $CurrentAC_control <- FALSE
  $"2WResistance_control" <- FALSE
  # BUTTONS VISIBILITY
  Property Node(instance in=reference to "VoltageAC_control", "Visible"=TRUE, "Disabled"=FALSE)
  Property Node(instance in=reference to "CurrentDC_control", "Visible"=TRUE, "Disabled"=FALSE)
  Property Node(instance in=reference to "CurrentAC_control", "Visible"=TRUE, "Disabled"=FALSE)
  Property Node(instance in=reference to "2WResistance_control", "Visible"=TRUE, "Disabled"=FALSE)
  Property Node(instance in=reference to "VoltageDC_indicator", "Visible"=FALSE)
  Property Node(instance in=reference to "4WResistance_control", "Visible"=TRUE, "Disabled"=FALSE)
  Property Node(instance in=reference to "Frequency_control", "Visible"=TRUE, "Disabled"=FALSE)
  Property Node(instance in=reference to "Capacitance_control", "Visible"=TRUE, "Disabled"=FALSE)
  Property Node(instance in=reference to "Continuity_control", "Visible"=TRUE, "Disabled"=FALSE)
  Property Node(instance in=reference to "Diode_control", "Visible"=TRUE, "Disabled"=FALSE)
  Property Node(instance in=reference to "Temperature_control", "Visible"=TRUE, "Disabled"=FALSE)
  Property Node(instance in=reference to unnamed text, "Visible"=FALSE)
  $"4WResistance_control" <- FALSE
  $Frequency_control <- FALSE
  Property Node(instance in=reference to "VoltageDC_control", "Visible"=TRUE, "Disabled"=FALSE)
  $Capacitance_control <- FALSE
  Property Node(instance in=reference to "VoltageAC_indicator", "Visible"=FALSE)
  Property Node(instance in=reference to "CurrentDC_indicator", "Visible"=FALSE)
  Property Node(instance in=reference to "CurrentAC_indicator", "Visible"=FALSE, "Disabled"=FALSE)
  Property Node(instance in=reference to "2WResistance_indicator", "Visible"=FALSE, "Disabled"=FALSE)
  Property Node(instance in=reference to unnamed text, "Visible"=FALSE)
  Property Node(instance in=reference to "4WResistance_indicator", "Visible"=FALSE, "Disabled"=FALSE)
  Property Node(instance in=reference to "Frequency_indicator", "Visible"=FALSE, "Disabled"=FALSE)
  Property Node(instance in=reference to "Capacitance_indicator", "Visible"=FALSE, "Disabled"=FALSE)
  Property Node(instance in=reference to "Continuity_indicator", "Visible"=FALSE, "Disabled"=FALSE)
  Property Node(instance in=reference to "Diode_indicator", "Visible"=FALSE, "Disabled"=FALSE)
  Property Node(instance in=reference to "Temperature_indicator", "Visible"=FALSE, "Disabled"=FALSE)
  $Continuity_control <- FALSE
  $Diode_control <- FALSE
  Property Node(instance in=reference to unnamed text, "Visible"=FALSE)
  $Temperature_control <- FALSE
  while {
    # ACV CONTROLS/INDICATORS
    # 2WR CONTROLS/INDICATORS
    # 4WR CONTROLS/INDICATORS
    # FREQ CONTROLS/INDICATORS
    event {
      on "VoltageDC_control" Value changed {
        # FREQ VISIBILITY
        Property Node(instance in=reference to "ACFilter_Freq", "Visible"=FALSE)
        Property Node(instance in=reference to "AutoRange_Freq", "Visible"=FALSE)
        # TITLES VISIBILITY
        Property Node(instance in=reference to unnamed text, "Visible"=FALSE)
        Property Node(instance in=reference to "GateTime_Freq", "Visible"=FALSE)
        Property Node(instance in=reference to unnamed text, "Visible"=TRUE)
        Property Node(instance in=reference to "ManualRange_Freq", "Visible"=FALSE)
        Property Node(instance in=reference to unnamed text, "Visible"=FALSE)
        Property Node(instance in=reference to "Timeout_Freq", "Visible"=FALSE)
        Property Node(instance in=reference to unnamed text, "Visible"=FALSE)
        Property Node(instance in=reference to "String_Freq", "Visible"=FALSE)
        # CAPACI VISIBILITY
        Property Node(instance in=reference to "ManualRange_Capaci", "Visible"=FALSE)
        # DCV VISIBILITY
        Property Node(instance in=reference to "DIG Option On/Off_DCV", "Visible"=TRUE)
        # DCC VISIBILITY
        Property Node(instance in=reference to "TerminalType_DCC", "Visible"=FALSE)
        # ACV VISIBILITY
        Property Node(instance in=reference to "ManualRange_ACV", "Visible"=FALSE)
        # DCVRATIO VISIBILITY
        Property Node(instance in=reference to "DIG Option On/Off_DCVR", "Visible"=FALSE)
        Property Node(instance in=reference to "Period_toenable", "Visible"=FALSE)
        # 2WR VISIBILITY
        Property Node(instance in=reference to "ApertureNPLC_2WR", "Visible"=FALSE)
        # 4WR VISIBILITY
        Property Node(instance in=reference to "ApertureNPLC_4WR", "Visible"=FALSE)
        Property Node(instance in=reference to "AutoRange_Capaci", "Visible"=FALSE)
        Property Node(instance in=reference to "Auto Impedance_DCV", "Visible"=TRUE)
        # ACC VISIBILITY
        Property Node(instance in=reference to "TerminalType_ACC", "Visible"=FALSE)
        Property Node(instance in=reference to "AutoRange_DCC", "Visible"=FALSE)
        Property Node(instance in=reference to "Auto Impedance_DCVR", "Visible"=FALSE)
        Property Node(instance in=reference to "ACFilter_ACV", "Visible"=FALSE)
        Property Node(instance in=reference to "ApertureTime_2WR", "Visible"=FALSE)
        Property Node(instance in=reference to "ApertureTime_4WR", "Visible"=FALSE)
        Property Node(instance in=reference to "String_Capaci", "Visible"=FALSE)
        Property Node(instance in=reference to "ManualRange_DCV", "Visible"=TRUE, "Disabled"=TRUE)
        Property Node(instance in=reference to "ACFilter_ACC", "Visible"=FALSE)
        Property Node(instance in=reference to "ManualRange_DCC", "Visible"=FALSE)
        Property Node(instance in=reference to "ManualRange_DCVR", "Visible"=FALSE)
        Property Node(instance in=reference to unnamed text, "Visible"=FALSE)
        Property Node(instance in=reference to "String_ACV", "Visible"=FALSE)
        Property Node(instance in=reference to "Aperture_2WR", "Visible"=FALSE)
        Property Node(instance in=reference to "Aperture_4WR", "Visible"=FALSE)
        Property Node(instance in=reference to "ApertureNPLC_DCV", "Visible"=TRUE)
        Property Node(instance in=reference to "ManualRange_ACC", "Visible"=FALSE)
        Property Node(instance in=reference to "Aperture_DCC", "Visible"=FALSE)
        # PERIOD VISIBILITY
        Property Node(instance in=reference to "ACFilter_Period", "Visible"=FALSE)
        Property Node(instance in=reference to "ApertureNPLC_DCVR", "Visible"=FALSE)
        Property Node(instance in=reference to "AutoRange_2WR", "Visible"=FALSE)
        Property Node(instance in=reference to "AutoRange_4WR", "Visible"=FALSE)
        Property Node(instance in=reference to "AutoRange_ACV", "Visible"=FALSE)
        Property Node(instance in=reference to "Aperture_DCV", "Visible"=TRUE)
        Property Node(instance in=reference to "AutoRange_ACC", "Visible"=FALSE)
        Property Node(instance in=reference to "ApertureNPLC_DCC", "Visible"=FALSE)
        Property Node(instance in=reference to "AutoRange_Period", "Visible"=FALSE)
        Property Node(instance in=reference to "Aperture_DCVR", "Visible"=FALSE)
        Property Node(instance in=reference to "AutoZero_2WR", "Visible"=FALSE)
        Property Node(instance in=reference to "LowPower_4WR", "Visible"=FALSE)
        Property Node(instance in=reference to unnamed text, "Visible"=FALSE)
        Property Node(instance in=reference to "AutoRange_DCV", "Visible"=TRUE)
        Property Node(instance in=reference to "String_ACC", "Visible"=FALSE)
        Property Node(instance in=reference to "ApertureTime_DCC", "Visible"=FALSE)
        Property Node(instance in=reference to "GateTime_Period", "Visible"=FALSE)
        Property Node(instance in=reference to "AutoRange_DCVR", "Visible"=FALSE)
        Property Node(instance in=reference to "LowPower_2WR", "Visible"=FALSE)
        Property Node(instance in=reference to "ManualRange_4WR", "Visible"=FALSE)
        Property Node(instance in=reference to unnamed text, "Visible"=FALSE)
        Property Node(instance in=reference to "DCV Ratio_toenable", "Visible"=TRUE)
        Property Node(instance in=reference to "AutoZero_DCC", "Visible"=FALSE)
        Property Node(instance in=reference to "ManualRange_Period", "Visible"=FALSE)
        Property Node(instance in=reference to "DCV Ratio_todisable", "Visible"=FALSE)
        Property Node(instance in=reference to "ManualRange_2WR", "Visible"=FALSE)
        Property Node(instance in=reference to "OffstComp_4WR", "Visible"=FALSE)
        Property Node(instance in=reference to unnamed text, "Visible"=FALSE)
        Property Node(instance in=reference to "ApertureTime_DCV", "Visible"=TRUE)
        Property Node(instance in=reference to "Timeout_Period", "Visible"=FALSE)
        Property Node(instance in=reference to "ApertureTime_DCVR", "Visible"=FALSE)
        Property Node(instance in=reference to "String_DCC", "Visible"=FALSE)
        Property Node(instance in=reference to "OffstComp_2WR", "Visible"=FALSE)
        Property Node(instance in=reference to "String_4WR", "Visible"=FALSE)
        Property Node(instance in=reference to unnamed text, "Visible"=FALSE)
        Property Node(instance in=reference to "String_DCV", "Visible"=TRUE)
        Property Node(instance in=reference to "String_Period", "Visible"=FALSE)
        Property Node(instance in=reference to "String_DCVR", "Visible"=FALSE)
        Property Node(instance in=reference to unnamed text, "Visible"=FALSE)
        Property Node(instance in=reference to "String_2WR", "Visible"=FALSE)
        Property Node(instance in=reference to "AutoZero_DCV", "Visible"=TRUE)
        Property Node(instance in=reference to "Period_todisable", "Visible"=FALSE)
        Property Node(instance in=reference to unnamed text, "Visible"=FALSE)
        Property Node(instance in=reference to unnamed text, "Visible"=FALSE)
        # TEMPTCOUPLE VISIBILITY
        Property Node(instance in=reference to "Aperture_TempTCouple", "Visible"=FALSE)
        # CONT VISIBILITY
        Property Node(instance in=reference to "Beeper_Cont", "Visible"=FALSE)
        # DIODE VISIBILITY
        Property Node(instance in=reference to "Beeper_Diode", "Visible"=FALSE)
        # TEMPRTD2W VISIBILITY
        Property Node(instance in=reference to "AutoZero_TempRTD2w", "Visible"=FALSE)
        # TEMPRTD4W VISIBILITY
        Property Node(instance in=reference to "LowPower_TempRTD4w", "Visible"=FALSE)
        # TEMPTHERMIS4W VISIBILITY
        Property Node(instance in=reference to "ApertureNPLC_TempThermis4w", "Visible"=FALSE)
        # TEMPTHERMIS2W VISIBILITY
        Property Node(instance in=reference to "ApertureNPLC_TempThermis2w", "Visible"=FALSE)
        Property Node(instance in=reference to unnamed text, "Visible"=FALSE)
        # TEMPMAIN VISIBILITY
        Property Node(instance in=reference to "Probe_TempMain", "Visible"=FALSE, "Value"=1)
        Property Node(instance in=reference to "ApertureNPLC_TempTCouple", "Visible"=FALSE)
        Property Node(instance in=reference to "String_Cont", "Visible"=FALSE)
        Property Node(instance in=reference to "String_Diode", "Visible"=FALSE)
        Property Node(instance in=reference to "LowPower_TempRTD2w", "Visible"=FALSE)
        Property Node(instance in=reference to "OffstComp_TempRTD4w", "Visible"=FALSE)
        Property Node(instance in=reference to "ApertureTime_TempThermis4w", "Visible"=FALSE)
        Property Node(instance in=reference to "ApertureTime_TempThermis2w", "Visible"=FALSE)
        Property Node(instance in=reference to unnamed text, "Visible"=FALSE)
        Property Node(instance in=reference to "ApertureTime_TempTCouple", "Visible"=FALSE)
        Property Node(instance in=reference to "OffstComp_TempRTD2w", "Visible"=FALSE)
        Property Node(instance in=reference to "R0_TempRTD4w", "Visible"=FALSE)
        Property Node(instance in=reference to "Aperture_TempThermis4w", "Visible"=FALSE)
        Property Node(instance in=reference to "Aperture_TempThermis2w", "Visible"=FALSE)
        Property Node(instance in=reference to "FixedOffset_TempTCouple", "Visible"=FALSE)
        Property Node(instance in=reference to "R0_TempRTD2w", "Visible"=FALSE)
        Property Node(instance in=reference to "ApertureNPLC_TempRTD4w", "Visible"=FALSE)
        Property Node(instance in=reference to "LowPower_TempThermis4w", "Visible"=FALSE)
        Property Node(instance in=reference to "AutoZero_TempThermis2w", "Visible"=FALSE)
        Property Node(instance in=reference to "OffsetAdjust_TempTCouple", "Visible"=FALSE)
        Event Data() -> ("Old Value"=w2, "New Value"=w3)
        # EVENT NIE DLA
        # CONTROL NEW VALUE F
        # INDICATOR OLD
        Property Node(instance in=reference to "VoltageAC_indicator", "Visible"=w2)
        Property Node(instance in=reference to "ApertureNPLC_TempRTD2w", "Visible"=FALSE)
        Property Node(instance in=reference to "ApertureTime_TempRTD4w", "Visible"=FALSE)
        Property Node(instance in=reference to "Units_TempThermis4w", "Visible"=FALSE)
        Property Node(instance in=reference to "LowPower_TempThermis2w", "Visible"=FALSE)
        Property Node(instance in=reference to "OpenCheck_TempTCouple", "Visible"=FALSE)
        Property Node(instance in=reference to "ApertureTime_TempRTD2w", "Visible"=FALSE)
        Property Node(instance in=reference to "Aperture_TempRTD4w", "Visible"=FALSE)
        Property Node(instance in=reference to "CurrentDC_indicator", "Visible"=w2)
        Property Node(instance in=reference to "String_TempThermis4w", "Visible"=FALSE)
        Property Node(instance in=reference to "Units_TempThermis2w", "Visible"=FALSE)
        Property Node(instance in=reference to "AutoZero_TempTCouple", "Visible"=FALSE)
        Property Node(instance in=reference to "Aperture_TempRTD2w", "Visible"=FALSE)
        Property Node(instance in=reference to "Units_TempRTD4w", "Visible"=FALSE)
        Property Node(instance in=reference to "String_TempThermis2w", "Visible"=FALSE)
        Property Node(instance in=reference to "CurrentAC_indicator", "Visible"=w2)
        Property Node(instance in=reference to "Reference_TempTCouple", "Visible"=FALSE)
        Property Node(instance in=reference to "Units_TempRTD2w", "Visible"=FALSE)
        Property Node(instance in=reference to "String_TempRTD4w", "Visible"=FALSE)
        Property Node(instance in=reference to "2WResistance_indicator", "Visible"=w2)
        Property Node(instance in=reference to "Type_TempTCouple", "Visible"=FALSE)
        Property Node(instance in=reference to "String_TempRTD2w", "Visible"=FALSE)
        Property Node(instance in=reference to "Units_TempTCouple", "Visible"=FALSE)
        Property Node(instance in=reference to "4WResistance_indicator", "Visible"=w2)
        Property Node(instance in=reference to "String_TempTCouple", "Visible"=FALSE)
        Property Node(instance in=reference to "Frequency_indicator", "Visible"=w2)
        Property Node(instance in=reference to "Capacitance_indicator", "Visible"=w2)
        Property Node(instance in=reference to "Continuity_indicator", "Visible"=w2)
        Property Node(instance in=reference to "Diode_indicator", "Visible"=w2)
        Property Node(instance in=reference to "Temperature_indicator", "Visible"=w2)
        # EVENT DLA
        # CONTROL OLD
        # INDICATOR NEW
        Property Node(instance in=reference to "VoltageDC_control", "Visible"=w2)
        Property Node(instance in=reference to "VoltageDC_indicator", "Visible"=w3)
        Property Node(instance in=reference to "VoltageAC_control", "Visible"=w3, "Value"=FALSE)
        Property Node(instance in=reference to "CurrentDC_control", "Visible"=w3, "Value"=FALSE)
        Property Node(instance in=reference to "CurrentAC_control", "Visible"=w3, "Value"=FALSE)
        Property Node(instance in=reference to "2WResistance_control", "Visible"=w3, "Value"=FALSE)
        Property Node(instance in=reference to "4WResistance_control", "Visible"=w3, "Value"=FALSE)
        Property Node(instance in=reference to "Frequency_control", "Visible"=w3, "Value"=FALSE)
        Property Node(instance in=reference to "Capacitance_control", "Visible"=w3, "Value"=FALSE)
        Property Node(instance in=reference to "Continuity_control", "Visible"=w3, "Value"=FALSE)
        Property Node(instance in=reference to "Diode_control", "Visible"=w3, "Value"=FALSE)
        Property Node(instance in=reference to "Temperature_control", "Visible"=w3, "Value"=FALSE)
        w1 = default
      }
      on "DCV Ratio_toenable" Value changed {
        Property Node(instance in=reference to "AutoRange_DCV", "Visible"=FALSE)
        Property Node(instance in=reference to "String_DCV", "Visible"=FALSE)
        Property Node(instance in=reference to "DIG Option On/Off_DCVR", "Visible"=TRUE)
        Property Node(instance in=reference to "AutoZero_DCV", "Visible"=FALSE)
        Property Node(instance in=reference to "Auto Impedance_DCVR", "Visible"=TRUE)
        Property Node(instance in=reference to "ManualRange_DCVR", "Visible"=TRUE)
        Property Node(instance in=reference to "ApertureNPLC_DCVR", "Visible"=TRUE)
        Property Node(instance in=reference to "Aperture_DCV", "Visible"=FALSE)
        Property Node(instance in=reference to "Aperture_DCVR", "Visible"=TRUE)
        Property Node(instance in=reference to unnamed text, "Visible"=FALSE)
        Property Node(instance in=reference to "AutoRange_DCVR", "Visible"=TRUE)
        Event Data() -> ("Old Value"=w4, "New Value"=w5)
        Property Node(instance in=reference to "DCV Ratio_toenable", "Visible"=w4)
        Property Node(instance in=reference to "DCV Ratio_todisable", "Visible"=TRUE)
        Property Node(instance in=reference to unnamed text, "Visible"=TRUE)
        Property Node(instance in=reference to "ApertureTime_DCVR", "Visible"=TRUE)
        Property Node(instance in=reference to "ManualRange_DCV", "Visible"=FALSE)
        Property Node(instance in=reference to "String_DCVR", "Visible"=TRUE)
        Property Node(instance in=reference to unnamed text, "Visible"=FALSE)
        Property Node(instance in=reference to "DCV Ratio_todisable", "Visible"=w5, "Value"=w5)
        Property Node(instance in=reference to "ApertureNPLC_DCV", "Visible"=FALSE)
        Property Node(instance in=reference to "VoltageAC_indicator", "Visible"=FALSE)
        Property Node(instance in=reference to "DCV Ratio_toenable", "Visible"=FALSE)
        Property Node(instance in=reference to unnamed text, "Visible"=FALSE)
        Property Node(instance in=reference to "DIG Option On/Off_DCV", "Visible"=FALSE)
        Property Node(instance in=reference to "ApertureTime_DCV", "Visible"=FALSE)
        Property Node(instance in=reference to "Auto Impedance_DCV", "Visible"=FALSE)
        w1 = default
      }
      on "DCV Ratio_todisable" Value changed {
        Property Node(instance in=reference to "AutoRange_DCV", "Visible"=TRUE)
        Property Node(instance in=reference to "String_DCV", "Visible"=TRUE)
        Property Node(instance in=reference to "DIG Option On/Off_DCVR", "Visible"=FALSE)
        Property Node(instance in=reference to "DIG Option On/Off_DCV", "Visible"=TRUE)
        Property Node(instance in=reference to "AutoZero_DCV", "Visible"=TRUE)
        Property Node(instance in=reference to "Auto Impedance_DCVR", "Visible"=FALSE)
        Property Node(instance in=reference to "ApertureTime_DCV", "Visible"=TRUE)
        Property Node(instance in=reference to "ManualRange_DCVR", "Visible"=FALSE)
        Property Node(instance in=reference to "ApertureNPLC_DCVR", "Visible"=FALSE)
        Property Node(instance in=reference to "Aperture_DCV", "Visible"=TRUE)
        Property Node(instance in=reference to "Aperture_DCVR", "Visible"=FALSE)
        Property Node(instance in=reference to unnamed text, "Visible"=FALSE)
        Property Node(instance in=reference to "AutoRange_DCVR", "Visible"=FALSE)
        Property Node(instance in=reference to "DCV Ratio_todisable", "Visible"=FALSE)
        Property Node(instance in=reference to unnamed text, "Visible"=FALSE)
        Property Node(instance in=reference to "ApertureTime_DCVR", "Visible"=FALSE)
        Property Node(instance in=reference to "ManualRange_DCV", "Visible"=TRUE)
        Property Node(instance in=reference to "String_DCVR", "Visible"=FALSE)
        Property Node(instance in=reference to unnamed text, "Visible"=TRUE)
        Property Node(instance in=reference to "ApertureNPLC_DCV", "Visible"=TRUE)
        Event Data() -> ("New Value"=w6)
        Property Node(instance in=reference to "DCV Ratio_toenable", "Visible"=TRUE, "Value"=w6)
        Property Node(instance in=reference to "Auto Impedance_DCV", "Visible"=TRUE)
        w1 = default
      }
      on "VoltageAC_control" Value changed {
        # TITLES VISIBILITY
        Property Node(instance in=reference to unnamed text, "Visible"=FALSE)
        Property Node(instance in=reference to unnamed text, "Visible"=FALSE)
        Property Node(instance in=reference to unnamed text, "Visible"=TRUE)
        # 4WR VISIBILITY
        Property Node(instance in=reference to "ApertureNPLC_4WR", "Visible"=FALSE)
        Property Node(instance in=reference to unnamed text, "Visible"=FALSE)
        # 2WR VISIBILITY
        Property Node(instance in=reference to "ApertureNPLC_2WR", "Visible"=FALSE)
        # DCV VISIBILITY
        Property Node(instance in=reference to "DIG Option On/Off_DCV", "Visible"=FALSE)
        # DCVRATIO VISIBILITY
        Property Node(instance in=reference to "DIG Option On/Off_DCVR", "Visible"=FALSE)
        # DCC VISIBILITY
        Property Node(instance in=reference to "TerminalType_DCC", "Visible"=FALSE)
        # CAPACI VISIBILITY
        Property Node(instance in=reference to "ManualRange_Capaci", "Visible"=FALSE)
        # ACV VISIBILITY
        Property Node(instance in=reference to "ManualRange_ACV", "Visible"=TRUE)
        Property Node(instance in=reference to "ApertureTime_4WR", "Visible"=FALSE)
        Property Node(instance in=reference to "ApertureTime_2WR", "Visible"=FALSE)
        Property Node(instance in=reference to "Auto Impedance_DCV", "Visible"=FALSE)
        Property Node(instance in=reference to "Auto Impedance_DCVR", "Visible"=FALSE)
        # ACC VISIBILITY
        Property Node(instance in=reference to "TerminalType_ACC", "Visible"=FALSE)
        Property Node(instance in=reference to "AutoRange_DCC", "Visible"=FALSE)
        Property Node(instance in=reference to "AutoRange_Capaci", "Visible"=FALSE)
        Property Node(instance in=reference to "ACFilter_ACV", "Visible"=TRUE)
        # CONT VISIBILITY
        Property Node(instance in=reference to "Beeper_Cont", "Visible"=FALSE)
        Property Node(instance in=reference to "Aperture_4WR", "Visible"=FALSE)
        # DIODE VISIBILITY
        Property Node(instance in=reference to "Beeper_Diode", "Visible"=FALSE)
        Property Node(instance in=reference to "Aperture_2WR", "Visible"=FALSE)
        Property Node(instance in=reference to "ManualRange_DCV", "Visible"=FALSE, "Disabled"=TRUE)
        Property Node(instance in=reference to "ManualRange_DCVR", "Visible"=FALSE)
        Property Node(instance in=reference to "ACFilter_ACC", "Visible"=FALSE)
        Property Node(instance in=reference to "ManualRange_DCC", "Visible"=FALSE)
        Property Node(instance in=reference to "String_Capaci", "Visible"=FALSE)
        Property Node(instance in=reference to "String_ACV", "Visible"=TRUE)
        Property Node(instance in=reference to "String_Cont", "Visible"=FALSE)
        Property Node(instance in=reference to "AutoRange_4WR", "Visible"=FALSE)
        Property Node(instance in=reference to "String_Diode", "Visible"=FALSE)
        Property Node(instance in=reference to "AutoRange_2WR", "Visible"=FALSE)
        Property Node(instance in=reference to "ApertureNPLC_DCV", "Visible"=FALSE)
        Property Node(instance in=reference to "ApertureNPLC_DCVR", "Visible"=FALSE)
        Property Node(instance in=reference to "ManualRange_ACC", "Visible"=FALSE)
        Property Node(instance in=reference to unnamed text, "Visible"=FALSE)
        Property Node(instance in=reference to "Aperture_DCC", "Visible"=FALSE)
        Property Node(instance in=reference to "LowPower_4WR", "Visible"=FALSE)
        Property Node(instance in=reference to "AutoRange_ACV", "Visible"=TRUE)
        Property Node(instance in=reference to "AutoZero_2WR", "Visible"=FALSE)
        Property Node(instance in=reference to "Aperture_DCV", "Visible"=FALSE)
        Property Node(instance in=reference to "Aperture_DCVR", "Visible"=FALSE)
        Property Node(instance in=reference to "AutoRange_ACC", "Visible"=FALSE)
        Property Node(instance in=reference to "ApertureNPLC_DCC", "Visible"=FALSE)
        Property Node(instance in=reference to "ManualRange_4WR", "Visible"=FALSE)
        Property Node(instance in=reference to "LowPower_2WR", "Visible"=FALSE)
        Property Node(instance in=reference to "AutoRange_DCV", "Visible"=FALSE)
        Property Node(instance in=reference to "AutoRange_DCVR", "Visible"=FALSE)
        Property Node(instance in=reference to "String_ACC", "Visible"=FALSE)
        Property Node(instance in=reference to "ApertureTime_DCC", "Visible"=FALSE)
        Property Node(instance in=reference to unnamed text, "Visible"=FALSE)
        Property Node(instance in=reference to "OffstComp_4WR", "Visible"=FALSE)
        Property Node(instance in=reference to "ManualRange_2WR", "Visible"=FALSE)
        Property Node(instance in=reference to "DCV Ratio_toenable", "Visible"=FALSE, "Value"=FALSE)
        Property Node(instance in=reference to "DCV Ratio_todisable", "Visible"=FALSE, "Value"=FALSE)
        Property Node(instance in=reference to "AutoZero_DCC", "Visible"=FALSE)
        Property Node(instance in=reference to unnamed text, "Visible"=FALSE)
        Property Node(instance in=reference to "String_4WR", "Visible"=FALSE)
        Property Node(instance in=reference to "OffstComp_2WR", "Visible"=FALSE)
        Property Node(instance in=reference to "ApertureTime_DCV", "Visible"=FALSE)
        Property Node(instance in=reference to "ApertureTime_DCVR", "Visible"=FALSE)
        Property Node(instance in=reference to unnamed text, "Visible"=FALSE)
        Property Node(instance in=reference to "String_DCC", "Visible"=FALSE)
        Property Node(instance in=reference to "String_2WR", "Visible"=FALSE)
        # FREQ VISIBILITY
        Property Node(instance in=reference to "ACFilter_Freq", "Visible"=FALSE)
        Property Node(instance in=reference to "String_DCV", "Visible"=FALSE)
        Property Node(instance in=reference to "String_DCVR", "Visible"=FALSE)
        Property Node(instance in=reference to unnamed text, "Visible"=FALSE)
        Property Node(instance in=reference to "AutoRange_Freq", "Visible"=FALSE)
        Property Node(instance in=reference to "AutoZero_DCV", "Visible"=FALSE)
        Property Node(instance in=reference to unnamed text, "Visible"=FALSE)
        # TEMPRTD2W VISIBILITY
        Property Node(instance in=reference to "AutoZero_TempRTD2w", "Visible"=FALSE)
        # TEMPRTD4W VISIBILITY
        Property Node(instance in=reference to "LowPower_TempRTD4w", "Visible"=FALSE)
        # TEMPTCOUPLE VISIBILITY
        Property Node(instance in=reference to "Aperture_TempTCouple", "Visible"=FALSE)
        Property Node(instance in=reference to "GateTime_Freq", "Visible"=FALSE)
        # TEMPTHERMIS4W VISIBILITY
        Property Node(instance in=reference to "ApertureNPLC_TempThermis4w", "Visible"=FALSE)
        # TEMPMAIN VISIBILITY
        Property Node(instance in=reference to "Probe_TempMain", "Visible"=FALSE, "Value"=1)
        # TEMPTHERMIS2W VISIBILITY
        Property Node(instance in=reference to "ApertureNPLC_TempThermis2w", "Visible"=FALSE)
        Property Node(instance in=reference to unnamed text, "Visible"=FALSE)
        Property Node(instance in=reference to "LowPower_TempRTD2w", "Visible"=FALSE)
        Property Node(instance in=reference to "OffstComp_TempRTD4w", "Visible"=FALSE)
        Property Node(instance in=reference to "ApertureNPLC_TempTCouple", "Visible"=FALSE)
        Property Node(instance in=reference to "ManualRange_Freq", "Visible"=FALSE)
        Property Node(instance in=reference to "ApertureTime_TempThermis4w", "Visible"=FALSE)
        Property Node(instance in=reference to "ApertureTime_TempThermis2w", "Visible"=FALSE)
        Property Node(instance in=reference to unnamed text, "Visible"=FALSE)
        Property Node(instance in=reference to "OffstComp_TempRTD2w", "Visible"=FALSE)
        Property Node(instance in=reference to "R0_TempRTD4w", "Visible"=FALSE)
        Property Node(instance in=reference to "ApertureTime_TempTCouple", "Visible"=FALSE)
        Property Node(instance in=reference to "Timeout_Freq", "Visible"=FALSE)
        Property Node(instance in=reference to "Aperture_TempThermis4w", "Visible"=FALSE)
        Property Node(instance in=reference to "Aperture_TempThermis2w", "Visible"=FALSE)
        Property Node(instance in=reference to unnamed text, "Visible"=FALSE)
        Property Node(instance in=reference to "R0_TempRTD2w", "Visible"=FALSE)
        Property Node(instance in=reference to "ApertureNPLC_TempRTD4w", "Visible"=FALSE)
        Property Node(instance in=reference to "FixedOffset_TempTCouple", "Visible"=FALSE)
        Property Node(instance in=reference to "String_Freq", "Visible"=FALSE)
        Property Node(instance in=reference to "LowPower_TempThermis4w", "Visible"=FALSE)
        Property Node(instance in=reference to "AutoZero_TempThermis2w", "Visible"=FALSE)
        Property Node(instance in=reference to unnamed text, "Visible"=FALSE)
        Property Node(instance in=reference to "ApertureNPLC_TempRTD2w", "Visible"=FALSE)
        Property Node(instance in=reference to "ApertureTime_TempRTD4w", "Visible"=FALSE)
        Property Node(instance in=reference to "OffsetAdjust_TempTCouple", "Visible"=FALSE)
        Property Node(instance in=reference to "Period_toenable", "Visible"=FALSE)
        Property Node(instance in=reference to "Units_TempThermis4w", "Visible"=FALSE)
        Property Node(instance in=reference to "LowPower_TempThermis2w", "Visible"=FALSE)
        Property Node(instance in=reference to "ApertureTime_TempRTD2w", "Visible"=FALSE)
        Property Node(instance in=reference to "Aperture_TempRTD4w", "Visible"=FALSE)
        Property Node(instance in=reference to "OpenCheck_TempTCouple", "Visible"=FALSE)
        Property Node(instance in=reference to "String_TempThermis4w", "Visible"=FALSE)
        Property Node(instance in=reference to "Units_TempThermis2w", "Visible"=FALSE)
        Event Data() -> ("Old Value"=w7, "New Value"=w8)
        # EVENT NIE DLA
        # CONTROL NEW VALUE F
        # INDICATOR OLD
        Property Node(instance in=reference to "VoltageDC_indicator", "Visible"=w7)
        Property Node(instance in=reference to "Aperture_TempRTD2w", "Visible"=FALSE)
        Property Node(instance in=reference to "Units_TempRTD4w", "Visible"=FALSE)
        Property Node(instance in=reference to "AutoZero_TempTCouple", "Visible"=FALSE)
        Property Node(instance in=reference to "String_TempThermis2w", "Visible"=FALSE)
        Property Node(instance in=reference to "CurrentDC_indicator", "Visible"=w7)
        Property Node(instance in=reference to "Units_TempRTD2w", "Visible"=FALSE)
        Property Node(instance in=reference to "String_TempRTD4w", "Visible"=FALSE)
        Property Node(instance in=reference to "Reference_TempTCouple", "Visible"=FALSE)
        # PERIOD VISIBILITY
        Property Node(instance in=reference to "ACFilter_Period", "Visible"=FALSE)
        Property Node(instance in=reference to "String_TempRTD2w", "Visible"=FALSE)
        Property Node(instance in=reference to "Type_TempTCouple", "Visible"=FALSE)
        Property Node(instance in=reference to "CurrentAC_indicator", "Visible"=w7)
        Property Node(instance in=reference to "AutoRange_Period", "Visible"=FALSE)
        Property Node(instance in=reference to "Units_TempTCouple", "Visible"=FALSE)
        Property Node(instance in=reference to "GateTime_Period", "Visible"=FALSE)
        Property Node(instance in=reference to "2WResistance_indicator", "Visible"=w7)
        Property Node(instance in=reference to "String_TempTCouple", "Visible"=FALSE)
        Property Node(instance in=reference to "ManualRange_Period", "Visible"=FALSE)
        Property Node(instance in=reference to "4WResistance_indicator", "Visible"=w7)
        Property Node(instance in=reference to "Timeout_Period", "Visible"=FALSE)
        Property Node(instance in=reference to "Frequency_indicator", "Visible"=w7)
        Property Node(instance in=reference to "String_Period", "Visible"=FALSE)
        Property Node(instance in=reference to "Capacitance_indicator", "Visible"=w7)
        Property Node(instance in=reference to "Period_todisable", "Visible"=FALSE)
        Property Node(instance in=reference to "Continuity_indicator", "Visible"=w7)
        Property Node(instance in=reference to "Diode_indicator", "Visible"=w7)
        Property Node(instance in=reference to "Temperature_indicator", "Visible"=w7)
        # EVENT DLA
        # CONTROL OLD
        # INDICATOR NEW
        Property Node(instance in=reference to "VoltageAC_control", "Visible"=w7)
        Property Node(instance in=reference to "VoltageAC_indicator", "Visible"=w8)
        Property Node(instance in=reference to "VoltageDC_control", "Visible"=w8, "Value"=FALSE)
        Property Node(instance in=reference to "CurrentDC_control", "Visible"=w8, "Value"=FALSE)
        Property Node(instance in=reference to "CurrentAC_control", "Visible"=w8, "Value"=FALSE)
        Property Node(instance in=reference to "2WResistance_control", "Visible"=w8, "Value"=FALSE)
        Property Node(instance in=reference to "4WResistance_control", "Visible"=w8, "Value"=FALSE)
        Property Node(instance in=reference to "Frequency_control", "Visible"=w8, "Value"=FALSE)
        Property Node(instance in=reference to "Capacitance_control", "Visible"=w8, "Value"=FALSE)
        Property Node(instance in=reference to "Continuity_control", "Visible"=w8, "Value"=FALSE)
        Property Node(instance in=reference to "Diode_control", "Visible"=w8, "Value"=FALSE)
        Property Node(instance in=reference to "Temperature_control", "Visible"=w8, "Value"=FALSE)
        w1 = default
      }
      on "CurrentDC_control" Value changed {
        # TITLES VISIBILITY
        Property Node(instance in=reference to unnamed text, "Visible"=FALSE)
        Property Node(instance in=reference to unnamed text, "Visible"=FALSE)
        Property Node(instance in=reference to unnamed text, "Visible"=FALSE)
        # DCV VISIBILITY
        Property Node(instance in=reference to "DIG Option On/Off_DCV", "Visible"=FALSE)
        # DCVRATIO VISIBILITY
        Property Node(instance in=reference to "DIG Option On/Off_DCVR", "Visible"=FALSE)
        Property Node(instance in=reference to unnamed text, "Visible"=FALSE)
        Property Node(instance in=reference to "Auto Impedance_DCV", "Visible"=FALSE)
        Property Node(instance in=reference to "Auto Impedance_DCVR", "Visible"=FALSE)
        # DCC VISIBILITY
        Property Node(instance in=reference to "TerminalType_DCC", "Visible"=TRUE)
        # ACV VISIBILITY
        Property Node(instance in=reference to "ManualRange_ACV", "Visible"=FALSE)
        # 2WR VISIBILITY
        Property Node(instance in=reference to "ApertureNPLC_2WR", "Visible"=FALSE)
        # 4WR VISIBILITY
        Property Node(instance in=reference to "ApertureNPLC_4WR", "Visible"=FALSE)
        Property Node(instance in=reference to "ManualRange_DCV", "Visible"=FALSE, "Disabled"=TRUE)
        Property Node(instance in=reference to "ManualRange_DCVR", "Visible"=FALSE)
        # ACC VISIBILITY
        Property Node(instance in=reference to "TerminalType_ACC", "Visible"=FALSE)
        Property Node(instance in=reference to "AutoRange_DCC", "Visible"=TRUE)
        # CAPACI VISIBILITY
        Property Node(instance in=reference to "ManualRange_Capaci", "Visible"=FALSE)
        Property Node(instance in=reference to "ACFilter_ACV", "Visible"=FALSE)
        Property Node(instance in=reference to "ApertureTime_2WR", "Visible"=FALSE)
        Property Node(instance in=reference to "ApertureTime_4WR", "Visible"=FALSE)
        Property Node(instance in=reference to "ApertureNPLC_DCV", "Visible"=FALSE)
        Property Node(instance in=reference to "ApertureNPLC_DCVR", "Visible"=FALSE)
        Property Node(instance in=reference to "ACFilter_ACC", "Visible"=FALSE)
        Property Node(instance in=reference to "ManualRange_DCC", "Visible"=TRUE)
        Property Node(instance in=reference to unnamed text, "Visible"=FALSE)
        Property Node(instance in=reference to "AutoRange_Capaci", "Visible"=FALSE)
        Property Node(instance in=reference to "String_ACV", "Visible"=FALSE)
        Property Node(instance in=reference to "Aperture_2WR", "Visible"=FALSE)
        Property Node(instance in=reference to "Aperture_4WR", "Visible"=FALSE)
        Property Node(instance in=reference to "Aperture_DCV", "Visible"=FALSE)
        Property Node(instance in=reference to "Aperture_DCVR", "Visible"=FALSE)
        Property Node(instance in=reference to "ManualRange_ACC", "Visible"=FALSE)
        Property Node(instance in=reference to "Aperture_DCC", "Visible"=TRUE)
        # FREQ VISIBILITY
        Property Node(instance in=reference to "ACFilter_Freq", "Visible"=FALSE)
        Property Node(instance in=reference to "String_Capaci", "Visible"=FALSE)
        Property Node(instance in=reference to "AutoRange_2WR", "Visible"=FALSE)
        Property Node(instance in=reference to "AutoRange_4WR", "Visible"=FALSE)
        Property Node(instance in=reference to "AutoRange_DCV", "Visible"=FALSE)
        Property Node(instance in=reference to "AutoRange_DCVR", "Visible"=FALSE)
        Property Node(instance in=reference to "AutoRange_ACV", "Visible"=FALSE)
        Property Node(instance in=reference to "AutoRange_ACC", "Visible"=FALSE)
        Property Node(instance in=reference to "ApertureNPLC_DCC", "Visible"=TRUE)
        Property Node(instance in=reference to "AutoRange_Freq", "Visible"=FALSE)
        Property Node(instance in=reference to unnamed text, "Visible"=TRUE)
        Property Node(instance in=reference to "AutoZero_2WR", "Visible"=FALSE)
        Property Node(instance in=reference to "LowPower_4WR", "Visible"=FALSE)
        Property Node(instance in=reference to "DCV Ratio_toenable", "Visible"=FALSE, "Value"=FALSE)
        Property Node(instance in=reference to "DCV Ratio_todisable", "Visible"=FALSE, "Value"=FALSE)
        Property Node(instance in=reference to "String_ACC", "Visible"=FALSE)
        Property Node(instance in=reference to "ApertureTime_DCC", "Visible"=TRUE)
        Property Node(instance in=reference to "GateTime_Freq", "Visible"=FALSE)
        Property Node(instance in=reference to unnamed text, "Visible"=FALSE)
        Property Node(instance in=reference to "LowPower_2WR", "Visible"=FALSE)
        Property Node(instance in=reference to "ManualRange_4WR", "Visible"=FALSE)
        Property Node(instance in=reference to "ApertureTime_DCV", "Visible"=FALSE)
        Property Node(instance in=reference to "ApertureTime_DCVR", "Visible"=FALSE)
        Property Node(instance in=reference to "AutoZero_DCC", "Visible"=TRUE)
        Property Node(instance in=reference to "ManualRange_Freq", "Visible"=FALSE)
        Property Node(instance in=reference to unnamed text, "Visible"=FALSE)
        Property Node(instance in=reference to "ManualRange_2WR", "Visible"=FALSE)
        Property Node(instance in=reference to "OffstComp_4WR", "Visible"=FALSE)
        Property Node(instance in=reference to "String_DCV", "Visible"=FALSE)
        Property Node(instance in=reference to "String_DCVR", "Visible"=FALSE)
        Property Node(instance in=reference to "Timeout_Freq", "Visible"=FALSE)
        Property Node(instance in=reference to unnamed text, "Visible"=FALSE)
        Property Node(instance in=reference to "String_DCC", "Visible"=TRUE)
        Property Node(instance in=reference to "OffstComp_2WR", "Visible"=FALSE)
        Property Node(instance in=reference to "String_4WR", "Visible"=FALSE)
        Property Node(instance in=reference to "AutoZero_DCV", "Visible"=FALSE)
        Property Node(instance in=reference to "String_Freq", "Visible"=FALSE)
        Property Node(instance in=reference to unnamed text, "Visible"=FALSE)
        Property Node(instance in=reference to "String_2WR", "Visible"=FALSE)
        Property Node(instance in=reference to "Period_toenable", "Visible"=FALSE)
        Property Node(instance in=reference to unnamed text, "Visible"=FALSE)
        # TEMPTCOUPLE VISIBILITY
        Property Node(instance in=reference to "Aperture_TempTCouple", "Visible"=FALSE)
        Property Node(instance in=reference to unnamed text, "Visible"=FALSE)
        # TEMPRTD2W VISIBILITY
        Property Node(instance in=reference to "AutoZero_TempRTD2w", "Visible"=FALSE)
        # TEMPRTD4W VISIBILITY
        Property Node(instance in=reference to "LowPower_TempRTD4w", "Visible"=FALSE)
        Property Node(instance in=reference to "ApertureNPLC_TempTCouple", "Visible"=FALSE)
        # TEMPTHERMIS4W VISIBILITY
        Property Node(instance in=reference to "ApertureNPLC_TempThermis4w", "Visible"=FALSE)
        Property Node(instance in=reference to unnamed text, "Visible"=FALSE)
        Property Node(instance in=reference to "LowPower_TempRTD2w", "Visible"=FALSE)
        Property Node(instance in=reference to "OffstComp_TempRTD4w", "Visible"=FALSE)
        # TEMPTHERMIS2W VISIBILITY
        Property Node(instance in=reference to "ApertureNPLC_TempThermis2w", "Visible"=FALSE)
        # CONT VISIBILITY
        Property Node(instance in=reference to "Beeper_Cont", "Visible"=FALSE)
        # DIODE VISIBILITY
        Property Node(instance in=reference to "Beeper_Diode", "Visible"=FALSE)
        # TEMPMAIN VISIBILITY
        Property Node(instance in=reference to "Probe_TempMain", "Visible"=FALSE, "Value"=1)
        # PERIOD VISIBILITY
        Property Node(instance in=reference to "ACFilter_Period", "Visible"=FALSE)
        Property Node(instance in=reference to "ApertureTime_TempTCouple", "Visible"=FALSE)
        Property Node(instance in=reference to "ApertureTime_TempThermis4w", "Visible"=FALSE)
        Property Node(instance in=reference to unnamed text, "Visible"=FALSE)
        Property Node(instance in=reference to "OffstComp_TempRTD2w", "Visible"=FALSE)
        Property Node(instance in=reference to "ApertureTime_TempThermis2w", "Visible"=FALSE)
        Property Node(instance in=reference to "R0_TempRTD4w", "Visible"=FALSE)
        Property Node(instance in=reference to "String_Cont", "Visible"=FALSE)
        Property Node(instance in=reference to "String_Diode", "Visible"=FALSE)
        Property Node(instance in=reference to "AutoRange_Period", "Visible"=FALSE)
        Property Node(instance in=reference to "FixedOffset_TempTCouple", "Visible"=FALSE)
        Property Node(instance in=reference to "Aperture_TempThermis4w", "Visible"=FALSE)
        Property Node(instance in=reference to "Aperture_TempThermis2w", "Visible"=FALSE)
        Property Node(instance in=reference to "R0_TempRTD2w", "Visible"=FALSE)
        Property Node(instance in=reference to "ApertureNPLC_TempRTD4w", "Visible"=FALSE)
        Property Node(instance in=reference to "GateTime_Period", "Visible"=FALSE)
        Property Node(instance in=reference to "OffsetAdjust_TempTCouple", "Visible"=FALSE)
        Property Node(instance in=reference to "LowPower_TempThermis4w", "Visible"=FALSE)
        Property Node(instance in=reference to "AutoZero_TempThermis2w", "Visible"=FALSE)
        Property Node(instance in=reference to "ApertureNPLC_TempRTD2w", "Visible"=FALSE)
        Property Node(instance in=reference to "ApertureTime_TempRTD4w", "Visible"=FALSE)
        Property Node(instance in=reference to "ManualRange_Period", "Visible"=FALSE)
        Event Data() -> ("Old Value"=w9, "New Value"=w10)
        # EVENT NIE DLA
        # CONTROL NEW VALUE F
        # INDICATOR OLD
        Property Node(instance in=reference to "VoltageAC_indicator", "Visible"=w9)
        Property Node(instance in=reference to "OpenCheck_TempTCouple", "Visible"=FALSE)
        Property Node(instance in=reference to "Units_TempThermis4w", "Visible"=FALSE)
        Property Node(instance in=reference to "LowPower_TempThermis2w", "Visible"=FALSE)
        Property Node(instance in=reference to "ApertureTime_TempRTD2w", "Visible"=FALSE)
        Property Node(instance in=reference to "Aperture_TempRTD4w", "Visible"=FALSE)
        Property Node(instance in=reference to "Timeout_Period", "Visible"=FALSE)
        Property Node(instance in=reference to "AutoZero_TempTCouple", "Visible"=FALSE)
        Property Node(instance in=reference to "VoltageDC_indicator", "Visible"=w9)
        Property Node(instance in=reference to "String_TempThermis4w", "Visible"=FALSE)
        Property Node(instance in=reference to "Units_TempThermis2w", "Visible"=FALSE)
        Property Node(instance in=reference to "Aperture_TempRTD2w", "Visible"=FALSE)
        Property Node(instance in=reference to "Units_TempRTD4w", "Visible"=FALSE)
        Property Node(instance in=reference to "String_Period", "Visible"=FALSE)
        Property Node(instance in=reference to "Reference_TempTCouple", "Visible"=FALSE)
        Property Node(instance in=reference to "String_TempThermis2w", "Visible"=FALSE)
        Property Node(instance in=reference to "Units_TempRTD2w", "Visible"=FALSE)
        Property Node(instance in=reference to "CurrentAC_indicator", "Visible"=w9)
        Property Node(instance in=reference to "String_TempRTD4w", "Visible"=FALSE)
        Property Node(instance in=reference to "Period_todisable", "Visible"=FALSE)
        Property Node(instance in=reference to "Type_TempTCouple", "Visible"=FALSE)
        Property Node(instance in=reference to "String_TempRTD2w", "Visible"=FALSE)
        Property Node(instance in=reference to "2WResistance_indicator", "Visible"=w9)
        Property Node(instance in=reference to "Units_TempTCouple", "Visible"=FALSE)
        Property Node(instance in=reference to "4WResistance_indicator", "Visible"=w9)
        Property Node(instance in=reference to "String_TempTCouple", "Visible"=FALSE)
        Property Node(instance in=reference to "Frequency_indicator", "Visible"=w9)
        Property Node(instance in=reference to "Capacitance_indicator", "Visible"=w9)
        Property Node(instance in=reference to "Continuity_indicator", "Visible"=w9)
        Property Node(instance in=reference to "Diode_indicator", "Visible"=w9)
        Property Node(instance in=reference to "Temperature_indicator", "Visible"=w9)
        # EVENT DLA
        # CONTROL OLD
        # INDICATOR NEW
        Property Node(instance in=reference to "CurrentDC_control", "Visible"=w9)
        Property Node(instance in=reference to "CurrentDC_indicator", "Visible"=w10)
        Property Node(instance in=reference to "VoltageAC_control", "Visible"=w10, "Value"=FALSE)
        Property Node(instance in=reference to "VoltageDC_control", "Visible"=w10, "Value"=FALSE)
        Property Node(instance in=reference to "CurrentAC_control", "Visible"=w10, "Value"=FALSE)
        Property Node(instance in=reference to "2WResistance_control", "Visible"=w10, "Value"=FALSE)
        Property Node(instance in=reference to "4WResistance_control", "Visible"=w10, "Value"=FALSE)
        Property Node(instance in=reference to "Frequency_control", "Visible"=w10, "Value"=FALSE)
        Property Node(instance in=reference to "Capacitance_control", "Visible"=w10, "Value"=FALSE)
        Property Node(instance in=reference to "Continuity_control", "Visible"=w10, "Value"=FALSE)
        Property Node(instance in=reference to "Diode_control", "Visible"=w10, "Value"=FALSE)
        Property Node(instance in=reference to "Temperature_control", "Visible"=w10, "Value"=FALSE)
        w1 = default
      }
      on "CurrentAC_control" Value changed {
        # TITLES VISIBILITY
        Property Node(instance in=reference to unnamed text, "Visible"=FALSE)
        Property Node(instance in=reference to unnamed text, "Visible"=FALSE)
        Property Node(instance in=reference to unnamed text, "Visible"=FALSE)
        Property Node(instance in=reference to unnamed text, "Visible"=FALSE)
        # DCV VISIBILITY
        Property Node(instance in=reference to "DIG Option On/Off_DCV", "Visible"=FALSE)
        # DCVRATIO VISIBILITY
        Property Node(instance in=reference to "DIG Option On/Off_DCVR", "Visible"=FALSE)
        # DCC VISIBILITY
        Property Node(instance in=reference to "TerminalType_DCC", "Visible"=FALSE)
        # ACV VISIBILITY
        Property Node(instance in=reference to "ManualRange_ACV", "Visible"=FALSE)
        Property Node(instance in=reference to "Auto Impedance_DCV", "Visible"=FALSE)
        Property Node(instance in=reference to "Auto Impedance_DCVR", "Visible"=FALSE)
        # 2WR VISIBILITY
        Property Node(instance in=reference to "ApertureNPLC_2WR", "Visible"=FALSE)
        # 4WR VISIBILITY
        Property Node(instance in=reference to "ApertureNPLC_4WR", "Visible"=FALSE)
        # ACC VISIBILITY
        Property Node(instance in=reference to "TerminalType_ACC", "Visible"=TRUE)
        Property Node(instance in=reference to "AutoRange_DCC", "Visible"=FALSE)
        Property Node(instance in=reference to "ACFilter_ACV", "Visible"=FALSE)
        # CAPACI VISIBILITY
        Property Node(instance in=reference to "ManualRange_Capaci", "Visible"=FALSE)
        # FREQ VISIBILITY
        Property Node(instance in=reference to "ACFilter_Freq", "Visible"=FALSE)
        Property Node(instance in=reference to "ManualRange_DCV", "Visible"=FALSE, "Disabled"=TRUE)
        Property Node(instance in=reference to "ManualRange_DCVR", "Visible"=FALSE)
        Property Node(instance in=reference to "ApertureTime_2WR", "Visible"=FALSE)
        Property Node(instance in=reference to "ApertureTime_4WR", "Visible"=FALSE)
        Property Node(instance in=reference to unnamed text, "Visible"=FALSE)
        Property Node(instance in=reference to "ACFilter_ACC", "Visible"=TRUE)
        Property Node(instance in=reference to "ManualRange_DCC", "Visible"=FALSE)
        Property Node(instance in=reference to "String_ACV", "Visible"=FALSE)
        Property Node(instance in=reference to "AutoRange_Capaci", "Visible"=FALSE)
        Property Node(instance in=reference to "AutoRange_Freq", "Visible"=FALSE)
        Property Node(instance in=reference to "ApertureNPLC_DCV", "Visible"=FALSE)
        Property Node(instance in=reference to "ApertureNPLC_DCVR", "Visible"=FALSE)
        Property Node(instance in=reference to "Aperture_2WR", "Visible"=FALSE)
        Property Node(instance in=reference to "Aperture_4WR", "Visible"=FALSE)
        Property Node(instance in=reference to "ManualRange_ACC", "Visible"=TRUE)
        Property Node(instance in=reference to "Aperture_DCC", "Visible"=FALSE)
        Property Node(instance in=reference to "String_Capaci", "Visible"=FALSE)
        Property Node(instance in=reference to "GateTime_Freq", "Visible"=FALSE)
        Property Node(instance in=reference to "Aperture_DCV", "Visible"=FALSE)
        Property Node(instance in=reference to "Aperture_DCVR", "Visible"=FALSE)
        Property Node(instance in=reference to "AutoRange_2WR", "Visible"=FALSE)
        Property Node(instance in=reference to "AutoRange_ACV", "Visible"=FALSE)
        Property Node(instance in=reference to "AutoRange_4WR", "Visible"=FALSE)
        Property Node(instance in=reference to "AutoRange_ACC", "Visible"=TRUE)
        Property Node(instance in=reference to "ApertureNPLC_DCC", "Visible"=FALSE)
        Property Node(instance in=reference to unnamed text, "Visible"=FALSE)
        Property Node(instance in=reference to "ManualRange_Freq", "Visible"=FALSE)
        Property Node(instance in=reference to "AutoRange_DCV", "Visible"=FALSE)
        Property Node(instance in=reference to "AutoRange_DCVR", "Visible"=FALSE)
        Property Node(instance in=reference to "AutoZero_2WR", "Visible"=FALSE)
        Property Node(instance in=reference to "LowPower_4WR", "Visible"=FALSE)
        Property Node(instance in=reference to "String_ACC", "Visible"=TRUE)
        Property Node(instance in=reference to "ApertureTime_DCC", "Visible"=FALSE)
        Property Node(instance in=reference to unnamed text, "Visible"=TRUE)
        Property Node(instance in=reference to "Timeout_Freq", "Visible"=FALSE)
        Property Node(instance in=reference to "DCV Ratio_toenable", "Visible"=FALSE, "Value"=FALSE)
        Property Node(instance in=reference to "DCV Ratio_todisable", "Visible"=FALSE, "Value"=FALSE)
        Property Node(instance in=reference to "LowPower_2WR", "Visible"=FALSE)
        Property Node(instance in=reference to "ManualRange_4WR", "Visible"=FALSE)
        Property Node(instance in=reference to "AutoZero_DCC", "Visible"=FALSE)
        Property Node(instance in=reference to unnamed text, "Visible"=FALSE)
        Property Node(instance in=reference to "String_Freq", "Visible"=FALSE)
        Property Node(instance in=reference to "ApertureTime_DCV", "Visible"=FALSE)
        Property Node(instance in=reference to "ApertureTime_DCVR", "Visible"=FALSE)
        Property Node(instance in=reference to "ManualRange_2WR", "Visible"=FALSE)
        Property Node(instance in=reference to "OffstComp_4WR", "Visible"=FALSE)
        Property Node(instance in=reference to unnamed text, "Visible"=FALSE)
        Property Node(instance in=reference to "Period_toenable", "Visible"=FALSE)
        Property Node(instance in=reference to "String_DCV", "Visible"=FALSE)
        Property Node(instance in=reference to "String_DCVR", "Visible"=FALSE)
        Property Node(instance in=reference to "String_DCC", "Visible"=FALSE)
        Property Node(instance in=reference to "OffstComp_2WR", "Visible"=FALSE)
        Property Node(instance in=reference to "String_4WR", "Visible"=FALSE)
        Property Node(instance in=reference to unnamed text, "Visible"=FALSE)
        Property Node(instance in=reference to "AutoZero_DCV", "Visible"=FALSE)
        Property Node(instance in=reference to "String_2WR", "Visible"=FALSE)
        Property Node(instance in=reference to unnamed text, "Visible"=FALSE)
        Property Node(instance in=reference to unnamed text, "Visible"=FALSE)
        # TEMPTCOUPLE VISIBILITY
        Property Node(instance in=reference to "Aperture_TempTCouple", "Visible"=FALSE)
        # PERIOD VISIBILITY
        Property Node(instance in=reference to "ACFilter_Period", "Visible"=FALSE)
        # CONT VISIBILITY
        Property Node(instance in=reference to "Beeper_Cont", "Visible"=FALSE)
        # DIODE VISIBILITY
        Property Node(instance in=reference to "Beeper_Diode", "Visible"=FALSE)
        Property Node(instance in=reference to unnamed text, "Visible"=FALSE)
        # TEMPRTD2W VISIBILITY
        Property Node(instance in=reference to "AutoZero_TempRTD2w", "Visible"=FALSE)
        Property Node(instance in=reference to "ApertureNPLC_TempTCouple", "Visible"=FALSE)
        # TEMPMAIN VISIBILITY
        Property Node(instance in=reference to "Probe_TempMain", "Visible"=FALSE, "Value"=1)
        # TEMPRTD4W VISIBILITY
        Property Node(instance in=reference to "LowPower_TempRTD4w", "Visible"=FALSE)
        Property Node(instance in=reference to "AutoRange_Period", "Visible"=FALSE)
        # TEMPTHERMIS4W VISIBILITY
        Property Node(instance in=reference to "ApertureNPLC_TempThermis4w", "Visible"=FALSE)
        # TEMPTHERMIS2W VISIBILITY
        Property Node(instance in=reference to "ApertureNPLC_TempThermis2w", "Visible"=FALSE)
        Property Node(instance in=reference to "String_Cont", "Visible"=FALSE)
        Property Node(instance in=reference to "String_Diode", "Visible"=FALSE)
        Property Node(instance in=reference to unnamed text, "Visible"=FALSE)
        Property Node(instance in=reference to "LowPower_TempRTD2w", "Visible"=FALSE)
        Property Node(instance in=reference to "ApertureTime_TempTCouple", "Visible"=FALSE)
        Property Node(instance in=reference to "OffstComp_TempRTD4w", "Visible"=FALSE)
        Property Node(instance in=reference to "GateTime_Period", "Visible"=FALSE)
        Property Node(instance in=reference to "ApertureTime_TempThermis4w", "Visible"=FALSE)
        Property Node(instance in=reference to "ApertureTime_TempThermis2w", "Visible"=FALSE)
        Property Node(instance in=reference to "OffstComp_TempRTD2w", "Visible"=FALSE)
        Property Node(instance in=reference to "FixedOffset_TempTCouple", "Visible"=FALSE)
        Property Node(instance in=reference to "R0_TempRTD4w", "Visible"=FALSE)
        Property Node(instance in=reference to "ManualRange_Period", "Visible"=FALSE)
        Property Node(instance in=reference to "Aperture_TempThermis4w", "Visible"=FALSE)
        Property Node(instance in=reference to "Aperture_TempThermis2w", "Visible"=FALSE)
        Property Node(instance in=reference to "R0_TempRTD2w", "Visible"=FALSE)
        Property Node(instance in=reference to "OffsetAdjust_TempTCouple", "Visible"=FALSE)
        Property Node(instance in=reference to "ApertureNPLC_TempRTD4w", "Visible"=FALSE)
        Property Node(instance in=reference to "Timeout_Period", "Visible"=FALSE)
        Property Node(instance in=reference to "LowPower_TempThermis4w", "Visible"=FALSE)
        Property Node(instance in=reference to "AutoZero_TempThermis2w", "Visible"=FALSE)
        Event Data() -> ("Old Value"=w11, "New Value"=w12)
        # EVENT NIE DLA
        # CONTROL NEW VALUE F
        # INDICATOR OLD
        Property Node(instance in=reference to "VoltageAC_indicator", "Visible"=w11)
        Property Node(instance in=reference to "ApertureNPLC_TempRTD2w", "Visible"=FALSE)
        Property Node(instance in=reference to "OpenCheck_TempTCouple", "Visible"=FALSE)
        Property Node(instance in=reference to "ApertureTime_TempRTD4w", "Visible"=FALSE)
        Property Node(instance in=reference to "String_Period", "Visible"=FALSE)
        Property Node(instance in=reference to "Units_TempThermis4w", "Visible"=FALSE)
        Property Node(instance in=reference to "LowPower_TempThermis2w", "Visible"=FALSE)
        Property Node(instance in=reference to "ApertureTime_TempRTD2w", "Visible"=FALSE)
        Property Node(instance in=reference to "AutoZero_TempTCouple", "Visible"=FALSE)
        Property Node(instance in=reference to "CurrentDC_indicator", "Visible"=w11)
        Property Node(instance in=reference to "Aperture_TempRTD4w", "Visible"=FALSE)
        Property Node(instance in=reference to "Period_todisable", "Visible"=FALSE)
        Property Node(instance in=reference to "String_TempThermis4w", "Visible"=FALSE)
        Property Node(instance in=reference to "Units_TempThermis2w", "Visible"=FALSE)
        Property Node(instance in=reference to "Aperture_TempRTD2w", "Visible"=FALSE)
        Property Node(instance in=reference to "Reference_TempTCouple", "Visible"=FALSE)
        Property Node(instance in=reference to "Units_TempRTD4w", "Visible"=FALSE)
        Property Node(instance in=reference to "String_TempThermis2w", "Visible"=FALSE)
        Property Node(instance in=reference to "VoltageDC_indicator", "Visible"=w11)
        Property Node(instance in=reference to "Type_TempTCouple", "Visible"=FALSE)
        Property Node(instance in=reference to "Units_TempRTD2w", "Visible"=FALSE)
        Property Node(instance in=reference to "String_TempRTD4w", "Visible"=FALSE)
        Property Node(instance in=reference to "2WResistance_indicator", "Visible"=w11)
        Property Node(instance in=reference to "Units_TempTCouple", "Visible"=FALSE)
        Property Node(instance in=reference to "String_TempRTD2w", "Visible"=FALSE)
        Property Node(instance in=reference to "4WResistance_indicator", "Visible"=w11)
        Property Node(instance in=reference to "String_TempTCouple", "Visible"=FALSE)
        Property Node(instance in=reference to "Frequency_indicator", "Visible"=w11)
        Property Node(instance in=reference to "Capacitance_indicator", "Visible"=w11)
        Property Node(instance in=reference to "Continuity_indicator", "Visible"=w11)
        Property Node(instance in=reference to "Diode_indicator", "Visible"=w11)
        Property Node(instance in=reference to "Temperature_indicator", "Visible"=w11)
        # EVENT DLA
        # CONTROL OLD
        # INDICATOR NEW
        Property Node(instance in=reference to "CurrentAC_control", "Visible"=w11)
        Property Node(instance in=reference to "CurrentAC_indicator", "Visible"=w12)
        Property Node(instance in=reference to "VoltageAC_control", "Visible"=w12, "Value"=FALSE)
        Property Node(instance in=reference to "CurrentDC_control", "Visible"=w12, "Value"=FALSE)
        Property Node(instance in=reference to "VoltageDC_control", "Visible"=w12, "Value"=FALSE)
        Property Node(instance in=reference to "2WResistance_control", "Visible"=w12, "Value"=FALSE)
        Property Node(instance in=reference to "4WResistance_control", "Visible"=w12, "Value"=FALSE)
        Property Node(instance in=reference to "Frequency_control", "Visible"=w12, "Value"=FALSE)
        Property Node(instance in=reference to "Capacitance_control", "Visible"=w12, "Value"=FALSE)
        Property Node(instance in=reference to "Continuity_control", "Visible"=w12, "Value"=FALSE)
        Property Node(instance in=reference to "Diode_control", "Visible"=w12, "Value"=FALSE)
        Property Node(instance in=reference to "Temperature_control", "Visible"=w12, "Value"=FALSE)
        w1 = default
      }
      on "2WResistance_control" Value changed {
        # TITLES VISIBILITY
        Property Node(instance in=reference to unnamed text, "Visible"=FALSE)
        Property Node(instance in=reference to unnamed text, "Visible"=FALSE)
        Property Node(instance in=reference to unnamed text, "Visible"=FALSE)
        Property Node(instance in=reference to unnamed text, "Visible"=FALSE)
        # 2WR VISIBILITY
        Property Node(instance in=reference to "ApertureNPLC_2WR", "Visible"=TRUE)
        # DCV VISIBILITY
        Property Node(instance in=reference to "DIG Option On/Off_DCV", "Visible"=FALSE)
        # DCVRATIO VISIBILITY
        Property Node(instance in=reference to "DIG Option On/Off_DCVR", "Visible"=FALSE)
        # 4WR VISIBILITY
        Property Node(instance in=reference to "ApertureNPLC_4WR", "Visible"=FALSE)
        # DCC VISIBILITY
        Property Node(instance in=reference to "TerminalType_DCC", "Visible"=FALSE)
        # ACV VISIBILITY
        Property Node(instance in=reference to "ManualRange_ACV", "Visible"=FALSE)
        Property Node(instance in=reference to "ApertureTime_2WR", "Visible"=TRUE)
        Property Node(instance in=reference to "Auto Impedance_DCV", "Visible"=FALSE)
        Property Node(instance in=reference to "Auto Impedance_DCVR", "Visible"=FALSE)
        Property Node(instance in=reference to "ApertureTime_4WR", "Visible"=FALSE)
        # CAPACI VISIBILITY
        Property Node(instance in=reference to "ManualRange_Capaci", "Visible"=FALSE)
        # ACC VISIBILITY
        Property Node(instance in=reference to "TerminalType_ACC", "Visible"=FALSE)
        Property Node(instance in=reference to "AutoRange_DCC", "Visible"=FALSE)
        Property Node(instance in=reference to "ACFilter_ACV", "Visible"=FALSE)
        Property Node(instance in=reference to "Aperture_2WR", "Visible"=TRUE)
        Property Node(instance in=reference to "ManualRange_DCV", "Visible"=FALSE, "Disabled"=TRUE)
        Property Node(instance in=reference to "ManualRange_DCVR", "Visible"=FALSE)
        Property Node(instance in=reference to unnamed text, "Visible"=FALSE)
        Property Node(instance in=reference to "Aperture_4WR", "Visible"=FALSE)
        Property Node(instance in=reference to "AutoRange_Capaci", "Visible"=FALSE)
        Property Node(instance in=reference to "ACFilter_ACC", "Visible"=FALSE)
        # FREQ VISIBILITY
        Property Node(instance in=reference to "ACFilter_Freq", "Visible"=FALSE)
        Property Node(instance in=reference to "ManualRange_DCC", "Visible"=FALSE)
        Property Node(instance in=reference to "String_ACV", "Visible"=FALSE)
        Property Node(instance in=reference to "AutoRange_2WR", "Visible"=TRUE)
        Property Node(instance in=reference to "ApertureNPLC_DCV", "Visible"=FALSE)
        Property Node(instance in=reference to "ApertureNPLC_DCVR", "Visible"=FALSE)
        Property Node(instance in=reference to "AutoRange_4WR", "Visible"=FALSE)
        Property Node(instance in=reference to "String_Capaci", "Visible"=FALSE)
        Property Node(instance in=reference to "ManualRange_ACC", "Visible"=FALSE)
        Property Node(instance in=reference to "AutoRange_Freq", "Visible"=FALSE)
        Property Node(instance in=reference to "Aperture_DCC", "Visible"=FALSE)
        Property Node(instance in=reference to "AutoZero_2WR", "Visible"=TRUE)
        Property Node(instance in=reference to "Aperture_DCV", "Visible"=FALSE)
        Property Node(instance in=reference to "Aperture_DCVR", "Visible"=FALSE)
        Property Node(instance in=reference to "AutoRange_ACV", "Visible"=FALSE)
        Property Node(instance in=reference to "LowPower_4WR", "Visible"=FALSE)
        Property Node(instance in=reference to "AutoRange_ACC", "Visible"=FALSE)
        Property Node(instance in=reference to "GateTime_Freq", "Visible"=FALSE)
        Property Node(instance in=reference to unnamed text, "Visible"=FALSE)
        Property Node(instance in=reference to "ApertureNPLC_DCC", "Visible"=FALSE)
        Property Node(instance in=reference to "LowPower_2WR", "Visible"=TRUE)
        Property Node(instance in=reference to "AutoRange_DCV", "Visible"=FALSE)
        Property Node(instance in=reference to "AutoRange_DCVR", "Visible"=FALSE)
        Property Node(instance in=reference to "ManualRange_4WR", "Visible"=FALSE)
        Property Node(instance in=reference to "String_ACC", "Visible"=FALSE)
        Property Node(instance in=reference to "ManualRange_Freq", "Visible"=FALSE)
        Property Node(instance in=reference to unnamed text, "Visible"=FALSE)
        Property Node(instance in=reference to "ApertureTime_DCC", "Visible"=FALSE)
        Property Node(instance in=reference to "ManualRange_2WR", "Visible"=TRUE)
        Property Node(instance in=reference to "DCV Ratio_toenable", "Visible"=FALSE, "Value"=FALSE)
        Property Node(instance in=reference to "DCV Ratio_todisable", "Visible"=FALSE, "Value"=FALSE)
        Property Node(instance in=reference to "OffstComp_4WR", "Visible"=FALSE)
        Property Node(instance in=reference to "Timeout_Freq", "Visible"=FALSE)
        Property Node(instance in=reference to unnamed text, "Visible"=TRUE)
        Property Node(instance in=reference to "AutoZero_DCC", "Visible"=FALSE)
        Property Node(instance in=reference to "OffstComp_2WR", "Visible"=TRUE)
        Property Node(instance in=reference to "ApertureTime_DCV", "Visible"=FALSE)
        Property Node(instance in=reference to "ApertureTime_DCVR", "Visible"=FALSE)
        Property Node(instance in=reference to "String_4WR", "Visible"=FALSE)
        Property Node(instance in=reference to "String_Freq", "Visible"=FALSE)
        Property Node(instance in=reference to unnamed text, "Visible"=FALSE)
        Property Node(instance in=reference to "String_2WR", "Visible"=TRUE)
        Property Node(instance in=reference to "String_DCV", "Visible"=FALSE)
        Property Node(instance in=reference to "String_DCVR", "Visible"=FALSE)
        Property Node(instance in=reference to "String_DCC", "Visible"=FALSE)
        Property Node(instance in=reference to "Period_toenable", "Visible"=FALSE)
        Property Node(instance in=reference to unnamed text, "Visible"=FALSE)
        Property Node(instance in=reference to "AutoZero_DCV", "Visible"=FALSE)
        # TEMPTCOUPLE VISIBILITY
        Property Node(instance in=reference to "Aperture_TempTCouple", "Visible"=FALSE)
        Property Node(instance in=reference to unnamed text, "Visible"=FALSE)
        Property Node(instance in=reference to "ApertureNPLC_TempTCouple", "Visible"=FALSE)
        Property Node(instance in=reference to unnamed text, "Visible"=FALSE)
        # TEMPRTD2W VISIBILITY
        Property Node(instance in=reference to "AutoZero_TempRTD2w", "Visible"=FALSE)
        # TEMPRTD4W VISIBILITY
        Property Node(instance in=reference to "LowPower_TempRTD4w", "Visible"=FALSE)
        # CONT VISIBILITY
        Property Node(instance in=reference to "Beeper_Cont", "Visible"=FALSE)
        # DIODE VISIBILITY
        Property Node(instance in=reference to "Beeper_Diode", "Visible"=FALSE)
        # TEMPTHERMIS4W VISIBILITY
        Property Node(instance in=reference to "ApertureNPLC_TempThermis4w", "Visible"=FALSE)
        # TEMPTHERMIS2W VISIBILITY
        Property Node(instance in=reference to "ApertureNPLC_TempThermis2w", "Visible"=FALSE)
        # PERIOD VISIBILITY
        Property Node(instance in=reference to "ACFilter_Period", "Visible"=FALSE)
        # TEMPMAIN VISIBILITY
        Property Node(instance in=reference to "Probe_TempMain", "Visible"=FALSE, "Value"=1)
        Property Node(instance in=reference to "ApertureTime_TempTCouple", "Visible"=FALSE)
        Property Node(instance in=reference to unnamed text, "Visible"=FALSE)
        Property Node(instance in=reference to "LowPower_TempRTD2w", "Visible"=FALSE)
        Property Node(instance in=reference to "OffstComp_TempRTD4w", "Visible"=FALSE)
        Property Node(instance in=reference to "String_Cont", "Visible"=FALSE)
        Property Node(instance in=reference to "String_Diode", "Visible"=FALSE)
        Property Node(instance in=reference to "ApertureTime_TempThermis4w", "Visible"=FALSE)
        Property Node(instance in=reference to "ApertureTime_TempThermis2w", "Visible"=FALSE)
        Property Node(instance in=reference to "AutoRange_Period", "Visible"=FALSE)
        Property Node(instance in=reference to "FixedOffset_TempTCouple", "Visible"=FALSE)
        Property Node(instance in=reference to unnamed text, "Visible"=FALSE)
        Property Node(instance in=reference to "OffstComp_TempRTD2w", "Visible"=FALSE)
        Property Node(instance in=reference to "R0_TempRTD4w", "Visible"=FALSE)
        Property Node(instance in=reference to "Aperture_TempThermis4w", "Visible"=FALSE)
        Property Node(instance in=reference to "Aperture_TempThermis2w", "Visible"=FALSE)
        Property Node(instance in=reference to "GateTime_Period", "Visible"=FALSE)
        Property Node(instance in=reference to "OffsetAdjust_TempTCouple", "Visible"=FALSE)
        Property Node(instance in=reference to "R0_TempRTD2w", "Visible"=FALSE)
        Property Node(instance in=reference to "ApertureNPLC_TempRTD4w", "Visible"=FALSE)
        Property Node(instance in=reference to "LowPower_TempThermis4w", "Visible"=FALSE)
        Property Node(instance in=reference to "AutoZero_TempThermis2w", "Visible"=FALSE)
        Property Node(instance in=reference to "ManualRange_Period", "Visible"=FALSE)
        Property Node(instance in=reference to "OpenCheck_TempTCouple", "Visible"=FALSE)
        Property Node(instance in=reference to "ApertureNPLC_TempRTD2w", "Visible"=FALSE)
        Property Node(instance in=reference to "ApertureTime_TempRTD4w", "Visible"=FALSE)
        Property Node(instance in=reference to "Units_TempThermis4w", "Visible"=FALSE)
        Property Node(instance in=reference to "LowPower_TempThermis2w", "Visible"=FALSE)
        Property Node(instance in=reference to "Timeout_Period", "Visible"=FALSE)
        Property Node(instance in=reference to "AutoZero_TempTCouple", "Visible"=FALSE)
        Property Node(instance in=reference to "ApertureTime_TempRTD2w", "Visible"=FALSE)
        Event Data() -> ("Old Value"=w13, "New Value"=w14)
        # EVENT NIE DLA
        # CONTROL NEW VALUE F
        # INDICATOR OLD
        Property Node(instance in=reference to "VoltageAC_indicator", "Visible"=w13)
        Property Node(instance in=reference to "Aperture_TempRTD4w", "Visible"=FALSE)
        Property Node(instance in=reference to "String_TempThermis4w", "Visible"=FALSE)
        Property Node(instance in=reference to "Units_TempThermis2w", "Visible"=FALSE)
        Property Node(instance in=reference to "String_Period", "Visible"=FALSE)
        Property Node(instance in=reference to "Reference_TempTCouple", "Visible"=FALSE)
        Property Node(instance in=reference to "Aperture_TempRTD2w", "Visible"=FALSE)
        Property Node(instance in=reference to "Units_TempRTD4w", "Visible"=FALSE)
        Property Node(instance in=reference to "CurrentDC_indicator", "Visible"=w13)
        Property Node(instance in=reference to "String_TempThermis2w", "Visible"=FALSE)
        Property Node(instance in=reference to "Type_TempTCouple", "Visible"=FALSE)
        Property Node(instance in=reference to "Period_todisable", "Visible"=FALSE)
        Property Node(instance in=reference to "Units_TempRTD2w", "Visible"=FALSE)
        Property Node(instance in=reference to "String_TempRTD4w", "Visible"=FALSE)
        Property Node(instance in=reference to "CurrentAC_indicator", "Visible"=w13)
        Property Node(instance in=reference to "Units_TempTCouple", "Visible"=FALSE)
        Property Node(instance in=reference to "String_TempRTD2w", "Visible"=FALSE)
        Property Node(instance in=reference to "VoltageDC_indicator", "Visible"=w13)
        Property Node(instance in=reference to "String_TempTCouple", "Visible"=FALSE)
        Property Node(instance in=reference to "4WResistance_indicator", "Visible"=w13)
        Property Node(instance in=reference to "Frequency_indicator", "Visible"=w13)
        Property Node(instance in=reference to "Capacitance_indicator", "Visible"=w13)
        Property Node(instance in=reference to "Continuity_indicator", "Visible"=w13)
        Property Node(instance in=reference to "Diode_indicator", "Visible"=w13)
        Property Node(instance in=reference to "Temperature_indicator", "Visible"=w13)
        # EVENT DLA
        # CONTROL OLD
        # INDICATOR NEW
        Property Node(instance in=reference to "2WResistance_control", "Visible"=w13)
        Property Node(instance in=reference to "2WResistance_indicator", "Visible"=w14)
        Property Node(instance in=reference to "VoltageAC_control", "Visible"=w14, "Value"=FALSE)
        Property Node(instance in=reference to "CurrentDC_control", "Visible"=w14, "Value"=FALSE)
        Property Node(instance in=reference to "CurrentAC_control", "Visible"=w14, "Value"=FALSE)
        Property Node(instance in=reference to "VoltageDC_control", "Visible"=w14, "Value"=FALSE)
        Property Node(instance in=reference to "4WResistance_control", "Visible"=w14, "Value"=FALSE)
        Property Node(instance in=reference to "Frequency_control", "Visible"=w14, "Value"=FALSE)
        Property Node(instance in=reference to "Capacitance_control", "Visible"=w14, "Value"=FALSE)
        Property Node(instance in=reference to "Continuity_control", "Visible"=w14, "Value"=FALSE)
        Property Node(instance in=reference to "Diode_control", "Visible"=w14, "Value"=FALSE)
        Property Node(instance in=reference to "Temperature_control", "Visible"=w14, "Value"=FALSE)
        w1 = default
      }
      on "4WResistance_control" Value changed {
        # TITLES VISIBILITY
        Property Node(instance in=reference to unnamed text, "Visible"=FALSE)
        Property Node(instance in=reference to unnamed text, "Visible"=FALSE)
        Property Node(instance in=reference to unnamed text, "Visible"=FALSE)
        Property Node(instance in=reference to unnamed text, "Visible"=FALSE)
        # DCV VISIBILITY
        Property Node(instance in=reference to "DIG Option On/Off_DCV", "Visible"=FALSE)
        # DCVRATIO VISIBILITY
        Property Node(instance in=reference to "DIG Option On/Off_DCVR", "Visible"=FALSE)
        # DCC VISIBILITY
        Property Node(instance in=reference to "TerminalType_DCC", "Visible"=FALSE)
        # ACV VISIBILITY
        Property Node(instance in=reference to "ManualRange_ACV", "Visible"=FALSE)
        Property Node(instance in=reference to "Auto Impedance_DCV", "Visible"=FALSE)
        Property Node(instance in=reference to "Auto Impedance_DCVR", "Visible"=FALSE)
        # ACC VISIBILITY
        Property Node(instance in=reference to "TerminalType_ACC", "Visible"=FALSE)
        # 4WR VISIBILITY
        Property Node(instance in=reference to "ApertureNPLC_4WR", "Visible"=TRUE)
        Property Node(instance in=reference to "AutoRange_DCC", "Visible"=FALSE)
        # 2WR VISIBILITY
        Property Node(instance in=reference to "ApertureNPLC_2WR", "Visible"=FALSE)
        Property Node(instance in=reference to "ACFilter_ACV", "Visible"=FALSE)
        Property Node(instance in=reference to "ManualRange_DCV", "Visible"=FALSE, "Disabled"=TRUE)
        Property Node(instance in=reference to "ManualRange_DCVR", "Visible"=FALSE)
        Property Node(instance in=reference to unnamed text, "Visible"=FALSE)
        Property Node(instance in=reference to "ACFilter_ACC", "Visible"=FALSE)
        Property Node(instance in=reference to "ApertureTime_4WR", "Visible"=TRUE)
        Property Node(instance in=reference to "ManualRange_DCC", "Visible"=FALSE)
        Property Node(instance in=reference to "ApertureTime_2WR", "Visible"=FALSE)
        # CAPACI VISIBILITY
        Property Node(instance in=reference to "ManualRange_Capaci", "Visible"=FALSE)
        Property Node(instance in=reference to "String_ACV", "Visible"=FALSE)
        Property Node(instance in=reference to "ApertureNPLC_DCV", "Visible"=FALSE)
        Property Node(instance in=reference to "ApertureNPLC_DCVR", "Visible"=FALSE)
        Property Node(instance in=reference to "ManualRange_ACC", "Visible"=FALSE)
        Property Node(instance in=reference to "Aperture_4WR", "Visible"=TRUE)
        Property Node(instance in=reference to "Aperture_DCC", "Visible"=FALSE)
        Property Node(instance in=reference to "Aperture_2WR", "Visible"=FALSE)
        Property Node(instance in=reference to "AutoRange_Capaci", "Visible"=FALSE)
        Property Node(instance in=reference to "AutoRange_ACV", "Visible"=FALSE)
        Property Node(instance in=reference to "Aperture_DCV", "Visible"=FALSE)
        Property Node(instance in=reference to "Aperture_DCVR", "Visible"=FALSE)
        Property Node(instance in=reference to "AutoRange_ACC", "Visible"=FALSE)
        Property Node(instance in=reference to "AutoRange_4WR", "Visible"=TRUE)
        Property Node(instance in=reference to "ApertureNPLC_DCC", "Visible"=FALSE)
        Property Node(instance in=reference to "AutoRange_2WR", "Visible"=FALSE)
        Property Node(instance in=reference to unnamed text, "Visible"=FALSE)
        Property Node(instance in=reference to "String_Capaci", "Visible"=FALSE)
        # FREQ VISIBILITY
        Property Node(instance in=reference to "ACFilter_Freq", "Visible"=FALSE)
        Property Node(instance in=reference to "AutoRange_DCV", "Visible"=FALSE)
        Property Node(instance in=reference to "AutoRange_DCVR", "Visible"=FALSE)
        Property Node(instance in=reference to "String_ACC", "Visible"=FALSE)
        Property Node(instance in=reference to "LowPower_4WR", "Visible"=TRUE)
        Property Node(instance in=reference to "ApertureTime_DCC", "Visible"=FALSE)
        Property Node(instance in=reference to "AutoZero_2WR", "Visible"=FALSE)
        Property Node(instance in=reference to unnamed text, "Visible"=FALSE)
        Property Node(instance in=reference to "AutoRange_Freq", "Visible"=FALSE)
        Property Node(instance in=reference to "DCV Ratio_toenable", "Visible"=FALSE, "Value"=FALSE)
        Property Node(instance in=reference to "DCV Ratio_todisable", "Visible"=FALSE, "Value"=FALSE)
        Property Node(instance in=reference to "ManualRange_4WR", "Visible"=TRUE)
        Property Node(instance in=reference to "AutoZero_DCC", "Visible"=FALSE)
        Property Node(instance in=reference to "LowPower_2WR", "Visible"=FALSE)
        Property Node(instance in=reference to unnamed text, "Visible"=FALSE)
        Property Node(instance in=reference to "GateTime_Freq", "Visible"=FALSE)
        Property Node(instance in=reference to "ApertureTime_DCV", "Visible"=FALSE)
        Property Node(instance in=reference to "ApertureTime_DCVR", "Visible"=FALSE)
        Property Node(instance in=reference to "OffstComp_4WR", "Visible"=TRUE)
        Property Node(instance in=reference to "ManualRange_2WR", "Visible"=FALSE)
        Property Node(instance in=reference to unnamed text, "Visible"=TRUE)
        Property Node(instance in=reference to "ManualRange_Freq", "Visible"=FALSE)
        Property Node(instance in=reference to "String_DCC", "Visible"=FALSE)
        Property Node(instance in=reference to "String_DCV", "Visible"=FALSE)
        Property Node(instance in=reference to "String_DCVR", "Visible"=FALSE)
        Property Node(instance in=reference to "String_4WR", "Visible"=TRUE)
        Property Node(instance in=reference to "OffstComp_2WR", "Visible"=FALSE)
        Property Node(instance in=reference to unnamed text, "Visible"=FALSE)
        Property Node(instance in=reference to "Timeout_Freq", "Visible"=FALSE)
        Property Node(instance in=reference to "AutoZero_DCV", "Visible"=FALSE)
        Property Node(instance in=reference to "String_2WR", "Visible"=FALSE)
        Property Node(instance in=reference to unnamed text, "Visible"=FALSE)
        Property Node(instance in=reference to "String_Freq", "Visible"=FALSE)
        Property Node(instance in=reference to unnamed text, "Visible"=FALSE)
        # CONT VISIBILITY
        Property Node(instance in=reference to "Beeper_Cont", "Visible"=FALSE)
        Property Node(instance in=reference to "Period_toenable", "Visible"=FALSE)
        # DIODE VISIBILITY
        Property Node(instance in=reference to "Beeper_Diode", "Visible"=FALSE)
        # TEMPTCOUPLE VISIBILITY
        Property Node(instance in=reference to "Aperture_TempTCouple", "Visible"=FALSE)
        # TEMPMAIN VISIBILITY
        Property Node(instance in=reference to "Probe_TempMain", "Visible"=FALSE, "Value"=1)
        # TEMPRTD2W VISIBILITY
        Property Node(instance in=reference to "AutoZero_TempRTD2w", "Visible"=FALSE)
        Property Node(instance in=reference to unnamed text, "Visible"=FALSE)
        # TEMPRTD4W VISIBILITY
        Property Node(instance in=reference to "LowPower_TempRTD4w", "Visible"=FALSE)
        Property Node(instance in=reference to "String_Cont", "Visible"=FALSE)
        Property Node(instance in=reference to "String_Diode", "Visible"=FALSE)
        Property Node(instance in=reference to "ApertureNPLC_TempTCouple", "Visible"=FALSE)
        # TEMPTHERMIS4W VISIBILITY
        Property Node(instance in=reference to "ApertureNPLC_TempThermis4w", "Visible"=FALSE)
        # TEMPTHERMIS2W VISIBILITY
        Property Node(instance in=reference to "ApertureNPLC_TempThermis2w", "Visible"=FALSE)
        Property Node(instance in=reference to "LowPower_TempRTD2w", "Visible"=FALSE)
        Property Node(instance in=reference to unnamed text, "Visible"=FALSE)
        Property Node(instance in=reference to "OffstComp_TempRTD4w", "Visible"=FALSE)
        Property Node(instance in=reference to "ApertureTime_TempTCouple", "Visible"=FALSE)
        Property Node(instance in=reference to "ApertureTime_TempThermis4w", "Visible"=FALSE)
        Property Node(instance in=reference to "ApertureTime_TempThermis2w", "Visible"=FALSE)
        Property Node(instance in=reference to "OffstComp_TempRTD2w", "Visible"=FALSE)
        Property Node(instance in=reference to "R0_TempRTD4w", "Visible"=FALSE)
        # PERIOD VISIBILITY
        Property Node(instance in=reference to "ACFilter_Period", "Visible"=FALSE)
        Property Node(instance in=reference to "FixedOffset_TempTCouple", "Visible"=FALSE)
        Property Node(instance in=reference to "Aperture_TempThermis4w", "Visible"=FALSE)
        Property Node(instance in=reference to "Aperture_TempThermis2w", "Visible"=FALSE)
        Property Node(instance in=reference to "R0_TempRTD2w", "Visible"=FALSE)
        Property Node(instance in=reference to "ApertureNPLC_TempRTD4w", "Visible"=FALSE)
        Property Node(instance in=reference to "AutoRange_Period", "Visible"=FALSE)
        Property Node(instance in=reference to "OffsetAdjust_TempTCouple", "Visible"=FALSE)
        Property Node(instance in=reference to "LowPower_TempThermis4w", "Visible"=FALSE)
        Property Node(instance in=reference to "AutoZero_TempThermis2w", "Visible"=FALSE)
        Event Data() -> ("Old Value"=w15, "New Value"=w16)
        # EVENT NIE DLA
        # CONTROL NEW VALUE F
        # INDICATOR OLD
        Property Node(instance in=reference to "VoltageAC_indicator", "Visible"=w15)
        Property Node(instance in=reference to "ApertureNPLC_TempRTD2w", "Visible"=FALSE)
        Property Node(instance in=reference to "ApertureTime_TempRTD4w", "Visible"=FALSE)
        Property Node(instance in=reference to "GateTime_Period", "Visible"=FALSE)
        Property Node(instance in=reference to "OpenCheck_TempTCouple", "Visible"=FALSE)
        Property Node(instance in=reference to "Units_TempThermis4w", "Visible"=FALSE)
        Property Node(instance in=reference to "LowPower_TempThermis2w", "Visible"=FALSE)
        Property Node(instance in=reference to "ApertureTime_TempRTD2w", "Visible"=FALSE)
        Property Node(instance in=reference to "Aperture_TempRTD4w", "Visible"=FALSE)
        Property Node(instance in=reference to "ManualRange_Period", "Visible"=FALSE)
        Property Node(instance in=reference to "CurrentDC_indicator", "Visible"=w15)
        Property Node(instance in=reference to "AutoZero_TempTCouple", "Visible"=FALSE)
        Property Node(instance in=reference to "String_TempThermis4w", "Visible"=FALSE)
        Property Node(instance in=reference to "Units_TempThermis2w", "Visible"=FALSE)
        Property Node(instance in=reference to "Aperture_TempRTD2w", "Visible"=FALSE)
        Property Node(instance in=reference to "Units_TempRTD4w", "Visible"=FALSE)
        Property Node(instance in=reference to "Timeout_Period", "Visible"=FALSE)
        Property Node(instance in=reference to "Reference_TempTCouple", "Visible"=FALSE)
        Property Node(instance in=reference to "CurrentAC_indicator", "Visible"=w15)
        Property Node(instance in=reference to "String_TempThermis2w", "Visible"=FALSE)
        Property Node(instance in=reference to "Units_TempRTD2w", "Visible"=FALSE)
        Property Node(instance in=reference to "String_TempRTD4w", "Visible"=FALSE)
        Property Node(instance in=reference to "String_Period", "Visible"=FALSE)
        Property Node(instance in=reference to "Type_TempTCouple", "Visible"=FALSE)
        Property Node(instance in=reference to "2WResistance_indicator", "Visible"=w15)
        Property Node(instance in=reference to "String_TempRTD2w", "Visible"=FALSE)
        Property Node(instance in=reference to "Period_todisable", "Visible"=FALSE)
        Property Node(instance in=reference to "Units_TempTCouple", "Visible"=FALSE)
        Property Node(instance in=reference to "VoltageDC_indicator", "Visible"=w15)
        Property Node(instance in=reference to "String_TempTCouple", "Visible"=FALSE)
        Property Node(instance in=reference to "Frequency_indicator", "Visible"=w15)
        Property Node(instance in=reference to "Capacitance_indicator", "Visible"=w15)
        Property Node(instance in=reference to "Continuity_indicator", "Visible"=w15)
        Property Node(instance in=reference to "Diode_indicator", "Visible"=w15)
        Property Node(instance in=reference to "Temperature_indicator", "Visible"=w15)
        # EVENT DLA
        # CONTROL OLD
        # INDICATOR NEW
        Property Node(instance in=reference to "4WResistance_control", "Visible"=w15)
        Property Node(instance in=reference to "4WResistance_indicator", "Visible"=w16)
        Property Node(instance in=reference to "VoltageAC_control", "Visible"=w16, "Value"=FALSE)
        Property Node(instance in=reference to "CurrentDC_control", "Visible"=w16, "Value"=FALSE)
        Property Node(instance in=reference to "CurrentAC_control", "Visible"=w16, "Value"=FALSE)
        Property Node(instance in=reference to "2WResistance_control", "Visible"=w16, "Value"=FALSE)
        Property Node(instance in=reference to "VoltageDC_control", "Visible"=w16, "Value"=FALSE)
        Property Node(instance in=reference to "Frequency_control", "Visible"=w16, "Value"=FALSE)
        Property Node(instance in=reference to "Capacitance_control", "Visible"=w16, "Value"=FALSE)
        Property Node(instance in=reference to "Continuity_control", "Visible"=w16, "Value"=FALSE)
        Property Node(instance in=reference to "Diode_control", "Visible"=w16, "Value"=FALSE)
        Property Node(instance in=reference to "Temperature_control", "Visible"=w16, "Value"=FALSE)
        w1 = default
      }
      on "Frequency_control" Value changed {
        # TITLES VISIBILITY
        Property Node(instance in=reference to unnamed text, "Visible"=FALSE)
        Property Node(instance in=reference to unnamed text, "Visible"=FALSE)
        Property Node(instance in=reference to unnamed text, "Visible"=FALSE)
        Property Node(instance in=reference to unnamed text, "Visible"=FALSE)
        # DCV VISIBILITY
        Property Node(instance in=reference to "DIG Option On/Off_DCV", "Visible"=FALSE)
        # DCVRATIO VISIBILITY
        Property Node(instance in=reference to "DIG Option On/Off_DCVR", "Visible"=FALSE)
        # DCC VISIBILITY
        Property Node(instance in=reference to "TerminalType_DCC", "Visible"=FALSE)
        # ACV VISIBILITY
        Property Node(instance in=reference to "ManualRange_ACV", "Visible"=FALSE)
        # 4WR VISIBILITY
        Property Node(instance in=reference to "ApertureNPLC_4WR", "Visible"=FALSE)
        Property Node(instance in=reference to unnamed text, "Visible"=FALSE)
        Property Node(instance in=reference to "Auto Impedance_DCV", "Visible"=FALSE)
        Property Node(instance in=reference to "Auto Impedance_DCVR", "Visible"=FALSE)
        # 2WR VISIBILITY
        Property Node(instance in=reference to "ApertureNPLC_2WR", "Visible"=FALSE)
        # ACC VISIBILITY
        Property Node(instance in=reference to "TerminalType_ACC", "Visible"=FALSE)
        Property Node(instance in=reference to "AutoRange_DCC", "Visible"=FALSE)
        Property Node(instance in=reference to "ACFilter_ACV", "Visible"=FALSE)
        # CAPACI VISIBILITY
        Property Node(instance in=reference to "ManualRange_Capaci", "Visible"=FALSE)
        Property Node(instance in=reference to "ApertureTime_4WR", "Visible"=FALSE)
        Property Node(instance in=reference to "ManualRange_DCV", "Visible"=FALSE, "Disabled"=TRUE)
        Property Node(instance in=reference to "ManualRange_DCVR", "Visible"=FALSE)
        Property Node(instance in=reference to "ApertureTime_2WR", "Visible"=FALSE)
        Property Node(instance in=reference to "ACFilter_ACC", "Visible"=FALSE)
        Property Node(instance in=reference to "ManualRange_DCC", "Visible"=FALSE)
        Property Node(instance in=reference to "AutoRange_Capaci", "Visible"=FALSE)
        Property Node(instance in=reference to "String_ACV", "Visible"=FALSE)
        Property Node(instance in=reference to "Aperture_4WR", "Visible"=FALSE)
        Property Node(instance in=reference to "ApertureNPLC_DCV", "Visible"=FALSE)
        Property Node(instance in=reference to "ApertureNPLC_DCVR", "Visible"=FALSE)
        Property Node(instance in=reference to "Aperture_2WR", "Visible"=FALSE)
        Property Node(instance in=reference to unnamed text, "Visible"=FALSE)
        Property Node(instance in=reference to "ManualRange_ACC", "Visible"=FALSE)
        Property Node(instance in=reference to "Aperture_DCC", "Visible"=FALSE)
        Property Node(instance in=reference to "String_Capaci", "Visible"=FALSE)
        Property Node(instance in=reference to "AutoRange_4WR", "Visible"=FALSE)
        Property Node(instance in=reference to "Aperture_DCV", "Visible"=FALSE)
        Property Node(instance in=reference to "Aperture_DCVR", "Visible"=FALSE)
        Property Node(instance in=reference to "AutoRange_2WR", "Visible"=FALSE)
        Property Node(instance in=reference to "AutoRange_ACV", "Visible"=FALSE)
        # FREQ VISIBILITY
        Property Node(instance in=reference to "ACFilter_Freq", "Visible"=TRUE)
        Property Node(instance in=reference to unnamed text, "Visible"=FALSE)
        Property Node(instance in=reference to "AutoRange_ACC", "Visible"=FALSE)
        Property Node(instance in=reference to "ApertureNPLC_DCC", "Visible"=FALSE)
        Property Node(instance in=reference to "LowPower_4WR", "Visible"=FALSE)
        Property Node(instance in=reference to "AutoRange_DCV", "Visible"=FALSE)
        Property Node(instance in=reference to "AutoRange_DCVR", "Visible"=FALSE)
        Property Node(instance in=reference to "AutoZero_2WR", "Visible"=FALSE)
        Property Node(instance in=reference to "AutoRange_Freq", "Visible"=TRUE)
        Property Node(instance in=reference to unnamed text, "Visible"=FALSE)
        Property Node(instance in=reference to "String_ACC", "Visible"=FALSE)
        Property Node(instance in=reference to "ApertureTime_DCC", "Visible"=FALSE)
        Property Node(instance in=reference to "ManualRange_4WR", "Visible"=FALSE)
        Property Node(instance in=reference to "DCV Ratio_toenable", "Visible"=FALSE, "Value"=FALSE)
        Property Node(instance in=reference to "DCV Ratio_todisable", "Visible"=FALSE, "Value"=FALSE)
        Property Node(instance in=reference to "LowPower_2WR", "Visible"=FALSE)
        Property Node(instance in=reference to "GateTime_Freq", "Visible"=TRUE)
        Property Node(instance in=reference to unnamed text, "Visible"=FALSE)
        Property Node(instance in=reference to "AutoZero_DCC", "Visible"=FALSE)
        Property Node(instance in=reference to "OffstComp_4WR", "Visible"=FALSE)
        Property Node(instance in=reference to "ApertureTime_DCV", "Visible"=FALSE)
        Property Node(instance in=reference to "ApertureTime_DCVR", "Visible"=FALSE)
        Property Node(instance in=reference to "ManualRange_2WR", "Visible"=FALSE)
        Property Node(instance in=reference to "ManualRange_Freq", "Visible"=TRUE)
        Property Node(instance in=reference to unnamed text, "Visible"=TRUE)
        Property Node(instance in=reference to "String_4WR", "Visible"=FALSE)
        Property Node(instance in=reference to "String_DCV", "Visible"=FALSE)
        Property Node(instance in=reference to "String_DCVR", "Visible"=FALSE)
        Property Node(instance in=reference to "String_DCC", "Visible"=FALSE)
        Property Node(instance in=reference to "OffstComp_2WR", "Visible"=FALSE)
        Property Node(instance in=reference to "Timeout_Freq", "Visible"=TRUE)
        Property Node(instance in=reference to unnamed text, "Visible"=FALSE)
        Property Node(instance in=reference to "AutoZero_DCV", "Visible"=FALSE)
        Property Node(instance in=reference to "String_2WR", "Visible"=FALSE)
        Property Node(instance in=reference to "String_Freq", "Visible"=TRUE)
        Property Node(instance in=reference to unnamed text, "Visible"=FALSE)
        Property Node(instance in=reference to "Period_toenable", "Visible"=TRUE)
        # TEMPTCOUPLE VISIBILITY
        Property Node(instance in=reference to "Aperture_TempTCouple", "Visible"=FALSE)
        Property Node(instance in=reference to unnamed text, "Visible"=FALSE)
        # CONT VISIBILITY
        Property Node(instance in=reference to "Beeper_Cont", "Visible"=FALSE)
        # DIODE VISIBILITY
        Property Node(instance in=reference to "Beeper_Diode", "Visible"=FALSE)
        # TEMPRTD2W VISIBILITY
        Property Node(instance in=reference to "AutoZero_TempRTD2w", "Visible"=FALSE)
        # TEMPRTD4W VISIBILITY
        Property Node(instance in=reference to "LowPower_TempRTD4w", "Visible"=FALSE)
        # TEMPMAIN VISIBILITY
        Property Node(instance in=reference to "Probe_TempMain", "Visible"=FALSE, "Value"=1)
        Property Node(instance in=reference to "ApertureNPLC_TempTCouple", "Visible"=FALSE)
        Property Node(instance in=reference to unnamed text, "Visible"=FALSE)
        Property Node(instance in=reference to "String_Cont", "Visible"=FALSE)
        Property Node(instance in=reference to "String_Diode", "Visible"=FALSE)
        # TEMPTHERMIS4W VISIBILITY
        Property Node(instance in=reference to "ApertureNPLC_TempThermis4w", "Visible"=FALSE)
        Property Node(instance in=reference to "LowPower_TempRTD2w", "Visible"=FALSE)
        Property Node(instance in=reference to "OffstComp_TempRTD4w", "Visible"=FALSE)
        # TEMPTHERMIS2W VISIBILITY
        Property Node(instance in=reference to "ApertureNPLC_TempThermis2w", "Visible"=FALSE)
        Property Node(instance in=reference to "ApertureTime_TempTCouple", "Visible"=FALSE)
        Property Node(instance in=reference to "ApertureTime_TempThermis4w", "Visible"=FALSE)
        Property Node(instance in=reference to "OffstComp_TempRTD2w", "Visible"=FALSE)
        Property Node(instance in=reference to "ApertureTime_TempThermis2w", "Visible"=FALSE)
        Property Node(instance in=reference to "R0_TempRTD4w", "Visible"=FALSE)
        # PERIOD VISIBILITY
        Property Node(instance in=reference to "ACFilter_Period", "Visible"=FALSE)
        Property Node(instance in=reference to "FixedOffset_TempTCouple", "Visible"=FALSE)
        Property Node(instance in=reference to "Aperture_TempThermis4w", "Visible"=FALSE)
        Property Node(instance in=reference to "Aperture_TempThermis2w", "Visible"=FALSE)
        Property Node(instance in=reference to "R0_TempRTD2w", "Visible"=FALSE)
        Property Node(instance in=reference to "ApertureNPLC_TempRTD4w", "Visible"=FALSE)
        Property Node(instance in=reference to "AutoRange_Period", "Visible"=FALSE)
        Property Node(instance in=reference to "OffsetAdjust_TempTCouple", "Visible"=FALSE)
        Property Node(instance in=reference to "LowPower_TempThermis4w", "Visible"=FALSE)
        Property Node(instance in=reference to "AutoZero_TempThermis2w", "Visible"=FALSE)
        Property Node(instance in=reference to "ApertureNPLC_TempRTD2w", "Visible"=FALSE)
        Property Node(instance in=reference to "ApertureTime_TempRTD4w", "Visible"=FALSE)
        Property Node(instance in=reference to "GateTime_Period", "Visible"=FALSE)
        Property Node(instance in=reference to "OpenCheck_TempTCouple", "Visible"=FALSE)
        Event Data() -> ("Old Value"=w17, "New Value"=w18)
        # EVENT NIE DLA
        # CONTROL NEW VALUE F
        # INDICATOR OLD
        Property Node(instance in=reference to "VoltageAC_indicator", "Visible"=w17)
        Property Node(instance in=reference to "Units_TempThermis4w", "Visible"=FALSE)
        Property Node(instance in=reference to "LowPower_TempThermis2w", "Visible"=FALSE)
        Property Node(instance in=reference to "ApertureTime_TempRTD2w", "Visible"=FALSE)
        Property Node(instance in=reference to "Aperture_TempRTD4w", "Visible"=FALSE)
        Property Node(instance in=reference to "ManualRange_Period", "Visible"=FALSE)
        Property Node(instance in=reference to "AutoZero_TempTCouple", "Visible"=FALSE)
        Property Node(instance in=reference to "String_TempThermis4w", "Visible"=FALSE)
        Property Node(instance in=reference to "Units_TempThermis2w", "Visible"=FALSE)
        Property Node(instance in=reference to "Aperture_TempRTD2w", "Visible"=FALSE)
        Property Node(instance in=reference to "CurrentDC_indicator", "Visible"=w17)
        Property Node(instance in=reference to "Units_TempRTD4w", "Visible"=FALSE)
        Property Node(instance in=reference to "Timeout_Period", "Visible"=FALSE)
        Property Node(instance in=reference to "Reference_TempTCouple", "Visible"=FALSE)
        Property Node(instance in=reference to "String_TempThermis2w", "Visible"=FALSE)
        Property Node(instance in=reference to "Units_TempRTD2w", "Visible"=FALSE)
        Property Node(instance in=reference to "String_TempRTD4w", "Visible"=FALSE)
        Property Node(instance in=reference to "CurrentAC_indicator", "Visible"=w17)
        Property Node(instance in=reference to "String_Period", "Visible"=FALSE)
        Property Node(instance in=reference to "Type_TempTCouple", "Visible"=FALSE)
        Property Node(instance in=reference to "String_TempRTD2w", "Visible"=FALSE)
        Property Node(instance in=reference to "Period_todisable", "Visible"=FALSE)
        Property Node(instance in=reference to "2WResistance_indicator", "Visible"=w17)
        Property Node(instance in=reference to "Units_TempTCouple", "Visible"=FALSE)
        Property Node(instance in=reference to "String_TempTCouple", "Visible"=FALSE)
        Property Node(instance in=reference to "4WResistance_indicator", "Visible"=w17)
        Property Node(instance in=reference to "VoltageDC_indicator", "Visible"=w17)
        Property Node(instance in=reference to "Capacitance_indicator", "Visible"=w17)
        Property Node(instance in=reference to "Continuity_indicator", "Visible"=w17)
        Property Node(instance in=reference to "Diode_indicator", "Visible"=w17)
        Property Node(instance in=reference to "Temperature_indicator", "Visible"=w17)
        # EVENT DLA
        # CONTROL OLD
        # INDICATOR NEW
        Property Node(instance in=reference to "Frequency_control", "Visible"=w17)
        Property Node(instance in=reference to "Frequency_indicator", "Visible"=w18)
        Property Node(instance in=reference to "VoltageAC_control", "Visible"=w18, "Value"=FALSE)
        Property Node(instance in=reference to "CurrentDC_control", "Visible"=w18, "Value"=FALSE)
        Property Node(instance in=reference to "CurrentAC_control", "Visible"=w18, "Value"=FALSE)
        Property Node(instance in=reference to "2WResistance_control", "Visible"=w18, "Value"=FALSE)
        Property Node(instance in=reference to "4WResistance_control", "Visible"=w18, "Value"=FALSE)
        Property Node(instance in=reference to "VoltageDC_control", "Visible"=w18, "Value"=FALSE)
        Property Node(instance in=reference to "Capacitance_control", "Visible"=w18, "Value"=FALSE)
        Property Node(instance in=reference to "Continuity_control", "Visible"=w18, "Value"=FALSE)
        Property Node(instance in=reference to "Diode_control", "Visible"=w18, "Value"=FALSE)
        Property Node(instance in=reference to "Temperature_control", "Visible"=w18, "Value"=FALSE)
        w1 = default
      }
      on "Period_toenable" Value changed {
        Property Node(instance in=reference to unnamed text, "Visible"=TRUE)
        Property Node(instance in=reference to unnamed text, "Visible"=FALSE)
        # FREQ VISIBILITY
        Property Node(instance in=reference to "ACFilter_Freq", "Visible"=FALSE)
        Property Node(instance in=reference to "AutoRange_Freq", "Visible"=FALSE)
        Property Node(instance in=reference to "GateTime_Freq", "Visible"=FALSE)
        Property Node(instance in=reference to "ManualRange_Freq", "Visible"=FALSE)
        Property Node(instance in=reference to "Timeout_Freq", "Visible"=FALSE)
        Property Node(instance in=reference to "String_Freq", "Visible"=FALSE)
        Property Node(instance in=reference to "Period_toenable", "Visible"=FALSE)
        Event Data() -> ("New Value"=w19)
        Property Node(instance in=reference to "Period_todisable", "Visible"=w19, "Value"=w19)
        # PERIOD VISIBILITY
        Property Node(instance in=reference to "ACFilter_Period", "Visible"=TRUE)
        Property Node(instance in=reference to "AutoRange_Period", "Visible"=TRUE)
        Property Node(instance in=reference to "GateTime_Period", "Visible"=TRUE)
        Property Node(instance in=reference to "ManualRange_Period", "Visible"=TRUE)
        Property Node(instance in=reference to "Timeout_Period", "Visible"=TRUE)
        Property Node(instance in=reference to "String_Period", "Visible"=TRUE)
        w1 = default
      }
      on "Period_todisable" Value changed {
        Property Node(instance in=reference to unnamed text, "Visible"=FALSE)
        Property Node(instance in=reference to unnamed text, "Visible"=TRUE)
        # FREQ VISIBILITY
        Property Node(instance in=reference to "ACFilter_Freq", "Visible"=TRUE)
        Property Node(instance in=reference to "AutoRange_Freq", "Visible"=TRUE)
        Property Node(instance in=reference to "GateTime_Freq", "Visible"=TRUE)
        Property Node(instance in=reference to "ManualRange_Freq", "Visible"=TRUE)
        Property Node(instance in=reference to "Timeout_Freq", "Visible"=TRUE)
        Property Node(instance in=reference to "String_Freq", "Visible"=TRUE)
        # PERIOD VISIBILITY
        Property Node(instance in=reference to "ACFilter_Period", "Visible"=FALSE)
        Property Node(instance in=reference to "AutoRange_Period", "Visible"=FALSE)
        Property Node(instance in=reference to "GateTime_Period", "Visible"=FALSE)
        Property Node(instance in=reference to "ManualRange_Period", "Visible"=FALSE)
        Property Node(instance in=reference to "Timeout_Period", "Visible"=FALSE)
        Event Data() -> ("New Value"=w20)
        Property Node(instance in=reference to "Period_toenable", "Visible"=TRUE, "Value"=w20)
        Property Node(instance in=reference to "String_Period", "Visible"=FALSE)
        Property Node(instance in=reference to "Period_todisable", "Visible"=FALSE)
        w1 = default
      }
      on "Capacitance_control" Value changed {
        # TITLES VISIBILITY
        Property Node(instance in=reference to unnamed text, "Visible"=FALSE)
        Property Node(instance in=reference to unnamed text, "Visible"=FALSE)
        Property Node(instance in=reference to unnamed text, "Visible"=FALSE)
        Property Node(instance in=reference to unnamed text, "Visible"=FALSE)
        # DCV VISIBILITY
        Property Node(instance in=reference to "DIG Option On/Off_DCV", "Visible"=FALSE)
        # DCVRATIO VISIBILITY
        Property Node(instance in=reference to "DIG Option On/Off_DCVR", "Visible"=FALSE)
        # DCC VISIBILITY
        Property Node(instance in=reference to "TerminalType_DCC", "Visible"=FALSE)
        # ACV VISIBILITY
        Property Node(instance in=reference to "ManualRange_ACV", "Visible"=FALSE)
        Property Node(instance in=reference to "Auto Impedance_DCV", "Visible"=FALSE)
        Property Node(instance in=reference to "Auto Impedance_DCVR", "Visible"=FALSE)
        # 4WR VISIBILITY
        Property Node(instance in=reference to "ApertureNPLC_4WR", "Visible"=FALSE)
        # 2WR VISIBILITY
        Property Node(instance in=reference to "ApertureNPLC_2WR", "Visible"=FALSE)
        # ACC VISIBILITY
        Property Node(instance in=reference to "TerminalType_ACC", "Visible"=FALSE)
        Property Node(instance in=reference to "AutoRange_DCC", "Visible"=FALSE)
        # CAPACI VISIBILITY
        Property Node(instance in=reference to "ManualRange_Capaci", "Visible"=TRUE)
        Property Node(instance in=reference to "ACFilter_ACV", "Visible"=FALSE)
        Property Node(instance in=reference to "ManualRange_DCV", "Visible"=FALSE, "Disabled"=TRUE)
        Property Node(instance in=reference to "ManualRange_DCVR", "Visible"=FALSE)
        Property Node(instance in=reference to "ApertureTime_4WR", "Visible"=FALSE)
        Property Node(instance in=reference to "ApertureTime_2WR", "Visible"=FALSE)
        Property Node(instance in=reference to "ACFilter_ACC", "Visible"=FALSE)
        Property Node(instance in=reference to "ManualRange_DCC", "Visible"=FALSE)
        Property Node(instance in=reference to "AutoRange_Capaci", "Visible"=TRUE)
        Property Node(instance in=reference to "String_ACV", "Visible"=FALSE)
        Property Node(instance in=reference to unnamed text, "Visible"=FALSE)
        Property Node(instance in=reference to "ApertureNPLC_DCV", "Visible"=FALSE)
        Property Node(instance in=reference to "ApertureNPLC_DCVR", "Visible"=FALSE)
        Property Node(instance in=reference to "Aperture_4WR", "Visible"=FALSE)
        Property Node(instance in=reference to "Aperture_2WR", "Visible"=FALSE)
        Property Node(instance in=reference to "ManualRange_ACC", "Visible"=FALSE)
        Property Node(instance in=reference to "Aperture_DCC", "Visible"=FALSE)
        # FREQ VISIBILITY
        Property Node(instance in=reference to "ACFilter_Freq", "Visible"=FALSE)
        Property Node(instance in=reference to "String_Capaci", "Visible"=TRUE)
        Property Node(instance in=reference to "Aperture_DCV", "Visible"=FALSE)
        Property Node(instance in=reference to "Aperture_DCVR", "Visible"=FALSE)
        Property Node(instance in=reference to "AutoRange_ACV", "Visible"=FALSE)
        Property Node(instance in=reference to "AutoRange_4WR", "Visible"=FALSE)
        Property Node(instance in=reference to "AutoRange_2WR", "Visible"=FALSE)
        Property Node(instance in=reference to "AutoRange_ACC", "Visible"=FALSE)
        Property Node(instance in=reference to "ApertureNPLC_DCC", "Visible"=FALSE)
        Property Node(instance in=reference to "AutoRange_Freq", "Visible"=FALSE)
        Property Node(instance in=reference to "AutoRange_DCV", "Visible"=FALSE)
        Property Node(instance in=reference to "AutoRange_DCVR", "Visible"=FALSE)
        Property Node(instance in=reference to "LowPower_4WR", "Visible"=FALSE)
        Property Node(instance in=reference to "AutoZero_2WR", "Visible"=FALSE)
        Property Node(instance in=reference to unnamed text, "Visible"=FALSE)
        Property Node(instance in=reference to "String_ACC", "Visible"=FALSE)
        Property Node(instance in=reference to "ApertureTime_DCC", "Visible"=FALSE)
        Property Node(instance in=reference to "GateTime_Freq", "Visible"=FALSE)
        Property Node(instance in=reference to "DCV Ratio_toenable", "Visible"=FALSE, "Value"=FALSE)
        Property Node(instance in=reference to "DCV Ratio_todisable", "Visible"=FALSE, "Value"=FALSE)
        Property Node(instance in=reference to "ManualRange_4WR", "Visible"=FALSE)
        Property Node(instance in=reference to "LowPower_2WR", "Visible"=FALSE)
        Property Node(instance in=reference to unnamed text, "Visible"=FALSE)
        Property Node(instance in=reference to "AutoZero_DCC", "Visible"=FALSE)
        Property Node(instance in=reference to "ManualRange_Freq", "Visible"=FALSE)
        Property Node(instance in=reference to "ApertureTime_DCV", "Visible"=FALSE)
        Property Node(instance in=reference to "ApertureTime_DCVR", "Visible"=FALSE)
        Property Node(instance in=reference to "OffstComp_4WR", "Visible"=FALSE)
        Property Node(instance in=reference to "ManualRange_2WR", "Visible"=FALSE)
        Property Node(instance in=reference to unnamed text, "Visible"=FALSE)
        Property Node(instance in=reference to "Timeout_Freq", "Visible"=FALSE)
        Property Node(instance in=reference to "String_DCC", "Visible"=FALSE)
        Property Node(instance in=reference to "String_DCV", "Visible"=FALSE)
        Property Node(instance in=reference to "String_DCVR", "Visible"=FALSE)
        Property Node(instance in=reference to "String_4WR", "Visible"=FALSE)
        Property Node(instance in=reference to "OffstComp_2WR", "Visible"=FALSE)
        Property Node(instance in=reference to unnamed text, "Visible"=FALSE)
        Property Node(instance in=reference to "String_Freq", "Visible"=FALSE)
        Property Node(instance in=reference to "AutoZero_DCV", "Visible"=FALSE)
        Property Node(instance in=reference to "String_2WR", "Visible"=FALSE)
        Property Node(instance in=reference to unnamed text, "Visible"=FALSE)
        Property Node(instance in=reference to "Period_toenable", "Visible"=FALSE)
        Property Node(instance in=reference to unnamed text, "Visible"=TRUE)
        # TEMPTCOUPLE VISIBILITY
        Property Node(instance in=reference to "Aperture_TempTCouple", "Visible"=FALSE)
        # CONT VISIBILITY
        Property Node(instance in=reference to "Beeper_Cont", "Visible"=FALSE)
        # DIODE VISIBILITY
        Property Node(instance in=reference to "Beeper_Diode", "Visible"=FALSE)
        # TEMPRTD2W VISIBILITY
        Property Node(instance in=reference to "AutoZero_TempRTD2w", "Visible"=FALSE)
        # TEMPMAIN VISIBILITY
        Property Node(instance in=reference to "Probe_TempMain", "Visible"=FALSE, "Value"=1)
        # TEMPRTD4W VISIBILITY
        Property Node(instance in=reference to "LowPower_TempRTD4w", "Visible"=FALSE)
        Property Node(instance in=reference to unnamed text, "Visible"=FALSE)
        Property Node(instance in=reference to "ApertureNPLC_TempTCouple", "Visible"=FALSE)
        Property Node(instance in=reference to "String_Cont", "Visible"=FALSE)
        Property Node(instance in=reference to "String_Diode", "Visible"=FALSE)
        # TEMPTHERMIS4W VISIBILITY
        Property Node(instance in=reference to "ApertureNPLC_TempThermis4w", "Visible"=FALSE)
        # TEMPTHERMIS2W VISIBILITY
        Property Node(instance in=reference to "ApertureNPLC_TempThermis2w", "Visible"=FALSE)
        Property Node(instance in=reference to "LowPower_TempRTD2w", "Visible"=FALSE)
        Property Node(instance in=reference to "OffstComp_TempRTD4w", "Visible"=FALSE)
        Property Node(instance in=reference to unnamed text, "Visible"=FALSE)
        Property Node(instance in=reference to "ApertureTime_TempTCouple", "Visible"=FALSE)
        # PERIOD VISIBILITY
        Property Node(instance in=reference to "ACFilter_Period", "Visible"=FALSE)
        Property Node(instance in=reference to "ApertureTime_TempThermis4w", "Visible"=FALSE)
        Property Node(instance in=reference to "ApertureTime_TempThermis2w", "Visible"=FALSE)
        Property Node(instance in=reference to "OffstComp_TempRTD2w", "Visible"=FALSE)
        Property Node(instance in=reference to "R0_TempRTD4w", "Visible"=FALSE)
        Property Node(instance in=reference to unnamed text, "Visible"=FALSE)
        Property Node(instance in=reference to "FixedOffset_TempTCouple", "Visible"=FALSE)
        Property Node(instance in=reference to "AutoRange_Period", "Visible"=FALSE)
        Property Node(instance in=reference to "Aperture_TempThermis4w", "Visible"=FALSE)
        Property Node(instance in=reference to "Aperture_TempThermis2w", "Visible"=FALSE)
        Property Node(instance in=reference to "R0_TempRTD2w", "Visible"=FALSE)
        Property Node(instance in=reference to "ApertureNPLC_TempRTD4w", "Visible"=FALSE)
        Property Node(instance in=reference to "OffsetAdjust_TempTCouple", "Visible"=FALSE)
        Property Node(instance in=reference to "GateTime_Period", "Visible"=FALSE)
        Property Node(instance in=reference to "LowPower_TempThermis4w", "Visible"=FALSE)
        Property Node(instance in=reference to "AutoZero_TempThermis2w", "Visible"=FALSE)
        Property Node(instance in=reference to "ApertureNPLC_TempRTD2w", "Visible"=FALSE)
        Property Node(instance in=reference to "ApertureTime_TempRTD4w", "Visible"=FALSE)
        Property Node(instance in=reference to "OpenCheck_TempTCouple", "Visible"=FALSE)
        Property Node(instance in=reference to "ManualRange_Period", "Visible"=FALSE)
        Event Data() -> ("Old Value"=w21, "New Value"=w22)
        # EVENT NIE DLA
        # CONTROL NEW VALUE F
        # INDICATOR OLD
        Property Node(instance in=reference to "VoltageAC_indicator", "Visible"=w21)
        Property Node(instance in=reference to "Units_TempThermis4w", "Visible"=FALSE)
        Property Node(instance in=reference to "LowPower_TempThermis2w", "Visible"=FALSE)
        Property Node(instance in=reference to "ApertureTime_TempRTD2w", "Visible"=FALSE)
        Property Node(instance in=reference to "Aperture_TempRTD4w", "Visible"=FALSE)
        Property Node(instance in=reference to "AutoZero_TempTCouple", "Visible"=FALSE)
        Property Node(instance in=reference to "Timeout_Period", "Visible"=FALSE)
        Property Node(instance in=reference to "CurrentDC_indicator", "Visible"=w21)
        Property Node(instance in=reference to "String_TempThermis4w", "Visible"=FALSE)
        Property Node(instance in=reference to "Units_TempThermis2w", "Visible"=FALSE)
        Property Node(instance in=reference to "Aperture_TempRTD2w", "Visible"=FALSE)
        Property Node(instance in=reference to "Units_TempRTD4w", "Visible"=FALSE)
        Property Node(instance in=reference to "Reference_TempTCouple", "Visible"=FALSE)
        Property Node(instance in=reference to "String_Period", "Visible"=FALSE)
        Property Node(instance in=reference to "String_TempThermis2w", "Visible"=FALSE)
        Property Node(instance in=reference to "CurrentAC_indicator", "Visible"=w21)
        Property Node(instance in=reference to "Units_TempRTD2w", "Visible"=FALSE)
        Property Node(instance in=reference to "String_TempRTD4w", "Visible"=FALSE)
        Property Node(instance in=reference to "Type_TempTCouple", "Visible"=FALSE)
        Property Node(instance in=reference to "Period_todisable", "Visible"=FALSE)
        Property Node(instance in=reference to "2WResistance_indicator", "Visible"=w21)
        Property Node(instance in=reference to "String_TempRTD2w", "Visible"=FALSE)
        Property Node(instance in=reference to "Units_TempTCouple", "Visible"=FALSE)
        Property Node(instance in=reference to "String_TempTCouple", "Visible"=FALSE)
        Property Node(instance in=reference to "4WResistance_indicator", "Visible"=w21)
        Property Node(instance in=reference to "Frequency_indicator", "Visible"=w21)
        Property Node(instance in=reference to "VoltageDC_indicator", "Visible"=w21)
        Property Node(instance in=reference to "Continuity_indicator", "Visible"=w21)
        Property Node(instance in=reference to "Diode_indicator", "Visible"=w21)
        Property Node(instance in=reference to "Temperature_indicator", "Visible"=w21)
        # EVENT DLA
        # CONTROL OLD
        # INDICATOR NEW
        Property Node(instance in=reference to "Capacitance_control", "Visible"=w21)
        Property Node(instance in=reference to "Capacitance_indicator", "Visible"=w22)
        Property Node(instance in=reference to "VoltageAC_control", "Visible"=w22, "Value"=FALSE)
        Property Node(instance in=reference to "CurrentDC_control", "Visible"=w22, "Value"=FALSE)
        Property Node(instance in=reference to "CurrentAC_control", "Visible"=w22, "Value"=FALSE)
        Property Node(instance in=reference to "2WResistance_control", "Visible"=w22, "Value"=FALSE)
        Property Node(instance in=reference to "4WResistance_control", "Visible"=w22, "Value"=FALSE)
        Property Node(instance in=reference to "Frequency_control", "Visible"=w22, "Value"=FALSE)
        Property Node(instance in=reference to "VoltageDC_control", "Visible"=w22, "Value"=FALSE)
        Property Node(instance in=reference to "Continuity_control", "Visible"=w22, "Value"=FALSE)
        Property Node(instance in=reference to "Diode_control", "Visible"=w22, "Value"=FALSE)
        Property Node(instance in=reference to "Temperature_control", "Visible"=w22, "Value"=FALSE)
        w1 = default
      }
      on "Continuity_control" Value changed {
        # TITLES VISIBILITY
        Property Node(instance in=reference to unnamed text, "Visible"=FALSE)
        Property Node(instance in=reference to unnamed text, "Visible"=FALSE)
        # DCC VISIBILITY
        Property Node(instance in=reference to "TerminalType_DCC", "Visible"=FALSE)
        # ACV VISIBILITY
        Property Node(instance in=reference to "ManualRange_ACV", "Visible"=FALSE)
        Property Node(instance in=reference to unnamed text, "Visible"=FALSE)
        # DCV VISIBILITY
        Property Node(instance in=reference to "DIG Option On/Off_DCV", "Visible"=FALSE)
        # DCVRATIO VISIBILITY
        Property Node(instance in=reference to "DIG Option On/Off_DCVR", "Visible"=FALSE)
        # ACC VISIBILITY
        Property Node(instance in=reference to "TerminalType_ACC", "Visible"=FALSE)
        Property Node(instance in=reference to "AutoRange_DCC", "Visible"=FALSE)
        # 2WR VISIBILITY
        # TEMPRTD2W VISIBILITY
        Property Node(instance in=reference to "ApertureNPLC_2WR", "Visible"=FALSE)
        # 4WR VISIBILITY
        Property Node(instance in=reference to "ApertureNPLC_4WR", "Visible"=FALSE)
        # FREQ VISIBILITY
        Property Node(instance in=reference to "ACFilter_Freq", "Visible"=FALSE)
        Property Node(instance in=reference to "ACFilter_ACV", "Visible"=FALSE)
        Property Node(instance in=reference to unnamed text, "Visible"=FALSE)
        Property Node(instance in=reference to "Auto Impedance_DCV", "Visible"=FALSE)
        Property Node(instance in=reference to "Auto Impedance_DCVR", "Visible"=FALSE)
        # CAPACI VISIBILITY
        Property Node(instance in=reference to "ManualRange_Capaci", "Visible"=FALSE)
        Property Node(instance in=reference to "ACFilter_ACC", "Visible"=FALSE)
        Property Node(instance in=reference to "ManualRange_DCC", "Visible"=FALSE)
        Property Node(instance in=reference to "ApertureTime_2WR", "Visible"=FALSE)
        Property Node(instance in=reference to "ApertureTime_4WR", "Visible"=FALSE)
        Property Node(instance in=reference to "AutoRange_Freq", "Visible"=FALSE)
        Property Node(instance in=reference to "ManualRange_DCV", "Visible"=FALSE, "Disabled"=TRUE)
        Property Node(instance in=reference to "ManualRange_DCVR", "Visible"=FALSE)
        Property Node(instance in=reference to "String_ACV", "Visible"=FALSE)
        Property Node(instance in=reference to "AutoRange_Capaci", "Visible"=FALSE)
        Property Node(instance in=reference to "ManualRange_ACC", "Visible"=FALSE)
        Property Node(instance in=reference to "Aperture_DCC", "Visible"=FALSE)
        Property Node(instance in=reference to "Aperture_2WR", "Visible"=FALSE)
        Property Node(instance in=reference to "Aperture_4WR", "Visible"=FALSE)
        Property Node(instance in=reference to "GateTime_Freq", "Visible"=FALSE)
        Property Node(instance in=reference to "ApertureNPLC_DCV", "Visible"=FALSE)
        Property Node(instance in=reference to "ApertureNPLC_DCVR", "Visible"=FALSE)
        Property Node(instance in=reference to "AutoRange_ACV", "Visible"=FALSE)
        Property Node(instance in=reference to "String_Capaci", "Visible"=FALSE)
        Property Node(instance in=reference to "AutoRange_ACC", "Visible"=FALSE)
        Property Node(instance in=reference to "ApertureNPLC_DCC", "Visible"=FALSE)
        Property Node(instance in=reference to "AutoRange_2WR", "Visible"=FALSE)
        Property Node(instance in=reference to "AutoRange_4WR", "Visible"=FALSE)
        Property Node(instance in=reference to "ManualRange_Freq", "Visible"=FALSE)
        Property Node(instance in=reference to "Aperture_DCV", "Visible"=FALSE)
        Property Node(instance in=reference to "Aperture_DCVR", "Visible"=FALSE)
        Property Node(instance in=reference to unnamed text, "Visible"=FALSE)
        Property Node(instance in=reference to "String_ACC", "Visible"=FALSE)
        Property Node(instance in=reference to "ApertureTime_DCC", "Visible"=FALSE)
        Property Node(instance in=reference to "AutoZero_2WR", "Visible"=FALSE)
        Property Node(instance in=reference to "LowPower_4WR", "Visible"=FALSE)
        Property Node(instance in=reference to "Timeout_Freq", "Visible"=FALSE)
        Property Node(instance in=reference to "AutoRange_DCV", "Visible"=FALSE)
        Property Node(instance in=reference to "AutoRange_DCVR", "Visible"=FALSE)
        Property Node(instance in=reference to "AutoZero_DCC", "Visible"=FALSE)
        Property Node(instance in=reference to "LowPower_2WR", "Visible"=FALSE)
        Property Node(instance in=reference to "ManualRange_4WR", "Visible"=FALSE)
        Property Node(instance in=reference to "String_Freq", "Visible"=FALSE)
        Property Node(instance in=reference to "DCV Ratio_toenable", "Visible"=FALSE, "Value"=FALSE)
        Property Node(instance in=reference to "DCV Ratio_todisable", "Visible"=FALSE, "Value"=FALSE)
        Property Node(instance in=reference to "ManualRange_2WR", "Visible"=FALSE)
        Property Node(instance in=reference to unnamed text, "Visible"=FALSE)
        Property Node(instance in=reference to "OffstComp_4WR", "Visible"=FALSE)
        Property Node(instance in=reference to "Period_toenable", "Visible"=FALSE)
        Property Node(instance in=reference to "ApertureTime_DCV", "Visible"=FALSE)
        Property Node(instance in=reference to "ApertureTime_DCVR", "Visible"=FALSE)
        Property Node(instance in=reference to "String_DCC", "Visible"=FALSE)
        Property Node(instance in=reference to "OffstComp_2WR", "Visible"=FALSE)
        Property Node(instance in=reference to unnamed text, "Visible"=FALSE)
        Property Node(instance in=reference to "String_4WR", "Visible"=FALSE)
        Property Node(instance in=reference to "String_DCV", "Visible"=FALSE)
        # CONT VISIBILITY
        Property Node(instance in=reference to "String_DCVR", "Visible"=FALSE)
        Property Node(instance in=reference to "String_2WR", "Visible"=FALSE)
        Property Node(instance in=reference to unnamed text, "Visible"=FALSE)
        Property Node(instance in=reference to "AutoZero_DCV", "Visible"=FALSE)
        # PERIOD VISIBILITY
        Property Node(instance in=reference to "ACFilter_Period", "Visible"=FALSE)
        Property Node(instance in=reference to unnamed text, "Visible"=FALSE)
        Property Node(instance in=reference to "Beeper_Cont", "Visible"=TRUE)
        # DIODE VISIBILITY
        Property Node(instance in=reference to "Beeper_Diode", "Visible"=FALSE)
        # TEMPTCOUPLE VISIBILITY
        Property Node(instance in=reference to "Aperture_TempTCouple", "Visible"=FALSE)
        Property Node(instance in=reference to "AutoRange_Period", "Visible"=FALSE)
        Property Node(instance in=reference to unnamed text, "Visible"=FALSE)
        Property Node(instance in=reference to "String_Cont", "Visible"=TRUE)
        Property Node(instance in=reference to "AutoZero_TempRTD2w", "Visible"=FALSE)
        Property Node(instance in=reference to "String_Diode", "Visible"=FALSE)
        # TEMPRTD4W VISIBILITY
        Property Node(instance in=reference to "LowPower_TempRTD4w", "Visible"=FALSE)
        # TEMPMAIN VISIBILITY
        Property Node(instance in=reference to "Probe_TempMain", "Visible"=FALSE, "Value"=1)
        # TEMPTHERMIS4W VISIBILITY
        Property Node(instance in=reference to "ApertureNPLC_TempThermis4w", "Visible"=FALSE)
        Property Node(instance in=reference to "ApertureNPLC_TempTCouple", "Visible"=FALSE)
        # TEMPTHERMIS2W VISIBILITY
        Property Node(instance in=reference to "ApertureNPLC_TempThermis2w", "Visible"=FALSE)
        Property Node(instance in=reference to "GateTime_Period", "Visible"=FALSE)
        Property Node(instance in=reference to unnamed text, "Visible"=FALSE)
        Property Node(instance in=reference to "LowPower_TempRTD2w", "Visible"=FALSE)
        Property Node(instance in=reference to "OffstComp_TempRTD4w", "Visible"=FALSE)
        Property Node(instance in=reference to "ApertureTime_TempThermis4w", "Visible"=FALSE)
        Property Node(instance in=reference to "ApertureTime_TempTCouple", "Visible"=FALSE)
        Property Node(instance in=reference to "ApertureTime_TempThermis2w", "Visible"=FALSE)
        Property Node(instance in=reference to "ManualRange_Period", "Visible"=FALSE)
        Property Node(instance in=reference to unnamed text, "Visible"=TRUE)
        Property Node(instance in=reference to "OffstComp_TempRTD2w", "Visible"=FALSE)
        Property Node(instance in=reference to "R0_TempRTD4w", "Visible"=FALSE)
        Property Node(instance in=reference to "Aperture_TempThermis4w", "Visible"=FALSE)
        Property Node(instance in=reference to "Aperture_TempThermis2w", "Visible"=FALSE)
        Property Node(instance in=reference to "FixedOffset_TempTCouple", "Visible"=FALSE)
        Property Node(instance in=reference to "Timeout_Period", "Visible"=FALSE)
        Property Node(instance in=reference to unnamed text, "Visible"=FALSE)
        Property Node(instance in=reference to "R0_TempRTD2w", "Visible"=FALSE)
        Property Node(instance in=reference to "ApertureNPLC_TempRTD4w", "Visible"=FALSE)
        Property Node(instance in=reference to "LowPower_TempThermis4w", "Visible"=FALSE)
        Property Node(instance in=reference to "AutoZero_TempThermis2w", "Visible"=FALSE)
        Property Node(instance in=reference to "OffsetAdjust_TempTCouple", "Visible"=FALSE)
        Property Node(instance in=reference to "String_Period", "Visible"=FALSE)
        Property Node(instance in=reference to unnamed text, "Visible"=FALSE)
        Event Data() -> ("Old Value"=w23, "New Value"=w24)
        # EVENT NIE DLA
        # CONTROL NEW VALUE F
        # INDICATOR OLD
        Property Node(instance in=reference to "VoltageAC_indicator", "Visible"=w23)
        Property Node(instance in=reference to "ApertureNPLC_TempRTD2w", "Visible"=FALSE)
        Property Node(instance in=reference to "ApertureTime_TempRTD4w", "Visible"=FALSE)
        Property Node(instance in=reference to "Units_TempThermis4w", "Visible"=FALSE)
        Property Node(instance in=reference to "LowPower_TempThermis2w", "Visible"=FALSE)
        Property Node(instance in=reference to "OpenCheck_TempTCouple", "Visible"=FALSE)
        Property Node(instance in=reference to "Period_todisable", "Visible"=FALSE)
        Property Node(instance in=reference to "ApertureTime_TempRTD2w", "Visible"=FALSE)
        Property Node(instance in=reference to "Aperture_TempRTD4w", "Visible"=FALSE)
        Property Node(instance in=reference to "CurrentDC_indicator", "Visible"=w23)
        Property Node(instance in=reference to "String_TempThermis4w", "Visible"=FALSE)
        Property Node(instance in=reference to "Units_TempThermis2w", "Visible"=FALSE)
        Property Node(instance in=reference to "AutoZero_TempTCouple", "Visible"=FALSE)
        Property Node(instance in=reference to "Aperture_TempRTD2w", "Visible"=FALSE)
        Property Node(instance in=reference to "Units_TempRTD4w", "Visible"=FALSE)
        Property Node(instance in=reference to "CurrentAC_indicator", "Visible"=w23)
        Property Node(instance in=reference to "Reference_TempTCouple", "Visible"=FALSE)
        Property Node(instance in=reference to "String_TempThermis2w", "Visible"=FALSE)
        Property Node(instance in=reference to "Units_TempRTD2w", "Visible"=FALSE)
        Property Node(instance in=reference to "String_TempRTD4w", "Visible"=FALSE)
        Property Node(instance in=reference to "2WResistance_indicator", "Visible"=w23)
        Property Node(instance in=reference to "Type_TempTCouple", "Visible"=FALSE)
        Property Node(instance in=reference to "String_TempRTD2w", "Visible"=FALSE)
        Property Node(instance in=reference to "Units_TempTCouple", "Visible"=FALSE)
        Property Node(instance in=reference to "4WResistance_indicator", "Visible"=w23)
        Property Node(instance in=reference to "String_TempTCouple", "Visible"=FALSE)
        Property Node(instance in=reference to "Frequency_indicator", "Visible"=w23)
        Property Node(instance in=reference to "Capacitance_indicator", "Visible"=w23)
        Property Node(instance in=reference to "VoltageDC_indicator", "Visible"=w23)
        Property Node(instance in=reference to "Diode_indicator", "Visible"=w23)
        Property Node(instance in=reference to "Temperature_indicator", "Visible"=w23)
        # EVENT DLA
        # CONTROL OLD
        # INDICATOR NEW
        Property Node(instance in=reference to "Continuity_control", "Visible"=w23)
        Property Node(instance in=reference to "Continuity_indicator", "Visible"=w24)
        Property Node(instance in=reference to "VoltageAC_control", "Visible"=w24, "Value"=FALSE)
        Property Node(instance in=reference to "CurrentDC_control", "Visible"=w24, "Value"=FALSE)
        Property Node(instance in=reference to "CurrentAC_control", "Visible"=w24, "Value"=FALSE)
        Property Node(instance in=reference to "2WResistance_control", "Visible"=w24, "Value"=FALSE)
        Property Node(instance in=reference to "4WResistance_control", "Visible"=w24, "Value"=FALSE)
        Property Node(instance in=reference to "Frequency_control", "Visible"=w24, "Value"=FALSE)
        Property Node(instance in=reference to "Capacitance_control", "Visible"=w24, "Value"=FALSE)
        Property Node(instance in=reference to "VoltageDC_control", "Visible"=w24, "Value"=FALSE)
        Property Node(instance in=reference to "Diode_control", "Visible"=w24, "Value"=FALSE)
        Property Node(instance in=reference to "Temperature_control", "Visible"=w24, "Value"=FALSE)
        w1 = default
      }
      on "Diode_control" Value changed {
        # TITLES VISIBILITY
        Property Node(instance in=reference to unnamed text, "Visible"=FALSE)
        Property Node(instance in=reference to unnamed text, "Visible"=FALSE)
        # DCC VISIBILITY
        Property Node(instance in=reference to "TerminalType_DCC", "Visible"=FALSE)
        # ACV VISIBILITY
        Property Node(instance in=reference to "ManualRange_ACV", "Visible"=FALSE)
        Property Node(instance in=reference to unnamed text, "Visible"=FALSE)
        # DCV VISIBILITY
        Property Node(instance in=reference to "DIG Option On/Off_DCV", "Visible"=FALSE)
        # DCVRATIO VISIBILITY
        Property Node(instance in=reference to "DIG Option On/Off_DCVR", "Visible"=FALSE)
        # ACC VISIBILITY
        Property Node(instance in=reference to "TerminalType_ACC", "Visible"=FALSE)
        Property Node(instance in=reference to "AutoRange_DCC", "Visible"=FALSE)
        # 2WR VISIBILITY
        Property Node(instance in=reference to "ApertureNPLC_2WR", "Visible"=FALSE)
        # 4WR VISIBILITY
        Property Node(instance in=reference to "ApertureNPLC_4WR", "Visible"=FALSE)
        Property Node(instance in=reference to "ACFilter_ACV", "Visible"=FALSE)
        # FREQ VISIBILITY
        Property Node(instance in=reference to "ACFilter_Freq", "Visible"=FALSE)
        Property Node(instance in=reference to unnamed text, "Visible"=FALSE)
        Property Node(instance in=reference to "Auto Impedance_DCV", "Visible"=FALSE)
        Property Node(instance in=reference to "Auto Impedance_DCVR", "Visible"=FALSE)
        Property Node(instance in=reference to "ACFilter_ACC", "Visible"=FALSE)
        # CAPACI VISIBILITY
        Property Node(instance in=reference to "ManualRange_Capaci", "Visible"=FALSE)
        Property Node(instance in=reference to "ManualRange_DCC", "Visible"=FALSE)
        Property Node(instance in=reference to "ApertureTime_2WR", "Visible"=FALSE)
        Property Node(instance in=reference to "ApertureTime_4WR", "Visible"=FALSE)
        Property Node(instance in=reference to "AutoRange_Freq", "Visible"=FALSE)
        Property Node(instance in=reference to "String_ACV", "Visible"=FALSE)
        Property Node(instance in=reference to "ManualRange_DCV", "Visible"=FALSE, "Disabled"=TRUE)
        Property Node(instance in=reference to "ManualRange_DCVR", "Visible"=FALSE)
        Property Node(instance in=reference to "ManualRange_ACC", "Visible"=FALSE)
        Property Node(instance in=reference to "AutoRange_Capaci", "Visible"=FALSE)
        Property Node(instance in=reference to "Aperture_DCC", "Visible"=FALSE)
        Property Node(instance in=reference to "Aperture_2WR", "Visible"=FALSE)
        Property Node(instance in=reference to "Aperture_4WR", "Visible"=FALSE)
        Property Node(instance in=reference to "GateTime_Freq", "Visible"=FALSE)
        Property Node(instance in=reference to "ApertureNPLC_DCV", "Visible"=FALSE)
        Property Node(instance in=reference to "ApertureNPLC_DCVR", "Visible"=FALSE)
        Property Node(instance in=reference to "AutoRange_ACV", "Visible"=FALSE)
        Property Node(instance in=reference to "AutoRange_ACC", "Visible"=FALSE)
        Property Node(instance in=reference to "String_Capaci", "Visible"=FALSE)
        Property Node(instance in=reference to "ApertureNPLC_DCC", "Visible"=FALSE)
        Property Node(instance in=reference to "AutoRange_2WR", "Visible"=FALSE)
        Property Node(instance in=reference to "AutoRange_4WR", "Visible"=FALSE)
        Property Node(instance in=reference to "ManualRange_Freq", "Visible"=FALSE)
        Property Node(instance in=reference to "Aperture_DCV", "Visible"=FALSE)
        Property Node(instance in=reference to "Aperture_DCVR", "Visible"=FALSE)
        Property Node(instance in=reference to unnamed text, "Visible"=FALSE)
        Property Node(instance in=reference to "String_ACC", "Visible"=FALSE)
        Property Node(instance in=reference to "ApertureTime_DCC", "Visible"=FALSE)
        Property Node(instance in=reference to "AutoZero_2WR", "Visible"=FALSE)
        Property Node(instance in=reference to "LowPower_4WR", "Visible"=FALSE)
        Property Node(instance in=reference to "Timeout_Freq", "Visible"=FALSE)
        Property Node(instance in=reference to "AutoRange_DCV", "Visible"=FALSE)
        Property Node(instance in=reference to "AutoRange_DCVR", "Visible"=FALSE)
        Property Node(instance in=reference to "AutoZero_DCC", "Visible"=FALSE)
        Property Node(instance in=reference to "LowPower_2WR", "Visible"=FALSE)
        Property Node(instance in=reference to "ManualRange_4WR", "Visible"=FALSE)
        Property Node(instance in=reference to "String_Freq", "Visible"=FALSE)
        Property Node(instance in=reference to "DCV Ratio_toenable", "Visible"=FALSE, "Value"=FALSE)
        Property Node(instance in=reference to "DCV Ratio_todisable", "Visible"=FALSE, "Value"=FALSE)
        Property Node(instance in=reference to "ManualRange_2WR", "Visible"=FALSE)
        Property Node(instance in=reference to "OffstComp_4WR", "Visible"=FALSE)
        Property Node(instance in=reference to unnamed text, "Visible"=FALSE)
        Property Node(instance in=reference to "Period_toenable", "Visible"=FALSE)
        Property Node(instance in=reference to "String_DCC", "Visible"=FALSE)
        Property Node(instance in=reference to "ApertureTime_DCV", "Visible"=FALSE)
        Property Node(instance in=reference to "ApertureTime_DCVR", "Visible"=FALSE)
        Property Node(instance in=reference to "OffstComp_2WR", "Visible"=FALSE)
        Property Node(instance in=reference to "String_4WR", "Visible"=FALSE)
        Property Node(instance in=reference to unnamed text, "Visible"=FALSE)
        Property Node(instance in=reference to "String_DCV", "Visible"=FALSE)
        # CONT VISIBILITY
        Property Node(instance in=reference to "String_DCVR", "Visible"=FALSE)
        Property Node(instance in=reference to "String_2WR", "Visible"=FALSE)
        Property Node(instance in=reference to unnamed text, "Visible"=FALSE)
        Property Node(instance in=reference to "AutoZero_DCV", "Visible"=FALSE)
        Property Node(instance in=reference to "Beeper_Cont", "Visible"=FALSE)
        # DIODE VISIBILITY
        Property Node(instance in=reference to "Beeper_Diode", "Visible"=TRUE)
        Property Node(instance in=reference to unnamed text, "Visible"=FALSE)
        # PERIOD VISIBILITY
        Property Node(instance in=reference to "ACFilter_Period", "Visible"=FALSE)
        # TEMPTCOUPLE VISIBILITY
        Property Node(instance in=reference to "Aperture_TempTCouple", "Visible"=FALSE)
        Property Node(instance in=reference to "String_Cont", "Visible"=FALSE)
        Property Node(instance in=reference to "String_Diode", "Visible"=TRUE)
        # TEMPMAIN VISIBILITY
        Property Node(instance in=reference to "Probe_TempMain", "Visible"=FALSE, "Value"=1)
        Property Node(instance in=reference to unnamed text, "Visible"=FALSE)
        Property Node(instance in=reference to "AutoRange_Period", "Visible"=FALSE)
        # TEMPRTD2W VISIBILITY
        Property Node(instance in=reference to "AutoZero_TempRTD2w", "Visible"=FALSE)
        Property Node(instance in=reference to "ApertureNPLC_TempTCouple", "Visible"=FALSE)
        # TEMPRTD4W VISIBILITY
        Property Node(instance in=reference to "LowPower_TempRTD4w", "Visible"=FALSE)
        # TEMPTHERMIS4W VISIBILITY
        Property Node(instance in=reference to "ApertureNPLC_TempThermis4w", "Visible"=FALSE)
        # TEMPTHERMIS2W VISIBILITY
        Property Node(instance in=reference to "ApertureNPLC_TempThermis2w", "Visible"=FALSE)
        Property Node(instance in=reference to unnamed text, "Visible"=FALSE)
        Property Node(instance in=reference to "GateTime_Period", "Visible"=FALSE)
        Property Node(instance in=reference to "LowPower_TempRTD2w", "Visible"=FALSE)
        Property Node(instance in=reference to "ApertureTime_TempTCouple", "Visible"=FALSE)
        Property Node(instance in=reference to "OffstComp_TempRTD4w", "Visible"=FALSE)
        Property Node(instance in=reference to "ApertureTime_TempThermis4w", "Visible"=FALSE)
        Property Node(instance in=reference to "ApertureTime_TempThermis2w", "Visible"=FALSE)
        Property Node(instance in=reference to unnamed text, "Visible"=FALSE)
        Property Node(instance in=reference to "ManualRange_Period", "Visible"=FALSE)
        Property Node(instance in=reference to "OffstComp_TempRTD2w", "Visible"=FALSE)
        Property Node(instance in=reference to "FixedOffset_TempTCouple", "Visible"=FALSE)
        Property Node(instance in=reference to "R0_TempRTD4w", "Visible"=FALSE)
        Property Node(instance in=reference to "Aperture_TempThermis4w", "Visible"=FALSE)
        Property Node(instance in=reference to "Aperture_TempThermis2w", "Visible"=FALSE)
        Property Node(instance in=reference to unnamed text, "Visible"=TRUE)
        Property Node(instance in=reference to "Timeout_Period", "Visible"=FALSE)
        Property Node(instance in=reference to "R0_TempRTD2w", "Visible"=FALSE)
        Property Node(instance in=reference to "OffsetAdjust_TempTCouple", "Visible"=FALSE)
        Property Node(instance in=reference to "ApertureNPLC_TempRTD4w", "Visible"=FALSE)
        Property Node(instance in=reference to "LowPower_TempThermis4w", "Visible"=FALSE)
        Property Node(instance in=reference to "AutoZero_TempThermis2w", "Visible"=FALSE)
        Property Node(instance in=reference to unnamed text, "Visible"=FALSE)
        Event Data() -> ("Old Value"=w25, "New Value"=w26)
        # EVENT NIE DLA
        # CONTROL NEW VALUE F
        # INDICATOR OLD
        Property Node(instance in=reference to "VoltageAC_indicator", "Visible"=w25)
        Property Node(instance in=reference to "String_Period", "Visible"=FALSE)
        Property Node(instance in=reference to "ApertureNPLC_TempRTD2w", "Visible"=FALSE)
        Property Node(instance in=reference to "OpenCheck_TempTCouple", "Visible"=FALSE)
        Property Node(instance in=reference to "ApertureTime_TempRTD4w", "Visible"=FALSE)
        Property Node(instance in=reference to "Units_TempThermis4w", "Visible"=FALSE)
        Property Node(instance in=reference to "LowPower_TempThermis2w", "Visible"=FALSE)
        Property Node(instance in=reference to "Period_todisable", "Visible"=FALSE)
        Property Node(instance in=reference to "CurrentDC_indicator", "Visible"=w25)
        Property Node(instance in=reference to "ApertureTime_TempRTD2w", "Visible"=FALSE)
        Property Node(instance in=reference to "AutoZero_TempTCouple", "Visible"=FALSE)
        Property Node(instance in=reference to "Aperture_TempRTD4w", "Visible"=FALSE)
        Property Node(instance in=reference to "String_TempThermis4w", "Visible"=FALSE)
        Property Node(instance in=reference to "Units_TempThermis2w", "Visible"=FALSE)
        Property Node(instance in=reference to "CurrentAC_indicator", "Visible"=w25)
        Property Node(instance in=reference to "Aperture_TempRTD2w", "Visible"=FALSE)
        Property Node(instance in=reference to "Reference_TempTCouple", "Visible"=FALSE)
        Property Node(instance in=reference to "Units_TempRTD4w", "Visible"=FALSE)
        Property Node(instance in=reference to "String_TempThermis2w", "Visible"=FALSE)
        Property Node(instance in=reference to "Type_TempTCouple", "Visible"=FALSE)
        Property Node(instance in=reference to "Units_TempRTD2w", "Visible"=FALSE)
        Property Node(instance in=reference to "2WResistance_indicator", "Visible"=w25)
        Property Node(instance in=reference to "String_TempRTD4w", "Visible"=FALSE)
        Property Node(instance in=reference to "Units_TempTCouple", "Visible"=FALSE)
        Property Node(instance in=reference to "String_TempRTD2w", "Visible"=FALSE)
        Property Node(instance in=reference to "4WResistance_indicator", "Visible"=w25)
        Property Node(instance in=reference to "String_TempTCouple", "Visible"=FALSE)
        Property Node(instance in=reference to "Frequency_indicator", "Visible"=w25)
        Property Node(instance in=reference to "Capacitance_indicator", "Visible"=w25)
        Property Node(instance in=reference to "Continuity_indicator", "Visible"=w25)
        Property Node(instance in=reference to "VoltageDC_indicator", "Visible"=w25)
        Property Node(instance in=reference to "Temperature_indicator", "Visible"=w25)
        # EVENT DLA
        # CONTROL OLD
        # INDICATOR NEW
        Property Node(instance in=reference to "Diode_control", "Visible"=w25)
        Property Node(instance in=reference to "Diode_indicator", "Visible"=w26)
        Property Node(instance in=reference to "VoltageAC_control", "Visible"=w26, "Value"=FALSE)
        Property Node(instance in=reference to "CurrentDC_control", "Visible"=w26, "Value"=FALSE)
        Property Node(instance in=reference to "CurrentAC_control", "Visible"=w26, "Value"=FALSE)
        Property Node(instance in=reference to "2WResistance_control", "Visible"=w26, "Value"=FALSE)
        Property Node(instance in=reference to "4WResistance_control", "Visible"=w26, "Value"=FALSE)
        Property Node(instance in=reference to "Frequency_control", "Visible"=w26, "Value"=FALSE)
        Property Node(instance in=reference to "Capacitance_control", "Visible"=w26, "Value"=FALSE)
        Property Node(instance in=reference to "Continuity_control", "Visible"=w26, "Value"=FALSE)
        Property Node(instance in=reference to "VoltageDC_control", "Visible"=w26, "Value"=FALSE)
        Property Node(instance in=reference to "Temperature_control", "Visible"=w26, "Value"=FALSE)
        w1 = default
      }
      on "Temperature_control" Value changed {
        # TITLES VISIBILITY
        Property Node(instance in=reference to unnamed text, "Visible"=FALSE)
        # DCC VISIBILITY
        Property Node(instance in=reference to "TerminalType_DCC", "Visible"=FALSE)
        # ACV VISIBILITY
        Property Node(instance in=reference to "ManualRange_ACV", "Visible"=FALSE)
        Property Node(instance in=reference to unnamed text, "Visible"=FALSE)
        # 2WR VISIBILITY
        Property Node(instance in=reference to "ApertureNPLC_2WR", "Visible"=FALSE)
        # 4WR VISIBILITY
        Property Node(instance in=reference to "ApertureNPLC_4WR", "Visible"=FALSE)
        # DCV VISIBILITY
        Property Node(instance in=reference to "DIG Option On/Off_DCV", "Visible"=FALSE)
        # DCVRATIO VISIBILITY
        Property Node(instance in=reference to "DIG Option On/Off_DCVR", "Visible"=FALSE)
        # ACC VISIBILITY
        Property Node(instance in=reference to "TerminalType_ACC", "Visible"=FALSE)
        Property Node(instance in=reference to "AutoRange_DCC", "Visible"=FALSE)
        # CAPACI VISIBILITY
        Property Node(instance in=reference to "ManualRange_Capaci", "Visible"=FALSE)
        Property Node(instance in=reference to unnamed text, "Visible"=FALSE)
        Property Node(instance in=reference to "ACFilter_ACV", "Visible"=FALSE)
        # FREQ VISIBILITY
        Property Node(instance in=reference to "ACFilter_Freq", "Visible"=FALSE)
        Property Node(instance in=reference to "ApertureTime_2WR", "Visible"=FALSE)
        Property Node(instance in=reference to "ApertureTime_4WR", "Visible"=FALSE)
        Property Node(instance in=reference to "Auto Impedance_DCV", "Visible"=FALSE)
        Property Node(instance in=reference to "Auto Impedance_DCVR", "Visible"=FALSE)
        Property Node(instance in=reference to "ACFilter_ACC", "Visible"=FALSE)
        Property Node(instance in=reference to "ManualRange_DCC", "Visible"=FALSE)
        Property Node(instance in=reference to "AutoRange_Capaci", "Visible"=FALSE)
        Property Node(instance in=reference to unnamed text, "Visible"=FALSE)
        Property Node(instance in=reference to "String_ACV", "Visible"=FALSE)
        Property Node(instance in=reference to "AutoRange_Freq", "Visible"=FALSE)
        Property Node(instance in=reference to "Aperture_2WR", "Visible"=FALSE)
        Property Node(instance in=reference to "Aperture_4WR", "Visible"=FALSE)
        Property Node(instance in=reference to "ManualRange_DCV", "Visible"=FALSE, "Disabled"=TRUE)
        Property Node(instance in=reference to "ManualRange_DCVR", "Visible"=FALSE)
        Property Node(instance in=reference to "ManualRange_ACC", "Visible"=FALSE)
        Property Node(instance in=reference to "Aperture_DCC", "Visible"=FALSE)
        Property Node(instance in=reference to "String_Capaci", "Visible"=FALSE)
        Property Node(instance in=reference to "GateTime_Freq", "Visible"=FALSE)
        Property Node(instance in=reference to "AutoRange_ACV", "Visible"=FALSE)
        Property Node(instance in=reference to "AutoRange_2WR", "Visible"=FALSE)
        Property Node(instance in=reference to "AutoRange_4WR", "Visible"=FALSE)
        Property Node(instance in=reference to "ApertureNPLC_DCV", "Visible"=FALSE)
        Property Node(instance in=reference to "ApertureNPLC_DCVR", "Visible"=FALSE)
        Property Node(instance in=reference to "AutoRange_ACC", "Visible"=FALSE)
        Property Node(instance in=reference to "ApertureNPLC_DCC", "Visible"=FALSE)
        Property Node(instance in=reference to "ManualRange_Freq", "Visible"=FALSE)
        Property Node(instance in=reference to "AutoZero_2WR", "Visible"=FALSE)
        Property Node(instance in=reference to "LowPower_4WR", "Visible"=FALSE)
        Property Node(instance in=reference to "Aperture_DCV", "Visible"=FALSE)
        Property Node(instance in=reference to "Aperture_DCVR", "Visible"=FALSE)
        Property Node(instance in=reference to "String_ACC", "Visible"=FALSE)
        Property Node(instance in=reference to "ApertureTime_DCC", "Visible"=FALSE)
        Property Node(instance in=reference to "Timeout_Freq", "Visible"=FALSE)
        Property Node(instance in=reference to unnamed text, "Visible"=FALSE)
        Property Node(instance in=reference to "LowPower_2WR", "Visible"=FALSE)
        Property Node(instance in=reference to "ManualRange_4WR", "Visible"=FALSE)
        Property Node(instance in=reference to "AutoRange_DCV", "Visible"=FALSE)
        Property Node(instance in=reference to "AutoRange_DCVR", "Visible"=FALSE)
        Property Node(instance in=reference to "AutoZero_DCC", "Visible"=FALSE)
        Property Node(instance in=reference to "String_Freq", "Visible"=FALSE)
        Property Node(instance in=reference to "ManualRange_2WR", "Visible"=FALSE)
        Property Node(instance in=reference to "OffstComp_4WR", "Visible"=FALSE)
        Property Node(instance in=reference to "DCV Ratio_toenable", "Visible"=FALSE, "Value"=FALSE)
        Property Node(instance in=reference to "DCV Ratio_todisable", "Visible"=FALSE, "Value"=FALSE)
        Property Node(instance in=reference to "String_DCC", "Visible"=FALSE)
        Property Node(instance in=reference to "Period_toenable", "Visible"=FALSE)
        Property Node(instance in=reference to "OffstComp_2WR", "Visible"=FALSE)
        Property Node(instance in=reference to "String_4WR", "Visible"=FALSE)
        Property Node(instance in=reference to "ApertureTime_DCV", "Visible"=FALSE)
        Property Node(instance in=reference to "ApertureTime_DCVR", "Visible"=FALSE)
        Property Node(instance in=reference to unnamed text, "Visible"=FALSE)
        Property Node(instance in=reference to "String_2WR", "Visible"=FALSE)
        Property Node(instance in=reference to "String_DCV", "Visible"=FALSE)
        Property Node(instance in=reference to "String_DCVR", "Visible"=FALSE)
        Property Node(instance in=reference to unnamed text, "Visible"=FALSE)
        Property Node(instance in=reference to "AutoZero_DCV", "Visible"=FALSE)
        Property Node(instance in=reference to unnamed text, "Visible"=FALSE)
        # CONT VISIBILITY
        Property Node(instance in=reference to "Beeper_Cont", "Visible"=FALSE)
        # DIODE VISIBILITY
        Property Node(instance in=reference to "Beeper_Diode", "Visible"=FALSE)
        # PERIOD VISIBILITY
        Property Node(instance in=reference to "ACFilter_Period", "Visible"=FALSE)
        # TEMPTCOUPLE VISIBILITY
        Property Node(instance in=reference to "Aperture_TempTCouple", "Visible"=FALSE)
        Property Node(instance in=reference to unnamed text, "Visible"=FALSE)
        Property Node(instance in=reference to "String_Cont", "Visible"=FALSE)
        Property Node(instance in=reference to "String_Diode", "Visible"=FALSE)
        # TEMPRTD2W VISIBILITY
        Property Node(instance in=reference to "AutoZero_TempRTD2w", "Visible"=FALSE)
        # TEMPRTD4W VISIBILITY
        Property Node(instance in=reference to "LowPower_TempRTD4w", "Visible"=TRUE)
        Property Node(instance in=reference to "AutoRange_Period", "Visible"=FALSE)
        # TEMPMAIN VISIBILITY
        Property Node(instance in=reference to "Probe_TempMain", "Visible"=TRUE, "Value"=1)
        # TEMPTHERMIS4W VISIBILITY
        Property Node(instance in=reference to "ApertureNPLC_TempThermis4w", "Visible"=FALSE)
        Property Node(instance in=reference to "ApertureNPLC_TempTCouple", "Visible"=FALSE)
        Property Node(instance in=reference to unnamed text, "Visible"=FALSE)
        # TEMPTHERMIS2W VISIBILITY
        Property Node(instance in=reference to "ApertureNPLC_TempThermis2w", "Visible"=FALSE)
        Property Node(instance in=reference to "LowPower_TempRTD2w", "Visible"=FALSE)
        Property Node(instance in=reference to "OffstComp_TempRTD4w", "Visible"=TRUE)
        Property Node(instance in=reference to "GateTime_Period", "Visible"=FALSE)
        Property Node(instance in=reference to "ApertureTime_TempThermis4w", "Visible"=FALSE)
        Property Node(instance in=reference to "ApertureTime_TempThermis2w", "Visible"=FALSE)
        Property Node(instance in=reference to "ApertureTime_TempTCouple", "Visible"=FALSE)
        Property Node(instance in=reference to unnamed text, "Visible"=FALSE)
        Property Node(instance in=reference to "OffstComp_TempRTD2w", "Visible"=FALSE)
        Property Node(instance in=reference to "R0_TempRTD4w", "Visible"=TRUE)
        Property Node(instance in=reference to "ManualRange_Period", "Visible"=FALSE)
        Property Node(instance in=reference to "Aperture_TempThermis4w", "Visible"=FALSE)
        Property Node(instance in=reference to "Aperture_TempThermis2w", "Visible"=FALSE)
        Property Node(instance in=reference to "FixedOffset_TempTCouple", "Visible"=FALSE)
        Property Node(instance in=reference to unnamed text, "Visible"=FALSE)
        Property Node(instance in=reference to "R0_TempRTD2w", "Visible"=FALSE)
        Property Node(instance in=reference to "ApertureNPLC_TempRTD4w", "Visible"=TRUE)
        Property Node(instance in=reference to "Timeout_Period", "Visible"=FALSE)
        Property Node(instance in=reference to "LowPower_TempThermis4w", "Visible"=FALSE)
        Property Node(instance in=reference to "AutoZero_TempThermis2w", "Visible"=FALSE)
        Property Node(instance in=reference to "OffsetAdjust_TempTCouple", "Visible"=FALSE)
        Property Node(instance in=reference to unnamed text, "Visible"=FALSE)
        Event Data() -> ("Old Value"=w27, "New Value"=w28)
        # EVENT NIE DLA
        # CONTROL NEW VALUE F
        # INDICATOR OLD
        Property Node(instance in=reference to "VoltageAC_indicator", "Visible"=w27)
        Property Node(instance in=reference to "ApertureNPLC_TempRTD2w", "Visible"=FALSE)
        Property Node(instance in=reference to "ApertureTime_TempRTD4w", "Visible"=TRUE)
        Property Node(instance in=reference to "String_Period", "Visible"=FALSE)
        Property Node(instance in=reference to "Units_TempThermis4w", "Visible"=FALSE)
        Property Node(instance in=reference to "LowPower_TempThermis2w", "Visible"=FALSE)
        Property Node(instance in=reference to "OpenCheck_TempTCouple", "Visible"=FALSE)
        Property Node(instance in=reference to unnamed text, "Visible"=TRUE)
        Property Node(instance in=reference to "ApertureTime_TempRTD2w", "Visible"=FALSE)
        Property Node(instance in=reference to "CurrentDC_indicator", "Visible"=w27)
        Property Node(instance in=reference to "Aperture_TempRTD4w", "Visible"=TRUE)
        Property Node(instance in=reference to "Period_todisable", "Visible"=FALSE)
        Property Node(instance in=reference to "String_TempThermis4w", "Visible"=FALSE)
        Property Node(instance in=reference to "Units_TempThermis2w", "Visible"=FALSE)
        Property Node(instance in=reference to "AutoZero_TempTCouple", "Visible"=FALSE)
        Property Node(instance in=reference to "Aperture_TempRTD2w", "Visible"=FALSE)
        Property Node(instance in=reference to "Units_TempRTD4w", "Visible"=TRUE)
        Property Node(instance in=reference to "CurrentAC_indicator", "Visible"=w27)
        Property Node(instance in=reference to "String_TempThermis2w", "Visible"=FALSE)
        Property Node(instance in=reference to "Reference_TempTCouple", "Visible"=FALSE)
        Property Node(instance in=reference to "Units_TempRTD2w", "Visible"=FALSE)
        Property Node(instance in=reference to "String_TempRTD4w", "Visible"=TRUE)
        Property Node(instance in=reference to "2WResistance_indicator", "Visible"=w27)
        Property Node(instance in=reference to "Type_TempTCouple", "Visible"=FALSE)
        Property Node(instance in=reference to "String_TempRTD2w", "Visible"=FALSE)
        Property Node(instance in=reference to "Units_TempTCouple", "Visible"=FALSE)
        Property Node(instance in=reference to "4WResistance_indicator", "Visible"=w27)
        Property Node(instance in=reference to "String_TempTCouple", "Visible"=FALSE)
        Property Node(instance in=reference to "Frequency_indicator", "Visible"=w27)
        Property Node(instance in=reference to "Capacitance_indicator", "Visible"=w27)
        Property Node(instance in=reference to "Continuity_indicator", "Visible"=w27)
        Property Node(instance in=reference to "Diode_indicator", "Visible"=w27)
        Property Node(instance in=reference to "VoltageDC_indicator", "Visible"=w27)
        # EVENT DLA
        # CONTROL OLD
        # INDICATOR NEW
        Property Node(instance in=reference to "Temperature_control", "Visible"=w27)
        Property Node(instance in=reference to "Temperature_indicator", "Visible"=w28)
        Property Node(instance in=reference to "VoltageAC_control", "Visible"=w28, "Value"=FALSE)
        Property Node(instance in=reference to "CurrentDC_control", "Visible"=w28, "Value"=FALSE)
        Property Node(instance in=reference to "CurrentAC_control", "Visible"=w28, "Value"=FALSE)
        Property Node(instance in=reference to "2WResistance_control", "Visible"=w28, "Value"=FALSE)
        Property Node(instance in=reference to "4WResistance_control", "Visible"=w28, "Value"=FALSE)
        Property Node(instance in=reference to "Frequency_control", "Visible"=w28, "Value"=FALSE)
        Property Node(instance in=reference to "Capacitance_control", "Visible"=w28, "Value"=FALSE)
        Property Node(instance in=reference to "Continuity_control", "Visible"=w28, "Value"=FALSE)
        Property Node(instance in=reference to "Diode_control", "Visible"=w28, "Value"=FALSE)
        Property Node(instance in=reference to "VoltageDC_control", "Visible"=w28, "Value"=FALSE)
        w1 = default
      }
      on "ApertureNPLC_DCV" Value changed; "ApertureTime_DCV" Value changed; "Aperture_DCV" Value changed; "Auto Impedance_DCV" Value changed; "AutoRange_DCV" Value changed; "AutoZero_DCV" Value changed; "DIG Option On/Off_DCV" Value changed; "ManualRange_DCV" Value changed {
        Property Node(instance in=reference to "Aperture_DCV") -> ("Value"=w29)
        Property Node(instance in=reference to "DIG Option On/Off_DCV") -> ("Value"=w30)
        case (w30) {
          frame False, Default {
            w31 = [0, 1, 2]
          }
          frame True {
            w31 = i32[] []
          }
        }
        Not(x=w29) -> w32
        Property Node(instance in=reference to "ApertureNPLC_DCV", "Disabled"=w32, "DisabledIndexes"=w31) -> ("Value"=w33)
        case (w30) {
          frame False, Default {
            w34 = 0.0002
          }
          frame True {
            w34 = 2e-05
          }
        }
        Property Node(instance in=reference to "ApertureTime_DCV", "Disabled"=w29, "Minimum"=w34) -> ("Value"=w35)
        Quotient And Remainder(x=w35, y=2e-06) -> (floor(x/y)=w36, x-y*floor(x/y)=w37)
        Multiply(w37, 1000000) -> w38
        Round To Nearest(number=w38) -> w39
        To Signed 32 Bit Integer(number=w39) -> w40
        case (w40) {
          frame 0, Default {
            Multiply(2e-06, w36) -> w41
          }
          frame 1 {
            Multiply(2e-06, w36) -> w41
          }
          frame 2 {
            Add(1, w36) -> w42
            Multiply(2e-06, w42) -> w41
          }
        }
        case (w29) {
          frame False, Default {
            Format Into String(formatString="%_6ps", initString="Aperture Time: ", w41) -> w43
          }
          frame True {
            Format Into String(formatString="%#gPLC", initString="Aperture NPLC: ", w33) -> w43
          }
        }
        Property Node(instance in=reference to "AutoRange_DCV") -> ("Value"=w44)
        Property Node(instance in=reference to "ManualRange_DCV", "Disabled"=w44) -> ("Value"=w45)
        case (w44) {
          frame False, Default {
            Format Into String(formatString="%.0pV", initString="Range: ", w45) -> w46
          }
          frame True {
            w46 = "Range: Auto"
          }
        }
        Property Node(instance in=reference to "Auto Impedance_DCV") -> ("Value"=w47)
        case (w47) {
          frame False, Default {
            w48 = "Input Z: 10MΩ"
          }
          frame True {
            w48 = "Input Z: Auto"
          }
        }
        Property Node(instance in=reference to "AutoZero_DCV") -> ("Value"=w49)
        case (w49) {
          frame False, Default {
            w50 = "Auto Zero: Off"
          }
          frame True {
            w50 = "Auto Zero: On"
          }
        }
        Concatenate Strings("Your settings:", "\r\n", w46, "\r\n", w43, "\r\n", w50, "\r\n", w48, "\r\n", "DCV Ratio: Off") -> w51
        $String_DCV <- w51
        Property Node(instance in=reference to "ApertureTime_DCV", "Value"=w41)
        w1 = default
      }
      on "ApertureNPLC_DCVR" Value changed; "ApertureTime_DCVR" Value changed; "Aperture_DCVR" Value changed; "Auto Impedance_DCVR" Value changed; "AutoRange_DCVR" Value changed; "DIG Option On/Off_DCVR" Value changed; "ManualRange_DCVR" Value changed {
        Property Node(instance in=reference to "Aperture_DCVR") -> ("Value"=w52)
        Property Node(instance in=reference to "DIG Option On/Off_DCVR") -> ("Value"=w53)
        case (w53) {
          frame False, Default {
            w54 = [0, 1, 2]
          }
          frame True {
            w54 = i32[] []
          }
        }
        Not(x=w52) -> w55
        Property Node(instance in=reference to "ApertureNPLC_DCVR", "Disabled"=w55, "DisabledIndexes"=w54) -> ("Value"=w56)
        case (w53) {
          frame False, Default {
            w57 = 0.0002
          }
          frame True {
            w57 = 2e-05
          }
        }
        Property Node(instance in=reference to "ApertureTime_DCVR", "Disabled"=w52, "Minimum"=w57) -> ("Value"=w58)
        Quotient And Remainder(x=w58, y=2e-06) -> (floor(x/y)=w59, x-y*floor(x/y)=w60)
        Multiply(w60, 1000000) -> w61
        Round To Nearest(number=w61) -> w62
        To Signed 32 Bit Integer(number=w62) -> w63
        case (w63) {
          frame 0, Default {
            Multiply(2e-06, w59) -> w64
          }
          frame 1 {
            Multiply(2e-06, w59) -> w64
          }
          frame 2 {
            Add(1, w59) -> w65
            Multiply(2e-06, w65) -> w64
          }
        }
        case (w52) {
          frame False, Default {
            Format Into String(formatString="%_6ps", initString="Aperture Time: ", w64) -> w66
          }
          frame True {
            Format Into String(formatString="%#gPLC", initString="Aperture NPLC: ", w56) -> w66
          }
        }
        Property Node(instance in=reference to "AutoRange_DCVR") -> ("Value"=w67)
        Property Node(instance in=reference to "ManualRange_DCVR", "Disabled"=w67) -> ("Value"=w68)
        case (w67) {
          frame False, Default {
            Format Into String(formatString="%.0pV", initString="Range: ", w68) -> w69
          }
          frame True {
            w69 = "Range: Auto"
          }
        }
        Property Node(instance in=reference to "Auto Impedance_DCVR") -> ("Value"=w70)
        case (w70) {
          frame False, Default {
            w71 = "Input Z: 10MΩ"
          }
          frame True {
            w71 = "Input Z: Auto"
          }
        }
        Concatenate Strings("Your settings:", "\r\n", w69, "\r\n", w66, "\r\n", "Auto Zero cannot be disabled during DCV Ratio", "\r\n", w71, "\r\n", "DCV Ratio: On") -> w72
        $String_DCVR <- w72
        Property Node(instance in=reference to "ApertureTime_DCVR", "Value"=w64)
        w1 = default
      }
      on "AutoRange_ACV" Value changed; "ManualRange_ACV" Value changed; "ACFilter_ACV" Value changed {
        Property Node(instance in=reference to "AutoRange_ACV") -> ("Value"=w73)
        Property Node(instance in=reference to "ManualRange_ACV", "Disabled"=w73) -> ("Value"=w74)
        case (w73) {
          frame False, Default {
            Format Into String(formatString="%.0pV", initString="Range: ", w74) -> w75
          }
          frame True {
            w75 = "Range: Auto"
          }
        }
        Property Node(instance in=reference to "ACFilter_ACV") -> ("Value"=w76)
        Format Into String(formatString="%.0pHz", initString="AC Filter: >", w76) -> w77
        Concatenate Strings("Your settings:", "\r\n", w75, "\r\n", w77) -> w78
        $String_ACV <- w78
        w1 = default
      }
      on "ApertureNPLC_DCC" Value changed; "ApertureTime_DCC" Value changed; "Aperture_DCC" Value changed; "AutoRange_DCC" Value changed; "AutoZero_DCC" Value changed; "ManualRange_DCC" Value changed; "TerminalType_DCC" Value changed {
        Property Node(instance in=reference to "Aperture_DCC") -> ("Value"=w79)
        Not(x=w79) -> w80
        Property Node(instance in=reference to "ApertureNPLC_DCC", "Disabled"=w80) -> ("Value"=w81)
        Property Node(instance in=reference to "ApertureTime_DCC", "Disabled"=w79) -> ("Value"=w82)
        Quotient And Remainder(x=w82, y=2e-06) -> (floor(x/y)=w83, x-y*floor(x/y)=w84)
        Multiply(w84, 1000000) -> w85
        Round To Nearest(number=w85) -> w86
        To Signed 32 Bit Integer(number=w86) -> w87
        case (w87) {
          frame 0, Default {
            Multiply(2e-06, w83) -> w88
          }
          frame 1 {
            Multiply(2e-06, w83) -> w88
          }
          frame 2 {
            Add(1, w83) -> w89
            Multiply(2e-06, w89) -> w88
          }
        }
        case (w79) {
          frame False, Default {
            Format Into String(formatString="%_6ps", initString="Aperture Time: ", w88) -> w90
          }
          frame True {
            Format Into String(formatString="%#gPLC", initString="Aperture NPLC: ", w81) -> w90
          }
        }
        Property Node(instance in=reference to "AutoZero_DCC") -> ("Value"=w91)
        case (w91) {
          frame False, Default {
            w92 = "Auto Zero: Off"
          }
          frame True {
            w92 = "Auto Zero: On"
          }
        }
        Property Node(instance in=reference to "AutoRange_DCC") -> ("Value"=w93)
        Property Node(instance in=reference to "TerminalType_DCC") -> ("Value"=w94)
        case (w94) {
          frame 3, Default {
            w95 = [8]
          }
          frame 10 {
            w95 = i32[] []
          }
        }
        Property Node(instance in=reference to "ManualRange_DCC", "Disabled"=w93, "DisabledIndexes"=w95) -> ("Value"=w96)
        Is Equal(x=w96, y=10) -> w97
        Is Equal(x=w94, y=3) -> w98
        Logical And(w97, w98) -> w99
        case (w99) {
          frame False, Default {
            w100 = w96
          }
          frame True {
            w100 = 3
          }
        }
        Property Node(instance in=reference to "ManualRange_DCC", "Value"=w100) -> ("Value"=w101)
        case (w93) {
          frame False, Default {
            Format Into String(formatString="%.0pA", initString="Range: ", w101) -> w102
          }
          frame True {
            w102 = "Range: Auto"
          }
        }
        Format Into String(formatString="%.0pA", initString="Terminal: ", w94) -> w103
        Concatenate Strings("Your settings:", "\r\n", w102, "\r\n", w90, "\r\n", w103, "\r\n", w92) -> w104
        $String_DCC <- w104
        Property Node(instance in=reference to "ApertureTime_DCC", "Value"=w88)
        w1 = default
      }
      on "AutoRange_ACC" Value changed; "ManualRange_ACC" Value changed; "TerminalType_ACC" Value changed; "ACFilter_ACC" Value changed {
        Property Node(instance in=reference to "AutoRange_ACC") -> ("Value"=w105)
        Property Node(instance in=reference to "ManualRange_ACC", "Disabled"=w105) -> ("Value"=w106)
        case (w105) {
          frame False, Default {
            Format Into String(formatString="%.0pA", initString="Range: ", w106) -> w107
          }
          frame True {
            w107 = "Range: Auto"
          }
        }
        Property Node(instance in=reference to "ACFilter_ACC") -> ("Value"=w108)
        Format Into String(formatString="%.0pHz", initString="AC Filter: >", w108) -> w109
        Property Node(instance in=reference to "TerminalType_ACC") -> ("Value"=w110)
        Format Into String(formatString="%.0pA", initString="Terminal: ", w110) -> w111
        Concatenate Strings("Your settings:", "\r\n", w107, "\r\n", w109, "\r\n", w111) -> w112
        $String_ACC <- w112
        w1 = default
      }
      on "ApertureNPLC_2WR" Value changed; "ApertureTime_2WR" Value changed; "Aperture_2WR" Value changed; "AutoRange_2WR" Value changed; "AutoZero_2WR" Value changed; "LowPower_2WR" Value changed; "ManualRange_2WR" Value changed; "OffstComp_2WR" Value changed {
        Property Node(instance in=reference to "Aperture_2WR") -> ("Value"=w113)
        Not(x=w113) -> w114
        Property Node(instance in=reference to "ApertureNPLC_2WR", "Disabled"=w114) -> ("Value"=w115)
        Property Node(instance in=reference to "ApertureTime_2WR", "Disabled"=w113) -> ("Value"=w116)
        Quotient And Remainder(x=w116, y=2e-06) -> (floor(x/y)=w117, x-y*floor(x/y)=w118)
        Multiply(w118, 1000000) -> w119
        Round To Nearest(number=w119) -> w120
        To Signed 32 Bit Integer(number=w120) -> w121
        case (w121) {
          frame 0, Default {
            Multiply(2e-06, w117) -> w122
          }
          frame 1 {
            Multiply(2e-06, w117) -> w122
          }
          frame 2 {
            Add(1, w117) -> w123
            Multiply(2e-06, w123) -> w122
          }
        }
        case (w113) {
          frame False, Default {
            Format Into String(formatString="%_6ps", initString="Aperture Time: ", w122) -> w124
          }
          frame True {
            Format Into String(formatString="%#gPLC", initString="Aperture NPLC: ", w115) -> w124
          }
        }
        Property Node(instance in=reference to "OffstComp_2WR") -> ("Value"=w125)
        case (w125) {
          frame False, Default {
            w126 = "Offset Compensation: Off"
          }
          frame True {
            w126 = "Offset Compensation: On"
          }
        }
        Property Node(instance in=reference to "AutoRange_2WR") -> ("Value"=w127)
        Property Node(instance in=reference to "ManualRange_2WR", "Disabled"=w127) -> ("Value"=w128)
        case (w127) {
          frame False, Default {
            Format Into String(formatString="%.0pΩ", initString="Range: ", w128) -> w129
          }
          frame True {
            w129 = "Range: Auto"
          }
        }
        Property Node(instance in=reference to "LowPower_2WR") -> ("Value"=w130)
        case (w130) {
          frame False, Default {
            w131 = "Low Power: Off"
          }
          frame True {
            w131 = "Low Power: On"
          }
        }
        Property Node(instance in=reference to "AutoZero_2WR") -> ("Value"=w132)
        case (w132) {
          frame False, Default {
            w133 = "Auto Zero: Off"
          }
          frame True {
            w133 = "Auto Zero: On"
          }
        }
        Concatenate Strings("Your settings:", "\r\n", w129, "\r\n", w124, "\r\n", w133, "\r\n", w131, "\r\n", w126) -> w134
        $String_2WR <- w134
        Property Node(instance in=reference to "ApertureTime_2WR", "Value"=w122)
        w1 = default
      }
      on "ApertureNPLC_4WR" Value changed; "ApertureTime_4WR" Value changed; "Aperture_4WR" Value changed; "AutoRange_4WR" Value changed; "LowPower_4WR" Value changed; "ManualRange_4WR" Value changed; "OffstComp_4WR" Value changed {
        Property Node(instance in=reference to "Aperture_4WR") -> ("Value"=w135)
        Not(x=w135) -> w136
        Property Node(instance in=reference to "ApertureNPLC_4WR", "Disabled"=w136) -> ("Value"=w137)
        Property Node(instance in=reference to "ApertureTime_4WR", "Disabled"=w135) -> ("Value"=w138)
        Quotient And Remainder(x=w138, y=2e-06) -> (floor(x/y)=w139, x-y*floor(x/y)=w140)
        Multiply(w140, 1000000) -> w141
        Round To Nearest(number=w141) -> w142
        To Signed 32 Bit Integer(number=w142) -> w143
        case (w143) {
          frame 0, Default {
            Multiply(2e-06, w139) -> w144
          }
          frame 1 {
            Multiply(2e-06, w139) -> w144
          }
          frame 2 {
            Add(1, w139) -> w145
            Multiply(2e-06, w145) -> w144
          }
        }
        case (w135) {
          frame False, Default {
            Format Into String(formatString="%_6ps", initString="Aperture Time: ", w144) -> w146
          }
          frame True {
            Format Into String(formatString="%#gPLC", initString="Aperture NPLC: ", w137) -> w146
          }
        }
        Property Node(instance in=reference to "OffstComp_4WR") -> ("Value"=w147)
        case (w147) {
          frame False, Default {
            w148 = "Offset Compensation: Off"
          }
          frame True {
            w148 = "Offset Compensation: On"
          }
        }
        Property Node(instance in=reference to "AutoRange_4WR") -> ("Value"=w149)
        Property Node(instance in=reference to "ManualRange_4WR", "Disabled"=w149) -> ("Value"=w150)
        case (w149) {
          frame False, Default {
            Format Into String(formatString="%.0pΩ", initString="Range: ", w150) -> w151
          }
          frame True {
            w151 = "Range: Auto"
          }
        }
        Property Node(instance in=reference to "LowPower_4WR") -> ("Value"=w152)
        case (w152) {
          frame False, Default {
            w153 = "Low Power: Off"
          }
          frame True {
            w153 = "Low Power: On"
          }
        }
        Concatenate Strings("Your settings:", "\r\n", w151, "\r\n", w146, "\r\n", "Auto Zero cannot be disabled", "\r\n", w153, "\r\n", w148) -> w154
        $String_4WR <- w154
        Property Node(instance in=reference to "ApertureTime_4WR", "Value"=w144)
        w1 = default
      }
      on "ACFilter_Freq" Value changed; "AutoRange_Freq" Value changed; "GateTime_Freq" Value changed; "ManualRange_Freq" Value changed; "Timeout_Freq" Value changed {
        Property Node(instance in=reference to "AutoRange_Freq") -> ("Value"=w155)
        Property Node(instance in=reference to "ManualRange_Freq", "Disabled"=w155) -> ("Value"=w156)
        case (w155) {
          frame False, Default {
            Format Into String(formatString="%.0pV", initString="Range: ", w156) -> w157
          }
          frame True {
            w157 = "Range: Auto"
          }
        }
        Property Node(instance in=reference to "ACFilter_Freq") -> ("Value"=w158)
        Format Into String(formatString="%.0pHz", initString="AC Filter: >", w158) -> w159
        Property Node(instance in=reference to "GateTime_Freq") -> ("Value"=w160)
        Format Into String(formatString="%.0ps", initString="Gate Time: ", w160) -> w161
        Property Node(instance in=reference to "Timeout_Freq") -> ("Value"=w162)
        case (w162) {
          frame False, Default {
            w163 = "Timeout: 1s"
          }
          frame True {
            w163 = "Timeout: Auto"
          }
        }
        Concatenate Strings("Your settings:", "\r\n", w157, "\r\n", w159, "\r\n", w161, "\r\n", w163) -> w164
        $String_Freq <- w164
        w1 = default
      }
      on "ACFilter_Period" Value changed; "AutoRange_Period" Value changed; "GateTime_Period" Value changed; "ManualRange_Period" Value changed; "Timeout_Period" Value changed {
        Property Node(instance in=reference to "AutoRange_Period") -> ("Value"=w165)
        Property Node(instance in=reference to "ManualRange_Period", "Disabled"=w165) -> ("Value"=w166)
        case (w165) {
          frame False, Default {
            Format Into String(formatString="%.0pV", initString="Range: ", w166) -> w167
          }
          frame True {
            w167 = "Range: Auto"
          }
        }
        Property Node(instance in=reference to "ACFilter_Period") -> ("Value"=w168)
        Format Into String(formatString="%.0pHz", initString="AC Filter: >", w168) -> w169
        Property Node(instance in=reference to "GateTime_Period") -> ("Value"=w170)
        Format Into String(formatString="%.0ps", initString="Gate Time: ", w170) -> w171
        Property Node(instance in=reference to "Timeout_Period") -> ("Value"=w172)
        case (w172) {
          frame False, Default {
            w173 = "Timeout: 1s"
          }
          frame True {
            w173 = "Timeout: Auto"
          }
        }
        Concatenate Strings("Your settings:", "\r\n", w167, "\r\n", w169, "\r\n", w171, "\r\n", w173) -> w174
        $String_Period <- w174
        w1 = default
      }
      on "AutoRange_Capaci" Value changed; "ManualRange_Capaci" Value changed {
        Property Node(instance in=reference to "AutoRange_Capaci") -> ("Value"=w175)
        Property Node(instance in=reference to "ManualRange_Capaci", "Disabled"=w175) -> ("Value"=w176)
        case (w175) {
          frame False, Default {
            Format Into String(formatString="%.0pF", initString="Range: ", w176) -> w177
          }
          frame True {
            w177 = "Range: Auto"
          }
        }
        Concatenate Strings("Your settings:", "\r\n", w177) -> w178
        $String_Capaci <- w178
        w1 = default
      }
      on "Beeper_Cont" Value changed {
        Property Node(instance in=reference to "Beeper_Cont") -> ("Value"=w179)
        case (w179) {
          frame False, Default {
            w180 = "Beeper: Off"
          }
          frame True {
            w180 = "Beeper: On"
          }
        }
        Concatenate Strings("Your settings:", "\r\n", w180) -> w181
        $String_Cont <- w181
        w1 = default
      }
      on "Beeper_Diode" Value changed {
        Property Node(instance in=reference to "Beeper_Diode") -> ("Value"=w182)
        case (w182) {
          frame False, Default {
            w183 = "Beeper: Off"
          }
          frame True {
            w183 = "Beeper: On"
          }
        }
        Concatenate Strings("Your settings:", "\r\n", w183) -> w184
        $String_Diode <- w184
        w1 = default
      }
      on "Probe_TempMain" Value changed {
        Event Data() -> ("Old Value"=w185, "New Value"=w186)
        case (w185) {
          frame 0, Default {
            # TEMPRTD2W VISIBILITY
            Property Node(instance in=reference to "AutoZero_TempRTD2w", "Visible"=FALSE)
            Property Node(instance in=reference to "LowPower_TempRTD2w", "Visible"=FALSE)
            Property Node(instance in=reference to "OffstComp_TempRTD2w", "Visible"=FALSE)
            Property Node(instance in=reference to "R0_TempRTD2w", "Visible"=FALSE)
            Property Node(instance in=reference to "ApertureNPLC_TempRTD2w", "Visible"=FALSE)
            Property Node(instance in=reference to "ApertureTime_TempRTD2w", "Visible"=FALSE)
            Property Node(instance in=reference to "Aperture_TempRTD2w", "Visible"=FALSE)
            Property Node(instance in=reference to "Units_TempRTD2w", "Visible"=FALSE)
            Property Node(instance in=reference to "String_TempRTD2w", "Visible"=FALSE)
          }
          frame 1 {
            # TEMPRTD4W VISIBILITY
            Property Node(instance in=reference to "LowPower_TempRTD4w", "Visible"=FALSE)
            Property Node(instance in=reference to "OffstComp_TempRTD4w", "Visible"=FALSE)
            Property Node(instance in=reference to "R0_TempRTD4w", "Visible"=FALSE)
            Property Node(instance in=reference to "ApertureNPLC_TempRTD4w", "Visible"=FALSE)
            Property Node(instance in=reference to "ApertureTime_TempRTD4w", "Visible"=FALSE)
            Property Node(instance in=reference to "Aperture_TempRTD4w", "Visible"=FALSE)
            Property Node(instance in=reference to "Units_TempRTD4w", "Visible"=FALSE)
            Property Node(instance in=reference to "String_TempRTD4w", "Visible"=FALSE)
          }
          frame 2 {
            # TEMPTHERMIS2W VISIBILITY
            Property Node(instance in=reference to "ApertureNPLC_TempThermis2w", "Visible"=FALSE)
            Property Node(instance in=reference to "ApertureTime_TempThermis2w", "Visible"=FALSE)
            Property Node(instance in=reference to "Aperture_TempThermis2w", "Visible"=FALSE)
            Property Node(instance in=reference to "AutoZero_TempThermis2w", "Visible"=FALSE)
            Property Node(instance in=reference to "LowPower_TempThermis2w", "Visible"=FALSE)
            Property Node(instance in=reference to "Units_TempThermis2w", "Visible"=FALSE)
            Property Node(instance in=reference to "String_TempThermis2w", "Visible"=FALSE)
          }
          frame 3 {
            # TEMPTHERMIS4W VISIBILITY
            Property Node(instance in=reference to "ApertureNPLC_TempThermis4w", "Visible"=FALSE)
            Property Node(instance in=reference to "ApertureTime_TempThermis4w", "Visible"=FALSE)
            Property Node(instance in=reference to "Aperture_TempThermis4w", "Visible"=FALSE)
            Property Node(instance in=reference to "LowPower_TempThermis4w", "Visible"=FALSE)
            Property Node(instance in=reference to "Units_TempThermis4w", "Visible"=FALSE)
            Property Node(instance in=reference to "String_TempThermis4w", "Visible"=FALSE)
          }
          frame 4 {
            # TEMPTCOUPLE VISIBILITY
            Property Node(instance in=reference to "Aperture_TempTCouple", "Visible"=FALSE)
            Property Node(instance in=reference to "ApertureNPLC_TempTCouple", "Visible"=FALSE)
            Property Node(instance in=reference to "ApertureTime_TempTCouple", "Visible"=FALSE)
            Property Node(instance in=reference to "FixedOffset_TempTCouple", "Visible"=FALSE)
            Property Node(instance in=reference to "OffsetAdjust_TempTCouple", "Visible"=FALSE)
            Property Node(instance in=reference to "OpenCheck_TempTCouple", "Visible"=FALSE)
            Property Node(instance in=reference to "AutoZero_TempTCouple", "Visible"=FALSE)
            Property Node(instance in=reference to "Reference_TempTCouple", "Visible"=FALSE)
            Property Node(instance in=reference to "Type_TempTCouple", "Visible"=FALSE)
            Property Node(instance in=reference to "Units_TempTCouple", "Visible"=FALSE)
            Property Node(instance in=reference to "String_TempTCouple", "Visible"=FALSE)
          }
        }
        case (w186) {
          frame 0, Default {
            # TEMPRTD2W VISIBILITY
            Property Node(instance in=reference to "AutoZero_TempRTD2w", "Visible"=TRUE)
            Property Node(instance in=reference to "LowPower_TempRTD2w", "Visible"=TRUE)
            Property Node(instance in=reference to "OffstComp_TempRTD2w", "Visible"=TRUE)
            Property Node(instance in=reference to "R0_TempRTD2w", "Visible"=TRUE)
            Property Node(instance in=reference to "ApertureNPLC_TempRTD2w", "Visible"=TRUE)
            Property Node(instance in=reference to "ApertureTime_TempRTD2w", "Visible"=TRUE)
            Property Node(instance in=reference to "Aperture_TempRTD2w", "Visible"=TRUE)
            Property Node(instance in=reference to "Units_TempRTD2w", "Visible"=TRUE)
            Property Node(instance in=reference to "String_TempRTD2w", "Visible"=TRUE)
          }
          frame 1 {
            # TEMPRTD4W VISIBILITY
            Property Node(instance in=reference to "LowPower_TempRTD4w", "Visible"=TRUE)
            Property Node(instance in=reference to "OffstComp_TempRTD4w", "Visible"=TRUE)
            Property Node(instance in=reference to "R0_TempRTD4w", "Visible"=TRUE)
            Property Node(instance in=reference to "ApertureNPLC_TempRTD4w", "Visible"=TRUE)
            Property Node(instance in=reference to "ApertureTime_TempRTD4w", "Visible"=TRUE)
            Property Node(instance in=reference to "Aperture_TempRTD4w", "Visible"=TRUE)
            Property Node(instance in=reference to "Units_TempRTD4w", "Visible"=TRUE)
            Property Node(instance in=reference to "String_TempRTD4w", "Visible"=TRUE)
          }
          frame 2 {
            # TEMPTHERMIS2W VISIBILITY
            Property Node(instance in=reference to "ApertureNPLC_TempThermis2w", "Visible"=TRUE)
            Property Node(instance in=reference to "ApertureTime_TempThermis2w", "Visible"=TRUE)
            Property Node(instance in=reference to "Aperture_TempThermis2w", "Visible"=TRUE)
            Property Node(instance in=reference to "AutoZero_TempThermis2w", "Visible"=TRUE)
            Property Node(instance in=reference to "LowPower_TempThermis2w", "Visible"=TRUE)
            Property Node(instance in=reference to "Units_TempThermis2w", "Visible"=TRUE)
            Property Node(instance in=reference to "String_TempThermis2w", "Visible"=TRUE)
          }
          frame 3 {
            # TEMPTHERMIS4W VISIBILITY
            Property Node(instance in=reference to "ApertureNPLC_TempThermis4w", "Visible"=TRUE)
            Property Node(instance in=reference to "ApertureTime_TempThermis4w", "Visible"=TRUE)
            Property Node(instance in=reference to "Aperture_TempThermis4w", "Visible"=TRUE)
            Property Node(instance in=reference to "LowPower_TempThermis4w", "Visible"=TRUE)
            Property Node(instance in=reference to "Units_TempThermis4w", "Visible"=TRUE)
            Property Node(instance in=reference to "String_TempThermis4w", "Visible"=TRUE)
          }
          frame 4 {
            # TEMPTCOUPLE VISIBILITY
            Property Node(instance in=reference to "Aperture_TempTCouple", "Visible"=TRUE)
            Property Node(instance in=reference to "ApertureNPLC_TempTCouple", "Visible"=TRUE)
            Property Node(instance in=reference to "ApertureTime_TempTCouple", "Visible"=TRUE)
            Property Node(instance in=reference to "FixedOffset_TempTCouple", "Visible"=TRUE)
            Property Node(instance in=reference to "OffsetAdjust_TempTCouple", "Visible"=TRUE)
            Property Node(instance in=reference to "OpenCheck_TempTCouple", "Visible"=TRUE)
            Property Node(instance in=reference to "AutoZero_TempTCouple", "Visible"=TRUE)
            Property Node(instance in=reference to "Reference_TempTCouple", "Visible"=TRUE)
            Property Node(instance in=reference to "Type_TempTCouple", "Visible"=TRUE)
            Property Node(instance in=reference to "Units_TempTCouple", "Visible"=TRUE)
            Property Node(instance in=reference to "String_TempTCouple", "Visible"=TRUE)
          }
        }
        w1 = default
      }
      on "ApertureNPLC_TempRTD4w" Value changed; "ApertureTime_TempRTD4w" Value changed; "Aperture_TempRTD4w" Value changed; "LowPower_TempRTD4w" Value changed; "OffstComp_TempRTD4w" Value changed; "R0_TempRTD4w" Value changed; "Units_TempRTD4w" Value changed {
        Property Node(instance in=reference to "Aperture_TempRTD4w") -> ("Value"=w187)
        Not(x=w187) -> w188
        Property Node(instance in=reference to "ApertureNPLC_TempRTD4w", "Disabled"=w188) -> ("Value"=w189)
        Property Node(instance in=reference to "ApertureTime_TempRTD4w", "Disabled"=w187) -> ("Value"=w190)
        Quotient And Remainder(x=w190, y=2e-06) -> (floor(x/y)=w191, x-y*floor(x/y)=w192)
        Multiply(w192, 1000000) -> w193
        Round To Nearest(number=w193) -> w194
        To Signed 32 Bit Integer(number=w194) -> w195
        case (w195) {
          frame 0, Default {
            Multiply(2e-06, w191) -> w196
          }
          frame 1 {
            Multiply(2e-06, w191) -> w196
          }
          frame 2 {
            Add(1, w191) -> w197
            Multiply(2e-06, w197) -> w196
          }
        }
        case (w187) {
          frame False, Default {
            Format Into String(formatString="%_6ps", initString="Aperture Time: ", w196) -> w198
          }
          frame True {
            Format Into String(formatString="%#gPLC", initString="Aperture NPLC: ", w189) -> w198
          }
        }
        Property Node(instance in=reference to "OffstComp_TempRTD4w") -> ("Value"=w199)
        case (w199) {
          frame False, Default {
            w200 = "OffstComp: Off "
          }
          frame True {
            w200 = "OffstComp: On"
          }
        }
        Property Node(instance in=reference to "Units_TempRTD4w") -> ("Value"=w201)
        case (w201) {
          frame 0, Default {
            w202 = "Units: °C"
          }
          frame 1 {
            w202 = "Units: K"
          }
          frame 2 {
            w202 = "Units: °F"
          }
        }
        Property Node(instance in=reference to "LowPower_TempRTD4w") -> ("Value"=w203)
        case (w203) {
          frame False, Default {
            w204 = "Low Power: Off"
          }
          frame True {
            w204 = "Low Power: On"
          }
        }
        Property Node(instance in=reference to "R0_TempRTD4w") -> ("Value"=w205)
        Quotient And Remainder(x=w205, y=0.0001) -> (floor(x/y)=w206, x-y*floor(x/y)=w207)
        Multiply(w207, 10000) -> w208
        Round To Nearest(number=w208) -> w209
        To Signed 32 Bit Integer(number=w209) -> w210
        case (w210) {
          frame 0, Default {
            Multiply(0.0001, w206) -> w211
          }
          frame 1 {
            Add(1, w206) -> w212
            Multiply(0.0001, w212) -> w211
          }
        }
        Format Into String(formatString="%_7ps", initString="R0: ", w211) -> w213
        Concatenate Strings("Your settings:", "\r\n", w200, "\r\n", w198, "\r\n", w202, "\r\n", w204, "\r\n", w213) -> w214
        $String_TempRTD4w <- w214
        Property Node(instance in=reference to "ApertureTime_TempRTD4w", "Value"=w196)
        Property Node(instance in=reference to "R0_TempRTD4w", "Value"=w211)
        w1 = default
      }
      on "ApertureNPLC_TempRTD2w" Value changed; "ApertureTime_TempRTD2w" Value changed; "Aperture_TempRTD2w" Value changed; "AutoZero_TempRTD2w" Value changed; "LowPower_TempRTD2w" Value changed; "OffstComp_TempRTD2w" Value changed; "R0_TempRTD2w" Value changed; "Units_TempRTD2w" Value changed {
        Property Node(instance in=reference to "Aperture_TempRTD2w") -> ("Value"=w215)
        Not(x=w215) -> w216
        Property Node(instance in=reference to "ApertureNPLC_TempRTD2w", "Disabled"=w216) -> ("Value"=w217)
        Property Node(instance in=reference to "ApertureTime_TempRTD2w", "Disabled"=w215) -> ("Value"=w218)
        Quotient And Remainder(x=w218, y=2e-06) -> (floor(x/y)=w219, x-y*floor(x/y)=w220)
        Multiply(w220, 1000000) -> w221
        Round To Nearest(number=w221) -> w222
        To Signed 32 Bit Integer(number=w222) -> w223
        case (w223) {
          frame 0, Default {
            Multiply(2e-06, w219) -> w224
          }
          frame 1 {
            Multiply(2e-06, w219) -> w224
          }
          frame 2 {
            Add(1, w219) -> w225
            Multiply(2e-06, w225) -> w224
          }
        }
        case (w215) {
          frame False, Default {
            Format Into String(formatString="%_6ps", initString="Aperture Time: ", w224) -> w226
          }
          frame True {
            Format Into String(formatString="%#gPLC", initString="Aperture NPLC: ", w217) -> w226
          }
        }
        Property Node(instance in=reference to "OffstComp_TempRTD2w") -> ("Value"=w227)
        case (w227) {
          frame False, Default {
            w228 = "OffstComp: Off "
          }
          frame True {
            w228 = "OffstComp: On"
          }
        }
        Property Node(instance in=reference to "R0_TempRTD2w") -> ("Value"=w229)
        Quotient And Remainder(x=w229, y=0.0001) -> (floor(x/y)=w230, x-y*floor(x/y)=w231)
        Multiply(w231, 10000) -> w232
        Round To Nearest(number=w232) -> w233
        To Signed 32 Bit Integer(number=w233) -> w234
        case (w234) {
          frame 0, Default {
            Multiply(0.0001, w230) -> w235
          }
          frame 1 {
            Add(1, w230) -> w236
            Multiply(0.0001, w236) -> w235
          }
        }
        Format Into String(formatString="%_6ps", initString="R0: ", w235) -> w237
        Property Node(instance in=reference to "Units_TempRTD2w") -> ("Value"=w238)
        case (w238) {
          frame 0, Default {
            w239 = "Units: °C"
          }
          frame 1 {
            w239 = "Units: K"
          }
          frame 2 {
            w239 = "Units: °F"
          }
        }
        Property Node(instance in=reference to "LowPower_TempRTD2w") -> ("Value"=w240)
        case (w240) {
          frame False, Default {
            w241 = "Low Power: Off"
          }
          frame True {
            w241 = "Low Power: On"
          }
        }
        Property Node(instance in=reference to "AutoZero_TempRTD2w") -> ("Value"=w242)
        case (w242) {
          frame False, Default {
            w243 = "Auto Zero: Off"
          }
          frame True {
            w243 = "Auto Zero: On"
          }
        }
        Concatenate Strings("Your settings:", "\r\n", w228, "\r\n", w226, "\r\n", w239, "\r\n", w241, "\r\n", w243, "\r\n", w237) -> w244
        $String_TempRTD2w <- w244
        Property Node(instance in=reference to "ApertureTime_TempRTD2w", "Value"=w224)
        Property Node(instance in=reference to "R0_TempRTD2w", "Value"=w235)
        w1 = default
      }
      on "ApertureNPLC_TempThermis4w" Value changed; "ApertureTime_TempThermis4w" Value changed; "Aperture_TempThermis4w" Value changed; "LowPower_TempThermis4w" Value changed; "Units_TempThermis4w" Value changed {
        Property Node(instance in=reference to "Aperture_TempThermis4w") -> ("Value"=w245)
        Not(x=w245) -> w246
        Property Node(instance in=reference to "ApertureNPLC_TempThermis4w", "Disabled"=w246) -> ("Value"=w247)
        Property Node(instance in=reference to "ApertureTime_TempThermis4w", "Disabled"=w245) -> ("Value"=w248)
        Quotient And Remainder(x=w248, y=2e-06) -> (floor(x/y)=w249, x-y*floor(x/y)=w250)
        Multiply(w250, 1000000) -> w251
        Round To Nearest(number=w251) -> w252
        To Signed 32 Bit Integer(number=w252) -> w253
        case (w253) {
          frame 0, Default {
            Multiply(2e-06, w249) -> w254
          }
          frame 1 {
            Multiply(2e-06, w249) -> w254
          }
          frame 2 {
            Add(1, w249) -> w255
            Multiply(2e-06, w255) -> w254
          }
        }
        case (w245) {
          frame False, Default {
            Format Into String(formatString="%_6ps", initString="Aperture Time: ", w254) -> w256
          }
          frame True {
            Format Into String(formatString="%#gPLC", initString="Aperture NPLC: ", w247) -> w256
          }
        }
        Property Node(instance in=reference to "Units_TempThermis4w") -> ("Value"=w257)
        case (w257) {
          frame 0, Default {
            w258 = "Units: °C"
          }
          frame 1 {
            w258 = "Units: K"
          }
          frame 2 {
            w258 = "Units: °F"
          }
        }
        Property Node(instance in=reference to "LowPower_TempThermis4w") -> ("Value"=w259)
        case (w259) {
          frame False, Default {
            w260 = "Low Power: Off"
          }
          frame True {
            w260 = "Low Power: On"
          }
        }
        Concatenate Strings("Your settings:", "\r\n", w256, "\r\n", w258, "\r\n", w260) -> w261
        $String_TempThermis4w <- w261
        Property Node(instance in=reference to "ApertureTime_TempThermis4w", "Value"=w254)
        w1 = default
      }
      on "ApertureNPLC_TempThermis2w" Value changed; "ApertureTime_TempThermis2w" Value changed; "Aperture_TempThermis2w" Value changed; "AutoZero_TempThermis2w" Value changed; "LowPower_TempThermis2w" Value changed; "Units_TempThermis2w" Value changed {
        Property Node(instance in=reference to "Aperture_TempThermis2w") -> ("Value"=w262)
        Not(x=w262) -> w263
        Property Node(instance in=reference to "ApertureNPLC_TempThermis2w", "Disabled"=w263) -> ("Value"=w264)
        Property Node(instance in=reference to "ApertureTime_TempThermis2w", "Disabled"=w262) -> ("Value"=w265)
        Quotient And Remainder(x=w265, y=2e-06) -> (floor(x/y)=w266, x-y*floor(x/y)=w267)
        Multiply(w267, 1000000) -> w268
        Round To Nearest(number=w268) -> w269
        To Signed 32 Bit Integer(number=w269) -> w270
        case (w270) {
          frame 0, Default {
            Multiply(2e-06, w266) -> w271
          }
          frame 1 {
            Multiply(2e-06, w266) -> w271
          }
          frame 2 {
            Add(1, w266) -> w272
            Multiply(2e-06, w272) -> w271
          }
        }
        case (w262) {
          frame False, Default {
            Format Into String(formatString="%_6ps", initString="Aperture Time: ", w271) -> w273
          }
          frame True {
            Format Into String(formatString="%#gPLC", initString="Aperture NPLC: ", w264) -> w273
          }
        }
        Property Node(instance in=reference to "Units_TempThermis2w") -> ("Value"=w274)
        case (w274) {
          frame 0, Default {
            w275 = "Units: °C"
          }
          frame 1 {
            w275 = "Units: K"
          }
          frame 2 {
            w275 = "Units: °F"
          }
        }
        Property Node(instance in=reference to "LowPower_TempThermis2w") -> ("Value"=w276)
        case (w276) {
          frame False, Default {
            w277 = "Low Power: Off"
          }
          frame True {
            w277 = "Low Power: On"
          }
        }
        Property Node(instance in=reference to "AutoZero_TempThermis2w") -> ("Value"=w278)
        case (w278) {
          frame False, Default {
            w279 = "Auto Zero: Off"
          }
          frame True {
            w279 = "Auto Zero: On"
          }
        }
        Concatenate Strings("Your settings:", "\r\n", w273, "\r\n", w275, "\r\n", w277, "\r\n", w279) -> w280
        $String_TempThermis2w <- w280
        Property Node(instance in=reference to "ApertureTime_TempThermis2w", "Value"=w271)
        w1 = default
      }
      on "Aperture_TempTCouple" Value changed; "ApertureNPLC_TempTCouple" Value changed; "ApertureTime_TempTCouple" Value changed; "AutoZero_TempTCouple" Value changed; "FixedOffset_TempTCouple" Value changed; "OffsetAdjust_TempTCouple" Value changed; "OpenCheck_TempTCouple" Value changed; "Reference_TempTCouple" Value changed; "Type_TempTCouple" Value changed; "Units_TempTCouple" Value changed {
        Property Node(instance in=reference to "Reference_TempTCouple") -> ("Value"=w281)
        case (w281) {
          frame 0, Default {
            w282 = "Reference: Internal"
            w283 = TRUE
          }
          frame 1 {
            w282 = "Reference: Fixed"
            w283 = FALSE
          }
        }
        Property Node(instance in=reference to "FixedOffset_TempTCouple", "Disabled"=w283) -> ("Value"=w284)
        Quotient And Remainder(x=w284, y=0.01) -> (floor(x/y)=w285, x-y*floor(x/y)=w286)
        Multiply(w286, 100) -> w287
        Round To Nearest(number=w287) -> w288
        To Signed 32 Bit Integer(number=w288) -> w289
        case (w289) {
          frame 0, Default {
            Multiply(0.01, w285) -> w290
          }
          frame 1 {
            Add(1, w285) -> w291
            Multiply(0.01, w291) -> w290
          }
        }
        Not(x=w283) -> w292
        Property Node(instance in=reference to "OffsetAdjust_TempTCouple", "Disabled"=w292) -> ("Value"=w293)
        Quotient And Remainder(x=w293, y=0.01) -> (floor(x/y)=w294, x-y*floor(x/y)=w295)
        Multiply(w295, 100) -> w296
        Round To Nearest(number=w296) -> w297
        To Signed 32 Bit Integer(number=w297) -> w298
        case (w298) {
          frame 0, Default {
            Multiply(0.01, w294) -> w299
          }
          frame 1 {
            Add(1, w294) -> w300
            Multiply(0.01, w300) -> w299
          }
        }
        Property Node(instance in=reference to "FixedOffset_TempTCouple", "Value"=w290) -> ("Disabled"=w301)
        case (w301) {
          frame False, Default {
            Format Into String(formatString="%_4p°C", initString="Fixed Offset: ", w290) -> w302
          }
          frame True {
            Format Into String(formatString="%_4p°C", initString="Offset Adjust: ", w299) -> w302
          }
        }
        Property Node(instance in=reference to "Aperture_TempTCouple") -> ("Value"=w303)
        Not(x=w303) -> w304
        Property Node(instance in=reference to "ApertureNPLC_TempTCouple", "Disabled"=w304) -> ("Value"=w305)
        Property Node(instance in=reference to "ApertureTime_TempTCouple", "Disabled"=w303) -> ("Value"=w306)
        Quotient And Remainder(x=w306, y=2e-06) -> (floor(x/y)=w307, x-y*floor(x/y)=w308)
        Multiply(w308, 1000000) -> w309
        Round To Nearest(number=w309) -> w310
        To Signed 32 Bit Integer(number=w310) -> w311
        case (w311) {
          frame 0, Default {
            Multiply(2e-06, w307) -> w312
          }
          frame 1 {
            Multiply(2e-06, w307) -> w312
          }
          frame 2 {
            Add(1, w307) -> w313
            Multiply(2e-06, w313) -> w312
          }
        }
        case (w303) {
          frame False, Default {
            Format Into String(formatString="%_6ps", initString="Aperture Time: ", w312) -> w314
          }
          frame True {
            Format Into String(formatString="%#gPLC", initString="Aperture NPLC: ", w305) -> w314
          }
        }
        Property Node(instance in=reference to "Type_TempTCouple") -> ("Value"=w315)
        case (w315) {
          frame 0, Default {
            w316 = "Type: J"
          }
          frame 1 {
            w316 = "Type: K"
          }
          frame 2 {
            w316 = "Type: T"
          }
          frame 3 {
            w316 = "Type: E"
          }
          frame 4 {
            w316 = "Type: N"
          }
          frame 5 {
            w316 = "Type: R"
          }
        }
        Property Node(instance in=reference to "Units_TempTCouple") -> ("Value"=w317)
        case (w317) {
          frame 0, Default {
            w318 = "Units: °C"
          }
          frame 1 {
            w318 = "Units: K"
          }
          frame 2 {
            w318 = "Units: °F"
          }
        }
        Property Node(instance in=reference to "OpenCheck_TempTCouple") -> ("Value"=w319)
        case (w319) {
          frame False, Default {
            w320 = "Open Check: Off"
          }
          frame True {
            w320 = "Open Check: On"
          }
        }
        Property Node(instance in=reference to "AutoZero_TempTCouple") -> ("Value"=w321)
        case (w321) {
          frame False, Default {
            w322 = "Auto Zero: Off"
          }
          frame True {
            w322 = "Auto Zero: On"
          }
        }
        Concatenate Strings("Your settings:", "\r\n", w316, "\r\n", w314, "\r\n", w318, "\r\n", w320, "\r\n", w322, "\r\n", w282, "\r\n", w302) -> w323
        $String_TempTCouple <- w323
        Property Node(instance in=reference to "ApertureTime_TempTCouple", "Value"=w312)
        Property Node(instance in=reference to "OffsetAdjust_TempTCouple", "Value"=w299)
        w1 = default
      }
      on "stop" Value changed; "Window" Close {
        w1 = TRUE
      }
    }
    # DCC CONTROLS/INDICATORS
    # ACC CONTROLS/INDICATORS
    # MAIN CONTROLS/INDICATORS
    $VoltageDC_indicator <- $VoltageDC_control
    # DCV CONTROLS/INDICATORS
    # DCVR CONTROLS/INDICATORS
    # CAPACI CONTROLS/INDICATORS
    # CONT CONTROLS/INDICATORS
    # DIODE CONTROLS/INDICATORS
    # TEMPPROBE CONTROL
    # TEMPRTD4W CONTROLS/INDICATORS
    # TEMPRTD2W CONTROLS/INDICATORS
    # TEMPTHERMIS4W CONTROLS/INDICATORS
    # TEMPTHERMIS2W CONTROLS/INDICATORS
    # TEMPTCOUPLE CONTROLS/INDICATORS
    $VoltageAC_indicator <- $VoltageAC_control
    $CurrentDC_indicator <- $CurrentDC_control
    $CurrentAC_indicator <- $CurrentAC_control
    $"2WResistance_indicator" <- $"2WResistance_control"
    $"4WResistance_indicator" <- $"4WResistance_control"
    $Frequency_indicator <- $Frequency_control
    $Capacitance_indicator <- $Capacitance_control
    # PERIOD CONTROLS/INDICATORS
    $Continuity_indicator <- $Continuity_control
    $Diode_indicator <- $Diode_control
    $Temperature_indicator <- $Temperature_control
    stop if w1
  }
  Property Node(instance in=reference to unnamed text, "Visible"=FALSE)
  Property Node(instance in=reference to unnamed text, "Visible"=FALSE)
  Property Node(instance in=reference to unnamed text, "Visible"=FALSE)
  Property Node(instance in=reference to unnamed text, "Visible"=FALSE)
  Property Node(instance in=reference to unnamed text, "Visible"=FALSE)
  Property Node(instance in=reference to unnamed text, "Visible"=FALSE)
  Property Node(instance in=reference to unnamed text, "Visible"=FALSE)
  Property Node(instance in=reference to unnamed text, "Visible"=FALSE)
  Property Node(instance in=reference to unnamed text, "Visible"=FALSE)
  Property Node(instance in=reference to unnamed text, "Visible"=FALSE)

