vi "DCVR_nowekontrolki.gvi"   [LabVIEW NXG 5.1.0]
panel controls:
  "VoltageDC_control": bool
  "VoltageAC_control": bool
  "CurrentDC_control": bool
  "CurrentAC_control": bool
  "stop": bool
  "Auto Range": bool = TRUE
  "Auto Zero": bool = TRUE
  "DCV Ratio_toenable": bool
  "Aperture NPLC": f64 = "10 PLC"(10)
  "Aperture Time": f64 = 0.1
  "Aperture": bool = TRUE
  "Manual Range": f64 = "1 V"(1)
  "DCV Ratio_todisable": bool
  "Manual Range_DCVRatio": f64 = "1 V"(1)
  "Aperture NPLC_DCVRatio": f64 = "10 PLC"(10)
panel indicators:
  "VoltageDC_indicator": bool
  "VoltageAC_indicator": bool
  "CurrentDC_indicator": bool
  "CurrentAC_indicator": bool
  "Auto Impedance": bool
  "DIG Option On/Off": bool
  "DCVoltage_string": string
  "Auto Range_DCVRatio": bool
  "Aperture_DCVRatio": bool
  "Aperture Time_DCVRatio": f64
  "Auto Impedance_DCVRatio": bool
  "DIG Option On/Off_DCVRatio": bool
  "DCVoltageRatio_string": string
diagram:
  Property Node(instance in=reference to "CurrentAC_indicator", "Visible"=FALSE, "Disabled"=FALSE)
  $"Auto Range" <- TRUE
  $"Auto Zero" <- TRUE
  Property Node(instance in=reference to "CurrentDC_control", "Visible"=TRUE, "Disabled"=FALSE)
  $"DIG Option On/Off" <- TRUE
  $"DCV Ratio_toenable" <- FALSE
  Property Node(instance in=reference to "CurrentAC_control", "Visible"=TRUE, "Disabled"=FALSE)
  Property Node(instance in=reference to "CurrentDC_indicator", "Visible"=FALSE)
  Property Node(instance in=reference to "VoltageAC_control", "Visible"=TRUE, "Disabled"=FALSE)
  $VoltageAC_control <- FALSE
  $VoltageDC_control <- FALSE
  $CurrentDC_control <- FALSE
  $CurrentAC_control <- FALSE
  Property Node(instance in=reference to "Auto Range", "Visible"=FALSE)
  Property Node(instance in=reference to "DCVoltage_string", "Visible"=FALSE)
  Property Node(instance in=reference to "Auto Zero", "Visible"=FALSE)
  Property Node(instance in=reference to unnamed text, "Visible"=TRUE)
  Property Node(instance in=reference to "VoltageDC_indicator", "Visible"=FALSE)
  Property Node(instance in=reference to "Aperture", "Visible"=FALSE)
  $"Auto Range_DCVRatio" <- TRUE
  Property Node(instance in=reference to unnamed text, "Visible"=FALSE)
  Property Node(instance in=reference to unnamed text, "Visible"=FALSE)
  Property Node(instance in=reference to "Manual Range", "Visible"=FALSE)
  Property Node(instance in=reference to unnamed text, "Visible"=FALSE)
  Property Node(instance in=reference to "Aperture NPLC", "Visible"=FALSE)
  Property Node(instance in=reference to "Auto Impedance_DCVRatio", "Visible"=FALSE)
  Property Node(instance in=reference to "Aperture Time_DCVRatio", "Visible"=FALSE)
  Property Node(instance in=reference to "VoltageAC_indicator", "Visible"=FALSE)
  Property Node(instance in=reference to "Aperture NPLC_DCVRatio", "Visible"=FALSE)
  Property Node(instance in=reference to "Auto Range_DCVRatio", "Visible"=FALSE)
  Property Node(instance in=reference to "DCV Ratio_toenable", "Visible"=FALSE)
  Property Node(instance in=reference to "Aperture_DCVRatio", "Visible"=FALSE)
  Property Node(instance in=reference to "VoltageDC_control", "Visible"=TRUE, "Disabled"=FALSE)
  Property Node(instance in=reference to "Manual Range_DCVRatio", "Visible"=FALSE)
  Property Node(instance in=reference to "DCVoltageRatio_string", "Visible"=FALSE)
  Property Node(instance in=reference to unnamed text, "Visible"=FALSE)
  $Aperture_DCVRatio <- TRUE
  Property Node(instance in=reference to "DIG Option On/Off", "Visible"=FALSE)
  Property Node(instance in=reference to "DIG Option On/Off_DCVRatio", "Visible"=FALSE)
  Property Node(instance in=reference to "Aperture Time", "Visible"=FALSE)
  Property Node(instance in=reference to "DCV Ratio_todisable", "Visible"=FALSE)
  $Aperture <- TRUE
  $stop <- FALSE
  $"DIG Option On/Off_DCVRatio" <- TRUE
  $"Auto Impedance_DCVRatio" <- FALSE
  Property Node(instance in=reference to "Auto Impedance", "Visible"=FALSE)
  $"DCV Ratio_todisable" <- FALSE
  $"DCV Ratio_toenable" <- FALSE
  $"Auto Impedance" <- FALSE
  while {
    event {
      on "VoltageDC_control" Value changed {
        Property Node(instance in=reference to unnamed text, "Visible"=TRUE)
        Event Data() -> ("Old Value"=w2, "New Value"=w3)
        Property Node(instance in=reference to "VoltageAC_indicator", "Visible"=w2)
        Property Node(instance in=reference to "CurrentDC_indicator", "Visible"=w2)
        Property Node(instance in=reference to "DCV Ratio_todisable", "Visible"=FALSE)
        Property Node(instance in=reference to "CurrentAC_indicator", "Visible"=w2)
        Property Node(instance in=reference to "CurrentAC_control", "Visible"=w3, "Value"=FALSE)
        Property Node(instance in=reference to "CurrentDC_control", "Visible"=w3, "Value"=FALSE)
        Property Node(instance in=reference to "VoltageDC_indicator", "Visible"=w3)
        Property Node(instance in=reference to "VoltageAC_control", "Visible"=w3, "Value"=FALSE)
        Property Node(instance in=reference to "VoltageDC_control", "Visible"=w2)
        Property Node(instance in=reference to "Manual Range", "Visible"=TRUE)
        Property Node(instance in=reference to "Auto Impedance", "Visible"=TRUE)
        Property Node(instance in=reference to "DCVoltage_string", "Visible"=TRUE)
        Property Node(instance in=reference to "Auto Zero", "Visible"=TRUE)
        Property Node(instance in=reference to "Aperture", "Visible"=TRUE)
        Property Node(instance in=reference to "Aperture Time", "Visible"=TRUE)
        Property Node(instance in=reference to unnamed text, "Visible"=FALSE)
        Property Node(instance in=reference to unnamed text, "Visible"=FALSE)
        Property Node(instance in=reference to unnamed text, "Visible"=FALSE)
        Property Node(instance in=reference to "Aperture NPLC", "Visible"=TRUE)
        Property Node(instance in=reference to "DIG Option On/Off", "Visible"=TRUE)
        Property Node(instance in=reference to "DCV Ratio_toenable", "Visible"=TRUE)
        Property Node(instance in=reference to "Auto Range", "Visible"=TRUE)
        w1 = default
      }
      on "VoltageAC_control" Value changed {
        Property Node(instance in=reference to "Aperture", "Visible"=FALSE)
        Event Data() -> ("Old Value"=w4, "New Value"=w5)
        Property Node(instance in=reference to "VoltageAC_indicator", "Visible"=w5)
        Property Node(instance in=reference to "CurrentAC_indicator", "Visible"=w4)
        Property Node(instance in=reference to "CurrentDC_control", "Visible"=w5, "Value"=FALSE)
        Property Node(instance in=reference to "VoltageDC_indicator", "Visible"=w4)
        Property Node(instance in=reference to "VoltageDC_control", "Visible"=w5, "Value"=FALSE)
        Property Node(instance in=reference to unnamed text, "Visible"=w5)
        Property Node(instance in=reference to "CurrentAC_control", "Visible"=w5, "Value"=FALSE)
        Property Node(instance in=reference to "VoltageAC_control", "Visible"=w4)
        Property Node(instance in=reference to "CurrentDC_indicator", "Visible"=w4)
        Property Node(instance in=reference to "DCV Ratio_toenable", "Visible"=FALSE)
        Property Node(instance in=reference to "Auto Impedance", "Visible"=FALSE)
        Property Node(instance in=reference to "DCVoltage_string", "Visible"=FALSE)
        Property Node(instance in=reference to "Auto Zero", "Visible"=FALSE)
        Property Node(instance in=reference to "Manual Range", "Visible"=FALSE)
        Property Node(instance in=reference to "Aperture Time", "Visible"=FALSE)
        Property Node(instance in=reference to unnamed text, "Visible"=FALSE)
        Property Node(instance in=reference to "Aperture NPLC", "Visible"=FALSE)
        Property Node(instance in=reference to "DIG Option On/Off", "Visible"=FALSE)
        Property Node(instance in=reference to unnamed text, "Visible"=FALSE)
        Property Node(instance in=reference to unnamed text, "Visible"=FALSE)
        Property Node(instance in=reference to "Auto Range", "Visible"=FALSE)
        w1 = default
      }
      on "CurrentDC_control" Value changed {
        Event Data() -> ("Old Value"=w6, "New Value"=w7)
        Property Node(instance in=reference to "CurrentDC_control", "Visible"=w6)
        Property Node(instance in=reference to "VoltageDC_indicator", "Visible"=w6)
        Property Node(instance in=reference to "CurrentAC_indicator", "Visible"=w6)
        Property Node(instance in=reference to "VoltageDC_control", "Visible"=w7, "Value"=FALSE)
        Property Node(instance in=reference to "VoltageAC_control", "Visible"=w7, "Value"=FALSE)
        Property Node(instance in=reference to "VoltageAC_indicator", "Visible"=w6)
        Property Node(instance in=reference to "CurrentDC_indicator", "Visible"=w7)
        Property Node(instance in=reference to "CurrentAC_control", "Visible"=w7, "Value"=FALSE)
        w1 = default
      }
      on "CurrentAC_control" Value changed {
        Event Data() -> ("Old Value"=w8, "New Value"=w9)
        Property Node(instance in=reference to "CurrentDC_control", "Visible"=w9, "Value"=FALSE)
        Property Node(instance in=reference to "VoltageAC_control", "Visible"=w9, "Value"=FALSE)
        Property Node(instance in=reference to "CurrentAC_control", "Visible"=w8)
        Property Node(instance in=reference to "VoltageDC_control", "Visible"=w9, "Value"=FALSE)
        Property Node(instance in=reference to "CurrentAC_indicator", "Visible"=w9)
        Property Node(instance in=reference to "CurrentDC_indicator", "Visible"=w8)
        Property Node(instance in=reference to "VoltageAC_indicator", "Visible"=w8)
        Property Node(instance in=reference to "VoltageDC_indicator", "Visible"=w8)
        w1 = default
      }
      on "Aperture" Value changed; "Aperture NPLC" Value changed; "Aperture Time" Value changed; "Auto Impedance" Value changed; "Auto Range" Value changed; "Auto Zero" Value changed; "DIG Option On/Off" Value changed; "Manual Range" Value changed {
        Property Node(instance in=reference to "Aperture") -> ("Value"=w10)
        Property Node(instance in=reference to "DIG Option On/Off") -> ("Value"=w11)
        case (w11) {
          frame False, Default {
            w12 = [0, 1, 2]
          }
          frame True {
            w12 = i32[] []
          }
        }
        Not(x=w10) -> w13
        Property Node(instance in=reference to "Aperture NPLC", "Disabled"=w13, "DisabledIndexes"=w12) -> ("Value"=w14)
        case (w11) {
          frame False, Default {
            w15 = 0.0002
          }
          frame True {
            w15 = 2e-05
          }
        }
        Property Node(instance in=reference to "Aperture Time", "Disabled"=w10, "Minimum"=w15) -> ("Value"=w16)
        Quotient And Remainder(x=w16, y=2e-06) -> (floor(x/y)=w17, x-y*floor(x/y)=w18)
        Multiply(w18, 1000000) -> w19
        Round To Nearest(number=w19) -> w20
        To Signed 32 Bit Integer(number=w20) -> w21
        case (w21) {
          frame 0, Default {
            Multiply(2e-06, w17) -> w22
          }
          frame 1 {
            Multiply(2e-06, w17) -> w22
          }
          frame 2 {
            Add(1, w17) -> w23
            Multiply(2e-06, w23) -> w22
          }
        }
        case (w10) {
          frame False, Default {
            Format Into String(formatString="%_6ps", initString="Aperture Time: ", w22) -> w24
          }
          frame True {
            Format Into String(formatString="%#gPLC", initString="Aperture NPLC: ", w14) -> w24
          }
        }
        Property Node(instance in=reference to "DCV Ratio_toenable") -> ("Value"=w25)
        case (w25) {
          frame False, Default {
            w26 = "DCV Ratio: Off"
          }
          frame True {
            $"Auto Zero" <- TRUE
            w26 = "DCV Ratio: On"
          }
        }
        Property Node(instance in=reference to "Auto Range") -> ("Value"=w27)
        Property Node(instance in=reference to "Manual Range", "Disabled"=w27) -> ("Value"=w28)
        case (w27) {
          frame False, Default {
            Format Into String(formatString="%.0pV", initString="Range: ", w28) -> w29
          }
          frame True {
            w29 = "Range: Auto"
          }
        }
        Property Node(instance in=reference to "Auto Impedance") -> ("Value"=w30)
        case (w30) {
          frame False, Default {
            w31 = "Input Z: 10MΩ"
          }
          frame True {
            w31 = "Input Z: Auto"
          }
        }
        Property Node(instance in=reference to "Auto Zero", "Disabled"=w25) -> ("Value"=w32)
        case (w32) {
          frame False, Default {
            w33 = "Auto Zero: Off"
          }
          frame True {
            w33 = "Auto Zero: On"
          }
        }
        Concatenate Strings("Your settings:", "\r\n", w29, "\r\n", w24, "\r\n", w33, "\r\n", w31, "\r\n", w26) -> w34
        $DCVoltage_string <- w34
        Property Node(instance in=reference to "Aperture Time", "Value"=w22)
        Not(x=w25) -> w35
        Property Node(instance in=reference to unnamed text, "Visible"=w35)
        Property Node(instance in=reference to unnamed text, "Visible"=w25)
        w1 = default
      }
      on "stop" Value changed; "Window" Close {
        w1 = TRUE
      }
      on "DCV Ratio_toenable" Value changed {
        Property Node(instance in=reference to "Aperture Time_DCVRatio", "Visible"=TRUE)
        Property Node(instance in=reference to "Auto Range_DCVRatio", "Visible"=TRUE)
        Event Data() -> ("New Value"=w36)
        Property Node(instance in=reference to "DCV Ratio_todisable", "Value"=w36, "Visible"=w36)
        Property Node(instance in=reference to "Manual Range_DCVRatio", "Visible"=TRUE)
        Property Node(instance in=reference to unnamed text, "Visible"=TRUE)
        Property Node(instance in=reference to "Aperture", "Visible"=FALSE)
        Property Node(instance in=reference to "DCVoltageRatio_string", "Visible"=TRUE)
        Property Node(instance in=reference to "DCV Ratio_toenable", "Visible"=FALSE)
        Property Node(instance in=reference to "Auto Impedance", "Visible"=FALSE)
        Property Node(instance in=reference to "DCVoltage_string", "Visible"=FALSE)
        Property Node(instance in=reference to "Auto Zero", "Visible"=FALSE)
        Property Node(instance in=reference to "Manual Range", "Visible"=FALSE)
        Property Node(instance in=reference to "Aperture Time", "Visible"=FALSE)
        Property Node(instance in=reference to unnamed text, "Visible"=FALSE)
        Property Node(instance in=reference to "Aperture NPLC", "Visible"=FALSE)
        Property Node(instance in=reference to "DIG Option On/Off", "Visible"=FALSE)
        Property Node(instance in=reference to unnamed text, "Visible"=FALSE)
        Property Node(instance in=reference to unnamed text, "Visible"=FALSE)
        Property Node(instance in=reference to "Auto Range", "Visible"=FALSE)
        Property Node(instance in=reference to "Auto Impedance_DCVRatio", "Visible"=TRUE)
        Property Node(instance in=reference to "Aperture NPLC_DCVRatio", "Visible"=TRUE)
        Property Node(instance in=reference to "Aperture_DCVRatio", "Visible"=TRUE)
        w1 = default
      }
      on "Aperture NPLC_DCVRatio" Value changed; "Aperture Time_DCVRatio" Value changed; "Aperture_DCVRatio" Value changed; "Auto Impedance_DCVRatio" Value changed; "Auto Range_DCVRatio" Value changed; "DIG Option On/Off_DCVRatio" Value changed; "Manual Range_DCVRatio" Value changed {
        Property Node(instance in=reference to "Aperture_DCVRatio") -> ("Value"=w37)
        Property Node(instance in=reference to "DIG Option On/Off_DCVRatio") -> ("Value"=w38)
        case (w38) {
          frame False, Default {
            w39 = [0, 1, 2]
          }
          frame True {
            w39 = i32[] []
          }
        }
        Not(x=w37) -> w40
        Property Node(instance in=reference to "Aperture NPLC_DCVRatio", "Disabled"=w40, "DisabledIndexes"=w39) -> ("Value"=w41)
        case (w38) {
          frame False, Default {
            w42 = 0.0002
          }
          frame True {
            w42 = 2e-05
          }
        }
        Property Node(instance in=reference to "Aperture Time_DCVRatio", "Disabled"=w37, "Minimum"=w42) -> ("Value"=w43)
        Quotient And Remainder(x=w43, y=2e-06) -> (floor(x/y)=w44, x-y*floor(x/y)=w45)
        Multiply(w45, 1000000) -> w46
        Round To Nearest(number=w46) -> w47
        To Signed 32 Bit Integer(number=w47) -> w48
        case (w48) {
          frame 0, Default {
            Multiply(2e-06, w44) -> w49
          }
          frame 1 {
            Multiply(2e-06, w44) -> w49
          }
          frame 2 {
            Add(1, w44) -> w50
            Multiply(2e-06, w50) -> w49
          }
        }
        case (w37) {
          frame False, Default {
            Format Into String(formatString="%_6ps", initString="Aperture Time: ", w49) -> w51
          }
          frame True {
            Format Into String(formatString="%#gPLC", initString="Aperture NPLC: ", w41) -> w51
          }
        }
        Property Node(instance in=reference to "Auto Range_DCVRatio") -> ("Value"=w52)
        Property Node(instance in=reference to "Manual Range_DCVRatio", "Disabled"=w52) -> ("Value"=w53)
        case (w52) {
          frame False, Default {
            Format Into String(formatString="%.0pV", initString="Range: ", w53) -> w54
          }
          frame True {
            w54 = "Range: Auto"
          }
        }
        Property Node(instance in=reference to "Auto Impedance_DCVRatio") -> ("Value"=w55)
        case (w55) {
          frame False, Default {
            w56 = "Input Z: 10MΩ"
          }
          frame True {
            w56 = "Input Z: Auto"
          }
        }
        Concatenate Strings("Your settings:", "\r\n", w54, "\r\n", w51, "\r\n", "Auto Zero cannot be disabled during DCV Ratio", "\r\n", w56, "\r\n", "DCV Ratio: On") -> w57
        $DCVoltageRatio_string <- w57
        Property Node(instance in=reference to "Aperture Time_DCVRatio", "Value"=w49)
        w1 = default
      }
    }
    $VoltageDC_indicator <- $VoltageDC_control
    $CurrentAC_indicator <- $CurrentAC_control
    $CurrentDC_indicator <- $CurrentDC_control
    $VoltageAC_indicator <- $VoltageAC_control
    stop if w1
  }
