vi "DZIALA.gvi"   [LabVIEW NXG 5.1.0]
panel controls:
  "1c": bool
  "2c": bool
  "3c": bool
  "4c": bool
  "stop": bool
diagram:
  Property Node(instance in=reference to "3c", "Disabled"=FALSE)
  Property Node(instance in=reference to "4c", "Disabled"=FALSE)
  Property Node(instance in=reference to "2c", "Disabled"=FALSE)
  $"2c" <- FALSE
  $"1c" <- FALSE
  $"3c" <- FALSE
  $"4c" <- FALSE
  Property Node(instance in=reference to "1c", "Disabled"=FALSE)
  while {
    event {
      on "1c" Value changed {
        Event Data() -> ("Old Value"=w1, "New Value"=w2)
        Property Node(instance in=reference to "4c", "Disabled"=w1, "Value"=FALSE)
        Property Node(instance in=reference to "3c", "Disabled"=w1, "Value"=FALSE)
        Property Node(instance in=reference to "2c", "Disabled"=w1, "Value"=FALSE)
        Property Node(instance in=reference to "1c", "Disabled"=w2)
      }
      on "2c" Value changed {
        Event Data() -> ("Old Value"=w3, "New Value"=w4)
        Property Node(instance in=reference to "4c", "Disabled"=w3, "Value"=FALSE)
        Property Node(instance in=reference to "3c", "Disabled"=w3, "Value"=FALSE)
        Property Node(instance in=reference to "1c", "Disabled"=w3, "Value"=FALSE)
        Property Node(instance in=reference to "2c", "Disabled"=w4)
      }
      on "3c" Value changed {
        Event Data() -> ("Old Value"=w5, "New Value"=w6)
        Property Node(instance in=reference to "1c", "Disabled"=w5, "Value"=FALSE)
        Property Node(instance in=reference to "4c", "Disabled"=w5, "Value"=FALSE)
        Property Node(instance in=reference to "2c", "Disabled"=w5, "Value"=FALSE)
        Property Node(instance in=reference to "3c", "Disabled"=w6)
      }
      on "4c" Value changed {
        Event Data() -> ("Old Value"=w7, "New Value"=w8)
        Property Node(instance in=reference to "1c", "Disabled"=w7, "Value"=FALSE)
        Property Node(instance in=reference to "3c", "Disabled"=w7, "Value"=FALSE)
        Property Node(instance in=reference to "2c", "Disabled"=w7, "Value"=FALSE)
        Property Node(instance in=reference to "4c", "Disabled"=w8)
      }
    }
    stop if $stop
  }
