vi "DZIALAALEDASIELEPIEJ.gvi"   [LabVIEW NXG 5.1.0]
panel controls:
  "VoltageDC_control": bool
  "VoltageAC_control": bool
  "CurrentDC_control": bool
  "CurrentAC_control": bool
  "stop": bool
  "Auto Range": bool = TRUE
  "Auto Zero": bool = TRUE
  "Aperture NPLC": f64 = "10 PLC"(10)
  "Aperture Time": f64 = 0.1
  "Aperture": bool = TRUE
  "Manual Range": f64 = "1 V"(1)
panel indicators:
  "VoltageDC_indicator": bool
  "VoltageAC_indicator": bool
  "CurrentDC_indicator": bool
  "CurrentAC_indicator": bool
  "DCV Ratio": bool
  "Auto Impedance": bool
  "DIG Option On/Off": bool
  "concatenated string_2": string
diagram:
  Property Node(instance in=reference to "CurrentAC_indicator", "Visible"=FALSE, "Disabled"=FALSE)
  $"Auto Range" <- TRUE
  $"Auto Zero" <- TRUE
  Property Node(instance in=reference to "CurrentDC_control", "Visible"=TRUE, "Disabled"=FALSE)
  $"DIG Option On/Off" <- TRUE
  $"DCV Ratio" <- FALSE
  Property Node(instance in=reference to "CurrentAC_control", "Visible"=TRUE, "Disabled"=FALSE)
  Property Node(instance in=reference to "CurrentDC_indicator", "Visible"=FALSE)
  Property Node(instance in=reference to "VoltageAC_control", "Visible"=TRUE, "Disabled"=FALSE)
  $VoltageAC_control <- FALSE
  $VoltageDC_control <- FALSE
  $CurrentDC_control <- FALSE
  $CurrentAC_control <- FALSE
  Property Node(instance in=reference to "Auto Range", "Visible"=FALSE)
  Property Node(instance in=reference to "concatenated string_2", "Visible"=FALSE)
  Property Node(instance in=reference to "Auto Zero", "Visible"=FALSE)
  Property Node(instance in=reference to unnamed text, "Visible"=TRUE)
  Property Node(instance in=reference to "VoltageDC_indicator", "Visible"=FALSE)
  Property Node(instance in=reference to "Aperture", "Visible"=FALSE)
  Property Node(instance in=reference to unnamed text, "Visible"=FALSE)
  Property Node(instance in=reference to unnamed text, "Visible"=FALSE)
  Property Node(instance in=reference to "Manual Range", "Visible"=FALSE)
  Property Node(instance in=reference to unnamed text, "Visible"=FALSE)
  Property Node(instance in=reference to "Aperture NPLC", "Visible"=FALSE)
  Property Node(instance in=reference to "VoltageAC_indicator", "Visible"=FALSE)
  Property Node(instance in=reference to "DCV Ratio", "Visible"=FALSE)
  Property Node(instance in=reference to "VoltageDC_control", "Visible"=TRUE, "Disabled"=FALSE)
  Property Node(instance in=reference to unnamed text, "Visible"=FALSE)
  Property Node(instance in=reference to "DIG Option On/Off", "Visible"=FALSE)
  Property Node(instance in=reference to "Aperture Time", "Visible"=FALSE)
  $Aperture <- TRUE
  $stop <- FALSE
  Property Node(instance in=reference to "Auto Impedance", "Visible"=FALSE)
  $"DCV Ratio" <- FALSE
  $"Auto Impedance" <- FALSE
  while {
    $CurrentAC_indicator <- $CurrentAC_control
    event {
      on "VoltageDC_control" Value changed {
        Property Node(instance in=reference to unnamed text, "Visible"=TRUE)
        Event Data() -> ("Old Value"=w2, "New Value"=w3)
        Property Node(instance in=reference to "CurrentDC_control", "Visible"=w3, "Value"=FALSE)
        Property Node(instance in=reference to "VoltageDC_control", "Visible"=w2)
        Property Node(instance in=reference to "CurrentAC_control", "Visible"=w3, "Value"=FALSE)
        Property Node(instance in=reference to "VoltageDC_indicator", "Visible"=w3)
        Property Node(instance in=reference to "CurrentDC_indicator", "Visible"=w2)
        Property Node(instance in=reference to "VoltageAC_control", "Visible"=w3, "Value"=FALSE)
        Property Node(instance in=reference to "VoltageAC_indicator", "Visible"=w2)
        Property Node(instance in=reference to "CurrentAC_indicator", "Visible"=w2)
        Property Node(instance in=reference to "Manual Range", "Visible"=TRUE)
        Property Node(instance in=reference to "Aperture NPLC", "Visible"=TRUE)
        Property Node(instance in=reference to "Aperture Time", "Visible"=TRUE)
        Property Node(instance in=reference to "concatenated string_2", "Visible"=TRUE)
        Property Node(instance in=reference to "Auto Range", "Visible"=TRUE)
        Property Node(instance in=reference to "DCV Ratio", "Visible"=TRUE)
        Property Node(instance in=reference to "Auto Impedance", "Visible"=TRUE)
        Property Node(instance in=reference to "Auto Zero", "Visible"=TRUE)
        Property Node(instance in=reference to "DIG Option On/Off", "Visible"=TRUE)
        Property Node(instance in=reference to unnamed text, "Visible"=FALSE)
        Property Node(instance in=reference to unnamed text, "Visible"=FALSE)
        Property Node(instance in=reference to unnamed text, "Visible"=FALSE)
        Property Node(instance in=reference to "Aperture", "Visible"=TRUE)
        w1 = default
      }
      on "VoltageAC_control" Value changed {
        Property Node(instance in=reference to "Aperture", "Visible"=FALSE)
        Event Data() -> ("Old Value"=w4, "New Value"=w5)
        Property Node(instance in=reference to "VoltageDC_control", "Visible"=w5, "Value"=FALSE)
        Property Node(instance in=reference to unnamed text, "Visible"=w5)
        Property Node(instance in=reference to "VoltageAC_control", "Visible"=w4)
        Property Node(instance in=reference to "CurrentAC_control", "Visible"=w5, "Value"=FALSE)
        Property Node(instance in=reference to "CurrentDC_indicator", "Visible"=w4)
        Property Node(instance in=reference to "CurrentDC_control", "Visible"=w5, "Value"=FALSE)
        Property Node(instance in=reference to "CurrentAC_indicator", "Visible"=w4)
        Property Node(instance in=reference to "VoltageDC_indicator", "Visible"=w4)
        Property Node(instance in=reference to "VoltageAC_indicator", "Visible"=w5)
        Property Node(instance in=reference to "DCV Ratio", "Visible"=FALSE)
        Property Node(instance in=reference to "Aperture NPLC", "Visible"=FALSE)
        Property Node(instance in=reference to "Aperture Time", "Visible"=FALSE)
        Property Node(instance in=reference to "concatenated string_2", "Visible"=FALSE)
        Property Node(instance in=reference to "Auto Range", "Visible"=FALSE)
        Property Node(instance in=reference to unnamed text, "Visible"=FALSE)
        Property Node(instance in=reference to "Auto Impedance", "Visible"=FALSE)
        Property Node(instance in=reference to "Auto Zero", "Visible"=FALSE)
        Property Node(instance in=reference to "DIG Option On/Off", "Visible"=FALSE)
        Property Node(instance in=reference to unnamed text, "Visible"=FALSE)
        Property Node(instance in=reference to unnamed text, "Visible"=FALSE)
        Property Node(instance in=reference to "Manual Range", "Visible"=FALSE)
        w1 = default
      }
      on "CurrentDC_control" Value changed {
        Event Data() -> ("Old Value"=w6, "New Value"=w7)
        Property Node(instance in=reference to "VoltageAC_control", "Visible"=w7, "Value"=FALSE)
        Property Node(instance in=reference to "VoltageAC_indicator", "Visible"=w6)
        Property Node(instance in=reference to "VoltageDC_indicator", "Visible"=w6)
        Property Node(instance in=reference to "VoltageDC_control", "Visible"=w7, "Value"=FALSE)
        Property Node(instance in=reference to "CurrentAC_control", "Visible"=w7, "Value"=FALSE)
        Property Node(instance in=reference to "CurrentDC_indicator", "Visible"=w7)
        Property Node(instance in=reference to "CurrentDC_control", "Visible"=w6)
        Property Node(instance in=reference to "CurrentAC_indicator", "Visible"=w6)
        w1 = default
      }
      on "CurrentAC_control" Value changed {
        Event Data() -> ("Old Value"=w8, "New Value"=w9)
        Property Node(instance in=reference to "CurrentDC_indicator", "Visible"=w8)
        Property Node(instance in=reference to "VoltageDC_indicator", "Visible"=w8)
        Property Node(instance in=reference to "VoltageDC_control", "Visible"=w9, "Value"=FALSE)
        Property Node(instance in=reference to "CurrentDC_control", "Visible"=w9, "Value"=FALSE)
        Property Node(instance in=reference to "CurrentAC_indicator", "Visible"=w9)
        Property Node(instance in=reference to "VoltageAC_control", "Visible"=w9, "Value"=FALSE)
        Property Node(instance in=reference to "VoltageAC_indicator", "Visible"=w8)
        Property Node(instance in=reference to "CurrentAC_control", "Visible"=w8)
        w1 = default
      }
      on "Aperture" Value changed; "Aperture NPLC" Value changed; "Aperture Time" Value changed; "Auto Impedance" Value changed; "Auto Range" Value changed; "Auto Zero" Value changed; "DCV Ratio" Value changed; "DIG Option On/Off" Value changed; "Manual Range" Value changed {
        Property Node(instance in=reference to "DIG Option On/Off") -> ("Value"=w10)
        case (w10) {
          frame False, Default {
            w11 = 0.0002
          }
          frame True {
            w11 = 2e-05
          }
        }
        Property Node(instance in=reference to "Aperture") -> ("Value"=w12)
        Property Node(instance in=reference to "Aperture Time", "Disabled"=w12, "Minimum"=w11) -> ("Value"=w13)
        Quotient And Remainder(x=w13, y=2e-06) -> (floor(x/y)=w14, x-y*floor(x/y)=w15)
        Multiply(w15, 1000000) -> w16
        Round To Nearest(number=w16) -> w17
        To Signed 32 Bit Integer(number=w17) -> w18
        case (w18) {
          frame 0, Default {
            Multiply(2e-06, w14) -> w19
          }
          frame 1 {
            Multiply(2e-06, w14) -> w19
          }
          frame 2 {
            Add(1, w14) -> w20
            Multiply(2e-06, w20) -> w19
          }
        }
        $"Aperture Time" <- w19
        case (w10) {
          frame False, Default {
            w21 = [0, 1, 2]
          }
          frame True {
            w21 = i32[] []
          }
        }
        Not(x=w12) -> w22
        Property Node(instance in=reference to "Aperture NPLC", "Disabled"=w22, "DisabledIndexes"=w21) -> ("Value"=w23)
        case (w12) {
          frame False, Default {
            Format Into String(formatString="%_6ps", initString="Aperture Time: ", w19) -> w24
          }
          frame True {
            Format Into String(formatString="%#gPLC", initString="Aperture NPLC: ", w23) -> w24
          }
        }
        Property Node(instance in=reference to "DCV Ratio") -> ("Value"=w25)
        case (w25) {
          frame False, Default {
            w26 = "DCV Ratio: Off"
          }
          frame True {
            $"Auto Zero" <- TRUE
            w26 = "DCV Ratio: On"
          }
        }
        Property Node(instance in=reference to "Auto Range") -> ("Value"=w27)
        Property Node(instance in=reference to "Manual Range", "Disabled"=w27) -> ("Value"=w28)
        case (w27) {
          frame False, Default {
            Format Into String(formatString="%.0pV", initString="Range: ", w28) -> w29
          }
          frame True {
            w29 = "Range: Auto"
          }
        }
        Property Node(instance in=reference to "Auto Impedance") -> ("Value"=w30)
        case (w30) {
          frame False, Default {
            w31 = "Input Z: 10MΩ"
          }
          frame True {
            w31 = "Input Z: Auto"
          }
        }
        Property Node(instance in=reference to "Auto Zero", "Disabled"=w25) -> ("Value"=w32)
        case (w32) {
          frame False, Default {
            w33 = "Auto Zero: Off"
          }
          frame True {
            w33 = "Auto Zero: On"
          }
        }
        Concatenate Strings("Your settings:", "\r\n", w29, "\r\n", w24, "\r\n", w33, "\r\n", w31, "\r\n", w26) -> w34
        $"concatenated string_2" <- w34
        Not(x=w25) -> w35
        Property Node(instance in=reference to unnamed text, "Visible"=w35)
        Property Node(instance in=reference to unnamed text, "Visible"=w25)
        w1 = default
      }
      on "stop" Value changed; "Window" Close {
        w1 = TRUE
      }
    }
    $VoltageAC_indicator <- $VoltageAC_control
    $VoltageDC_indicator <- $VoltageDC_control
    $CurrentDC_indicator <- $CurrentDC_control
    stop if w1
  }
