vi "GUInormalnecontrollki(takjakpowinnotobyc).gvi"   [LabVIEW NXG 5.1.0]
panel controls:
  "VoltageDC_control": bool
  "VoltageAC_control": bool
  "CurrentDC_control": bool
  "CurrentAC_control": bool
  "stop": bool
  "TerminalType_DCC": i32 = 1
  "2WResistance_control": bool
  "4WResistance_control": bool
  "Frequency_control": bool
  "Capacitance_control": bool
  "Continuity_control": bool
  "Diode_control": bool
  "Temperature_control": bool
  "OffstComp_2WR": bool = TRUE
  "LowPower_2WR": bool = TRUE
  "LowPower_4WR": bool = TRUE
  "OffstComp_4WR": bool = TRUE
  "GateTime_Freq": f64 = "1 s"(1)
  "Timeout_Freq": bool = TRUE
  "Units_TempMain": i32 = "°C"(0)
  "Probe_TempMain": i32 = 10
  "Beeper": bool = TRUE
  "AC Filter": i32 = 1
  "DCV Ratio": bool
  "Aperture": bool = TRUE
  "Beeper": bool = TRUE
  "AutoZero": bool = TRUE
  "InputZ": bool
  "ApertureNPLC": f64 = "10 PLC"(10)
  "ApertureTime": f64 = 0.1
  "ManualRange": f64 = "1 V"(1)
  "AutoRange": bool = TRUE
panel indicators:
  "VoltageDC_indicator": bool
  "VoltageAC_indicator": bool
  "CurrentDC_indicator": bool
  "CurrentAC_indicator": bool
  "2WResistance_indicator": bool
  "4WResistance_indicator": bool
  "Frequency_indicator": bool
  "Capacitance_indicator": bool
  "Continuity_indicator": bool
  "Diode_indicator": bool
  "Temperature_indicator": bool
  "R0_TempRTD4w": f64
  "String_Settings": string
diagram:
  # TEMPMAIN DEFAULTS
  # TEMPRTD4W DEFAULTS
  # TEMPRTD2W DEFAULTS
  $Units_TempMain <- "°C"(0)
  # FREQ DEFAULTS
  # CAPACI DEFAULTS
  # CONT DEFAULTS
  # DIODE DEFAULTS
  $Probe_TempMain <- "RTD 4w"(1)
  # DCVRATIO DEFAULTS
  # ACV DEFAULTS
  # DCC DEFAULTS
  # VISIBILITY
  Build Cluster(reference to "ManualRange", reference to "ApertureNPLC", reference to "ApertureTime", reference to "Aperture", reference to "AutoRange", reference to "AutoZero", reference to "InputZ") -> w1
  Property Node(instance in=w1) -> ("Element 1"=w2, "Element 2"=w3, "Element 3"=w4, "Element 4"=w5, "Element 5"=w6, "Element 6"=w7, "Element 7"=w8)
  # ACC DEFAULTS
  # 2WR DEFAULTS
  # 4WR DEFAULTS
  Property Node(instance in=w2, "Visible"=FALSE, "Disabled"=TRUE)
  Property Node(instance in=w3, "Visible"=FALSE, "Value"=10, "Disabled"=FALSE)
  Property Node(instance in=w4, "Visible"=FALSE, "Value"=0.1, "Disabled"=TRUE)
  Property Node(instance in=w5, "Visible"=FALSE, "Value"=TRUE)
  Property Node(instance in=w6, "Visible"=FALSE, "Value"=TRUE)
  Property Node(instance in=w7, "Visible"=FALSE, "Value"=TRUE)
  Property Node(instance in=w8, "Visible"=FALSE, "Value"=FALSE)
  # MAIN DEFAULTS
  $stop <- FALSE
  $VoltageAC_control <- FALSE
  $VoltageDC_control <- FALSE
  $CurrentDC_control <- FALSE
  $CurrentAC_control <- FALSE
  $"2WResistance_control" <- FALSE
  # BUTTONS VISIBILITY
  Property Node(instance in=reference to "VoltageAC_control", "Visible"=TRUE, "Disabled"=FALSE)
  Property Node(instance in=reference to "CurrentDC_control", "Visible"=TRUE, "Disabled"=FALSE)
  Property Node(instance in=reference to "CurrentAC_control", "Visible"=TRUE, "Disabled"=FALSE)
  Property Node(instance in=reference to "2WResistance_control", "Visible"=TRUE, "Disabled"=FALSE)
  Property Node(instance in=reference to "VoltageDC_indicator", "Visible"=FALSE)
  Property Node(instance in=reference to "4WResistance_control", "Visible"=TRUE, "Disabled"=FALSE)
  Property Node(instance in=reference to "Frequency_control", "Visible"=TRUE, "Disabled"=FALSE)
  Property Node(instance in=reference to "Capacitance_control", "Visible"=TRUE, "Disabled"=FALSE)
  Property Node(instance in=reference to "Continuity_control", "Visible"=TRUE, "Disabled"=FALSE)
  Property Node(instance in=reference to "Diode_control", "Visible"=TRUE, "Disabled"=FALSE)
  Property Node(instance in=reference to "Temperature_control", "Visible"=TRUE, "Disabled"=FALSE)
  $"4WResistance_control" <- FALSE
  $Frequency_control <- FALSE
  Property Node(instance in=reference to "VoltageDC_control", "Visible"=TRUE, "Disabled"=FALSE)
  $Capacitance_control <- FALSE
  Property Node(instance in=reference to "VoltageAC_indicator", "Visible"=FALSE)
  Property Node(instance in=reference to "CurrentDC_indicator", "Visible"=FALSE)
  Property Node(instance in=reference to "CurrentAC_indicator", "Visible"=FALSE, "Disabled"=FALSE)
  Property Node(instance in=reference to "2WResistance_indicator", "Visible"=FALSE, "Disabled"=FALSE)
  Property Node(instance in=reference to "4WResistance_indicator", "Visible"=FALSE, "Disabled"=FALSE)
  Property Node(instance in=reference to "Frequency_indicator", "Visible"=FALSE, "Disabled"=FALSE)
  Property Node(instance in=reference to "Capacitance_indicator", "Visible"=FALSE, "Disabled"=FALSE)
  Property Node(instance in=reference to "Continuity_indicator", "Visible"=FALSE, "Disabled"=FALSE)
  Property Node(instance in=reference to "Diode_indicator", "Visible"=FALSE, "Disabled"=FALSE)
  Property Node(instance in=reference to "Temperature_indicator", "Visible"=FALSE, "Disabled"=FALSE)
  $Continuity_control <- FALSE
  $Diode_control <- FALSE
  # TITLES VISIBILITY
  Property Node(instance in=reference to unnamed text, "Text"="Virtual DMM")
  $Temperature_control <- FALSE
  while {
    # ACV CONTROLS/INDICATORS
    # DCC CONTROLS/INDICATORS
    # ACC CONTROLS/INDICATORS
    # 2WR CONTROLS/INDICATORS
    # 4WR CONTROLS/INDICATORS
    # FREQ CONTROLS/INDICATORS
    # DCV CONTROLS/INDICATORS
    # DCVR CONTROLS/INDICATORS
    # CAPACI CONTROLS/INDICATORS
    # CONT CONTROLS/INDICATORS
    # DIODE CONTROLS/INDICATORS
    # TEMPMAIN CONTROLS/INDICATORS
    # TEMPRTD4W CONTROLS/INDICATORS
    # TEMPRTD2W CONTROLS/INDICATORS
    event {
      on "VoltageDC_control" Value changed {
        Property Node(instance in=reference to unnamed text, "Text"="DC Voltage")
        Event Data() -> ("Old Value"=w10, "New Value"=w11)
        # EVENT NIE DLA
        # CONTROL NEW VALUE F
        # INDICATOR OLD
        Property Node(instance in=reference to "VoltageAC_indicator", "Visible"=w10)
        Property Node(instance in=reference to "CurrentDC_indicator", "Visible"=w10)
        Property Node(instance in=reference to "CurrentAC_indicator", "Visible"=w10)
        Property Node(instance in=reference to "2WResistance_indicator", "Visible"=w10)
        Property Node(instance in=reference to "4WResistance_indicator", "Visible"=w10)
        Property Node(instance in=reference to "Frequency_indicator", "Visible"=w10)
        Property Node(instance in=reference to "Capacitance_indicator", "Visible"=w10)
        Property Node(instance in=reference to "Continuity_indicator", "Visible"=w10)
        Property Node(instance in=reference to "Diode_indicator", "Visible"=w10)
        Property Node(instance in=reference to "Temperature_indicator", "Visible"=w10)
        # EVENT DLA
        # CONTROL OLD
        # INDICATOR NEW
        Property Node(instance in=reference to "VoltageDC_control", "Visible"=w10)
        Build Cluster(reference to "ManualRange", reference to "ApertureNPLC", reference to "ApertureTime", reference to "Aperture", reference to "AutoRange", reference to "AutoZero", reference to "InputZ") -> w12
        Property Node(instance in=w12) -> ("Element 1"=w13, "Element 2"=w14, "Element 3"=w15, "Element 4"=w16, "Element 5"=w17, "Element 6"=w18, "Element 7"=w19)
        Property Node(instance in=w16, "Visible"=TRUE, "Value"=TRUE) -> ("Value"=w20)
        Property Node(instance in=w14, "Visible"=TRUE, "Value"=10, "Disabled"=FALSE) -> ("Value"=w21)
        Property Node(instance in=w15, "Visible"=TRUE, "Value"=0.1, "Disabled"=TRUE) -> ("Value"=w22)
        case (w20) {
          frame False, Default {
            Format Into String(formatString="%_6ps", initString="Aperture Time: ", w22) -> w23
          }
          frame True {
            Format Into String(formatString="%#gPLC", initString="Aperture NPLC: ", w21) -> w23
          }
        }
        Property Node(instance in=w13, "Visible"=TRUE, "Disabled"=TRUE) -> ("Value"=w24)
        Property Node(instance in=w17, "Visible"=TRUE, "Value"=TRUE) -> ("Value"=w25)
        case (w25) {
          frame False, Default {
            Format Into String(formatString="%.0pV", initString="Range: ", w24) -> w26
          }
          frame True {
            w26 = "Range: Auto"
          }
        }
        Property Node(instance in=w19, "Visible"=TRUE, "Value"=FALSE) -> ("Value"=w27)
        case (w27) {
          frame False, Default {
            w28 = "Input Z: 10MΩ"
          }
          frame True {
            w28 = "Input Z: Auto"
          }
        }
        Property Node(instance in=w18, "Visible"=TRUE, "Value"=TRUE) -> ("Value"=w29)
        case (w29) {
          frame False, Default {
            w30 = "Auto Zero: Off"
          }
          frame True {
            w30 = "Auto Zero: On"
          }
        }
        Concatenate Strings("Your settings:", "\r\n", w26, "\r\n", w23, "\r\n", w30, "\r\n", w28, "\r\n", "DCV Ratio: Off", "\r\n") -> w31
        $String_Settings <- w31
        Property Node(instance in=reference to "VoltageDC_indicator", "Visible"=w11)
        Property Node(instance in=reference to "VoltageAC_control", "Visible"=w11, "Value"=FALSE)
        Property Node(instance in=reference to "CurrentDC_control", "Visible"=w11, "Value"=FALSE)
        Property Node(instance in=reference to "CurrentAC_control", "Visible"=w11, "Value"=FALSE)
        Property Node(instance in=reference to "2WResistance_control", "Visible"=w11, "Value"=FALSE)
        Property Node(instance in=reference to "4WResistance_control", "Visible"=w11, "Value"=FALSE)
        Property Node(instance in=reference to "Frequency_control", "Visible"=w11, "Value"=FALSE)
        Property Node(instance in=reference to "Capacitance_control", "Visible"=w11, "Value"=FALSE)
        Property Node(instance in=reference to "Continuity_control", "Visible"=w11, "Value"=FALSE)
        Property Node(instance in=reference to "Diode_control", "Visible"=w11, "Value"=FALSE)
        Property Node(instance in=reference to "Temperature_control", "Visible"=w11, "Value"=FALSE)
        w9 = default
      }
      on "stop" Value changed; "Window" Close {
        w9 = TRUE
      }
    }
    # MAIN CONTROLS/INDICATORS
    $VoltageDC_indicator <- $VoltageDC_control
    $VoltageAC_indicator <- $VoltageAC_control
    $CurrentDC_indicator <- $CurrentDC_control
    $CurrentAC_indicator <- $CurrentAC_control
    $"2WResistance_indicator" <- $"2WResistance_control"
    $"4WResistance_indicator" <- $"4WResistance_control"
    $Frequency_indicator <- $Frequency_control
    $Capacitance_indicator <- $Capacitance_control
    $Continuity_indicator <- $Continuity_control
    $Diode_indicator <- $Diode_control
    $Temperature_indicator <- $Temperature_control
    stop if w9
  }
