vi "MAIN.gvi"   [LabVIEW NXG 5.1.0]
panel controls:
  "stop": bool
  "measurement function": i32 = "Voltage DC"(10)
  "thermocouple type": i32 = "J"(0)
  "thermocouple reference junction type": i32 = "Internal"(0)
  "Radio Button Group": enum{"Item 0", "Item 1"} = "Item 0"
  "Image Button": bool
panel indicators:
  "error out_2": error
  "POMIAR": f64
uses:
  Agilent 3446X Series::Initialize.gvi
  Agilent 3446X Series::Configure Measurement.gvi
  Agilent 3446X Series::Read (Single Point).gvi
  Agilent 3446X Series::Close.gvi
  Agilent 3446X Series::Configure Transducer.gvi
  Agilent 3446X Series::Configure Trigger Slope.gvi
  Agilent 3446X Series::Configure Trigger.gvi
  Agilent 3446X Series::Configure Measurement Trigger Parameters.gvi
diagram:
  call "Initialize.gvi"(VISA resource name="TCPIP0::A-34461A-0000-2.local::inst0::INSTR") -> (VISA resource name out=w1, error out=w2)
  while {
    call "Configure Measurement.gvi"(VISA resource name=w1, error in=w2, measurement function=$"measurement function") -> (VISA resource name out=w3, error out=w4)
    case (TRUE) {
      frame False, Default {
        w5 = w3
        w6 = w4
      }
      frame True {
        call "Read (Single Point).gvi"(VISA resource name=w3, error in=w4) -> (VISA resource name out=w5, error out=w6, measurement=w7)
        $POMIAR <- w7
      }
    }
    stop if $stop
  }
  call "Close.gvi"(VISA resource name=w5, error in=w6) -> (error out=w8)
  $"error out_2" <- w8
  call "Configure Transducer.gvi"(thermocouple reference junction type=$"thermocouple reference junction type", thermocouple type=$"thermocouple type")
  call "Configure Trigger Slope.gvi"(trigger edge="Negative"(1))
  call "Configure Trigger.gvi"(manual trigger delay=1, trigger source="Immediate"(0), auto delay=TRUE, trigger level=0)
  call "Configure Measurement Trigger Parameters.gvi"(trigger measurement operation="Voltage AC"(8))
