vi "MAINTEST.gvi"   [LabVIEW NXG 5.1.0]
panel controls:
  "Manual Range": f64 = "1 V"(1)
  "Auto Range": bool = TRUE
  "Auto Zero": bool = TRUE
  "DCV Ratio": bool
  "Auto Impedance": bool
  "Aperture NPLC": f64 = "10 PLC"(10)
  "Aperture Time": f64 = 0.1
  "Aperture": bool = TRUE
  "DIG Option On/Off": bool
  "stop": bool
  "DC Voltage_control": bool
  "AC Voltage_control": bool
  "Resistance_control": bool
panel indicators:
  "concatenated string": string
  "DC Voltage_indicator": bool
  "AC Voltage_indicator": bool
  "Resistance_indicator": bool
diagram:
  while {
    Quotient And Remainder(x=$"Aperture Time", y=2e-06) -> (floor(x/y)=w1, x-y*floor(x/y)=w2)
    Multiply(w2, 1000000) -> w3
    Round To Nearest(number=w3) -> w4
    To Signed 32 Bit Integer(number=w4) -> w5
    case (w5) {
      frame 0, Default {
        Multiply(2e-06, w1) -> w6
      }
      frame 1 {
        Multiply(2e-06, w1) -> w6
      }
      frame 2 {
        Add(1, w1) -> w7
        Multiply(2e-06, w7) -> w6
      }
    }
    case ($Aperture) {
      frame False, Default {
        Format Into String(formatString="%_6ps", initString="Aperture Time: ", w6) -> w8
      }
      frame True {
        Format Into String(formatString="%#gPLC", initString="Aperture NPLC: ", $"Aperture NPLC") -> w8
      }
    }
    case ($"DCV Ratio") {
      frame False, Default {
        w9 = "DCV Ratio: Off"
      }
      frame True {
        $"Auto Zero" <- TRUE
        w9 = "DCV Ratio: On"
      }
    }
    case ($"Auto Range") {
      frame False, Default {
        Format Into String(formatString="%.0pV", initString="Range: ", $"Manual Range") -> w10
      }
      frame True {
        w10 = "Range: Auto"
      }
    }
    case ($"Auto Zero") {
      frame False, Default {
        w11 = "Auto Zero: Off"
      }
      frame True {
        w11 = "Auto Zero: On"
      }
    }
    case ($"Auto Impedance") {
      frame False, Default {
        w12 = "Input Z: 10MΩ"
      }
      frame True {
        w12 = "Input Z: Auto"
      }
    }
    Concatenate Strings("Your settings:", "\r\n", w10, "\r\n", w8, "\r\n", w11, "\r\n", w12, "\r\n", w9) -> w13
    $"concatenated string" <- w13
    $"DC Voltage_indicator" <- $"DC Voltage_control"
    case ($"DC Voltage_control") {
      frame False, Default {
        w14 = $"DC Voltage_control"
      }
      frame True {
        $"AC Voltage_control" <- FALSE
        $Resistance_control <- FALSE
        w14 = $"DC Voltage_control"
      }
    }
    case (w14) {
      frame False, Default {
        Property Node(instance in=reference to "DC Voltage_control", "Visible"=TRUE)
        Property Node(instance in=reference to "DC Voltage_indicator", "Visible"=FALSE)
      }
      frame True {
        Property Node(instance in=reference to "DC Voltage_control", "Visible"=FALSE)
        Property Node(instance in=reference to "DC Voltage_indicator", "Visible"=TRUE)
      }
    }
    Property Node(instance in=reference to "Manual Range", "Disabled"=$"Auto Range")
    Property Node(instance in=reference to "Aperture Time", "Disabled"=$Aperture)
    $"AC Voltage_indicator" <- $"AC Voltage_control"
    case ($"AC Voltage_control") {
      frame False, Default {
        w15 = $"AC Voltage_control"
      }
      frame True {
        $"DC Voltage_control" <- FALSE
        $Resistance_control <- FALSE
        w15 = $"AC Voltage_control"
      }
    }
    case (w15) {
      frame False, Default {
        Property Node(instance in=reference to "AC Voltage_control", "Visible"=TRUE)
        Property Node(instance in=reference to "AC Voltage_indicator", "Visible"=FALSE)
      }
      frame True {
        Property Node(instance in=reference to "AC Voltage_control", "Visible"=FALSE)
        Property Node(instance in=reference to "AC Voltage_indicator", "Visible"=TRUE)
      }
    }
    case ($"DIG Option On/Off") {
      frame False, Default {
        w16 = 0.0002
      }
      frame True {
        w16 = 2e-05
      }
    }
    Property Node(instance in=reference to "Aperture Time", "Minimum"=w16)
    Not(x=$Aperture) -> w17
    Property Node(instance in=reference to "Aperture NPLC", "Disabled"=w17)
    case ($"DIG Option On/Off") {
      frame False, Default {
        w18 = [0, 1, 2]
      }
      frame True {
        w18 = i32[] []
      }
    }
    Property Node(instance in=reference to "Aperture NPLC", "DisabledIndexes"=w18)
    $Resistance_indicator <- $Resistance_control
    $"Aperture Time" <- w6
    case ($Resistance_control) {
      frame False, Default {
        w19 = $Resistance_control
      }
      frame True {
        $"AC Voltage_control" <- FALSE
        $"DC Voltage_control" <- FALSE
        w19 = $Resistance_control
      }
    }
    case (w19) {
      frame False, Default {
        Property Node(instance in=reference to "Resistance_control", "Visible"=TRUE)
        Property Node(instance in=reference to "Resistance_indicator", "Visible"=FALSE)
      }
      frame True {
        Property Node(instance in=reference to "Resistance_control", "Visible"=FALSE)
        Property Node(instance in=reference to "Resistance_indicator", "Visible"=TRUE)
      }
    }
    Not(x=$"DCV Ratio") -> w20
    Property Node(instance in=reference to unnamed text, "Visible"=w20)
    Property Node(instance in=reference to unnamed text, "Visible"=$"DCV Ratio")
    Property Node(instance in=reference to "Auto Zero", "Disabled"=$"DCV Ratio")
    stop if $stop
  }
  $"DC Voltage_control" <- FALSE
  $"AC Voltage_control" <- FALSE
  $Resistance_control <- FALSE
