vi "UCZELNIATEST1.gvi"   [LabVIEW NXG 5.1.0]
panel controls:
  "VoltageDC_control": bool
  "VoltageAC_control": bool
  "CurrentDC_control": bool
  "CurrentAC_control": bool
  "stop": bool
  "Auto Range": bool = TRUE
  "Auto Zero": bool = TRUE
  "Aperture NPLC": f64 = "10 PLC"(10)
  "Aperture Time": f64 = 0.1
  "Aperture": bool = TRUE
  "Manual Range": f64 = "1 V"(1)
  "Absolute Resolution": f64 = 10
panel indicators:
  "VoltageDC_indicator": bool
  "VoltageAC_indicator": bool
  "CurrentDC_indicator": bool
  "CurrentAC_indicator": bool
  "DCV Ratio": bool
  "Auto Impedance": bool
  "DIG Option On/Off": bool
  "concatenated string_2": string
uses:
  Agilent 3446X Series::Initialize.gvi
  Agilent 3446X Series::Configure Measurement.gvi
  Agilent 3446X Series::Configure Voltage.gvi
  Agilent 3446X Series::Configure Measurement Aperture.gvi
  Agilent 3446X Series::Auto Zero.gvi
  Agilent 3446X Series::Close.gvi
diagram:
  Property Node(instance in=reference to "CurrentAC_indicator", "Visible"=FALSE, "Disabled"=FALSE)
  $"Auto Range" <- TRUE
  $"Auto Zero" <- TRUE
  Property Node(instance in=reference to "CurrentDC_control", "Visible"=TRUE, "Disabled"=FALSE)
  $"DIG Option On/Off" <- TRUE
  $"DCV Ratio" <- FALSE
  Property Node(instance in=reference to "CurrentAC_control", "Visible"=TRUE, "Disabled"=FALSE)
  Property Node(instance in=reference to "CurrentDC_indicator", "Visible"=FALSE)
  Property Node(instance in=reference to "VoltageAC_control", "Visible"=TRUE, "Disabled"=FALSE)
  $VoltageAC_control <- FALSE
  $VoltageDC_control <- FALSE
  $CurrentDC_control <- FALSE
  $CurrentAC_control <- FALSE
  Property Node(instance in=reference to "Auto Range", "Visible"=FALSE)
  Property Node(instance in=reference to "concatenated string_2", "Visible"=FALSE)
  Property Node(instance in=reference to "Auto Zero", "Visible"=FALSE)
  Property Node(instance in=reference to unnamed text, "Visible"=TRUE)
  Property Node(instance in=reference to "VoltageDC_indicator", "Visible"=FALSE)
  Property Node(instance in=reference to "Aperture", "Visible"=FALSE)
  Property Node(instance in=reference to unnamed text, "Visible"=FALSE)
  Property Node(instance in=reference to unnamed text, "Visible"=FALSE)
  Property Node(instance in=reference to "Manual Range", "Visible"=FALSE)
  Property Node(instance in=reference to unnamed text, "Visible"=FALSE)
  Property Node(instance in=reference to "Aperture NPLC", "Visible"=FALSE)
  Property Node(instance in=reference to "VoltageAC_indicator", "Visible"=FALSE)
  Property Node(instance in=reference to "DCV Ratio", "Visible"=FALSE)
  Property Node(instance in=reference to "VoltageDC_control", "Visible"=TRUE, "Disabled"=FALSE)
  Property Node(instance in=reference to unnamed text, "Visible"=FALSE)
  Property Node(instance in=reference to "DIG Option On/Off", "Visible"=FALSE)
  Property Node(instance in=reference to "Aperture Time", "Visible"=FALSE)
  $Aperture <- TRUE
  Property Node(instance in=reference to "Auto Impedance", "Visible"=FALSE)
  $"DCV Ratio" <- FALSE
  $"Auto Impedance" <- FALSE
  call "Initialize.gvi"(VISA resource name="TCPIP0::A-34461A-0000-2.local::inst0::INSTR") -> (VISA resource name out=w1, error out=w2)
  while {
    $CurrentAC_indicator <- $CurrentAC_control
    event {
      on "VoltageDC_control" Value changed {
        Property Node(instance in=reference to unnamed text, "Visible"=TRUE)
        Event Data() -> ("Old Value"=w6, "New Value"=w7)
        Property Node(instance in=reference to "CurrentDC_control", "Visible"=w7, "Value"=FALSE)
        Property Node(instance in=reference to "VoltageDC_control", "Visible"=w6)
        Property Node(instance in=reference to "CurrentAC_control", "Visible"=w7, "Value"=FALSE)
        Property Node(instance in=reference to "VoltageDC_indicator", "Visible"=w7)
        Property Node(instance in=reference to "CurrentDC_indicator", "Visible"=w6)
        Property Node(instance in=reference to "VoltageAC_control", "Visible"=w7, "Value"=FALSE)
        Property Node(instance in=reference to "VoltageAC_indicator", "Visible"=w6)
        Property Node(instance in=reference to "CurrentAC_indicator", "Visible"=w6)
        Property Node(instance in=reference to "Manual Range", "Visible"=TRUE)
        Property Node(instance in=reference to "Aperture NPLC", "Visible"=TRUE)
        Property Node(instance in=reference to "Aperture Time", "Visible"=TRUE)
        Property Node(instance in=reference to "concatenated string_2", "Visible"=TRUE)
        Property Node(instance in=reference to "Auto Range", "Visible"=TRUE)
        Property Node(instance in=reference to "DCV Ratio", "Visible"=TRUE)
        Property Node(instance in=reference to "Auto Impedance", "Visible"=TRUE)
        Property Node(instance in=reference to "Auto Zero", "Visible"=TRUE)
        Property Node(instance in=reference to "Absolute Resolution", "Visible"=TRUE)
        Property Node(instance in=reference to "DIG Option On/Off", "Visible"=TRUE)
        Property Node(instance in=reference to unnamed text, "Visible"=FALSE)
        Property Node(instance in=reference to unnamed text, "Visible"=FALSE)
        Property Node(instance in=reference to unnamed text, "Visible"=FALSE)
        Property Node(instance in=reference to "Aperture", "Visible"=TRUE)
        w3 = default
        w4 = default
        w5 = default
      }
      on "VoltageAC_control" Value changed {
        Property Node(instance in=reference to "Aperture", "Visible"=FALSE)
        Event Data() -> ("Old Value"=w8, "New Value"=w9)
        Property Node(instance in=reference to "VoltageDC_control", "Visible"=w9, "Value"=FALSE)
        Property Node(instance in=reference to unnamed text, "Visible"=w9)
        Property Node(instance in=reference to "VoltageAC_control", "Visible"=w8)
        Property Node(instance in=reference to "CurrentAC_control", "Visible"=w9, "Value"=FALSE)
        Property Node(instance in=reference to "CurrentDC_indicator", "Visible"=w8)
        Property Node(instance in=reference to "CurrentDC_control", "Visible"=w9, "Value"=FALSE)
        Property Node(instance in=reference to "CurrentAC_indicator", "Visible"=w8)
        Property Node(instance in=reference to "Absolute Resolution", "Visible"=FALSE)
        Property Node(instance in=reference to "VoltageDC_indicator", "Visible"=w8)
        Property Node(instance in=reference to "VoltageAC_indicator", "Visible"=w9)
        Property Node(instance in=reference to "DCV Ratio", "Visible"=FALSE)
        Property Node(instance in=reference to "Aperture NPLC", "Visible"=FALSE)
        Property Node(instance in=reference to "Aperture Time", "Visible"=FALSE)
        Property Node(instance in=reference to "concatenated string_2", "Visible"=FALSE)
        Property Node(instance in=reference to "Auto Range", "Visible"=FALSE)
        Property Node(instance in=reference to unnamed text, "Visible"=FALSE)
        Property Node(instance in=reference to "Auto Impedance", "Visible"=FALSE)
        Property Node(instance in=reference to "Auto Zero", "Visible"=FALSE)
        Property Node(instance in=reference to "DIG Option On/Off", "Visible"=FALSE)
        Property Node(instance in=reference to unnamed text, "Visible"=FALSE)
        Property Node(instance in=reference to unnamed text, "Visible"=FALSE)
        Property Node(instance in=reference to "Manual Range", "Visible"=FALSE)
        w3 = default
        w4 = default
        w5 = default
      }
      on "CurrentDC_control" Value changed {
        Event Data() -> ("Old Value"=w10, "New Value"=w11)
        Property Node(instance in=reference to "VoltageAC_control", "Visible"=w11, "Value"=FALSE)
        Property Node(instance in=reference to "VoltageAC_indicator", "Visible"=w10)
        Property Node(instance in=reference to "VoltageDC_indicator", "Visible"=w10)
        Property Node(instance in=reference to "VoltageDC_control", "Visible"=w11, "Value"=FALSE)
        Property Node(instance in=reference to "CurrentAC_control", "Visible"=w11, "Value"=FALSE)
        Property Node(instance in=reference to "CurrentDC_indicator", "Visible"=w11)
        Property Node(instance in=reference to "CurrentDC_control", "Visible"=w10)
        Property Node(instance in=reference to "CurrentAC_indicator", "Visible"=w10)
        w3 = default
        w4 = default
        w5 = default
      }
      on "CurrentAC_control" Value changed {
        Event Data() -> ("Old Value"=w12, "New Value"=w13)
        Property Node(instance in=reference to "CurrentDC_indicator", "Visible"=w12)
        Property Node(instance in=reference to "VoltageDC_indicator", "Visible"=w12)
        Property Node(instance in=reference to "VoltageDC_control", "Visible"=w13, "Value"=FALSE)
        Property Node(instance in=reference to "CurrentDC_control", "Visible"=w13, "Value"=FALSE)
        Property Node(instance in=reference to "CurrentAC_indicator", "Visible"=w13)
        Property Node(instance in=reference to "VoltageAC_control", "Visible"=w13, "Value"=FALSE)
        Property Node(instance in=reference to "VoltageAC_indicator", "Visible"=w12)
        Property Node(instance in=reference to "CurrentAC_control", "Visible"=w12)
        w3 = default
        w4 = default
        w5 = default
      }
      on "Aperture" Value changed; "Aperture NPLC" Value changed; "Aperture Time" Value changed; "Auto Impedance" Value changed; "Auto Range" Value changed; "Auto Zero" Value changed; "DCV Ratio" Value changed; "DIG Option On/Off" Value changed; "Manual Range" Value changed {
        Property Node(instance in=reference to "DIG Option On/Off") -> ("Value"=w14)
        case (w14) {
          frame False, Default {
            w15 = 0.0002
          }
          frame True {
            w15 = 2e-05
          }
        }
        Property Node(instance in=reference to "Aperture") -> ("Value"=w16)
        Property Node(instance in=reference to "Aperture Time", "Disabled"=w16, "Minimum"=w15) -> ("Value"=w17)
        Quotient And Remainder(x=w17, y=2e-06) -> (floor(x/y)=w18, x-y*floor(x/y)=w19)
        Multiply(w19, 1000000) -> w20
        Round To Nearest(number=w20) -> w21
        To Signed 32 Bit Integer(number=w21) -> w22
        case (w22) {
          frame 0, Default {
            Multiply(2e-06, w18) -> w23
          }
          frame 1 {
            Multiply(2e-06, w18) -> w23
          }
          frame 2 {
            Add(1, w18) -> w24
            Multiply(2e-06, w24) -> w23
          }
        }
        $"Aperture Time" <- w23
        case (w14) {
          frame False, Default {
            w25 = [0, 1, 2]
          }
          frame True {
            w25 = i32[] []
          }
        }
        Not(x=w16) -> w26
        Property Node(instance in=reference to "Aperture NPLC", "Disabled"=w26, "DisabledIndexes"=w25) -> ("Value"=w27)
        case (w16) {
          frame False, Default {
            Format Into String(formatString="%_6ps", initString="Aperture Time: ", w23) -> w28
          }
          frame True {
            Format Into String(formatString="%#gPLC", initString="Aperture NPLC: ", w27) -> w28
          }
        }
        Property Node(instance in=reference to "DCV Ratio") -> ("Value"=w29)
        case (w29) {
          frame False, Default {
            w30 = "DCV Ratio: Off"
          }
          frame True {
            $"Auto Zero" <- TRUE
            w30 = "DCV Ratio: On"
          }
        }
        Property Node(instance in=reference to "Auto Range") -> ("Value"=w31)
        Property Node(instance in=reference to "Manual Range", "Disabled"=w31) -> ("Value"=w32)
        case (w31) {
          frame False, Default {
            Format Into String(formatString="%.0pV", initString="Range: ", w32) -> w33
          }
          frame True {
            w33 = "Range: Auto"
          }
        }
        Property Node(instance in=reference to "Auto Impedance") -> ("Value"=w34)
        case (w34) {
          frame False, Default {
            w35 = "Input Z: 10MΩ"
          }
          frame True {
            w35 = "Input Z: Auto"
          }
        }
        Property Node(instance in=reference to "Auto Zero", "Disabled"=w29) -> ("Value"=w36)
        case (w36) {
          frame False, Default {
            w37 = "Auto Zero: Off"
          }
          frame True {
            w37 = "Auto Zero: On"
          }
        }
        Concatenate Strings("Your settings:", "\r\n", w33, "\r\n", w28, "\r\n", w37, "\r\n", w35, "\r\n", w30) -> w38
        $"concatenated string_2" <- w38
        Not(x=w29) -> w39
        Property Node(instance in=reference to unnamed text, "Visible"=w39)
        Property Node(instance in=reference to unnamed text, "Visible"=w29)
        Property Node(instance in=reference to "Absolute Resolution") -> ("Value"=w40)
        Boolean To 0 Or 1(Boolean=w36) -> (0, 1=w41)
        case (w29) {
          frame False, Default {
            call "Configure Measurement.gvi"(manual range=w32, VISA resource name=w1, error in=w2, measurement function="Voltage DC"(10), auto range=w31, absolute resolution=w40) -> (VISA resource name out=w42, error out=w43)
            call "Configure Voltage.gvi"(VISA resource name=w42, error in=w43, auto impedance=w34, voltage integration time=w27) -> (VISA resource name out=w44, error out=w45)
            case (w16) {
              frame False, Default {
                call "Configure Measurement Aperture.gvi"(VISA resource name=w44, error in=w45, measurement function="Voltage DC"(10), enable aperture=TRUE, aperture time=w23) -> (VISA resource name out=w46, error out=w47)
              }
              frame True {
                w46 = w44
                w47 = w45
              }
            }
            call "Auto Zero.gvi"(VISA resource name=w46, error in=w47, zero type="Voltage DC"(3), auto zero=w41) -> (VISA resource name out=w4, error out=w5)
          }
          frame True {
            call "Configure Measurement.gvi"(manual range=w32, VISA resource name=w1, error in=w2, measurement function="Voltage DC Ratio"(11), auto range=w31, absolute resolution=w40) -> (VISA resource name out=w48, error out=w49)
            call "Configure Voltage.gvi"(VISA resource name=w48, error in=w49, auto impedance=w34, voltage integration time=w27) -> (VISA resource name out=w50, error out=w51)
            case (w16) {
              frame False, Default {
                call "Configure Measurement Aperture.gvi"(VISA resource name=w50, error in=w51, measurement function="Voltage DC Ratio"(11), enable aperture=TRUE, aperture time=w23) -> (VISA resource name out=w4, error out=w5)
              }
              frame True {
                w4 = w50
                w5 = w51
              }
            }
          }
        }
        w3 = default
      }
      on "stop" Value changed; "Window" Close {
        w3 = TRUE
        w4 = default
        w5 = default
      }
    }
    $VoltageAC_indicator <- $VoltageAC_control
    $VoltageDC_indicator <- $VoltageDC_control
    $CurrentDC_indicator <- $CurrentDC_control
    stop if w3
  }
  call "Close.gvi"(VISA resource name=w4, error in=w5)
  Property Node(instance in=reference to "Absolute Resolution", "Visible"=FALSE)
