vi "X_2WIRERESISTANCE_TRYHOME.gvi"   [LabVIEW NXG 5.1.0]
panel controls:
  "Właściwy_control": bool
  "stop": bool
  "AutoRange_Właściwy": bool = TRUE
  "ManualRange_Właściwy": f64 = 1
  "Zmiana_control": bool
  "Aperture_Właściwy": bool = TRUE
  "ApertureNPLC_Właściwy": f64 = "10 PLC"(10)
  "AutoZero_Właściwy": bool = TRUE
  "OffstComp_Właściwy": bool = TRUE
  "LowPower_Właściwy": bool = TRUE
panel indicators:
  "Właściwy_indicator": bool
  "String_Właściwy": string
  "Zmiana_indicator": bool
  "ApertureTime_Właściwy": f64
diagram:
  disable {
    frame Enabled {
      Property Node(instance in=reference to "ApertureNPLC_Właściwy", "Visible"=FALSE)
      Property Node(instance in=reference to "ApertureTime_Właściwy", "Visible"=FALSE)
      Property Node(instance in=reference to "LowPower_Właściwy", "Visible"=FALSE)
      Property Node(instance in=reference to "AutoZero_Właściwy", "Visible"=FALSE)
      Property Node(instance in=reference to "ManualRange_Właściwy", "Visible"=FALSE)
      Property Node(instance in=reference to "OffstComp_Właściwy", "Visible"=FALSE)
      Property Node(instance in=reference to "Aperture_Właściwy", "Visible"=FALSE)
      Property Node(instance in=reference to "AutoRange_Właściwy", "Visible"=FALSE)
    }
    frame Disabled { }
  }
  disable {
    frame Enabled {
      Property Node(instance in=reference to unnamed text, "Visible"=FALSE)
      Property Node(instance in=reference to "String_Właściwy", "Visible"=FALSE)
    }
    frame Disabled { }
  }
  disable {
    frame Enabled {
      Property Node(instance in=reference to "Zmiana_indicator", "Visible"=FALSE)
      Property Node(instance in=reference to "Właściwy_indicator", "Visible"=FALSE)
      Property Node(instance in=reference to "Właściwy_control", "Visible"=TRUE, "Disabled"=FALSE)
      Property Node(instance in=reference to "Zmiana_control", "Visible"=TRUE, "Disabled"=FALSE)
    }
    frame Disabled { }
  }
  disable {
    frame Enabled {
      $Zmiana_indicator <- FALSE
      $OffstComp_Właściwy <- FALSE
      $LowPower_Właściwy <- FALSE
      $Właściwy_indicator <- FALSE
    }
    frame Disabled { }
  }
  while {
    disable {
      frame Enabled {
        $Zmiana_indicator <- $Zmiana_control
        $Właściwy_indicator <- $Właściwy_control
      }
      frame Disabled { }
    }
    event {
      on "Właściwy_control" Value changed {
        Event Data() -> ("Old Value"=w2, "New Value"=w3)
        Property Node(instance in=reference to "Zmiana_indicator", "Visible"=w2)
        Property Node(instance in=reference to "Właściwy_control", "Visible"=w2)
        Property Node(instance in=reference to "Właściwy_indicator", "Visible"=w3)
        Property Node(instance in=reference to "Zmiana_control", "Visible"=w3, "Value"=FALSE)
        Property Node(instance in=reference to "ApertureNPLC_Właściwy", "Visible"=TRUE)
        Property Node(instance in=reference to "ApertureTime_Właściwy", "Visible"=TRUE)
        Property Node(instance in=reference to "LowPower_Właściwy", "Visible"=TRUE)
        Property Node(instance in=reference to "AutoZero_Właściwy", "Visible"=TRUE)
        Property Node(instance in=reference to "ManualRange_Właściwy", "Visible"=TRUE)
        Property Node(instance in=reference to "Aperture_Właściwy", "Visible"=TRUE)
        Property Node(instance in=reference to "OffstComp_Właściwy", "Visible"=TRUE)
        Property Node(instance in=reference to "AutoRange_Właściwy", "Visible"=TRUE)
        Property Node(instance in=reference to unnamed text, "Visible"=TRUE)
        Property Node(instance in=reference to "String_Właściwy", "Visible"=TRUE)
        w1 = default
      }
      on "Zmiana_control" Value changed {
        Property Node(instance in=reference to unnamed text, "Visible"=FALSE)
        Property Node(instance in=reference to "String_Właściwy", "Visible"=FALSE)
        Property Node(instance in=reference to "ApertureNPLC_Właściwy", "Visible"=FALSE)
        Property Node(instance in=reference to "ApertureTime_Właściwy", "Visible"=FALSE)
        Property Node(instance in=reference to "LowPower_Właściwy", "Visible"=FALSE)
        Property Node(instance in=reference to "AutoZero_Właściwy", "Visible"=FALSE)
        Property Node(instance in=reference to "ManualRange_Właściwy", "Visible"=FALSE)
        Property Node(instance in=reference to "Aperture_Właściwy", "Visible"=FALSE)
        Property Node(instance in=reference to "OffstComp_Właściwy", "Visible"=FALSE)
        Property Node(instance in=reference to "AutoRange_Właściwy", "Visible"=FALSE)
        Event Data() -> ("Old Value"=w4, "New Value"=w5)
        Property Node(instance in=reference to "Właściwy_indicator", "Visible"=w4)
        Property Node(instance in=reference to "Zmiana_control", "Visible"=w4)
        Property Node(instance in=reference to "Właściwy_control", "Visible"=w5, "Value"=FALSE)
        Property Node(instance in=reference to "Zmiana_indicator", "Visible"=w5)
        w1 = default
      }
      on "Aperture_Właściwy" Value changed; "ApertureNPLC_Właściwy" Value changed; "ApertureTime_Właściwy" Value changed; "AutoRange_Właściwy" Value changed; "AutoZero_Właściwy" Value changed; "LowPower_Właściwy" Value changed; "ManualRange_Właściwy" Value changed; "OffstComp_Właściwy" Value changed {
        Property Node(instance in=reference to "Aperture_Właściwy") -> ("Value"=w6)
        Property Node(instance in=reference to "ApertureTime_Właściwy", "Disabled"=w6) -> ("Value"=w7)
        Quotient And Remainder(x=w7, y=2e-06) -> (floor(x/y)=w8, x-y*floor(x/y)=w9)
        Multiply(w9, 1000000) -> w10
        Round To Nearest(number=w10) -> w11
        To Signed 32 Bit Integer(number=w11) -> w12
        case (w12) {
          frame 0, Default {
            Multiply(2e-06, w8) -> w13
          }
          frame 1 {
            Multiply(2e-06, w8) -> w13
          }
          frame 2 {
            Add(1, w8) -> w14
            Multiply(2e-06, w14) -> w13
          }
        }
        Property Node(instance in=reference to "ApertureTime_Właściwy", "Value"=w13)
        Event Data() -> ("Index"=w15, "Old Value"=w16)
        Is Equal(x=w15, y=5) -> w17
        Property Node(instance in=reference to "OffstComp_Właściwy") -> ("Value"=w18)
        Property Node(instance in=reference to "LowPower_Właściwy") -> ("Value"=w19)
        Logical And(w18, w19) -> w20
        Logical And(w20, w17) -> w21
        Variant To Flattened Byte Array(variant=w16) -> (data string=w22)
        Array Index(array=w22) -> (out0[0]=w23)
        Is Equal(x=w23, y=1) -> w24
        case (w21) {
          frame False, Default {
            Property Node(instance in=reference to "OffstComp_Właściwy") -> ("Value"=w25)
          }
          frame True {
            Property Node(instance in=reference to "OffstComp_Właściwy", "Value"=w24) -> ("Value"=w25)
          }
        }
        case (w25) {
          frame False, Default {
            w26 = "Offset Compensation: Off"
          }
          frame True {
            w26 = "Offset Compensation: On"
          }
        }
        Is Equal(x=w15, y=7) -> w27
        Logical And(w20, w27) -> w28
        case (w28) {
          frame False, Default {
            Property Node(instance in=reference to "LowPower_Właściwy") -> ("Value"=w29)
          }
          frame True {
            Property Node(instance in=reference to "LowPower_Właściwy", "Value"=w24) -> ("Value"=w29)
          }
        }
        case (w29) {
          frame False, Default {
            w30 = "Low Power: Off"
          }
          frame True {
            w30 = "Low Power: On"
          }
        }
        Not(x=w6) -> w31
        Property Node(instance in=reference to "ApertureNPLC_Właściwy", "Disabled"=w31) -> ("Value"=w32)
        case (w6) {
          frame False, Default {
            Format Into String(formatString="%_6ps", initString="Aperture Time: ", w13) -> w33
          }
          frame True {
            Format Into String(formatString="%#gPLC", initString="Aperture NPLC: ", w32) -> w33
          }
        }
        Property Node(instance in=reference to "AutoRange_Właściwy") -> ("Value"=w34)
        Property Node(instance in=reference to "ManualRange_Właściwy", "Disabled"=w34) -> ("Value"=w35)
        case (w34) {
          frame False, Default {
            Format Into String(formatString="%.0pΩ", initString="Range: ", w35) -> w36
          }
          frame True {
            w36 = "Range: Auto"
          }
        }
        Property Node(instance in=reference to "AutoZero_Właściwy") -> ("Value"=w37)
        case (w37) {
          frame False, Default {
            w38 = "Auto Zero: Off"
          }
          frame True {
            w38 = "Auto Zero: On"
          }
        }
        Concatenate Strings("Your settings:", "\r\n", w36, "\r\n", w33, "\r\n", w38, "\r\n", w26, "\r\n", w30) -> w39
        $String_Właściwy <- w39
        w1 = default
      }
      on "stop" Value changed; "Window" Close {
        w1 = TRUE
      }
    }
    stop if w1
  }
