vi "X_4WIRERESISTANCE.gvi"   [LabVIEW NXG 5.1.0]
panel controls:
  "Właściwy_control": bool
  "stop": bool
  "AutoRange_Właściwy": bool = TRUE
  "ManualRange_Właściwy": f64 = 1
  "Zmiana_control": bool
  "Aperture_Właściwy": bool = TRUE
  "ApertureNPLC_Właściwy": f64 = "10 PLC"(10)
  "OffstComp_Właściwy": bool = TRUE
  "LowPower_Właściwy": bool = TRUE
panel indicators:
  "Właściwy_indicator": bool
  "String_Właściwy": string
  "Zmiana_indicator": bool
  "ApertureTime_Właściwy": f64
uses:
  Agilent 3446X Series::Initialize.gvi
  Agilent 3446X Series::Configure Measurement.gvi
  Agilent 3446X Series::Configure Resistance.gvi
  Agilent 3446X Series::Configure Measurement Aperture.gvi
  Agilent 3446X Series::Close.gvi
diagram:
  disable {
    frame Enabled {
      Property Node(instance in=reference to "ApertureNPLC_Właściwy", "Visible"=FALSE)
      Property Node(instance in=reference to "ApertureTime_Właściwy", "Visible"=FALSE)
      Property Node(instance in=reference to "LowPower_Właściwy", "Visible"=FALSE)
      Property Node(instance in=reference to "OffstComp_Właściwy", "Visible"=FALSE)
      Property Node(instance in=reference to "Aperture_Właściwy", "Visible"=FALSE)
      Property Node(instance in=reference to "ManualRange_Właściwy", "Visible"=FALSE)
      Property Node(instance in=reference to "AutoRange_Właściwy", "Visible"=FALSE)
    }
    frame Disabled { }
  }
  disable {
    frame Enabled {
      Property Node(instance in=reference to unnamed text, "Visible"=FALSE)
      Property Node(instance in=reference to "String_Właściwy", "Visible"=FALSE)
    }
    frame Disabled { }
  }
  disable {
    frame Enabled {
      Property Node(instance in=reference to "Właściwy_indicator", "Visible"=FALSE)
      Property Node(instance in=reference to "Zmiana_indicator", "Visible"=FALSE)
      Property Node(instance in=reference to "Zmiana_control", "Visible"=TRUE, "Disabled"=FALSE)
      Property Node(instance in=reference to "Właściwy_control", "Visible"=TRUE, "Disabled"=FALSE)
    }
    frame Disabled { }
  }
  disable {
    frame Enabled {
      $Zmiana_indicator <- FALSE
      $Właściwy_indicator <- FALSE
    }
    frame Disabled { }
  }
  call "Initialize.gvi"(VISA resource name="TCPIP0::A-34461A-0000-2.local::inst0::INSTR") -> (VISA resource name out=w1, error out=w2)
  while {
    disable {
      frame Enabled {
        $Właściwy_indicator <- $Właściwy_control
        $Zmiana_indicator <- $Zmiana_control
      }
      frame Disabled { }
    }
    event {
      on "Właściwy_control" Value changed {
        Event Data() -> ("Old Value"=w6, "New Value"=w7)
        Property Node(instance in=reference to "Właściwy_control", "Visible"=w6)
        Property Node(instance in=reference to "Zmiana_indicator", "Visible"=w6)
        Property Node(instance in=reference to "Zmiana_control", "Visible"=w7, "Value"=FALSE)
        Property Node(instance in=reference to "Właściwy_indicator", "Visible"=w7)
        Property Node(instance in=reference to unnamed text, "Visible"=TRUE)
        Property Node(instance in=reference to "String_Właściwy", "Visible"=TRUE)
        call "Configure Measurement.gvi"(VISA resource name=w1, error in=w2, measurement function="Resistance 4-wire"(5)) -> (VISA resource name out=w4, error out=w5)
        Property Node(instance in=reference to "ApertureNPLC_Właściwy", "Visible"=TRUE)
        Property Node(instance in=reference to "ApertureTime_Właściwy", "Visible"=TRUE)
        Property Node(instance in=reference to "LowPower_Właściwy", "Visible"=TRUE)
        Property Node(instance in=reference to "OffstComp_Właściwy", "Visible"=TRUE)
        Property Node(instance in=reference to "Aperture_Właściwy", "Visible"=TRUE)
        Property Node(instance in=reference to "ManualRange_Właściwy", "Visible"=TRUE)
        Property Node(instance in=reference to "AutoRange_Właściwy", "Visible"=TRUE)
        w3 = default
      }
      on "Zmiana_control" Value changed {
        Property Node(instance in=reference to "ApertureNPLC_Właściwy", "Visible"=FALSE)
        Property Node(instance in=reference to "ApertureTime_Właściwy", "Visible"=FALSE)
        Property Node(instance in=reference to "LowPower_Właściwy", "Visible"=FALSE)
        Property Node(instance in=reference to "OffstComp_Właściwy", "Visible"=FALSE)
        Property Node(instance in=reference to "Aperture_Właściwy", "Visible"=FALSE)
        Property Node(instance in=reference to "ManualRange_Właściwy", "Visible"=FALSE)
        Property Node(instance in=reference to "AutoRange_Właściwy", "Visible"=FALSE)
        call "Configure Measurement.gvi"(VISA resource name=w1, error in=w2, measurement function="Voltage DC"(10)) -> (VISA resource name out=w4, error out=w5)
        Event Data() -> ("Old Value"=w8, "New Value"=w9)
        Property Node(instance in=reference to "Zmiana_control", "Visible"=w8)
        Property Node(instance in=reference to "Właściwy_indicator", "Visible"=w8)
        Property Node(instance in=reference to "Właściwy_control", "Visible"=w9, "Value"=FALSE)
        Property Node(instance in=reference to "Zmiana_indicator", "Visible"=w9)
        Property Node(instance in=reference to unnamed text, "Visible"=FALSE)
        Property Node(instance in=reference to "String_Właściwy", "Visible"=FALSE)
        w3 = default
      }
      on "Aperture_Właściwy" Value changed; "ApertureNPLC_Właściwy" Value changed; "ApertureTime_Właściwy" Value changed; "AutoRange_Właściwy" Value changed; "LowPower_Właściwy" Value changed; "ManualRange_Właściwy" Value changed; "OffstComp_Właściwy" Value changed {
        Property Node(instance in=reference to "Aperture_Właściwy") -> ("Value"=w10)
        Property Node(instance in=reference to "ApertureTime_Właściwy", "Disabled"=w10) -> ("Value"=w11)
        Quotient And Remainder(x=w11, y=2e-06) -> (floor(x/y)=w12, x-y*floor(x/y)=w13)
        Multiply(w13, 1000000) -> w14
        Round To Nearest(number=w14) -> w15
        To Signed 32 Bit Integer(number=w15) -> w16
        case (w16) {
          frame 0, Default {
            Multiply(2e-06, w12) -> w17
          }
          frame 1 {
            Multiply(2e-06, w12) -> w17
          }
          frame 2 {
            Add(1, w12) -> w18
            Multiply(2e-06, w18) -> w17
          }
        }
        Property Node(instance in=reference to "ApertureTime_Właściwy", "Value"=w17)
        Property Node(instance in=reference to "LowPower_Właściwy") -> ("Value"=w19)
        Property Node(instance in=reference to "OffstComp_Właściwy") -> ("Value"=w20)
        Not(x=w10) -> w21
        Property Node(instance in=reference to "ApertureNPLC_Właściwy", "Disabled"=w21) -> ("Value"=w22)
        Property Node(instance in=reference to "AutoRange_Właściwy") -> ("Value"=w23)
        Property Node(instance in=reference to "ManualRange_Właściwy", "Disabled"=w23) -> ("Value"=w24)
        call "Configure Measurement.gvi"(manual range=w24, VISA resource name=w1, error in=w2, measurement function="Resistance 4-wire"(5), auto range=w23) -> (VISA resource name out=w25, error out=w26)
        case (w10) {
          frame False, Default {
            call "Configure Resistance.gvi"(enable offset compensation=w20, VISA resource name=w25, error in=w26, resistance type="Resistance 4-wire"(1), enable power limit=w19) -> (VISA resource name out=w27, error out=w28)
            call "Configure Measurement Aperture.gvi"(VISA resource name=w27, error in=w28, measurement function="Resistance 4-wire"(5), enable aperture=TRUE, aperture time=w17) -> (VISA resource name out=w4, error out=w5)
          }
          frame True {
            call "Configure Resistance.gvi"(enable offset compensation=w20, VISA resource name=w25, error in=w26, resistance type="Resistance 4-wire"(1), resistance integration time=w22, enable power limit=w19) -> (VISA resource name out=w29, error out=w30)
            call "Configure Measurement Aperture.gvi"(VISA resource name=w29, error in=w30, measurement function="Resistance 4-wire"(5), enable aperture=FALSE) -> (VISA resource name out=w4, error out=w5)
          }
        }
        case (w23) {
          frame False, Default {
            Format Into String(formatString="%.0pΩ", initString="Range: ", w24) -> w31
          }
          frame True {
            w31 = "Range: Auto"
          }
        }
        case (w10) {
          frame False, Default {
            Format Into String(formatString="%_6ps", initString="Aperture Time: ", w17) -> w32
          }
          frame True {
            Format Into String(formatString="%#gPLC", initString="Aperture NPLC: ", w22) -> w32
          }
        }
        case (w20) {
          frame False, Default {
            w33 = "Offset Compensation: Off"
          }
          frame True {
            w33 = "Offset Compensation: On"
          }
        }
        case (w19) {
          frame False, Default {
            w34 = "Low Power: Off"
          }
          frame True {
            w34 = "Low Power: On"
          }
        }
        Concatenate Strings("Your settings:", "\r\n", w31, "\r\n", w32, "\r\n", w33, "\r\n", w34) -> w35
        $String_Właściwy <- w35
        w3 = default
      }
      on "stop" Value changed; "Window" Close {
        w3 = TRUE
        w4 = w1
        w5 = w2
      }
    }
    stop if w3
  }
  call "Close.gvi"(VISA resource name=w4, error in=w5)
