vi "X_ACCURRENT.gvi"   [LabVIEW NXG 5.1.0]
panel controls:
  "Właściwy_control": bool
  "stop": bool
  "AutoRange_Właściwy": bool = TRUE
  "ManualRange_Właściwy": f64 = "1 A"(1)
  "Zmiana_control": bool
  "TerminalType_Właściwy": i32 = 1
  "ACFilter_Właściwy": i32 = ">3Hz"(3)
panel indicators:
  "Właściwy_indicator": bool
  "String_Właściwy": string
  "Zmiana_indicator": bool
uses:
  Agilent 3446X Series::Initialize.gvi
  Agilent 3446X Series::Configure Measurement.gvi
  Agilent 3446X Series::Configure Current.gvi
  Agilent 3446X Series::Close.gvi
diagram:
  disable {
    frame Enabled {
      Property Node(instance in=reference to "AutoRange_Właściwy", "Visible"=FALSE)
      Property Node(instance in=reference to "TerminalType_Właściwy", "Visible"=FALSE)
      Property Node(instance in=reference to "ACFilter_Właściwy", "Visible"=FALSE)
      Property Node(instance in=reference to "ManualRange_Właściwy", "Visible"=FALSE)
    }
    frame Disabled { }
  }
  disable {
    frame Enabled {
      Property Node(instance in=reference to unnamed text, "Visible"=FALSE)
      Property Node(instance in=reference to "String_Właściwy", "Visible"=FALSE)
    }
    frame Disabled { }
  }
  disable {
    frame Enabled {
      Property Node(instance in=reference to "Zmiana_indicator", "Visible"=FALSE)
      Property Node(instance in=reference to "Właściwy_indicator", "Visible"=FALSE)
      Property Node(instance in=reference to "Właściwy_control", "Visible"=TRUE, "Disabled"=FALSE)
      Property Node(instance in=reference to "Zmiana_control", "Visible"=TRUE, "Disabled"=FALSE)
    }
    frame Disabled { }
  }
  disable {
    frame Enabled {
      $Zmiana_indicator <- FALSE
      $Właściwy_indicator <- FALSE
    }
    frame Disabled { }
  }
  call "Initialize.gvi"(VISA resource name="TCPIP0::A-34461A-0000-2.local::inst0::INSTR") -> (VISA resource name out=w1, error out=w2)
  while {
    disable {
      frame Enabled {
        $Właściwy_indicator <- $Właściwy_control
        $Zmiana_indicator <- $Zmiana_control
      }
      frame Disabled { }
    }
    event {
      on "Właściwy_control" Value changed {
        Property Node(instance in=reference to "AutoRange_Właściwy", "Visible"=TRUE)
        Property Node(instance in=reference to "TerminalType_Właściwy", "Visible"=TRUE)
        Property Node(instance in=reference to "ACFilter_Właściwy", "Visible"=TRUE)
        Property Node(instance in=reference to "ManualRange_Właściwy", "Visible"=TRUE)
        Property Node(instance in=reference to unnamed text, "Visible"=TRUE)
        Property Node(instance in=reference to "String_Właściwy", "Visible"=TRUE)
        call "Configure Measurement.gvi"(VISA resource name=w1, error in=w2, measurement function="Current AC"(1)) -> (VISA resource name out=w4, error out=w5)
        Event Data() -> ("Old Value"=w6, "New Value"=w7)
        Property Node(instance in=reference to "Zmiana_indicator", "Visible"=w6)
        Property Node(instance in=reference to "Właściwy_control", "Visible"=w6)
        Property Node(instance in=reference to "Zmiana_control", "Visible"=w7, "Value"=FALSE)
        Property Node(instance in=reference to "Właściwy_indicator", "Visible"=w7)
        w3 = default
      }
      on "Zmiana_control" Value changed {
        Property Node(instance in=reference to "AutoRange_Właściwy", "Visible"=FALSE)
        Property Node(instance in=reference to "TerminalType_Właściwy", "Visible"=FALSE)
        Property Node(instance in=reference to "ACFilter_Właściwy", "Visible"=FALSE)
        Property Node(instance in=reference to "ManualRange_Właściwy", "Visible"=FALSE)
        Property Node(instance in=reference to unnamed text, "Visible"=FALSE)
        Property Node(instance in=reference to "String_Właściwy", "Visible"=FALSE)
        call "Configure Measurement.gvi"(VISA resource name=w1, error in=w2, measurement function="Voltage DC"(10)) -> (VISA resource name out=w4, error out=w5)
        Event Data() -> ("Old Value"=w8, "New Value"=w9)
        Property Node(instance in=reference to "Właściwy_control", "Visible"=w9, "Value"=FALSE)
        Property Node(instance in=reference to "Właściwy_indicator", "Visible"=w8)
        Property Node(instance in=reference to "Zmiana_control", "Visible"=w8)
        Property Node(instance in=reference to "Zmiana_indicator", "Visible"=w9)
        w3 = default
      }
      on "ACFilter_Właściwy" Value changed; "AutoRange_Właściwy" Value changed; "ManualRange_Właściwy" Value changed; "TerminalType_Właściwy" Value changed {
        Property Node(instance in=reference to "TerminalType_Właściwy") -> ("Value"=w10)
        Property Node(instance in=reference to "AutoRange_Właściwy") -> ("Value"=w11)
        case (w10) {
          frame 3, Default {
            w12 = [8]
          }
          frame 10 {
            w12 = i32[] []
          }
        }
        Property Node(instance in=reference to "ManualRange_Właściwy", "Disabled"=w11, "DisabledIndexes"=w12) -> ("Value"=w13)
        Is Equal(x=w10, y=3) -> w14
        Is Equal(x=w13, y=10) -> w15
        Logical And(w15, w14) -> w16
        case (w16) {
          frame False, Default {
            w17 = w13
          }
          frame True {
            w17 = 3
          }
        }
        call "Configure Measurement.gvi"(manual range=w17, VISA resource name=w1, error in=w2, measurement function="Current AC"(1), auto range=w11) -> (VISA resource name out=w18, error out=w19)
        Property Node(instance in=reference to "ACFilter_Właściwy") -> ("Value"=w20)
        To Double Precision Float(number=w20) -> w21
        call "Configure Current.gvi"(VISA resource name=w18, error in=w19, current bandwidth=w21, current type="AC"(0), terminal type=w10) -> (VISA resource name out=w4, error out=w5)
        Format Into String(formatString="%.0pA", initString="Terminal: ", w10) -> w22
        Property Node(instance in=reference to "ManualRange_Właściwy", "Value"=w17) -> ("Value"=w23)
        case (w11) {
          frame False, Default {
            Format Into String(formatString="%.0pA", initString="Range: ", w23) -> w24
          }
          frame True {
            w24 = "Range: Auto"
          }
        }
        Format Into String(formatString="%.0pHz", initString="AC Filter: >", w20) -> w25
        Concatenate Strings("Your settings:", "\r\n", w22, "\r\n", w24, "\r\n", w25) -> w26
        $String_Właściwy <- w26
        w3 = default
      }
      on "stop" Value changed; "Window" Close {
        w3 = TRUE
        w4 = w1
        w5 = w2
      }
    }
    stop if w3
  }
  call "Close.gvi"(VISA resource name=w4, error in=w5)
