vi "X_CAPACITANCE.gvi"   [LabVIEW NXG 5.1.0]
panel controls:
  "Właściwy_control": bool
  "stop": bool
  "AutoRange_Właściwy": bool = TRUE
  "ManualRange_Właściwy": f64 = 1
  "Zmiana_control": bool
panel indicators:
  "Właściwy_indicator": bool
  "String_Właściwy": string
  "Zmiana_indicator": bool
uses:
  Agilent 3446X Series::Initialize.gvi
  Agilent 3446X Series::Configure Measurement.gvi
  Agilent 3446X Series::Close.gvi
diagram:
  Property Node(instance in=reference to "ManualRange_Właściwy", "Visible"=FALSE)
  Property Node(instance in=reference to "String_Właściwy", "Visible"=FALSE)
  Property Node(instance in=reference to unnamed text, "Visible"=FALSE)
  # VISIBILITY
  Property Node(instance in=reference to "AutoRange_Właściwy", "Visible"=FALSE)
  Property Node(instance in=reference to "Zmiana_control", "Visible"=TRUE, "Disabled"=FALSE)
  Property Node(instance in=reference to "Właściwy_control", "Visible"=TRUE, "Disabled"=FALSE)
  $Właściwy_indicator <- FALSE
  $Zmiana_indicator <- FALSE
  Property Node(instance in=reference to "Właściwy_indicator", "Visible"=FALSE)
  Property Node(instance in=reference to "Zmiana_indicator", "Visible"=FALSE)
  call "Initialize.gvi"(VISA resource name="TCPIP0::A-34461A-0000-2.local::inst0::INSTR") -> (VISA resource name out=w1, error out=w2)
  while {
    $Właściwy_indicator <- $Właściwy_control
    event {
      on "Właściwy_control" Value changed {
        Property Node(instance in=reference to "ManualRange_Właściwy", "Visible"=TRUE)
        Property Node(instance in=reference to "String_Właściwy", "Visible"=TRUE)
        Property Node(instance in=reference to unnamed text, "Visible"=TRUE)
        # VISIBILITY
        Property Node(instance in=reference to "AutoRange_Właściwy", "Visible"=TRUE)
        Event Data() -> ("Old Value"=w6, "New Value"=w7)
        Property Node(instance in=reference to "Zmiana_indicator", "Visible"=w6)
        Property Node(instance in=reference to "Właściwy_control", "Visible"=w6)
        Property Node(instance in=reference to "Właściwy_indicator", "Visible"=w7)
        Property Node(instance in=reference to "Zmiana_control", "Visible"=w7, "Value"=FALSE)
        call "Configure Measurement.gvi"(VISA resource name=w1, error in=w2, measurement function="Capacitance"(12)) -> (VISA resource name out=w4, error out=w5)
        w3 = default
      }
      on "Zmiana_control" Value changed {
        Property Node(instance in=reference to "ManualRange_Właściwy", "Visible"=FALSE)
        Property Node(instance in=reference to "String_Właściwy", "Visible"=FALSE)
        Property Node(instance in=reference to unnamed text, "Visible"=FALSE)
        # VISIBILITY
        Property Node(instance in=reference to "AutoRange_Właściwy", "Visible"=FALSE)
        Event Data() -> ("Old Value"=w8, "New Value"=w9)
        Property Node(instance in=reference to "Właściwy_indicator", "Visible"=w8)
        Property Node(instance in=reference to "Właściwy_control", "Visible"=w9, "Value"=FALSE)
        Property Node(instance in=reference to "Zmiana_indicator", "Visible"=w9)
        Property Node(instance in=reference to "Zmiana_control", "Visible"=w8)
        call "Configure Measurement.gvi"(VISA resource name=w1, error in=w2, measurement function="Voltage DC"(10)) -> (VISA resource name out=w4, error out=w5)
        w3 = default
      }
      on "AutoRange_Właściwy" Value changed; "ManualRange_Właściwy" Value changed {
        Property Node(instance in=reference to "AutoRange_Właściwy") -> ("Value"=w10)
        Property Node(instance in=reference to "ManualRange_Właściwy", "Disabled"=w10) -> ("Value"=w11)
        call "Configure Measurement.gvi"(manual range=w11, VISA resource name=w1, error in=w2, measurement function="Capacitance"(12), auto range=w10) -> (VISA resource name out=w4, error out=w5)
        # BUILDING STRING
        case (w10) {
          frame False, Default {
            Format Into String(formatString="%.0pV", initString="Range: ", w11) -> w12
          }
          frame True {
            w12 = "Range: Auto"
          }
        }
        Concatenate Strings("Your settings:", "\r\n", w12) -> w13
        $String_Właściwy <- w13
        w3 = default
      }
      on "stop" Value changed; "Window" Close {
        w3 = TRUE
        w4 = w1
        w5 = w2
      }
    }
    $Zmiana_indicator <- $Zmiana_control
    stop if w3
  }
  call "Close.gvi"(VISA resource name=w4, error in=w5)
