vi "X_DCCURRENT.gvi"   [LabVIEW NXG 5.1.0]
panel controls:
  "Właściwy_control": bool
  "stop": bool
  "AutoRange_Właściwy": bool = TRUE
  "ManualRange_Właściwy": f64 = "1 A"(1)
  "Zmiana_control": bool
  "Aperture_Właściwy": bool = TRUE
  "ApertureNPLC_Właściwy": f64 = "10 PLC"(10)
  "AutoZero_Właściwy": bool = TRUE
  "TerminalType_Właściwy": i32 = 1
panel indicators:
  "Właściwy_indicator": bool
  "String_Właściwy": string
  "Zmiana_indicator": bool
  "ApertureTime_Właściwy": f64
uses:
  Agilent 3446X Series::Initialize.gvi
  Agilent 3446X Series::Configure Measurement.gvi
  Agilent 3446X Series::Auto Zero.gvi
  Agilent 3446X Series::Configure Current.gvi
  Agilent 3446X Series::Configure Measurement Aperture.gvi
  Agilent 3446X Series::Close.gvi
diagram:
  disable {
    frame Enabled {
      Property Node(instance in=reference to "AutoZero_Właściwy", "Visible"=FALSE)
      Property Node(instance in=reference to "ApertureTime_Właściwy", "Visible"=FALSE)
      # VISIBILITY
      Property Node(instance in=reference to "AutoRange_Właściwy", "Visible"=FALSE)
      Property Node(instance in=reference to "ApertureNPLC_Właściwy", "Visible"=FALSE)
      Property Node(instance in=reference to "TerminalType_Właściwy", "Visible"=FALSE)
      Property Node(instance in=reference to "Aperture_Właściwy", "Visible"=FALSE)
      Property Node(instance in=reference to "ManualRange_Właściwy", "Visible"=FALSE)
    }
    frame Disabled { }
  }
  disable {
    frame Enabled {
      Property Node(instance in=reference to unnamed text, "Visible"=FALSE)
      Property Node(instance in=reference to "String_Właściwy", "Visible"=FALSE)
    }
    frame Disabled { }
  }
  disable {
    frame Enabled {
      Property Node(instance in=reference to "Zmiana_indicator", "Visible"=FALSE)
      Property Node(instance in=reference to "Właściwy_indicator", "Visible"=FALSE)
      Property Node(instance in=reference to "Właściwy_control", "Visible"=TRUE, "Disabled"=FALSE)
      Property Node(instance in=reference to "Zmiana_control", "Visible"=TRUE, "Disabled"=FALSE)
    }
    frame Disabled { }
  }
  disable {
    frame Enabled {
      $Zmiana_indicator <- FALSE
      $Właściwy_indicator <- FALSE
    }
    frame Disabled { }
  }
  call "Initialize.gvi"(VISA resource name="TCPIP0::A-34461A-0000-2.local::inst0::INSTR") -> (VISA resource name out=w1, error out=w2)
  while {
    disable {
      frame Enabled {
        $Właściwy_indicator <- $Właściwy_control
        $Zmiana_indicator <- $Zmiana_control
      }
      frame Disabled { }
    }
    event {
      on "Właściwy_control" Value changed {
        Event Data() -> ("Old Value"=w6, "New Value"=w7)
        Property Node(instance in=reference to "Zmiana_indicator", "Visible"=w6)
        Property Node(instance in=reference to "Właściwy_control", "Visible"=w6)
        Property Node(instance in=reference to "Zmiana_control", "Visible"=w7, "Value"=FALSE)
        Property Node(instance in=reference to "Właściwy_indicator", "Visible"=w7)
        Property Node(instance in=reference to unnamed text, "Visible"=TRUE)
        Property Node(instance in=reference to "String_Właściwy", "Visible"=TRUE)
        call "Configure Measurement.gvi"(VISA resource name=w1, error in=w2, measurement function="Current DC"(2)) -> (VISA resource name out=w4, error out=w5)
        Property Node(instance in=reference to "AutoZero_Właściwy", "Visible"=TRUE)
        Property Node(instance in=reference to "ApertureTime_Właściwy", "Visible"=TRUE)
        # VISIBILITY
        Property Node(instance in=reference to "AutoRange_Właściwy", "Visible"=TRUE)
        Property Node(instance in=reference to "ApertureNPLC_Właściwy", "Visible"=TRUE)
        Property Node(instance in=reference to "TerminalType_Właściwy", "Visible"=TRUE)
        Property Node(instance in=reference to "Aperture_Właściwy", "Visible"=TRUE)
        Property Node(instance in=reference to "ManualRange_Właściwy", "Visible"=TRUE)
        w3 = default
      }
      on "Zmiana_control" Value changed {
        Property Node(instance in=reference to unnamed text, "Visible"=FALSE)
        Property Node(instance in=reference to "String_Właściwy", "Visible"=FALSE)
        call "Configure Measurement.gvi"(VISA resource name=w1, error in=w2, measurement function="Voltage DC"(10)) -> (VISA resource name out=w4, error out=w5)
        Event Data() -> ("Old Value"=w8, "New Value"=w9)
        Property Node(instance in=reference to "Właściwy_indicator", "Visible"=w8)
        Property Node(instance in=reference to "Zmiana_control", "Visible"=w8)
        Property Node(instance in=reference to "Właściwy_control", "Visible"=w9, "Value"=FALSE)
        Property Node(instance in=reference to "Zmiana_indicator", "Visible"=w9)
        Property Node(instance in=reference to "AutoZero_Właściwy", "Visible"=FALSE)
        Property Node(instance in=reference to "ApertureTime_Właściwy", "Visible"=FALSE)
        # VISIBILITY
        Property Node(instance in=reference to "AutoRange_Właściwy", "Visible"=FALSE)
        Property Node(instance in=reference to "ApertureNPLC_Właściwy", "Visible"=FALSE)
        Property Node(instance in=reference to "TerminalType_Właściwy", "Visible"=FALSE)
        Property Node(instance in=reference to "Aperture_Właściwy", "Visible"=FALSE)
        Property Node(instance in=reference to "ManualRange_Właściwy", "Visible"=FALSE)
        w3 = default
      }
      on "Aperture_Właściwy" Value changed; "ApertureNPLC_Właściwy" Value changed; "ApertureTime_Właściwy" Value changed; "AutoRange_Właściwy" Value changed; "AutoZero_Właściwy" Value changed; "ManualRange_Właściwy" Value changed; "TerminalType_Właściwy" Value changed {
        Property Node(instance in=reference to "TerminalType_Właściwy") -> ("Value"=w10)
        Format Into String(formatString="%.0pA", initString="Terminal: ", w10) -> w11
        Property Node(instance in=reference to "AutoRange_Właściwy") -> ("Value"=w12)
        case (w10) {
          frame 3, Default {
            w13 = [8]
          }
          frame 10 {
            w13 = i32[] []
          }
        }
        Property Node(instance in=reference to "ManualRange_Właściwy", "Disabled"=w12, "DisabledIndexes"=w13) -> ("Value"=w14)
        Is Equal(x=w10, y=3) -> w15
        Is Equal(x=w14, y=10) -> w16
        Logical And(w16, w15) -> w17
        case (w17) {
          frame False, Default {
            w18 = w14
          }
          frame True {
            w18 = 3
          }
        }
        Property Node(instance in=reference to "ManualRange_Właściwy", "Value"=w18) -> ("Value"=w19)
        case (w12) {
          frame False, Default {
            Format Into String(formatString="%.0pA", initString="Range: ", w19) -> w20
          }
          frame True {
            w20 = "Range: Auto"
          }
        }
        Property Node(instance in=reference to "AutoZero_Właściwy") -> ("Value"=w21)
        case (w21) {
          frame False, Default {
            w22 = "Auto Zero: Off"
          }
          frame True {
            w22 = "Auto Zero: On"
          }
        }
        Property Node(instance in=reference to "Aperture_Właściwy") -> ("Value"=w23)
        Property Node(instance in=reference to "ApertureTime_Właściwy", "Disabled"=w23) -> ("Value"=w24)
        Quotient And Remainder(x=w24, y=2e-06) -> (floor(x/y)=w25, x-y*floor(x/y)=w26)
        Multiply(w26, 1000000) -> w27
        Round To Nearest(number=w27) -> w28
        To Signed 32 Bit Integer(number=w28) -> w29
        case (w29) {
          frame 0, Default {
            Multiply(2e-06, w25) -> w30
          }
          frame 1 {
            Multiply(2e-06, w25) -> w30
          }
          frame 2 {
            Add(1, w25) -> w31
            Multiply(2e-06, w31) -> w30
          }
        }
        Not(x=w23) -> w32
        Property Node(instance in=reference to "ApertureNPLC_Właściwy", "Disabled"=w32) -> ("Value"=w33)
        case (w23) {
          frame False, Default {
            Format Into String(formatString="%_6ps", initString="Aperture Time: ", w30) -> w34
          }
          frame True {
            Format Into String(formatString="%#gPLC", initString="Aperture NPLC: ", w33) -> w34
          }
        }
        Concatenate Strings("Your settings:", "\r\n", w11, "\r\n", w20, "\r\n", w34, "\r\n", w22) -> w35
        $String_Właściwy <- w35
        call "Configure Measurement.gvi"(manual range=w18, VISA resource name=w1, error in=w2, measurement function="Current DC"(2), auto range=w12) -> (VISA resource name out=w36, error out=w37)
        case (w21) {
          frame False, Default {
            call "Auto Zero.gvi"(VISA resource name=w36, error in=w37, zero type="Current DC"(0), auto zero="Disable"(0)) -> (VISA resource name out=w38, error out=w39)
          }
          frame True {
            call "Auto Zero.gvi"(VISA resource name=w36, error in=w37, zero type="Current DC"(0), auto zero="Enable"(1)) -> (VISA resource name out=w38, error out=w39)
          }
        }
        case (w23) {
          frame False, Default {
            call "Configure Current.gvi"(current integration time=w33, VISA resource name=w38, error in=w39, current type="DC"(1), terminal type=w10) -> (VISA resource name out=w40, error out=w41)
            call "Configure Measurement Aperture.gvi"(VISA resource name=w40, error in=w41, measurement function="Current DC"(2), enable aperture=TRUE, aperture time=w30) -> (VISA resource name out=w4, error out=w5)
          }
          frame True {
            call "Configure Current.gvi"(current integration time=w33, VISA resource name=w38, error in=w39, current type="DC"(1), terminal type=w10) -> (VISA resource name out=w42, error out=w43)
            call "Configure Measurement Aperture.gvi"(VISA resource name=w42, error in=w43, measurement function="Current DC"(2), enable aperture=FALSE) -> (VISA resource name out=w4, error out=w5)
          }
        }
        Property Node(instance in=reference to "ApertureTime_Właściwy", "Value"=w30)
        w3 = default
      }
      on "stop" Value changed; "Window" Close {
        w3 = TRUE
        w4 = w1
        w5 = w2
      }
    }
    stop if w3
  }
  call "Close.gvi"(VISA resource name=w4, error in=w5)
