vi "X_FREQPERIOD.gvi"   [LabVIEW NXG 5.1.0]
panel controls:
  "Właściwy_control": bool
  "stop": bool
  "AutoRange_WłaściwyF": bool = TRUE
  "ManualRange_WłaściwyF": f64 = "1 V"(1)
  "ACFilter_WłaściwyF": i32 = ">3Hz"(3)
  "Zmiana_control": bool
  "GateTime_WłaściwyF": f64 = "1 s"(1)
  "Timeout_WłaściwyF": bool = TRUE
  "Timeout_WłaściwyP": bool = TRUE
  "GateTime_WłaściwyP": f64 = "1 s"(1)
  "AutoRange_WłaściwyP": bool = TRUE
  "ManualRange_WłaściwyP": f64 = "1 V"(1)
  "ACFilter_WłaściwyP": i32 = ">3Hz"(3)
  "Addition_toenable": bool = TRUE
  "Addition_todisable": bool = TRUE
panel indicators:
  "Właściwy_indicator": bool
  "Zmiana_indicator": bool
  "String_WłaściwyP": string
  "String_WłaściwyF": string
uses:
  Agilent 3446X Series::Initialize.gvi
  Agilent 3446X Series::Configure Measurement.gvi
  Agilent 3446X Series::Configure Frequency Period.gvi
  Agilent 3446X Series::Close.gvi
diagram:
  disable {
    frame Enabled {
      Property Node(instance in=reference to "ManualRange_WłaściwyP", "Visible"=FALSE)
      Property Node(instance in=reference to "GateTime_WłaściwyP", "Visible"=FALSE)
      Property Node(instance in=reference to "Timeout_WłaściwyP", "Visible"=FALSE)
      Property Node(instance in=reference to "AutoRange_WłaściwyP", "Visible"=FALSE)
      Property Node(instance in=reference to "ACFilter_WłaściwyP", "Visible"=FALSE)
    }
    frame Disabled { }
  }
  disable {
    frame Enabled {
      Property Node(instance in=reference to "String_WłaściwyP", "Visible"=FALSE)
      Property Node(instance in=reference to "String_WłaściwyF", "Visible"=FALSE)
      Property Node(instance in=reference to unnamed text, "Visible"=FALSE)
    }
    frame Disabled { }
  }
  disable {
    frame Enabled {
      Property Node(instance in=reference to "Właściwy_indicator", "Visible"=FALSE)
      Property Node(instance in=reference to "Zmiana_indicator", "Visible"=FALSE)
      Property Node(instance in=reference to "Zmiana_control", "Visible"=TRUE, "Disabled"=FALSE)
      Property Node(instance in=reference to "Właściwy_control", "Visible"=TRUE, "Disabled"=FALSE)
    }
    frame Disabled { }
  }
  disable {
    frame Enabled {
      Property Node(instance in=reference to "Addition_todisable", "Visible"=FALSE)
      Property Node(instance in=reference to "Addition_toenable", "Visible"=FALSE)
    }
    frame Disabled { }
  }
  disable {
    frame Enabled {
      Property Node(instance in=reference to "Timeout_WłaściwyF", "Visible"=FALSE)
      Property Node(instance in=reference to "GateTime_WłaściwyF", "Visible"=FALSE)
      Property Node(instance in=reference to "ACFilter_WłaściwyF", "Visible"=FALSE)
      Property Node(instance in=reference to "ManualRange_WłaściwyF", "Visible"=FALSE)
      # VISIBILITY
      Property Node(instance in=reference to "AutoRange_WłaściwyF", "Visible"=FALSE)
    }
    frame Disabled { }
  }
  disable {
    frame Enabled {
      $Zmiana_indicator <- FALSE
      $Addition_toenable <- FALSE
      $Addition_todisable <- FALSE
      $Właściwy_indicator <- FALSE
    }
    frame Disabled { }
  }
  call "Initialize.gvi"(VISA resource name="TCPIP0::A-34461A-0000-2.local::inst0::INSTR") -> (VISA resource name out=w1, error out=w2)
  while {
    $Właściwy_indicator <- $Właściwy_control
    event {
      on "Właściwy_control" Value changed {
        Property Node(instance in=reference to "GateTime_WłaściwyF", "Visible"=TRUE)
        Property Node(instance in=reference to "ACFilter_WłaściwyF", "Visible"=TRUE)
        Property Node(instance in=reference to "Timeout_WłaściwyF", "Visible"=TRUE)
        Property Node(instance in=reference to "ManualRange_WłaściwyF", "Visible"=TRUE)
        # VISIBILITY
        Property Node(instance in=reference to "AutoRange_WłaściwyF", "Visible"=TRUE)
        Event Data() -> ("Old Value"=w6, "New Value"=w7)
        Property Node(instance in=reference to "Właściwy_control", "Visible"=w6)
        Property Node(instance in=reference to "Zmiana_indicator", "Visible"=w6)
        Property Node(instance in=reference to "Właściwy_indicator", "Visible"=w7)
        Property Node(instance in=reference to "Zmiana_control", "Visible"=w7, "Value"=FALSE)
        Property Node(instance in=reference to "Addition_toenable", "Visible"=TRUE)
        call "Configure Measurement.gvi"(VISA resource name=w1, error in=w2, measurement function="Frequency"(4)) -> (VISA resource name out=w4, error out=w5)
        Property Node(instance in=reference to "Addition_todisable", "Visible"=FALSE)
        Property Node(instance in=reference to "String_WłaściwyF", "Visible"=TRUE)
        Property Node(instance in=reference to unnamed text, "Visible"=TRUE)
        w3 = default
      }
      on "Zmiana_control" Value changed {
        Property Node(instance in=reference to "ManualRange_WłaściwyP", "Visible"=FALSE)
        Property Node(instance in=reference to "GateTime_WłaściwyP", "Visible"=FALSE)
        Property Node(instance in=reference to "Timeout_WłaściwyP", "Visible"=FALSE)
        Property Node(instance in=reference to "AutoRange_WłaściwyP", "Visible"=FALSE)
        Property Node(instance in=reference to "ACFilter_WłaściwyP", "Visible"=FALSE)
        Property Node(instance in=reference to "GateTime_WłaściwyF", "Visible"=FALSE)
        Property Node(instance in=reference to "ACFilter_WłaściwyF", "Visible"=FALSE)
        Property Node(instance in=reference to "Timeout_WłaściwyF", "Visible"=FALSE)
        Property Node(instance in=reference to "ManualRange_WłaściwyF", "Visible"=FALSE)
        # VISIBILITY
        Property Node(instance in=reference to "AutoRange_WłaściwyF", "Visible"=FALSE)
        Property Node(instance in=reference to "Addition_todisable", "Visible"=FALSE, "Value"=FALSE)
        Property Node(instance in=reference to "Addition_toenable", "Visible"=FALSE, "Value"=FALSE)
        Property Node(instance in=reference to "String_WłaściwyP", "Visible"=FALSE)
        Property Node(instance in=reference to "String_WłaściwyF", "Visible"=FALSE)
        Property Node(instance in=reference to unnamed text, "Visible"=FALSE)
        call "Configure Measurement.gvi"(VISA resource name=w1, error in=w2, measurement function="Voltage DC"(10)) -> (VISA resource name out=w4, error out=w5)
        Event Data() -> ("Old Value"=w8, "New Value"=w9)
        Property Node(instance in=reference to "Zmiana_control", "Visible"=w8)
        Property Node(instance in=reference to "Właściwy_indicator", "Visible"=w8)
        Property Node(instance in=reference to "Właściwy_control", "Visible"=w9, "Value"=FALSE)
        Property Node(instance in=reference to "Zmiana_indicator", "Visible"=w9)
        w3 = default
      }
      on "ACFilter_WłaściwyF" Value changed; "AutoRange_WłaściwyF" Value changed; "GateTime_WłaściwyF" Value changed; "ManualRange_WłaściwyF" Value changed; "Timeout_WłaściwyF" Value changed {
        Property Node(instance in=reference to "AutoRange_WłaściwyF") -> ("Value"=w10)
        Property Node(instance in=reference to "ManualRange_WłaściwyF", "Disabled"=w10) -> ("Value"=w11)
        case (w10) {
          frame False, Default {
            Format Into String(formatString="%.0pV", initString="Range: ", w11) -> w12
          }
          frame True {
            w12 = "Range: Auto"
          }
        }
        Property Node(instance in=reference to "Timeout_WłaściwyF") -> ("Value"=w13)
        case (w13) {
          frame False, Default {
            w14 = "Timeout: 1s"
          }
          frame True {
            w14 = "Timeout: Auto"
          }
        }
        Property Node(instance in=reference to "ACFilter_WłaściwyF") -> ("Value"=w15)
        Format Into String(formatString="%.0pHz", initString="AC Filter: >", w15) -> w16
        Property Node(instance in=reference to "GateTime_WłaściwyF") -> ("Value"=w17)
        Format Into String(formatString="%.0ps", initString="Gate Time: ", w17) -> w18
        Concatenate Strings("Your settings:", "\r\n", w12, "\r\n", w16, "\r\n", w18, "\r\n", w14) -> w19
        $String_WłaściwyF <- w19
        To Double Precision Float(number=w15) -> w20
        Boolean To 0 Or 1(Boolean=w10) -> (0, 1=w21)
        To Signed 32 Bit Integer(number=w21) -> w22
        call "Configure Frequency Period.gvi"(auto voltage range=w22, auto timeout=w13, VISA resource name=w1, error in=w2, frequency period="Frequency"(0), aperture time=w17, AC bandwidth=w20, voltage range=w11) -> (VISA resource name out=w4, error out=w5)
        w3 = default
      }
      on "ACFilter_WłaściwyP" Value changed; "AutoRange_WłaściwyP" Value changed; "GateTime_WłaściwyP" Value changed; "ManualRange_WłaściwyP" Value changed; "Timeout_WłaściwyP" Value changed {
        Property Node(instance in=reference to "AutoRange_WłaściwyP") -> ("Value"=w23)
        Property Node(instance in=reference to "ManualRange_WłaściwyP", "Disabled"=w23) -> ("Value"=w24)
        case (w23) {
          frame False, Default {
            Format Into String(formatString="%.0pV", initString="Range: ", w24) -> w25
          }
          frame True {
            w25 = "Range: Auto"
          }
        }
        Property Node(instance in=reference to "Timeout_WłaściwyP") -> ("Value"=w26)
        case (w26) {
          frame False, Default {
            w27 = "Timeout: 1s"
          }
          frame True {
            w27 = "Timeout: Auto"
          }
        }
        Property Node(instance in=reference to "ACFilter_WłaściwyP") -> ("Value"=w28)
        Format Into String(formatString="%.0pHz", initString="AC Filter: >", w28) -> w29
        Property Node(instance in=reference to "GateTime_WłaściwyP") -> ("Value"=w30)
        Format Into String(formatString="%.0ps", initString="Gate Time: ", w30) -> w31
        Concatenate Strings("Your settings:", "\r\n", w25, "\r\n", w29, "\r\n", w31, "\r\n", w27) -> w32
        $String_WłaściwyP <- w32
        To Double Precision Float(number=w28) -> w33
        Boolean To 0 Or 1(Boolean=w23) -> (0, 1=w34)
        To Signed 32 Bit Integer(number=w34) -> w35
        call "Configure Frequency Period.gvi"(auto voltage range=w35, auto timeout=w26, VISA resource name=w1, error in=w2, frequency period="Period"(1), aperture time=w30, AC bandwidth=w33, voltage range=w24) -> (VISA resource name out=w4, error out=w5)
        w3 = default
      }
      on "stop" Value changed; "Window" Close {
        w3 = TRUE
        w4 = w1
        w5 = w2
      }
      on "Addition_toenable" Value changed {
        Event Data() -> ("Old Value"=w36, "New Value"=w37)
        Property Node(instance in=reference to "Addition_toenable", "Visible"=w36)
        Property Node(instance in=reference to "Addition_todisable", "Visible"=w37, "Value"=w37)
        Property Node(instance in=reference to "String_WłaściwyP", "Visible"=TRUE)
        Property Node(instance in=reference to "ManualRange_WłaściwyP", "Visible"=TRUE)
        Property Node(instance in=reference to "GateTime_WłaściwyP", "Visible"=TRUE)
        Property Node(instance in=reference to "Timeout_WłaściwyP", "Visible"=TRUE)
        Property Node(instance in=reference to "AutoRange_WłaściwyP", "Visible"=TRUE)
        Property Node(instance in=reference to "ACFilter_WłaściwyP", "Visible"=TRUE)
        call "Configure Measurement.gvi"(VISA resource name=w1, error in=w2, measurement function="Period"(6)) -> (VISA resource name out=w4, error out=w5)
        Property Node(instance in=reference to "String_WłaściwyF", "Visible"=FALSE)
        Property Node(instance in=reference to "Timeout_WłaściwyF", "Visible"=FALSE)
        Property Node(instance in=reference to "GateTime_WłaściwyF", "Visible"=FALSE)
        Property Node(instance in=reference to "ACFilter_WłaściwyF", "Visible"=FALSE)
        Property Node(instance in=reference to "ManualRange_WłaściwyF", "Visible"=FALSE)
        Property Node(instance in=reference to "AutoRange_WłaściwyF", "Visible"=FALSE)
        w3 = default
      }
      on "Addition_todisable" Value changed {
        Property Node(instance in=reference to "String_WłaściwyP", "Visible"=FALSE)
        Property Node(instance in=reference to "ManualRange_WłaściwyP", "Visible"=FALSE)
        Property Node(instance in=reference to "GateTime_WłaściwyP", "Visible"=FALSE)
        Property Node(instance in=reference to "Timeout_WłaściwyP", "Visible"=FALSE)
        Property Node(instance in=reference to "AutoRange_WłaściwyP", "Visible"=FALSE)
        Property Node(instance in=reference to "ACFilter_WłaściwyP", "Visible"=FALSE)
        call "Configure Measurement.gvi"(VISA resource name=w1, error in=w2, measurement function="Frequency"(4)) -> (VISA resource name out=w4, error out=w5)
        Property Node(instance in=reference to "Addition_todisable", "Visible"=FALSE)
        Property Node(instance in=reference to "String_WłaściwyF", "Visible"=TRUE)
        Property Node(instance in=reference to "Timeout_WłaściwyF", "Visible"=TRUE)
        Property Node(instance in=reference to "GateTime_WłaściwyF", "Visible"=TRUE)
        Property Node(instance in=reference to "ACFilter_WłaściwyF", "Visible"=TRUE)
        Property Node(instance in=reference to "ManualRange_WłaściwyF", "Visible"=TRUE)
        Property Node(instance in=reference to "AutoRange_WłaściwyF", "Visible"=TRUE)
        Event Data() -> ("New Value"=w38)
        Property Node(instance in=reference to "Addition_toenable", "Visible"=TRUE, "Value"=w38)
        w3 = default
      }
    }
    $Zmiana_indicator <- $Zmiana_control
    stop if w3
  }
  call "Close.gvi"(VISA resource name=w4, error in=w5)
