vi "X_RESET.gvi"   [LabVIEW NXG 5.1.0]
panel controls:
  "Właściwy_control": bool
  "stop": bool
  "Zmiana_control": bool
panel indicators:
  "Właściwy_indicator": bool
  "Zmiana_indicator": bool
uses:
  Agilent 3446X Series::Initialize.gvi
  Agilent 3446X Series::Reset.gvi
  Agilent 3446X Series::Configure Measurement.gvi
  Agilent 3446X Series::Close.gvi
diagram:
  Property Node(instance in=reference to unnamed text, "Visible"=FALSE)
  Property Node(instance in=reference to "Zmiana_control", "Visible"=TRUE, "Disabled"=FALSE)
  Property Node(instance in=reference to "Właściwy_control", "Visible"=TRUE, "Disabled"=FALSE)
  $Właściwy_indicator <- FALSE
  $Zmiana_indicator <- FALSE
  Property Node(instance in=reference to "Właściwy_indicator", "Visible"=FALSE)
  Property Node(instance in=reference to "Zmiana_indicator", "Visible"=FALSE)
  call "Initialize.gvi"(VISA resource name="TCPIP0::A-34461A-0000-2.local::inst0::INSTR") -> (VISA resource name out=w1, error out=w2)
  while {
    $Właściwy_indicator <- $Właściwy_control
    event {
      on "Właściwy_control" Value changed {
        Property Node(instance in=reference to unnamed text, "Visible"=TRUE)
        Event Data() -> ("Old Value"=w6, "New Value"=w7)
        Property Node(instance in=reference to "Właściwy_control", "Visible"=w6)
        # VISIBILITY
        Property Node(instance in=reference to "Zmiana_indicator", "Visible"=w6)
        Property Node(instance in=reference to "Właściwy_indicator", "Visible"=w7)
        Property Node(instance in=reference to "Zmiana_control", "Visible"=w7, "Value"=FALSE)
        call "Reset.gvi"(VISA resource name=w1, error in=w2) -> (VISA resource name out=w4, error out=w5)
        w3 = default
      }
      on "Zmiana_control" Value changed {
        Property Node(instance in=reference to unnamed text, "Visible"=FALSE)
        Event Data() -> ("Old Value"=w8, "New Value"=w9)
        Property Node(instance in=reference to "Zmiana_indicator", "Visible"=w9)
        Property Node(instance in=reference to "Zmiana_control", "Visible"=w8)
        Property Node(instance in=reference to "Właściwy_control", "Visible"=w9, "Value"=FALSE)
        Property Node(instance in=reference to "Właściwy_indicator", "Visible"=w8)
        # VISIBILITY
        call "Configure Measurement.gvi"(VISA resource name=w1, error in=w2, measurement function="Voltage DC"(10)) -> (VISA resource name out=w4, error out=w5)
        w3 = default
      }
      on "stop" Value changed; "Window" Close {
        w3 = TRUE
        w4 = w1
        w5 = w2
      }
    }
    $Zmiana_indicator <- $Zmiana_control
    stop if w3
  }
  call "Close.gvi"(VISA resource name=w4, error in=w5)
