vi "X_TEMPERATURE.gvi"   [LabVIEW NXG 5.1.0]
panel controls:
  "Właściwy_control": bool
  "stop": bool
  "Zmiana_control": bool
  "Aperture_Właściwy1": bool = TRUE
  "ApertureNPLC_Właściwy1": f64 = "10 PLC"(10)
  "OffstComp_Właściwy1": bool = TRUE
  "LowPower_Właściwy1": bool = TRUE
  "Units_Właściwy1": i32 = "°C"(0)
  "Probe_Main": i32 = "RTD 4w"(1)
  "LowPower_Właściwy0": bool = TRUE
  "OffstComp_Właściwy0": bool = TRUE
  "Units_Właściwy0": i32 = "°C"(0)
  "Aperture_Właściwy0": bool = TRUE
  "ApertureNPLC_Właściwy0": f64 = "10 PLC"(10)
  "AutoZero_Właściwy0": bool = TRUE
  "AutoZero_Właściwy2": bool = TRUE
  "LowPower_Właściwy2": bool = TRUE
  "Units_Właściwy2": i32 = "°C"(0)
  "Aperture_Właściwy2": bool = TRUE
  "ApertureNPLC_Właściwy2": f64 = "10 PLC"(10)
  "LowPower_Właściwy3": bool = TRUE
  "Aperture_Właściwy3": bool = TRUE
  "ApertureNPLC_Właściwy3": f64 = "10 PLC"(10)
  "Units_Właściwy3": i32 = "°C"(0)
  "Aperture_Właściwy4": bool = TRUE
  "ApertureNPLC_Właściwy4": f64 = "10 PLC"(10)
  "AutoZero_Właściwy4": bool = TRUE
  "Units_Właściwy4": i32 = "°C"(0)
  "Type_Właściwy4": i32 = "K"(1)
  "Reference_Właściwy4": i32 = "Internal"(0)
  "OpenCheck_Właściwy4": bool = TRUE
panel indicators:
  "Właściwy_indicator": bool
  "String_Właściwy1": string
  "Zmiana_indicator": bool
  "ApertureTime_Właściwy1": f64
  "R0_Właściwy1": f64
  "String_Właściwy0": string
  "ApertureTime_Właściwy0": f64
  "R0_Właściwy0": f64
  "String_Właściwy2": string
  "ApertureTime_Właściwy2": f64
  "String_Właściwy3": string
  "ApertureTime_Właściwy3": f64
  "ApertureTime_Właściwy4": f64
  "FixedOffset_Właściwy4": f64
  "OffsetAdjust_Właściwy4": f64
  "String_Właściwy4": string
uses:
  Agilent 3446X Series::Initialize.gvi
  Agilent 3446X Series::Configure Measurement.gvi
  Agilent 3446X Series::Configure Transducer.gvi
  Agilent 3446X Series::Configure Temperature.gvi
  Agilent 3446X Series::Configure Measurement Aperture.gvi
  Agilent 3446X Series::Auto Zero.gvi
  Agilent 3446X Series::Close.gvi
diagram:
  disable {
    frame Enabled {
      Property Node(instance in=reference to "Aperture_Właściwy3", "Visible"=FALSE)
      Property Node(instance in=reference to "ApertureNPLC_Właściwy3", "Visible"=FALSE)
      Property Node(instance in=reference to "Units_Właściwy3", "Visible"=FALSE)
      Property Node(instance in=reference to "ApertureTime_Właściwy3", "Visible"=FALSE)
      Property Node(instance in=reference to "String_Właściwy3", "Visible"=FALSE)
      Property Node(instance in=reference to "LowPower_Właściwy3", "Visible"=FALSE)
    }
    frame Disabled { }
  }
  disable {
    frame Enabled {
      Property Node(instance in=reference to "OffstComp_Właściwy1", "Visible"=FALSE)
      Property Node(instance in=reference to "R0_Właściwy1", "Visible"=FALSE)
      Property Node(instance in=reference to "Probe_Main", "Visible"=FALSE)
      Property Node(instance in=reference to "String_Właściwy1", "Visible"=FALSE)
      Property Node(instance in=reference to "Units_Właściwy1", "Visible"=FALSE)
      Property Node(instance in=reference to "ApertureNPLC_Właściwy1", "Visible"=FALSE)
      Property Node(instance in=reference to "ApertureTime_Właściwy1", "Visible"=FALSE)
      Property Node(instance in=reference to "LowPower_Właściwy1", "Visible"=FALSE)
      Property Node(instance in=reference to "Aperture_Właściwy1", "Visible"=FALSE)
    }
    frame Disabled { }
  }
  disable {
    frame Enabled {
      Property Node(instance in=reference to "ApertureTime_Właściwy0", "Visible"=FALSE)
      Property Node(instance in=reference to "AutoZero_Właściwy0", "Visible"=FALSE)
      Property Node(instance in=reference to "LowPower_Właściwy0", "Visible"=FALSE)
      Property Node(instance in=reference to "ApertureNPLC_Właściwy0", "Visible"=FALSE)
      Property Node(instance in=reference to "Units_Właściwy0", "Visible"=FALSE)
      Property Node(instance in=reference to "OffstComp_Właściwy0", "Visible"=FALSE)
      Property Node(instance in=reference to "R0_Właściwy0", "Visible"=FALSE)
      Property Node(instance in=reference to "String_Właściwy0", "Visible"=FALSE)
      Property Node(instance in=reference to "Aperture_Właściwy0", "Visible"=FALSE)
    }
    frame Disabled { }
  }
  disable {
    frame Enabled {
      Property Node(instance in=reference to "AutoZero_Właściwy2", "Visible"=FALSE)
      Property Node(instance in=reference to "ApertureNPLC_Właściwy2", "Visible"=FALSE)
      Property Node(instance in=reference to "Units_Właściwy2", "Visible"=FALSE)
      Property Node(instance in=reference to "ApertureTime_Właściwy2", "Visible"=FALSE)
      Property Node(instance in=reference to "String_Właściwy2", "Visible"=FALSE)
      Property Node(instance in=reference to "LowPower_Właściwy2", "Visible"=FALSE)
      Property Node(instance in=reference to "Aperture_Właściwy2", "Visible"=FALSE)
    }
    frame Disabled { }
  }
  disable {
    frame Enabled {
      Property Node(instance in=reference to "ApertureNPLC_Właściwy4", "Visible"=FALSE)
      Property Node(instance in=reference to "ApertureTime_Właściwy4", "Visible"=FALSE)
      Property Node(instance in=reference to "AutoZero_Właściwy4", "Visible"=FALSE)
      Property Node(instance in=reference to "FixedOffset_Właściwy4", "Visible"=FALSE)
      Property Node(instance in=reference to "OffsetAdjust_Właściwy4", "Visible"=FALSE)
      Property Node(instance in=reference to "OpenCheck_Właściwy4", "Visible"=FALSE)
      Property Node(instance in=reference to "String_Właściwy4", "Visible"=FALSE)
      Property Node(instance in=reference to "Reference_Właściwy4", "Visible"=FALSE)
      Property Node(instance in=reference to "Type_Właściwy4", "Visible"=FALSE)
      Property Node(instance in=reference to "Units_Właściwy4", "Visible"=FALSE)
      Property Node(instance in=reference to "Aperture_Właściwy4", "Visible"=FALSE)
    }
    frame Disabled { }
  }
  disable {
    frame Enabled {
      Property Node(instance in=reference to unnamed text, "Visible"=FALSE)
    }
    frame Disabled { }
  }
  disable {
    frame Enabled {
      Property Node(instance in=reference to "Właściwy_indicator", "Visible"=FALSE)
      Property Node(instance in=reference to "Zmiana_indicator", "Visible"=FALSE)
      Property Node(instance in=reference to "Zmiana_control", "Visible"=TRUE, "Disabled"=FALSE)
      Property Node(instance in=reference to "Właściwy_control", "Visible"=TRUE, "Disabled"=FALSE)
    }
    frame Disabled { }
  }
  $Probe_Main <- "RTD 4w"(1)
  disable {
    frame Enabled {
      $Zmiana_indicator <- FALSE
      $Właściwy_indicator <- FALSE
    }
    frame Disabled { }
  }
  call "Initialize.gvi"(VISA resource name="TCPIP0::A-34461A-0000-2.local::inst0::INSTR") -> (VISA resource name out=w1, error out=w2)
  while {
    disable {
      frame Enabled {
        $Zmiana_indicator <- $Zmiana_control
        $Właściwy_indicator <- $Właściwy_control
      }
      frame Disabled { }
    }
    disable {
      frame Enabled { }
      frame Disabled { }
    }
    disable {
      frame Enabled { }
      frame Disabled { }
    }
    disable {
      frame Enabled { }
      frame Disabled { }
    }
    disable {
      frame Enabled { }
      frame Disabled { }
    }
    event {
      on "Właściwy_control" Value changed {
        Event Data() -> ("Old Value"=w6, "New Value"=w7)
        Property Node(instance in=reference to "Właściwy_control", "Visible"=w6)
        Property Node(instance in=reference to "Zmiana_indicator", "Visible"=w6)
        Property Node(instance in=reference to "Zmiana_control", "Visible"=w7, "Value"=FALSE)
        Property Node(instance in=reference to "Właściwy_indicator", "Visible"=w7)
        Property Node(instance in=reference to "R0_Właściwy1", "Visible"=TRUE)
        Property Node(instance in=reference to "ApertureNPLC_Właściwy1", "Visible"=TRUE)
        Property Node(instance in=reference to "OffstComp_Właściwy1", "Visible"=TRUE)
        Property Node(instance in=reference to "String_Właściwy1", "Visible"=TRUE)
        Property Node(instance in=reference to "Units_Właściwy1", "Visible"=TRUE)
        Property Node(instance in=reference to "Probe_Main", "Visible"=TRUE)
        Property Node(instance in=reference to "ApertureTime_Właściwy1", "Visible"=TRUE)
        Property Node(instance in=reference to "LowPower_Właściwy1", "Visible"=TRUE)
        Property Node(instance in=reference to "Aperture_Właściwy1", "Visible"=TRUE)
        call "Configure Measurement.gvi"(VISA resource name=w1, error in=w2, measurement function="Temperature"(8)) -> (VISA resource name out=w4, error out=w5)
        w3 = default
      }
      on "Zmiana_control" Value changed {
        Property Node(instance in=reference to "LowPower_Właściwy2", "Visible"=FALSE)
        Property Node(instance in=reference to "ApertureNPLC_Właściwy2", "Visible"=FALSE)
        Property Node(instance in=reference to "Units_Właściwy2", "Visible"=FALSE)
        Property Node(instance in=reference to "ApertureTime_Właściwy2", "Visible"=FALSE)
        call "Configure Measurement.gvi"(VISA resource name=w1, error in=w2, measurement function="Voltage DC"(10)) -> (VISA resource name out=w4, error out=w5)
        Property Node(instance in=reference to "AutoZero_Właściwy2", "Visible"=FALSE)
        Property Node(instance in=reference to "Aperture_Właściwy2", "Visible"=FALSE)
        Property Node(instance in=reference to "String_Właściwy2", "Visible"=FALSE)
        Property Node(instance in=reference to "String_Właściwy1", "Visible"=FALSE)
        Property Node(instance in=reference to "ApertureNPLC_Właściwy1", "Visible"=FALSE)
        Property Node(instance in=reference to "Aperture_Właściwy1", "Visible"=FALSE)
        Property Node(instance in=reference to "R0_Właściwy1", "Visible"=FALSE)
        Property Node(instance in=reference to "Probe_Main", "Visible"=FALSE, "Value"=1)
        Property Node(instance in=reference to "LowPower_Właściwy1", "Visible"=FALSE)
        Property Node(instance in=reference to "ApertureTime_Właściwy1", "Visible"=FALSE)
        Property Node(instance in=reference to "Units_Właściwy1", "Visible"=FALSE)
        Property Node(instance in=reference to "OffstComp_Właściwy1", "Visible"=FALSE)
        Event Data() -> ("Old Value"=w8, "New Value"=w9)
        Property Node(instance in=reference to "Właściwy_indicator", "Visible"=w8)
        Property Node(instance in=reference to "Zmiana_control", "Visible"=w8)
        Property Node(instance in=reference to "Właściwy_control", "Visible"=w9, "Value"=FALSE)
        Property Node(instance in=reference to "Zmiana_indicator", "Visible"=w9)
        Property Node(instance in=reference to unnamed text, "Visible"=FALSE)
        Property Node(instance in=reference to "String_Właściwy3", "Visible"=FALSE)
        Property Node(instance in=reference to "LowPower_Właściwy3", "Visible"=FALSE)
        Property Node(instance in=reference to "Units_Właściwy3", "Visible"=FALSE)
        Property Node(instance in=reference to "Aperture_Właściwy3", "Visible"=FALSE)
        Property Node(instance in=reference to "ApertureNPLC_Właściwy3", "Visible"=FALSE)
        Property Node(instance in=reference to "ApertureTime_Właściwy3", "Visible"=FALSE)
        Property Node(instance in=reference to "Reference_Właściwy4", "Visible"=FALSE)
        Property Node(instance in=reference to "ApertureNPLC_Właściwy4", "Visible"=FALSE)
        Property Node(instance in=reference to "ApertureTime_Właściwy4", "Visible"=FALSE)
        Property Node(instance in=reference to "AutoZero_Właściwy4", "Visible"=FALSE)
        Property Node(instance in=reference to "FixedOffset_Właściwy4", "Visible"=FALSE)
        Property Node(instance in=reference to "OffsetAdjust_Właściwy4", "Visible"=FALSE)
        Property Node(instance in=reference to "OpenCheck_Właściwy4", "Visible"=FALSE)
        Property Node(instance in=reference to "String_Właściwy4", "Visible"=FALSE)
        Property Node(instance in=reference to "Type_Właściwy4", "Visible"=FALSE)
        Property Node(instance in=reference to "Units_Właściwy4", "Visible"=FALSE)
        Property Node(instance in=reference to "Aperture_Właściwy4", "Visible"=FALSE)
        Property Node(instance in=reference to "LowPower_Właściwy0", "Visible"=FALSE)
        Property Node(instance in=reference to "R0_Właściwy0", "Visible"=FALSE)
        Property Node(instance in=reference to "ApertureNPLC_Właściwy0", "Visible"=FALSE)
        Property Node(instance in=reference to "OffstComp_Właściwy0", "Visible"=FALSE)
        Property Node(instance in=reference to "ApertureTime_Właściwy0", "Visible"=FALSE)
        Property Node(instance in=reference to "String_Właściwy0", "Visible"=FALSE)
        Property Node(instance in=reference to "Aperture_Właściwy0", "Visible"=FALSE)
        Property Node(instance in=reference to "Units_Właściwy0", "Visible"=FALSE)
        Property Node(instance in=reference to "AutoZero_Właściwy0", "Visible"=FALSE)
        w3 = default
      }
      on "Aperture_Właściwy1" Value changed; "ApertureNPLC_Właściwy1" Value changed; "ApertureTime_Właściwy1" Value changed; "LowPower_Właściwy1" Value changed; "OffstComp_Właściwy1" Value changed; "R0_Właściwy1" Value changed; "Units_Właściwy1" Value changed {
        Property Node(instance in=reference to "Aperture_Właściwy1") -> ("Value"=w10)
        Property Node(instance in=reference to "ApertureTime_Właściwy1", "Disabled"=w10) -> ("Value"=w11)
        Quotient And Remainder(x=w11, y=2e-06) -> (floor(x/y)=w12, x-y*floor(x/y)=w13)
        Multiply(w13, 1000000) -> w14
        Round To Nearest(number=w14) -> w15
        To Signed 32 Bit Integer(number=w15) -> w16
        case (w16) {
          frame 0, Default {
            Multiply(2e-06, w12) -> w17
          }
          frame 1 {
            Multiply(2e-06, w12) -> w17
          }
          frame 2 {
            Add(1, w12) -> w18
            Multiply(2e-06, w18) -> w17
          }
        }
        Property Node(instance in=reference to "R0_Właściwy1") -> ("Value"=w19)
        Quotient And Remainder(x=w19, y=0.0001) -> (floor(x/y)=w20, x-y*floor(x/y)=w21)
        Multiply(w21, 10000) -> w22
        Round To Nearest(number=w22) -> w23
        To Signed 32 Bit Integer(number=w23) -> w24
        case (w24) {
          frame 0, Default {
            Multiply(0.0001, w20) -> w25
          }
          frame 1 {
            Add(1, w20) -> w26
            Multiply(0.0001, w26) -> w25
          }
        }
        Not(x=w10) -> w27
        Property Node(instance in=reference to "ApertureNPLC_Właściwy1", "Disabled"=w27) -> ("Value"=w28)
        Property Node(instance in=reference to "OffstComp_Właściwy1") -> ("Value"=w29)
        Property Node(instance in=reference to "LowPower_Właściwy1") -> ("Value"=w30)
        call "Configure Transducer.gvi"(VISA resource name=w1, error in=w2, enable offset compensation=w29, enable RTD power limit=w30) -> (VISA resource name out=w31, error out=w32)
        case (w10) {
          frame False, Default {
            call "Configure Temperature.gvi"(nominal resistance=w25, VISA resource name=w31, error in=w32, probe type="RTD 4-wire"(0)) -> (VISA resource name out=w33, error out=w34)
            call "Configure Measurement Aperture.gvi"(VISA resource name=w33, error in=w34, measurement function="Temperature"(8), enable aperture=TRUE, aperture time=w17) -> (VISA resource name out=w4, error out=w5)
          }
          frame True {
            call "Configure Temperature.gvi"(nominal resistance=w25, VISA resource name=w31, error in=w32, temperature integration time=w28, probe type="RTD 4-wire"(0)) -> (VISA resource name out=w35, error out=w36)
            call "Configure Measurement Aperture.gvi"(VISA resource name=w35, error in=w36, measurement function="Temperature"(8), enable aperture=FALSE) -> (VISA resource name out=w4, error out=w5)
          }
        }
        case (w29) {
          frame False, Default {
            w37 = "OffstComp: Off "
          }
          frame True {
            w37 = "OffstComp: On"
          }
        }
        case (w30) {
          frame False, Default {
            w38 = "Low Power: Off"
          }
          frame True {
            w38 = "Low Power: On"
          }
        }
        case (w10) {
          frame False, Default {
            Format Into String(formatString="%_6ps", initString="Aperture Time: ", w17) -> w39
          }
          frame True {
            Format Into String(formatString="%#gPLC", initString="Aperture NPLC: ", w28) -> w39
          }
        }
        Format Into String(formatString="%_7ps", initString="R0: ", w25) -> w40
        Property Node(instance in=reference to "Units_Właściwy1") -> ("Value"=w41)
        case (w41) {
          frame 0, Default {
            w42 = "Units: °C"
          }
          frame 1 {
            w42 = "Units: K"
          }
          frame 2 {
            w42 = "Units: °F"
          }
        }
        Concatenate Strings("Your settings:", "\r\n", w39, "\r\n", w42, "\r\n", w40, "\r\n", w37, "\r\n", w38) -> w43
        $String_Właściwy1 <- w43
        Property Node(instance in=reference to "ApertureTime_Właściwy1", "Value"=w17)
        Property Node(instance in=reference to "R0_Właściwy1", "Value"=w25)
        w3 = default
      }
      on "stop" Value changed; "Window" Close {
        w3 = TRUE
        w4 = w1
        w5 = w2
      }
      on "Probe_Main" Value changed {
        Event Data() -> ("Old Value"=w44, "New Value"=w45)
        case (w44) {
          frame 0, Default {
            Property Node(instance in=reference to "R0_Właściwy0", "Visible"=FALSE)
            Property Node(instance in=reference to "OffstComp_Właściwy0", "Visible"=FALSE)
            Property Node(instance in=reference to "AutoZero_Właściwy0", "Visible"=FALSE)
            Property Node(instance in=reference to "ApertureTime_Właściwy0", "Visible"=FALSE)
            Property Node(instance in=reference to "String_Właściwy0", "Visible"=FALSE)
            Property Node(instance in=reference to "Aperture_Właściwy0", "Visible"=FALSE)
            Property Node(instance in=reference to "LowPower_Właściwy0", "Visible"=FALSE)
            Property Node(instance in=reference to "ApertureNPLC_Właściwy0", "Visible"=FALSE)
            Property Node(instance in=reference to "Units_Właściwy0", "Visible"=FALSE)
          }
          frame 1 {
            Property Node(instance in=reference to "R0_Właściwy1", "Visible"=FALSE)
            Property Node(instance in=reference to "OffstComp_Właściwy1", "Visible"=FALSE)
            Property Node(instance in=reference to "String_Właściwy1", "Visible"=FALSE)
            Property Node(instance in=reference to "Units_Właściwy1", "Visible"=FALSE)
            Property Node(instance in=reference to "ApertureNPLC_Właściwy1", "Visible"=FALSE)
            Property Node(instance in=reference to "ApertureTime_Właściwy1", "Visible"=FALSE)
            Property Node(instance in=reference to "LowPower_Właściwy1", "Visible"=FALSE)
            Property Node(instance in=reference to "Aperture_Właściwy1", "Visible"=FALSE)
          }
          frame 2 {
            Property Node(instance in=reference to "Units_Właściwy2", "Visible"=FALSE)
            Property Node(instance in=reference to "ApertureTime_Właściwy2", "Visible"=FALSE)
            Property Node(instance in=reference to "String_Właściwy2", "Visible"=FALSE)
            Property Node(instance in=reference to "LowPower_Właściwy2", "Visible"=FALSE)
            Property Node(instance in=reference to "Aperture_Właściwy2", "Visible"=FALSE)
            Property Node(instance in=reference to "ApertureNPLC_Właściwy2", "Visible"=FALSE)
            Property Node(instance in=reference to "AutoZero_Właściwy2", "Visible"=FALSE)
          }
          frame 3 {
            Property Node(instance in=reference to "Aperture_Właściwy3", "Visible"=FALSE)
            Property Node(instance in=reference to "ApertureTime_Właściwy3", "Visible"=FALSE)
            Property Node(instance in=reference to "ApertureNPLC_Właściwy3", "Visible"=FALSE)
            Property Node(instance in=reference to "String_Właściwy3", "Visible"=FALSE)
            Property Node(instance in=reference to "LowPower_Właściwy3", "Visible"=FALSE)
            Property Node(instance in=reference to "Units_Właściwy3", "Visible"=FALSE)
          }
          frame 4 {
            Property Node(instance in=reference to "ApertureTime_Właściwy4", "Visible"=FALSE)
            Property Node(instance in=reference to "AutoZero_Właściwy4", "Visible"=FALSE)
            Property Node(instance in=reference to "FixedOffset_Właściwy4", "Visible"=FALSE)
            Property Node(instance in=reference to "OffsetAdjust_Właściwy4", "Visible"=FALSE)
            Property Node(instance in=reference to "ApertureNPLC_Właściwy4", "Visible"=FALSE)
            Property Node(instance in=reference to "OpenCheck_Właściwy4", "Visible"=FALSE)
            Property Node(instance in=reference to "String_Właściwy4", "Visible"=FALSE)
            Property Node(instance in=reference to "Reference_Właściwy4", "Visible"=FALSE)
            Property Node(instance in=reference to "Type_Właściwy4", "Visible"=FALSE)
            Property Node(instance in=reference to "Units_Właściwy4", "Visible"=FALSE)
            Property Node(instance in=reference to "Aperture_Właściwy4", "Visible"=FALSE)
          }
        }
        case (w45) {
          frame 0, Default {
            Property Node(instance in=reference to "R0_Właściwy0", "Visible"=TRUE)
            Property Node(instance in=reference to "OffstComp_Właściwy0", "Visible"=TRUE)
            Property Node(instance in=reference to "AutoZero_Właściwy0", "Visible"=TRUE)
            Property Node(instance in=reference to "ApertureTime_Właściwy0", "Visible"=TRUE)
            Property Node(instance in=reference to "String_Właściwy0", "Visible"=TRUE)
            Property Node(instance in=reference to "Aperture_Właściwy0", "Visible"=TRUE)
            Property Node(instance in=reference to "LowPower_Właściwy0", "Visible"=TRUE)
            Property Node(instance in=reference to "ApertureNPLC_Właściwy0", "Visible"=TRUE)
            Property Node(instance in=reference to "Units_Właściwy0", "Visible"=TRUE)
            call "Configure Temperature.gvi"(VISA resource name=w1, error in=w2, probe type="RTD 2-wire"(1)) -> (VISA resource name out=w4, error out=w5)
          }
          frame 1 {
            Property Node(instance in=reference to "R0_Właściwy1", "Visible"=TRUE)
            Property Node(instance in=reference to "OffstComp_Właściwy1", "Visible"=TRUE)
            Property Node(instance in=reference to "String_Właściwy1", "Visible"=TRUE)
            Property Node(instance in=reference to "Units_Właściwy1", "Visible"=TRUE)
            Property Node(instance in=reference to "ApertureNPLC_Właściwy1", "Visible"=TRUE)
            Property Node(instance in=reference to "ApertureTime_Właściwy1", "Visible"=TRUE)
            Property Node(instance in=reference to "LowPower_Właściwy1", "Visible"=TRUE)
            Property Node(instance in=reference to "Aperture_Właściwy1", "Visible"=TRUE)
            call "Configure Temperature.gvi"(VISA resource name=w1, error in=w2, probe type="RTD 4-wire"(0)) -> (VISA resource name out=w4, error out=w5)
          }
          frame 2 {
            Property Node(instance in=reference to "Units_Właściwy2", "Visible"=TRUE)
            Property Node(instance in=reference to "ApertureTime_Właściwy2", "Visible"=TRUE)
            Property Node(instance in=reference to "String_Właściwy2", "Visible"=TRUE)
            Property Node(instance in=reference to "LowPower_Właściwy2", "Visible"=TRUE)
            Property Node(instance in=reference to "Aperture_Właściwy2", "Visible"=TRUE)
            Property Node(instance in=reference to "ApertureNPLC_Właściwy2", "Visible"=TRUE)
            Property Node(instance in=reference to "AutoZero_Właściwy2", "Visible"=TRUE)
            call "Configure Temperature.gvi"(VISA resource name=w1, error in=w2, probe type="Thermistor 2-wire"(3)) -> (VISA resource name out=w4, error out=w5)
          }
          frame 3 {
            Property Node(instance in=reference to "Aperture_Właściwy3", "Visible"=TRUE)
            Property Node(instance in=reference to "ApertureTime_Właściwy3", "Visible"=TRUE)
            Property Node(instance in=reference to "ApertureNPLC_Właściwy3", "Visible"=TRUE)
            Property Node(instance in=reference to "String_Właściwy3", "Visible"=TRUE)
            Property Node(instance in=reference to "LowPower_Właściwy3", "Visible"=TRUE)
            Property Node(instance in=reference to "Units_Właściwy3", "Visible"=TRUE)
            call "Configure Temperature.gvi"(VISA resource name=w1, error in=w2, probe type="Thermistor 4-wire"(2)) -> (VISA resource name out=w4, error out=w5)
          }
          frame 4 {
            Property Node(instance in=reference to "ApertureTime_Właściwy4", "Visible"=TRUE)
            Property Node(instance in=reference to "AutoZero_Właściwy4", "Visible"=TRUE)
            Property Node(instance in=reference to "FixedOffset_Właściwy4", "Visible"=TRUE)
            Property Node(instance in=reference to "OffsetAdjust_Właściwy4", "Visible"=TRUE)
            Property Node(instance in=reference to "ApertureNPLC_Właściwy4", "Visible"=TRUE)
            Property Node(instance in=reference to "OpenCheck_Właściwy4", "Visible"=TRUE)
            Property Node(instance in=reference to "String_Właściwy4", "Visible"=TRUE)
            Property Node(instance in=reference to "Reference_Właściwy4", "Visible"=TRUE)
            Property Node(instance in=reference to "Type_Właściwy4", "Visible"=TRUE)
            Property Node(instance in=reference to "Units_Właściwy4", "Visible"=TRUE)
            Property Node(instance in=reference to "Aperture_Właściwy4", "Visible"=TRUE)
            call "Configure Temperature.gvi"(VISA resource name=w1, error in=w2, probe type="Thermocouple"(4)) -> (VISA resource name out=w4, error out=w5)
          }
        }
        w3 = default
      }
      on "Aperture_Właściwy2" Value changed; "ApertureNPLC_Właściwy2" Value changed; "ApertureTime_Właściwy2" Value changed; "AutoZero_Właściwy2" Value changed; "LowPower_Właściwy2" Value changed; "Units_Właściwy2" Value changed {
        Property Node(instance in=reference to "AutoZero_Właściwy2") -> ("Value"=w46)
        case (w46) {
          frame False, Default {
            w47 = "Auto Zero: Off"
          }
          frame True {
            w47 = "Auto Zero: On"
          }
        }
        Property Node(instance in=reference to "LowPower_Właściwy2") -> ("Value"=w48)
        case (w48) {
          frame False, Default {
            w49 = "Low Power: Off"
          }
          frame True {
            w49 = "Low Power: On"
          }
        }
        Property Node(instance in=reference to "Aperture_Właściwy2") -> ("Value"=w50)
        Property Node(instance in=reference to "ApertureTime_Właściwy2", "Disabled"=w50) -> ("Value"=w51)
        Quotient And Remainder(x=w51, y=2e-06) -> (floor(x/y)=w52, x-y*floor(x/y)=w53)
        Multiply(w53, 1000000) -> w54
        Round To Nearest(number=w54) -> w55
        To Signed 32 Bit Integer(number=w55) -> w56
        case (w56) {
          frame 0, Default {
            Multiply(2e-06, w52) -> w57
          }
          frame 1 {
            Multiply(2e-06, w52) -> w57
          }
          frame 2 {
            Add(1, w52) -> w58
            Multiply(2e-06, w58) -> w57
          }
        }
        Not(x=w50) -> w59
        Property Node(instance in=reference to "ApertureNPLC_Właściwy2", "Disabled"=w59) -> ("Value"=w60)
        case (w50) {
          frame False, Default {
            Format Into String(formatString="%_6ps", initString="Aperture Time: ", w57) -> w61
          }
          frame True {
            Format Into String(formatString="%#gPLC", initString="Aperture NPLC: ", w60) -> w61
          }
        }
        Property Node(instance in=reference to "Units_Właściwy2") -> ("Value"=w62)
        case (w62) {
          frame 0, Default {
            w63 = "Units: °C"
          }
          frame 1 {
            w63 = "Units: K"
          }
          frame 2 {
            w63 = "Units: °F"
          }
        }
        Concatenate Strings("Your settings:", "\r\n", w61, "\r\n", w47, "\r\n", w63, "\r\n", w49) -> w64
        $String_Właściwy2 <- w64
        case (w46) {
          frame False, Default {
            call "Auto Zero.gvi"(VISA resource name=w1, error in=w2, zero type="Temperature"(2), auto zero="Disable"(0)) -> (VISA resource name out=w65, error out=w66)
          }
          frame True {
            call "Auto Zero.gvi"(VISA resource name=w1, error in=w2, zero type="Temperature"(2), auto zero="Enable"(1)) -> (VISA resource name out=w65, error out=w66)
          }
        }
        call "Configure Transducer.gvi"(VISA resource name=w65, error in=w66, enable thermistor power limit=w48) -> (VISA resource name out=w67, error out=w68)
        case (w50) {
          frame False, Default {
            call "Configure Temperature.gvi"(VISA resource name=w67, error in=w68, probe type="Thermistor 2-wire"(3)) -> (VISA resource name out=w69, error out=w70)
            call "Configure Measurement Aperture.gvi"(VISA resource name=w69, error in=w70, measurement function="Temperature"(8), enable aperture=TRUE, aperture time=w57) -> (VISA resource name out=w4, error out=w5)
          }
          frame True {
            call "Configure Temperature.gvi"(VISA resource name=w67, error in=w68, temperature integration time=w60, probe type="Thermistor 2-wire"(3)) -> (VISA resource name out=w71, error out=w72)
            call "Configure Measurement Aperture.gvi"(VISA resource name=w71, error in=w72, measurement function="Temperature"(8), enable aperture=FALSE) -> (VISA resource name out=w4, error out=w5)
          }
        }
        Property Node(instance in=reference to "ApertureTime_Właściwy2", "Value"=w57)
        w3 = default
      }
      on "Aperture_Właściwy0" Value changed; "ApertureNPLC_Właściwy0" Value changed; "ApertureTime_Właściwy0" Value changed; "AutoZero_Właściwy0" Value changed; "LowPower_Właściwy0" Value changed; "OffstComp_Właściwy0" Value changed; "R0_Właściwy0" Value changed; "Units_Właściwy0" Value changed {
        Property Node(instance in=reference to "Aperture_Właściwy0") -> ("Value"=w73)
        Property Node(instance in=reference to "ApertureTime_Właściwy0", "Disabled"=w73) -> ("Value"=w74)
        Quotient And Remainder(x=w74, y=2e-06) -> (floor(x/y)=w75, x-y*floor(x/y)=w76)
        Multiply(w76, 1000000) -> w77
        Round To Nearest(number=w77) -> w78
        To Signed 32 Bit Integer(number=w78) -> w79
        case (w79) {
          frame 0, Default {
            Multiply(2e-06, w75) -> w80
          }
          frame 1 {
            Multiply(2e-06, w75) -> w80
          }
          frame 2 {
            Add(1, w75) -> w81
            Multiply(2e-06, w81) -> w80
          }
        }
        Property Node(instance in=reference to "R0_Właściwy0") -> ("Value"=w82)
        Quotient And Remainder(x=w82, y=0.0001) -> (floor(x/y)=w83, x-y*floor(x/y)=w84)
        Multiply(w84, 10000) -> w85
        Round To Nearest(number=w85) -> w86
        To Signed 32 Bit Integer(number=w86) -> w87
        case (w87) {
          frame 0, Default {
            Multiply(0.0001, w83) -> w88
          }
          frame 1 {
            Add(1, w83) -> w89
            Multiply(0.0001, w89) -> w88
          }
        }
        Not(x=w73) -> w90
        Property Node(instance in=reference to "ApertureNPLC_Właściwy0", "Disabled"=w90) -> ("Value"=w91)
        Property Node(instance in=reference to "AutoZero_Właściwy0") -> ("Value"=w92)
        case (w92) {
          frame False, Default {
            call "Auto Zero.gvi"(VISA resource name=w1, error in=w2, zero type="Temperature"(2), auto zero="Disable"(0)) -> (VISA resource name out=w93, error out=w94)
          }
          frame True {
            call "Auto Zero.gvi"(VISA resource name=w1, error in=w2, zero type="Temperature"(2), auto zero="Enable"(1)) -> (VISA resource name out=w93, error out=w94)
          }
        }
        Property Node(instance in=reference to "OffstComp_Właściwy0") -> ("Value"=w95)
        Property Node(instance in=reference to "LowPower_Właściwy0") -> ("Value"=w96)
        call "Configure Transducer.gvi"(VISA resource name=w93, error in=w94, enable offset compensation=w95, enable RTD power limit=w96) -> (VISA resource name out=w97, error out=w98)
        case (w73) {
          frame False, Default {
            call "Configure Temperature.gvi"(nominal resistance=w88, VISA resource name=w97, error in=w98, probe type="RTD 2-wire"(1)) -> (VISA resource name out=w99, error out=w100)
            call "Configure Measurement Aperture.gvi"(VISA resource name=w99, error in=w100, measurement function="Temperature"(8), enable aperture=TRUE, aperture time=w80) -> (VISA resource name out=w4, error out=w5)
          }
          frame True {
            call "Configure Temperature.gvi"(nominal resistance=w88, VISA resource name=w97, error in=w98, temperature integration time=w91, probe type="RTD 2-wire"(1)) -> (VISA resource name out=w101, error out=w102)
            call "Configure Measurement Aperture.gvi"(VISA resource name=w101, error in=w102, measurement function="Temperature"(8), enable aperture=FALSE) -> (VISA resource name out=w4, error out=w5)
          }
        }
        Property Node(instance in=reference to "ApertureTime_Właściwy0", "Value"=w80)
        Property Node(instance in=reference to "R0_Właściwy0", "Value"=w88)
        case (w92) {
          frame False, Default {
            w103 = "Auto Zero: Off"
          }
          frame True {
            w103 = "Auto Zero: On"
          }
        }
        case (w73) {
          frame False, Default {
            Format Into String(formatString="%_6ps", initString="Aperture Time: ", w80) -> w104
          }
          frame True {
            Format Into String(formatString="%#gPLC", initString="Aperture NPLC: ", w91) -> w104
          }
        }
        case (w95) {
          frame False, Default {
            w105 = "OffstComp: Off "
          }
          frame True {
            w105 = "OffstComp: On"
          }
        }
        case (w96) {
          frame False, Default {
            w106 = "Low Power: Off"
          }
          frame True {
            w106 = "Low Power: On"
          }
        }
        Property Node(instance in=reference to "Units_Właściwy0") -> ("Value"=w107)
        case (w107) {
          frame 0, Default {
            w108 = "Units: °C"
          }
          frame 1 {
            w108 = "Units: K"
          }
          frame 2 {
            w108 = "Units: °F"
          }
        }
        Format Into String(formatString="%_6ps", initString="R0: ", w88) -> w109
        Concatenate Strings("Your settings:", "\r\n", w104, "\r\n", w103, "\r\n", w108, "\r\n", w109, "\r\n", w105, "\r\n", w106) -> w110
        $String_Właściwy0 <- w110
        w3 = default
      }
      on "Aperture_Właściwy3" Value changed; "ApertureNPLC_Właściwy3" Value changed; "ApertureTime_Właściwy3" Value changed; "LowPower_Właściwy3" Value changed; "Units_Właściwy3" Value changed {
        Property Node(instance in=reference to "Aperture_Właściwy3") -> ("Value"=w111)
        Property Node(instance in=reference to "ApertureTime_Właściwy3", "Disabled"=w111) -> ("Value"=w112)
        Quotient And Remainder(x=w112, y=2e-06) -> (floor(x/y)=w113, x-y*floor(x/y)=w114)
        Multiply(w114, 1000000) -> w115
        Round To Nearest(number=w115) -> w116
        To Signed 32 Bit Integer(number=w116) -> w117
        case (w117) {
          frame 0, Default {
            Multiply(2e-06, w113) -> w118
          }
          frame 1 {
            Multiply(2e-06, w113) -> w118
          }
          frame 2 {
            Add(1, w113) -> w119
            Multiply(2e-06, w119) -> w118
          }
        }
        Property Node(instance in=reference to "ApertureTime_Właściwy3", "Value"=w118)
        Not(x=w111) -> w120
        Property Node(instance in=reference to "ApertureNPLC_Właściwy3", "Disabled"=w120) -> ("Value"=w121)
        Property Node(instance in=reference to "LowPower_Właściwy3") -> ("Value"=w122)
        call "Configure Transducer.gvi"(VISA resource name=w1, error in=w2, enable thermistor power limit=w122) -> (VISA resource name out=w123, error out=w124)
        case (w111) {
          frame False, Default {
            call "Configure Temperature.gvi"(VISA resource name=w123, error in=w124, probe type="Thermistor 4-wire"(2)) -> (VISA resource name out=w125, error out=w126)
            call "Configure Measurement Aperture.gvi"(VISA resource name=w125, error in=w126, measurement function="Temperature"(8), enable aperture=TRUE, aperture time=w118) -> (VISA resource name out=w4, error out=w5)
          }
          frame True {
            call "Configure Temperature.gvi"(VISA resource name=w123, error in=w124, temperature integration time=w121, probe type="Thermistor 4-wire"(2)) -> (VISA resource name out=w127, error out=w128)
            call "Configure Measurement Aperture.gvi"(VISA resource name=w127, error in=w128, measurement function="Temperature"(8), enable aperture=FALSE) -> (VISA resource name out=w4, error out=w5)
          }
        }
        case (w122) {
          frame False, Default {
            w129 = "Low Power: Off"
          }
          frame True {
            w129 = "Low Power: On"
          }
        }
        case (w111) {
          frame False, Default {
            Format Into String(formatString="%_6ps", initString="Aperture Time: ", w118) -> w130
          }
          frame True {
            Format Into String(formatString="%#gPLC", initString="Aperture NPLC: ", w121) -> w130
          }
        }
        Property Node(instance in=reference to "Units_Właściwy3") -> ("Value"=w131)
        case (w131) {
          frame 0, Default {
            w132 = "Units: °C"
          }
          frame 1 {
            w132 = "Units: K"
          }
          frame 2 {
            w132 = "Units: °F"
          }
        }
        Concatenate Strings("Your settings:", "\r\n", w130, "\r\n", w132, "\r\n", w129) -> w133
        $String_Właściwy3 <- w133
        w3 = default
      }
      on "Aperture_Właściwy4" Value changed; "ApertureNPLC_Właściwy4" Value changed; "ApertureTime_Właściwy4" Value changed; "AutoZero_Właściwy4" Value changed; "FixedOffset_Właściwy4" Value changed; "OffsetAdjust_Właściwy4" Value changed; "OpenCheck_Właściwy4" Value changed; "Reference_Właściwy4" Value changed; "Type_Właściwy4" Value changed; "Units_Właściwy4" Value changed {
        Property Node(instance in=reference to "Reference_Właściwy4") -> ("Value"=w134)
        case (w134) {
          frame 0, Default {
            w135 = "Reference: Internal"
            w136 = TRUE
          }
          frame 1 {
            w135 = "Reference: Fixed"
            w136 = FALSE
          }
        }
        Property Node(instance in=reference to "AutoZero_Właściwy4") -> ("Value"=w137)
        case (w137) {
          frame False, Default {
            w138 = "Auto Zero: Off"
          }
          frame True {
            w138 = "Auto Zero: On"
          }
        }
        Property Node(instance in=reference to "Aperture_Właściwy4") -> ("Value"=w139)
        Property Node(instance in=reference to "ApertureTime_Właściwy4", "Disabled"=w139) -> ("Value"=w140)
        Quotient And Remainder(x=w140, y=2e-06) -> (floor(x/y)=w141, x-y*floor(x/y)=w142)
        Multiply(w142, 1000000) -> w143
        Round To Nearest(number=w143) -> w144
        To Signed 32 Bit Integer(number=w144) -> w145
        case (w145) {
          frame 0, Default {
            Multiply(2e-06, w141) -> w146
          }
          frame 1 {
            Multiply(2e-06, w141) -> w146
          }
          frame 2 {
            Add(1, w141) -> w147
            Multiply(2e-06, w147) -> w146
          }
        }
        Not(x=w139) -> w148
        Property Node(instance in=reference to "ApertureNPLC_Właściwy4", "Disabled"=w148) -> ("Value"=w149)
        case (w139) {
          frame False, Default {
            Format Into String(formatString="%_6ps", initString="Aperture Time: ", w146) -> w150
          }
          frame True {
            Format Into String(formatString="%#gPLC", initString="Aperture NPLC: ", w149) -> w150
          }
        }
        Property Node(instance in=reference to "OpenCheck_Właściwy4") -> ("Value"=w151)
        case (w151) {
          frame False, Default {
            w152 = "Open Check: Off"
          }
          frame True {
            w152 = "Open Check: On"
          }
        }
        Property Node(instance in=reference to "Type_Właściwy4") -> ("Value"=w153)
        case (w153) {
          frame 0, Default {
            w154 = "Type: J"
          }
          frame 1 {
            w154 = "Type: K"
          }
          frame 2 {
            w154 = "Type: T"
          }
          frame 3 {
            w154 = "Type: E"
          }
          frame 4 {
            w154 = "Type: N"
          }
          frame 5 {
            w154 = "Type: R"
          }
        }
        Property Node(instance in=reference to "FixedOffset_Właściwy4", "Disabled"=w136) -> ("Value"=w155)
        Quotient And Remainder(x=w155, y=0.01) -> (floor(x/y)=w156, x-y*floor(x/y)=w157)
        Multiply(w157, 100) -> w158
        Round To Nearest(number=w158) -> w159
        To Signed 32 Bit Integer(number=w159) -> w160
        case (w160) {
          frame 0, Default {
            Multiply(0.01, w156) -> w161
          }
          frame 1 {
            Add(1, w156) -> w162
            Multiply(0.01, w162) -> w161
          }
        }
        Not(x=w136) -> w163
        Property Node(instance in=reference to "OffsetAdjust_Właściwy4", "Disabled"=w163) -> ("Value"=w164)
        Quotient And Remainder(x=w164, y=0.01) -> (floor(x/y)=w165, x-y*floor(x/y)=w166)
        Multiply(w166, 100) -> w167
        Round To Nearest(number=w167) -> w168
        To Signed 32 Bit Integer(number=w168) -> w169
        case (w169) {
          frame 0, Default {
            Multiply(0.01, w165) -> w170
          }
          frame 1 {
            Add(1, w165) -> w171
            Multiply(0.01, w171) -> w170
          }
        }
        Property Node(instance in=reference to "FixedOffset_Właściwy4", "Value"=w161) -> ("Disabled"=w172)
        case (w172) {
          frame False, Default {
            Format Into String(formatString="%_4p°C", initString="Fixed Offset: ", w161) -> w173
          }
          frame True {
            Format Into String(formatString="%_4p°C", initString="Offset Adjust: ", w170) -> w173
          }
        }
        Property Node(instance in=reference to "Units_Właściwy4") -> ("Value"=w174)
        case (w174) {
          frame 0, Default {
            w175 = "Units: °C"
          }
          frame 1 {
            w175 = "Units: K"
          }
          frame 2 {
            w175 = "Units: °F"
          }
        }
        Concatenate Strings("Your settings:", "\r\n", w150, "\r\n", w138, "\r\n", w152, "\r\n", w175, "\r\n", w154, "\r\n", w135, "\r\n", w173) -> w176
        $String_Właściwy4 <- w176
        Property Node(instance in=reference to "ApertureTime_Właściwy4", "Value"=w146)
        case (w137) {
          frame False, Default {
            call "Auto Zero.gvi"(VISA resource name=w1, error in=w2, zero type="Temperature"(2), auto zero="Disable"(0)) -> (VISA resource name out=w177, error out=w178)
          }
          frame True {
            call "Auto Zero.gvi"(VISA resource name=w1, error in=w2, zero type="Temperature"(2), auto zero="Enable"(1)) -> (VISA resource name out=w177, error out=w178)
          }
        }
        call "Configure Transducer.gvi"(reference junction temperature adjust=w170, thermocouple reference junction type=w134, VISA resource name=w177, error in=w178, thermocouple type=w153, enable thermocouple check=w151, reference junction temperature=w161) -> (VISA resource name out=w179, error out=w180)
        case (w139) {
          frame False, Default {
            call "Configure Temperature.gvi"(VISA resource name=w179, error in=w180, probe type="Thermocouple"(4)) -> (VISA resource name out=w181, error out=w182)
            call "Configure Measurement Aperture.gvi"(VISA resource name=w181, error in=w182, measurement function="Temperature"(8), enable aperture=TRUE, aperture time=w146) -> (VISA resource name out=w4, error out=w5)
          }
          frame True {
            call "Configure Temperature.gvi"(VISA resource name=w179, error in=w180, temperature integration time=w149, probe type="Thermocouple"(4)) -> (VISA resource name out=w183, error out=w184)
            call "Configure Measurement Aperture.gvi"(VISA resource name=w183, error in=w184, measurement function="Temperature"(8), enable aperture=FALSE) -> (VISA resource name out=w4, error out=w5)
          }
        }
        Property Node(instance in=reference to "OffsetAdjust_Właściwy4", "Value"=w170)
        w3 = default
      }
    }
    stop if w3
  }
  call "Close.gvi"(VISA resource name=w4, error in=w5)
