vi "Y_ACVOLTAGE.gvi"   [LabVIEW NXG 5.1.0]
panel controls:
  "Właściwy_control": bool
  "stop": bool
  "AutoRange_Właściwy": bool = TRUE
  "ManualRange_Właściwy": f64 = "1 V"(1)
  "ACFilter_Właściwy": i32 = ">3Hz"(3)
  "Zmiana_control": bool
panel indicators:
  "Właściwy_indicator": bool
  "String_Właściwy": string
  "Zmiana_indicator": bool
uses:
  Agilent 3446X Series::Initialize.gvi
  Agilent 3446X Series::Configure Measurement.gvi
  Agilent 3446X Series::Configure Voltage.gvi
  Agilent 3446X Series::Read (Single Point).gvi
  Agilent 3446X Series::Close.gvi
diagram:
  Property Node(instance in=reference to "ManualRange_Właściwy", "Visible"=FALSE)
  Property Node(instance in=reference to "String_Właściwy", "Visible"=FALSE)
  Property Node(instance in=reference to unnamed text, "Visible"=FALSE)
  Property Node(instance in=reference to "ACFilter_Właściwy", "Visible"=FALSE)
  # VISIBILITY
  Property Node(instance in=reference to "AutoRange_Właściwy", "Visible"=FALSE)
  Property Node(instance in=reference to "Zmiana_control", "Visible"=TRUE, "Disabled"=FALSE)
  Property Node(instance in=reference to "Właściwy_control", "Visible"=TRUE, "Disabled"=FALSE)
  $Właściwy_indicator <- FALSE
  $Zmiana_indicator <- FALSE
  Property Node(instance in=reference to "Właściwy_indicator", "Visible"=FALSE)
  Property Node(instance in=reference to "Zmiana_indicator", "Visible"=FALSE)
  call "Initialize.gvi"(VISA resource name="TCPIP0::A-34461A-0000-2.local::inst0::INSTR") -> (VISA resource name out=w1, error out=w2)
  while {
    $Właściwy_indicator <- $Właściwy_control
    event {
      on "Właściwy_control" Value changed {
        Property Node(instance in=reference to "ManualRange_Właściwy", "Visible"=TRUE)
        Property Node(instance in=reference to "String_Właściwy", "Visible"=TRUE)
        Property Node(instance in=reference to unnamed text, "Visible"=TRUE)
        Property Node(instance in=reference to "ACFilter_Właściwy", "Visible"=TRUE)
        # VISIBILITY
        Property Node(instance in=reference to "AutoRange_Właściwy", "Visible"=TRUE)
        Event Data() -> ("Old Value"=w6, "New Value"=w7)
        Property Node(instance in=reference to "Zmiana_indicator", "Visible"=w6)
        Property Node(instance in=reference to "Właściwy_control", "Visible"=w6)
        Property Node(instance in=reference to "Właściwy_indicator", "Visible"=w7)
        Property Node(instance in=reference to "Zmiana_control", "Visible"=w7, "Value"=FALSE)
        call "Configure Measurement.gvi"(VISA resource name=w1, error in=w2, measurement function="Voltage AC"(9)) -> (VISA resource name out=w4, error out=w5)
        w3 = default
      }
      on "Zmiana_control" Value changed {
        Property Node(instance in=reference to "ManualRange_Właściwy", "Visible"=FALSE)
        Property Node(instance in=reference to "String_Właściwy", "Visible"=FALSE)
        Property Node(instance in=reference to unnamed text, "Visible"=FALSE)
        Property Node(instance in=reference to "ACFilter_Właściwy", "Visible"=FALSE)
        # VISIBILITY
        Property Node(instance in=reference to "AutoRange_Właściwy", "Visible"=FALSE)
        call "Configure Measurement.gvi"(VISA resource name=w1, error in=w2, measurement function="Voltage DC"(10)) -> (VISA resource name out=w4, error out=w5)
        Event Data() -> ("Old Value"=w8, "New Value"=w9)
        Property Node(instance in=reference to "Właściwy_indicator", "Visible"=w8)
        Property Node(instance in=reference to "Właściwy_control", "Visible"=w9, "Value"=FALSE)
        Property Node(instance in=reference to "Zmiana_indicator", "Visible"=w9)
        Property Node(instance in=reference to "Zmiana_control", "Visible"=w8)
        w3 = default
      }
      on "ACFilter_Właściwy" Value changed; "AutoRange_Właściwy" Value changed; "ManualRange_Właściwy" Value changed {
        Property Node(instance in=reference to "AutoRange_Właściwy") -> ("Value"=w10)
        Property Node(instance in=reference to "ManualRange_Właściwy", "Disabled"=w10) -> ("Value"=w11)
        # BUILDING STRING
        case (w10) {
          frame False, Default {
            Format Into String(formatString="%.0pV", initString="Range: ", w11) -> w12
          }
          frame True {
            w12 = "Range: Auto"
          }
        }
        Property Node(instance in=reference to "ACFilter_Właściwy") -> ("Value"=w13)
        Format Into String(formatString="%.0pHz", initString="AC Filter: >", w13) -> w14
        Concatenate Strings("Your settings:", "\r\n", w12, "\r\n", w14) -> w15
        $String_Właściwy <- w15
        call "Configure Measurement.gvi"(manual range=w11, VISA resource name=w1, error in=w2, measurement function="Voltage AC"(9), auto range=w10) -> (VISA resource name out=w16, error out=w17)
        call "Configure Voltage.gvi"(VISA resource name=w16, error in=w17, voltage bandwidth=w13) -> (VISA resource name out=w4, error out=w5)
        w3 = default
      }
      on "stop" Value changed; "Window" Close {
        w3 = TRUE
        w4 = w1
        w5 = w2
      }
    }
    case (TRUE) {
      frame False, Default {
        w18 = w4
        w19 = w5
      }
      frame True {
        call "Read (Single Point).gvi"(VISA resource name=w4, error in=w5) -> (VISA resource name out=w18, error out=w19)
      }
    }
    $Zmiana_indicator <- $Zmiana_control
    stop if w3
  }
  call "Close.gvi"(VISA resource name=w18, error in=w19)
