vi "DC Voltage.gvi"   [LabVIEW NXG 5.1.0]
panel controls:
  "Manual Range": f64 = "1 V"(1)
  "Auto Range": bool = TRUE
  "Auto Zero": bool = TRUE
  "DCV Ratio": bool
  "Auto Impedance": bool
  "Aperture NPLC": f64 = "10 PLC"(10)
  "Aperture Time": f64 = 0.1
  "Aperture": bool = TRUE
  "DIG Option On/Off": bool
  "DONE": bool
  "Absolute Resolution": f64 = 1e-06
panel indicators:
  "concatenated string": string
uses:
  Agilent 3446X Series::Initialize.gvi
  Agilent 3446X Series::Configure Measurement.gvi
  Agilent 3446X Series::Configure Voltage.gvi
  Agilent 3446X Series::Configure Measurement Aperture.gvi
  Agilent 3446X Series::Auto Zero.gvi
  Agilent 3446X Series::Close.gvi
diagram:
  call "Initialize.gvi"(VISA resource name="TCPIP0::A-34461A-0000-2.local::inst0::INSTR") -> (VISA resource name out=w1, error out=w2)
  while {
    Property Node(instance in=reference to "Auto Zero", "Visible"=$"DCV Ratio")
    Not(x=$"DCV Ratio") -> w3
    Quotient And Remainder(x=$"Aperture Time", y=2e-06) -> (floor(x/y)=w4, x-y*floor(x/y)=w5)
    Multiply(w5, 1000000) -> w6
    Round To Nearest(number=w6) -> w7
    To Signed 32 Bit Integer(number=w7) -> w8
    case (w8) {
      frame 0, Default {
        Multiply(2e-06, w4) -> w9
      }
      frame 1 {
        Multiply(2e-06, w4) -> w9
      }
      frame 2 {
        Add(1, w4) -> w10
        Multiply(2e-06, w10) -> w9
      }
    }
    case ($"Auto Zero") {
      frame False, Default {
        Boolean To 0 Or 1(Boolean=$"Auto Zero") -> (0, 1=w11)
      }
      frame True {
        Boolean To 0 Or 1(Boolean=$"Auto Zero") -> (0, 1=w11)
      }
    }
    case (w3) {
      frame False, Default {
        call "Configure Measurement.gvi"(manual range=$"Manual Range", VISA resource name=w1, error in=w2, measurement function="Voltage DC Ratio"(11), auto range=$"Auto Range", absolute resolution=$"Absolute Resolution") -> (VISA resource name out=w14, error out=w15)
        call "Configure Voltage.gvi"(VISA resource name=w14, error in=w15, auto impedance=$"Auto Impedance", voltage integration time=$"Aperture NPLC") -> (VISA resource name out=w16, error out=w17)
        case ($Aperture) {
          frame False, Default {
            Not(x=$Aperture) -> w18
            call "Configure Measurement Aperture.gvi"(VISA resource name=w16, error in=w17, measurement function="Voltage DC Ratio"(11), enable aperture=w18, aperture time=w9) -> (VISA resource name out=w12, error out=w13)
          }
          frame True {
            w12 = w16
            w13 = w17
          }
        }
      }
      frame True {
        call "Configure Measurement.gvi"(manual range=$"Manual Range", VISA resource name=w1, error in=w2, measurement function="Voltage DC"(10), auto range=$"Auto Range", absolute resolution=$"Absolute Resolution") -> (VISA resource name out=w19, error out=w20)
        call "Configure Voltage.gvi"(VISA resource name=w19, error in=w20, auto impedance=$"Auto Impedance", voltage integration time=$"Aperture NPLC") -> (VISA resource name out=w21, error out=w22)
        case ($Aperture) {
          frame False, Default {
            Not(x=$Aperture) -> w25
            call "Configure Measurement Aperture.gvi"(VISA resource name=w21, error in=w22, measurement function="Voltage DC"(10), enable aperture=w25, aperture time=w9) -> (VISA resource name out=w23, error out=w24)
          }
          frame True {
            w23 = w21
            w24 = w22
          }
        }
        call "Auto Zero.gvi"(VISA resource name=w23, error in=w24, zero type="Voltage DC"(3)) -> (VISA resource name out=w12, error out=w13)
      }
    }
    Property Node(instance in=reference to "Aperture Time", "Disabled"=$Aperture)
    $"Aperture Time" <- w9
    Format Into String(formatString="%.0e", initString="Absolute Resolution: ", $"Absolute Resolution") -> w26
    case ($Aperture) {
      frame False, Default {
        Format Into String(formatString="%_6ps", initString="Aperture Time: ", w9) -> w27
      }
      frame True {
        Format Into String(formatString="%#gPLC", initString="Aperture NPLC: ", $"Aperture NPLC") -> w27
      }
    }
    case ($"DCV Ratio") {
      frame False, Default {
        w28 = "DCV Ratio: Off"
      }
      frame True {
        w28 = "DCV Ratio: On"
      }
    }
    case ($"Auto Zero") {
      frame False, Default {
        w29 = "Auto Zero: Off"
      }
      frame True {
        w29 = "Auto Zero: On"
      }
    }
    case ($"Auto Range") {
      frame False, Default {
        Format Into String(formatString="%.0pV", initString="Range: ", $"Manual Range") -> w30
      }
      frame True {
        w30 = "Range: Auto"
      }
    }
    case ($"Auto Impedance") {
      frame False, Default {
        w31 = "Input Z: 10MΩ"
      }
      frame True {
        w31 = "Input Z: Auto"
      }
    }
    Concatenate Strings("Your settings:", "\r\n", w30, "\r\n", w27, "\r\n", w29, "\r\n", w31, "\r\n", w28, "\r\n", w26) -> w32
    $"concatenated string" <- w32
    case ($"DIG Option On/Off") {
      frame False, Default {
        w33 = 0.0002
      }
      frame True {
        w33 = 2e-05
      }
    }
    Property Node(instance in=reference to "Aperture Time", "Minimum"=w33)
    Property Node(instance in=reference to "Manual Range", "Disabled"=$"Auto Range")
    Not(x=$Aperture) -> w34
    Property Node(instance in=reference to "Aperture NPLC", "Disabled"=w34)
    case ($"DIG Option On/Off") {
      frame False, Default {
        w35 = [0, 1, 2]
      }
      frame True {
        w35 = i32[] []
      }
    }
    Property Node(instance in=reference to "Aperture NPLC", "DisabledIndexes"=w35)
    stop if $DONE
  }
  call "Close.gvi"(VISA resource name=w12, error in=w13)
