vi "1703DZIALADCVoltagebezRATIO.gvi"   [LabVIEW NXG 5.1.0]
panel controls:
  "VoltageDC_control": bool
  "VoltageAC_control": bool
  "CurrentDC_control": bool
  "CurrentAC_control": bool
  "stop": bool
  "Auto Range": bool = TRUE
  "Auto Zero": bool = TRUE
  "Aperture NPLC": f64 = "10 PLC"(10)
  "Aperture Time": f64 = 0.1
  "Aperture": bool = TRUE
  "Manual Range": f64 = "1 V"(1)
  "Absolute Resolution": f64 = 10
panel indicators:
  "VoltageDC_indicator": bool
  "VoltageAC_indicator": bool
  "CurrentDC_indicator": bool
  "CurrentAC_indicator": bool
  "DCV Ratio": bool
  "Auto Impedance": bool
  "DIG Option On/Off": bool
  "concatenated string_2": string
uses:
  Agilent 3446X Series::Initialize.gvi
  Agilent 3446X Series::Configure Measurement.gvi
  Agilent 3446X Series::Auto Zero.gvi
  Agilent 3446X Series::Configure Voltage.gvi
  Agilent 3446X Series::Configure Measurement Aperture.gvi
  Agilent 3446X Series::Close.gvi
diagram:
  Property Node(instance in=reference to "CurrentAC_indicator", "Visible"=FALSE, "Disabled"=FALSE)
  $"Auto Range" <- TRUE
  $"Auto Zero" <- TRUE
  Property Node(instance in=reference to "CurrentDC_control", "Visible"=TRUE, "Disabled"=FALSE)
  $"DIG Option On/Off" <- TRUE
  $"DCV Ratio" <- FALSE
  Property Node(instance in=reference to "CurrentAC_control", "Visible"=TRUE, "Disabled"=FALSE)
  Property Node(instance in=reference to "CurrentDC_indicator", "Visible"=FALSE)
  Property Node(instance in=reference to "VoltageAC_control", "Visible"=TRUE, "Disabled"=FALSE)
  $VoltageAC_control <- FALSE
  $VoltageDC_control <- FALSE
  $CurrentDC_control <- FALSE
  $CurrentAC_control <- FALSE
  Property Node(instance in=reference to "Auto Range", "Visible"=FALSE)
  Property Node(instance in=reference to "concatenated string_2", "Visible"=FALSE)
  Property Node(instance in=reference to "Auto Zero", "Visible"=FALSE)
  Property Node(instance in=reference to unnamed text, "Visible"=TRUE)
  Property Node(instance in=reference to "VoltageDC_indicator", "Visible"=FALSE)
  Property Node(instance in=reference to "Aperture", "Visible"=FALSE)
  Property Node(instance in=reference to unnamed text, "Visible"=FALSE)
  Property Node(instance in=reference to unnamed text, "Visible"=FALSE)
  Property Node(instance in=reference to "Manual Range", "Visible"=FALSE)
  Property Node(instance in=reference to unnamed text, "Visible"=FALSE)
  Property Node(instance in=reference to "Aperture NPLC", "Visible"=FALSE)
  Property Node(instance in=reference to "VoltageAC_indicator", "Visible"=FALSE)
  Property Node(instance in=reference to "DCV Ratio", "Visible"=FALSE)
  Property Node(instance in=reference to "VoltageDC_control", "Visible"=TRUE, "Disabled"=FALSE)
  Property Node(instance in=reference to unnamed text, "Visible"=FALSE)
  Property Node(instance in=reference to "DIG Option On/Off", "Visible"=FALSE)
  Property Node(instance in=reference to "Aperture Time", "Visible"=FALSE)
  $Aperture <- TRUE
  Property Node(instance in=reference to "Auto Impedance", "Visible"=FALSE)
  $"DCV Ratio" <- FALSE
  $"Auto Impedance" <- FALSE
  call "Initialize.gvi"(VISA resource name="TCPIP0::A-34461A-0000-2.local::inst0::INSTR") -> (VISA resource name out=w1, error out=w2)
  while {
    event {
      on "VoltageDC_control" Value changed {
        Property Node(instance in=reference to unnamed text, "Visible"=TRUE)
        Event Data() -> ("Old Value"=w6, "New Value"=w7)
        Property Node(instance in=reference to "VoltageAC_indicator", "Visible"=w6)
        Property Node(instance in=reference to "CurrentDC_indicator", "Visible"=w6)
        Property Node(instance in=reference to "CurrentDC_control", "Visible"=w7, "Value"=FALSE)
        Property Node(instance in=reference to "VoltageDC_indicator", "Visible"=w7)
        Property Node(instance in=reference to "CurrentAC_indicator", "Visible"=w6)
        Property Node(instance in=reference to "CurrentAC_control", "Visible"=w7, "Value"=FALSE)
        Property Node(instance in=reference to "VoltageAC_control", "Visible"=w7, "Value"=FALSE)
        Property Node(instance in=reference to "VoltageDC_control", "Visible"=w6)
        Property Node(instance in=reference to "Manual Range", "Visible"=TRUE)
        Property Node(instance in=reference to "Auto Impedance", "Visible"=TRUE)
        Property Node(instance in=reference to "concatenated string_2", "Visible"=TRUE)
        Property Node(instance in=reference to unnamed text, "Visible"=FALSE)
        Property Node(instance in=reference to "Aperture", "Visible"=TRUE)
        Property Node(instance in=reference to "Aperture Time", "Visible"=TRUE)
        Property Node(instance in=reference to unnamed text, "Visible"=FALSE)
        Property Node(instance in=reference to unnamed text, "Visible"=FALSE)
        Property Node(instance in=reference to "Auto Zero", "Visible"=TRUE)
        Property Node(instance in=reference to "DIG Option On/Off", "Visible"=TRUE)
        Property Node(instance in=reference to "Aperture NPLC", "Visible"=TRUE)
        Property Node(instance in=reference to "Absolute Resolution", "Visible"=TRUE)
        Property Node(instance in=reference to "DCV Ratio", "Visible"=TRUE)
        Property Node(instance in=reference to "Auto Range", "Visible"=TRUE)
        w3 = default
        w4 = default
        w5 = default
      }
      on "VoltageAC_control" Value changed {
        Property Node(instance in=reference to "Aperture", "Visible"=FALSE)
        Event Data() -> ("Old Value"=w8, "New Value"=w9)
        Property Node(instance in=reference to "VoltageAC_indicator", "Visible"=w9)
        Property Node(instance in=reference to "CurrentAC_indicator", "Visible"=w8)
        Property Node(instance in=reference to "VoltageDC_control", "Visible"=w9, "Value"=FALSE)
        Property Node(instance in=reference to "VoltageDC_indicator", "Visible"=w8)
        Property Node(instance in=reference to "CurrentDC_control", "Visible"=w9, "Value"=FALSE)
        Property Node(instance in=reference to unnamed text, "Visible"=w9)
        Property Node(instance in=reference to "CurrentAC_control", "Visible"=w9, "Value"=FALSE)
        Property Node(instance in=reference to "VoltageAC_control", "Visible"=w8)
        Property Node(instance in=reference to "CurrentDC_indicator", "Visible"=w8)
        Property Node(instance in=reference to "Aperture NPLC", "Visible"=FALSE)
        Property Node(instance in=reference to "Auto Zero", "Visible"=FALSE)
        Property Node(instance in=reference to "Auto Impedance", "Visible"=FALSE)
        Property Node(instance in=reference to "concatenated string_2", "Visible"=FALSE)
        Property Node(instance in=reference to "Manual Range", "Visible"=FALSE)
        Property Node(instance in=reference to "DCV Ratio", "Visible"=FALSE)
        Property Node(instance in=reference to "Absolute Resolution", "Visible"=FALSE)
        Property Node(instance in=reference to unnamed text, "Visible"=FALSE)
        Property Node(instance in=reference to "DIG Option On/Off", "Visible"=FALSE)
        Property Node(instance in=reference to unnamed text, "Visible"=FALSE)
        Property Node(instance in=reference to "Aperture Time", "Visible"=FALSE)
        Property Node(instance in=reference to "Auto Range", "Visible"=FALSE)
        Property Node(instance in=reference to unnamed text, "Visible"=FALSE)
        w3 = default
        w4 = default
        w5 = default
      }
      on "CurrentDC_control" Value changed {
        Event Data() -> ("Old Value"=w10, "New Value"=w11)
        Property Node(instance in=reference to "VoltageAC_indicator", "Visible"=w10)
        Property Node(instance in=reference to "VoltageDC_indicator", "Visible"=w10)
        Property Node(instance in=reference to "CurrentAC_control", "Visible"=w11, "Value"=FALSE)
        Property Node(instance in=reference to "VoltageDC_control", "Visible"=w11, "Value"=FALSE)
        Property Node(instance in=reference to "CurrentAC_indicator", "Visible"=w10)
        Property Node(instance in=reference to "VoltageAC_control", "Visible"=w11, "Value"=FALSE)
        Property Node(instance in=reference to "CurrentDC_indicator", "Visible"=w11)
        Property Node(instance in=reference to "CurrentDC_control", "Visible"=w10)
        w3 = default
        w4 = default
        w5 = default
      }
      on "CurrentAC_control" Value changed {
        Event Data() -> ("Old Value"=w12, "New Value"=w13)
        Property Node(instance in=reference to "CurrentAC_control", "Visible"=w12)
        Property Node(instance in=reference to "VoltageAC_indicator", "Visible"=w12)
        Property Node(instance in=reference to "VoltageDC_control", "Visible"=w13, "Value"=FALSE)
        Property Node(instance in=reference to "CurrentAC_indicator", "Visible"=w13)
        Property Node(instance in=reference to "CurrentDC_control", "Visible"=w13, "Value"=FALSE)
        Property Node(instance in=reference to "VoltageAC_control", "Visible"=w13, "Value"=FALSE)
        Property Node(instance in=reference to "CurrentDC_indicator", "Visible"=w12)
        Property Node(instance in=reference to "VoltageDC_indicator", "Visible"=w12)
        w3 = default
        w4 = default
        w5 = default
      }
      on "Aperture" Value changed; "Aperture NPLC" Value changed; "Aperture Time" Value changed; "Auto Impedance" Value changed; "Auto Range" Value changed; "Auto Zero" Value changed; "DCV Ratio" Value changed; "DIG Option On/Off" Value changed; "Manual Range" Value changed {
        Property Node(instance in=reference to "DCV Ratio") -> ("Value"=w14)
        Not(x=w14) -> w15
        Property Node(instance in=reference to unnamed text, "Visible"=w15)
        Property Node(instance in=reference to unnamed text, "Visible"=w14)
        case (w14) {
          frame False, Default {
            w16 = "DCV Ratio: Off"
          }
          frame True {
            $"Auto Zero" <- TRUE
            w16 = "DCV Ratio: On"
          }
        }
        Property Node(instance in=reference to "Aperture") -> ("Value"=w17)
        Property Node(instance in=reference to "DIG Option On/Off") -> ("Value"=w18)
        case (w18) {
          frame False, Default {
            w19 = [0, 1, 2]
          }
          frame True {
            w19 = i32[] []
          }
        }
        Not(x=w17) -> w20
        Property Node(instance in=reference to "Aperture NPLC", "Disabled"=w20, "DisabledIndexes"=w19) -> ("Value"=w21)
        case (w18) {
          frame False, Default {
            w22 = 0.0002
          }
          frame True {
            w22 = 2e-05
          }
        }
        Property Node(instance in=reference to "Aperture Time", "Disabled"=w17, "Minimum"=w22) -> ("Value"=w23)
        Quotient And Remainder(x=w23, y=2e-06) -> (floor(x/y)=w24, x-y*floor(x/y)=w25)
        Multiply(w25, 1000000) -> w26
        Round To Nearest(number=w26) -> w27
        To Signed 32 Bit Integer(number=w27) -> w28
        case (w28) {
          frame 0, Default {
            Multiply(2e-06, w24) -> w29
          }
          frame 1 {
            Multiply(2e-06, w24) -> w29
          }
          frame 2 {
            Add(1, w24) -> w30
            Multiply(2e-06, w30) -> w29
          }
        }
        case (w17) {
          frame False, Default {
            Format Into String(formatString="%_6ps", initString="Aperture Time: ", w29) -> w31
          }
          frame True {
            Format Into String(formatString="%#gPLC", initString="Aperture NPLC: ", w21) -> w31
          }
        }
        Property Node(instance in=reference to "Auto Zero", "Disabled"=w14) -> ("Value"=w32)
        case (w32) {
          frame False, Default {
            w33 = "Auto Zero: Off"
          }
          frame True {
            w33 = "Auto Zero: On"
          }
        }
        Property Node(instance in=reference to "Auto Range") -> ("Value"=w34)
        Property Node(instance in=reference to "Manual Range", "Disabled"=w34) -> ("Value"=w35)
        case (w34) {
          frame False, Default {
            Format Into String(formatString="%.0pV", initString="Range: ", w35) -> w36
          }
          frame True {
            w36 = "Range: Auto"
          }
        }
        Property Node(instance in=reference to "Auto Impedance") -> ("Value"=w37)
        case (w37) {
          frame False, Default {
            w38 = "Input Z: 10MΩ"
          }
          frame True {
            w38 = "Input Z: Auto"
          }
        }
        Concatenate Strings("Your settings:", "\r\n", w36, "\r\n", w31, "\r\n", w33, "\r\n", w38, "\r\n", w16) -> w39
        $"concatenated string_2" <- w39
        Property Node(instance in=reference to "Aperture Time", "Value"=w29)
        Property Node(instance in=reference to "Absolute Resolution") -> ("Value"=w40)
        case (w14) {
          frame False, Default {
            call "Configure Measurement.gvi"(manual range=w35, VISA resource name=w1, error in=w2, measurement function="Voltage DC"(10), auto range=w34, absolute resolution=w40) -> (VISA resource name out=w41, error out=w42)
            case (w32) {
              frame False, Default {
                call "Auto Zero.gvi"(VISA resource name=w41, error in=w42, zero type="Voltage DC"(3), auto zero="Disable"(0)) -> (VISA resource name out=w43, error out=w44)
              }
              frame True {
                call "Auto Zero.gvi"(VISA resource name=w41, error in=w42, zero type="Voltage DC"(3), auto zero="Enable"(1)) -> (VISA resource name out=w43, error out=w44)
              }
            }
            case (w17) {
              frame False, Default {
                call "Configure Voltage.gvi"(VISA resource name=w43, error in=w44, auto impedance=w37) -> (VISA resource name out=w45, error out=w46)
                call "Configure Measurement Aperture.gvi"(VISA resource name=w45, error in=w46, measurement function="Voltage DC"(10), enable aperture=TRUE, aperture time=w29) -> (VISA resource name out=w4, error out=w5)
              }
              frame True {
                call "Configure Voltage.gvi"(VISA resource name=w43, error in=w44, auto impedance=w37, voltage integration time=w21) -> (VISA resource name out=w47, error out=w48)
                call "Configure Measurement Aperture.gvi"(VISA resource name=w47, error in=w48, measurement function="Voltage DC"(10), enable aperture=FALSE) -> (VISA resource name out=w4, error out=w5)
              }
            }
          }
          frame True {
            case (w34) {
              frame False, Default {
                call "Configure Measurement.gvi"(manual range=w35, VISA resource name=w1, error in=w2, measurement function="Voltage DC Ratio"(11), auto range=FALSE, absolute resolution=w40) -> (VISA resource name out=w49, error out=w50)
              }
              frame True {
                call "Configure Measurement.gvi"(VISA resource name=w1, error in=w2, measurement function="Voltage DC Ratio"(11), auto range=TRUE, absolute resolution=w40) -> (VISA resource name out=w49, error out=w50)
              }
            }
            case (w32) {
              frame False, Default {
                call "Configure Voltage.gvi"(VISA resource name=w49, error in=w50, auto impedance=w37) -> (VISA resource name out=w51, error out=w52)
                call "Configure Measurement Aperture.gvi"(VISA resource name=w51, error in=w52, measurement function="Voltage DC Ratio"(11), enable aperture=TRUE, aperture time=w29) -> (VISA resource name out=w4, error out=w5)
              }
              frame True {
                call "Configure Voltage.gvi"(VISA resource name=w49, error in=w50, auto impedance=w37, voltage integration time=w21) -> (VISA resource name out=w53, error out=w54)
                call "Configure Measurement Aperture.gvi"(VISA resource name=w53, error in=w54, measurement function="Voltage DC Ratio"(11), enable aperture=FALSE) -> (VISA resource name out=w4, error out=w5)
              }
            }
          }
        }
        w3 = default
      }
      on "stop" Value changed; "Window" Close {
        w3 = TRUE
        w4 = default
        w5 = default
      }
    }
    $VoltageDC_indicator <- $VoltageDC_control
    $CurrentAC_indicator <- $CurrentAC_control
    $CurrentDC_indicator <- $CurrentDC_control
    $VoltageAC_indicator <- $VoltageAC_control
    stop if w3
  }
  call "Close.gvi"(VISA resource name=w4, error in=w5)
  Property Node(instance in=reference to "Absolute Resolution", "Visible"=FALSE)
